vi "Get Id.gvi"   [LabVIEW NXG 5.0.0]
# Main process for interfacing with the framework to get the selected Instrument’s identity
inputs:
  "Instrument Name": string  # The name of the instrument whose Id shoudl be fetched.
  "Error in": error
outputs:
  "Error out": error
  "IDN Id": string  # The fetched identity.
uses:
  Hardware Abstraction Framework::Common::ExecutableProcessor.gtype::Add Director.gvi
  Hardware Abstraction Framework::Common::ExecutableProcessor.gtype::Process Directors.gvi
diagram:
  # We find the right Driver and set up the necessary executables to be processed.  They are only sent for processing if no error has occurred.
  #
  # The IDN Id is used by the Main Processing Loop to correlate a Result message to the correct command.  In this example, of course, only once result is expected so it's 'extraneous' but does show the principle for more complex examples.
  case ($"Error in") {
    frame Error, Default {
      w1 = $"Error in"
    }
    frame No Error {
      call "Find Driver.gvi"(Instrument Name=$"Instrument Name", Error in=$"Error in") -> (Found Driver=w2, Error out=w3)
      call "Setup Identity Executables.gvi"(Driver=w2, Error In=w3) -> (ExecutableDirector=w4, IDN Id=w5, Error Out=w6)
      call "Add Director.gvi"(ExecutableProcessor in="ExecutableProcessor.gtype" constant, ExecutableDirector=w4, Error in=w6) -> (ExecutableProcessor out=w7, Error out=w8)
      case (w8) {
        frame Error, Default {
          w1 = w8
        }
        frame No Error {
          call "Process Directors.gvi"(ExecutableProcessor in=w7) -> (Error out=w1)
        }
      }
      $"IDN Id" <- w5
    }
  }
  $"Error out" <- w1
