vi "Id From Result.gvi"   [LabVIEW NXG 5.0.0]
inputs:
  "Read Executable In": "ReadExecutable.gtype"  # The Executable that has the result embedded.
  "IDN ID": string  # The ID of the Executable that we want a result from.
  "Error In": error
outputs:
  "Error Out": error
  "Result": string
uses:
  Hardware Abstraction Framework::Common::WriteExecutable.gtype::Read Id.gvi
diagram:
  # If this Read Executable's ID matches the one we are waiting for, try and build a result.
  #
  # It's not really necessary to recast the Executable to an IDN as we can use the parent implementation of Build Result but it is used here to show how it would be done
  case ($"Error In") {
    frame Error, Default {
      w1 = $"Error In"
    }
    frame No Error {
      call "Read Id.gvi"(Executable in=$"Read Executable In", Error in=$"Error In") -> (Executable out=w2, Id=w3, Error out=w4)
      Is Equal(x=$"IDN ID", y=w3) -> w5
      case (w5) {
        frame False, Default {
          # Result isn't for the expected command so ignore.
          w1 = w4
        }
        frame True {
          call "Parse Identity from Result.gvi"(Read Executable In=w2, Error In=w4) -> (Result=w6, Error Out=w1)
          $Result <- w6
        }
      }
    }
  }
  $"Error Out" <- w1
