vi "Parse Measurement Result.gvi"   [LabVIEW NXG 5.0.0]
inputs:
  "Read Executable In": "ReadExecutable.gtype", required  # The Executable that has the result embedded.
  "IDs": string[]
  "Error In": error
outputs:
  "Error Out": error
  "is Identity": bool
  "Result": string
uses:
  Hardware Abstraction Framework::Common::WriteExecutable.gtype::Read Id.gvi
diagram:
  # This can concatenate output from each case statement because when a
  # result isn't for that case, it will tunnel out a BLANK.
  case ($"Error In") {
    frame Error, Default {
      w1 = $"Error In"
      w2 = default
      w3 = default
    }
    frame No Error {
      call "Read Id.gvi"(Executable in=$"Read Executable In", Error in=$"Error In") -> (Executable out=w4, Id=w5, Error out=w6)
      Array Index(array=$IDs) -> (out0[1]=w7)
      Is Equal(x=w7, y=w5) -> w8
      case (w8) {
        frame False, Default {
          w9 = w6
          w10 = ""
          w11 = FALSE
        }
        frame True {
          # Read Measurement from result
          call "Parse Measurement from Result.gvi"(Read Executable In=w4, Error In=w6) -> (Result=w10, Error Out=w9)
          w11 = FALSE
        }
      }
      Array Index(array=$IDs) -> (out0[0]=w12)
      Is Equal(x=w12, y=w5) -> w13
      case (w13) {
        frame False, Default {
          w14 = ""
          w15 = w6
          w16 = FALSE
        }
        frame True {
          # Read ID from result
          call "Parse Identity from Result.gvi"(Read Executable In=w4, Error In=w6) -> (Result=w14, Error Out=w15)
          w16 = TRUE
        }
      }
      Concatenate Strings(w10, w14) -> w2
      Merge Errors(w9, w15) -> (error out=w1)
      Logical Or(w11, w16) -> w3
    }
  }
  $Result <- w2
  $"Error Out" <- w1
  $"is Identity" <- w3
