vi "Setup Measure Executable.gvi"   [LabVIEW NXG 5.0.0]
inputs:
  "Driver": "Driver.gtype"  # Driver to obtain Id for.
  "Error In": error
  "Function": u16
  "Buffer Elements": string[]
outputs:
  "Error Out": error
  "ExecutableDirector": "ExecutableDirector.gtype"  # Configured Executable Director (execute once) capable of running the necessary commands.
  "MEAS Id": string  # The ID of the the *IDN? Executable which will be used to identify an incoming result.
uses:
  Hardware Abstraction Framework::Common::WriteExecutable.gtype::Write Driver.gvi
  Hardware Abstraction Framework::Command::SCPI Acquire::Measure.gtype::Configure.gvi
  Hardware Abstraction Framework::Support::Helpers::Parameter Builder.gvi
  Hardware Abstraction Framework::Common::WriteExecutable.gtype::Write Parameters.gvi
  Hardware Abstraction Framework::Common::WriteExecutable.gtype::Read Id.gvi
  Hardware Abstraction Framework::Command::SCPI Generic::User Defined Write.gtype::Write Command to Execute.gvi
  Hardware Abstraction Framework::Common::ExecutableDirector.gtype::Add Executable.gvi
diagram:
  # Adds the Driver to the :MEAS? command and add to an Executable Director.  Also, uses a User Defined Write Executable to set up a Buffer to use.
  # The Id of the :MEAS? command is used in processing results: each result notified will contain an Id so that the user can correlate results.
  case ($"Error In") {
    frame Error, Default {
      w1 = $"Error In"
    }
    frame No Error {
      call "Write Driver.gvi"(Executable in="Measure.gtype" constant, Driver In=$Driver, Error in=$"Error In") -> (Executable out=w2, Error out=w3)
      call "Configure.gvi"(Measure in=w2, Function=$Function, Buffer Name="mybuffer", Error in=w3) -> (Measure out=w4, Error out=w5)
      call "Parameter Builder.gvi"(Names=$"Buffer Elements") -> (Parameters=w6)
      call "Write Parameters.gvi"(Executable in=w4, Parameters=w6, Error in=w5) -> (Executable out=w7, Error out=w8)
      call "Read Id.gvi"(Executable in=w7, Error in=w8) -> (Executable out=w9, Id=w10, Error out=w11)
      call "Write Command to Execute.gvi"(User Defined Write in="User Defined Write.gtype" constant, Command to Execute=":TRAC:MAKE \"mybuffer\", 10000, FULL", Error in=$"Error In") -> (User Defined Write out=w12, Error out=w13)
      call "Write Driver.gvi"(Executable in=w12, Driver In=$Driver, Error in=w13) -> (Executable out=w14, Error out=w15)
      call "Add Executable.gvi"(ExecutableDirector in="ExecutableDirector.gtype" constant, Executable=w14, Error in=w15) -> (ExecutableDirector out=w16, Error out=w17)
      Merge Errors(w17, w11) -> (error out=w18)
      call "Add Executable.gvi"(ExecutableDirector in=w16, Executable=w9, Error in=w18) -> (ExecutableDirector out=w19, Error out=w1)
      $ExecutableDirector <- w19
      $"MEAS Id" <- w10
    }
  }
  $"Error Out" <- w1
