vi "Generate and Measure.gvi"   [LabVIEW NXG 5.0.0]
inputs:
  "Generate Instrument Name": string  # The name of the instrument whose Id shoudl be fetched.
  "Measure Instrument Name": string  # The name of the instrument whose Id shoudl be fetched.
  "Error In": error
  "Voltage": f32 = 0.001
outputs:
  "Error Out": error
  "IDs": string[]
uses:
  Hardware Abstraction Framework::Common::ExecutableProcessor.gtype::Add Director.gvi
  Hardware Abstraction Framework::Common::ExecutableProcessor.gtype::Process Directors.gvi
diagram:
  case ($"Error In") {
    frame Error, Default {
      w1 = $"Error In"
    }
    frame No Error {
      call "Find Driver.gvi"(Instrument Name=$"Measure Instrument Name", Error in=$"Error In") -> (Found Driver=w2, Error out=w3)
      call "Setup Identity Executables.gvi"(Driver=w2, Error In=w3) -> (ExecutableDirector=w4, IDN Id=w5, Error Out=w6)
      call "Setup Volt Measure Executable.gvi"(Driver=w2, Error In=w6) -> (ExecutableDirector=w7, MEAS Id=w8, Error Out=w9)
      call "Find Driver.gvi"(Instrument Name=$"Generate Instrument Name", Error in=$"Error In") -> (Found Driver=w10, Error out=w11)
      call "Setup Identity Executables.gvi"(Driver=w10, Error In=w11) -> (ExecutableDirector=w12, IDN Id=w13, Error Out=w14)
      call "Add Director.gvi"(ExecutableProcessor in="ExecutableProcessor.gtype" constant, ExecutableDirector=w12, Error in=w14) -> (ExecutableProcessor out=w15, Error out=w16)
      call "Add Director.gvi"(ExecutableProcessor in=w15, ExecutableDirector=w4, Error in=w16) -> (ExecutableProcessor out=w17, Error out=w18)
      call "Setup Generate Executables.gvi"(Driver=w10, Voltage=$Voltage, Error In=$"Error In") -> (ExecutableDirector=w19, Error Out=w20)
      call "Add Director.gvi"(ExecutableProcessor in=w17, ExecutableDirector=w19, Error in=w18) -> (ExecutableProcessor out=w21, Error out=w22)
      call "Add Director.gvi"(ExecutableProcessor in=w21, ExecutableDirector=w7, Error in=w22) -> (ExecutableProcessor out=w23, Error out=w24)
      Merge Errors(w24, w20, w9) -> (error out=w25)
      case (w25) {
        frame Error, Default {
          w1 = w25
        }
        frame No Error {
          call "Process Directors.gvi"(ExecutableProcessor in=w23, Wait Time=10, Error in=w25) -> (Error out=w1)
        }
      }
      Build Array(w13, w5, w8) -> w26
      $IDs <- w26
    }
  }
  $"Error Out" <- w1
