vi "Parse Result.gvi"   [LabVIEW NXG 5.0.0]
inputs:
  "Read Executable In": "ReadExecutable.gtype"  # The Executable that has the result embedded.
  "IDs": string[]
  "Error In": error
outputs:
  "Error Out": error
  "Generate ID": string
  "Measure ID": string
  "Voltage": f32
  "Result Identifier": enum{"Generate", "Measure", "Voltage"}
uses:
  Hardware Abstraction Framework::Common::WriteExecutable.gtype::Read Id.gvi
diagram:
  case ($"Error In") {
    frame Error, Default {
      w1 = $"Error In"
    }
    frame No Error {
      call "Read Id.gvi"(Executable in=$"Read Executable In", Error in=$"Error In") -> (Executable out=w2, Id=w3, Error out=w4)
      Array Index(array=$IDs) -> (out0[0]=w5)
      Is Equal(x=w5, y=w3) -> w6
      case (w6) {
        frame False, Default {
          w7 = w4
        }
        frame True {
          call "Parse Identity from Result.gvi"(Read Executable In=w2, Error In=w4) -> (Result=w8, Error Out=w7)
          $"Generate ID" <- w8
          $"Result Identifier" <- "Generate"
        }
      }
      Array Index(array=$IDs) -> (out0[1]=w9)
      Is Equal(x=w9, y=w3) -> w10
      case (w10) {
        frame False, Default {
          w11 = w4
        }
        frame True {
          call "Parse Identity from Result.gvi"(Read Executable In=w2, Error In=w4) -> (Result=w12, Error Out=w11)
          $"Measure ID" <- w12
          $"Result Identifier" <- "Measure"
        }
      }
      Array Index(array=$IDs) -> (out0[2]=w13)
      Is Equal(x=w13, y=w3) -> w14
      case (w14) {
        frame False, Default {
          w15 = w4
        }
        frame True {
          call "Parse Voltage From Result.gvi"(Read Executable In=w2, Error In=w4) -> (Voltage=w16, Error Out=w15)
          $Voltage <- w16
          $"Result Identifier" <- "Voltage"
        }
      }
      Merge Errors(w7, w11, w15) -> (error out=w1)
    }
  }
  $"Error Out" <- w1
