vi "Setup Generate Executables.gvi"   [LabVIEW NXG 5.0.0]
inputs:
  "Voltage": f32 = 0.001
  "Driver": "Driver.gtype"  # Driver to obtain Id for.
  "Error In": error
outputs:
  "Error Out": error
  "ExecutableDirector": "ExecutableDirector.gtype"  # Configured Executable Director (execute once) capable of running the necessary commands.
uses:
  Hardware Abstraction Framework::Common::WriteExecutable.gtype::Write Driver.gvi
  Hardware Abstraction Framework::Command::SCPI Generate::Voltage.gtype::Write Volts.gvi
  Hardware Abstraction Framework::Command::SCPI Generate::Output.gtype::Write Output Switch.gvi
  Hardware Abstraction Framework::Command::SCPI Generate::Output.gtype::Write Control Master Switch.gvi
  Hardware Abstraction Framework::Command::SCPI Generate::Instrument.gtype::Write Channel.gvi
  Hardware Abstraction Framework::Common::ExecutableDirector.gtype::Add Executable.gvi
diagram:
  case ($"Error In") {
    frame Error, Default {
      w1 = $"Error In"
    }
    frame No Error {
      call "Write Driver.gvi"(Executable in="Voltage.gtype" constant, Driver In=$Driver, Error in=$"Error In") -> (Executable out=w2, Error out=w3)
      call "Write Volts.gvi"(Voltage in=w2, Volts=$Voltage, Error in=w3) -> (Voltage out=w4, Error out=w5)
      call "Write Driver.gvi"(Executable in="Output.gtype" constant, Driver In=$Driver, Error in=$"Error In") -> (Executable out=w6, Error out=w7)
      call "Write Output Switch.gvi"(Output in=w6, Output Switch=TRUE, Error in=w7) -> (Output out=w8, Error out=w9)
      call "Write Control Master Switch.gvi"(Output in=w8, Control Master Switch=TRUE, Error in=w9) -> (Output out=w10, Error out=w11)
      call "Write Driver.gvi"(Executable in="Output.gtype" constant, Driver In=$Driver, Error in=$"Error In") -> (Executable out=w12, Error out=w13)
      call "Write Output Switch.gvi"(Output in=w12, Output Switch=TRUE, Error in=w13) -> (Output out=w14, Error out=w15)
      call "Write Driver.gvi"(Executable in="Instrument.gtype" constant, Driver In=$Driver, Error in=$"Error In") -> (Executable out=w16, Error out=w17)
      call "Write Channel.gvi"(Instrument in=w16, Channel=1, Error in=w17) -> (Instrument out=w18, Error out=w19)
      call "Add Executable.gvi"(ExecutableDirector in="ExecutableDirector.gtype" constant, Executable=w18, Error in=w19) -> (ExecutableDirector out=w20, Error out=w21)
      call "Add Executable.gvi"(ExecutableDirector in=w20, Executable=w14, Error in=w21) -> (ExecutableDirector out=w22, Error out=w23)
      call "Add Executable.gvi"(ExecutableDirector in=w22, Executable=w10, Error in=w23) -> (ExecutableDirector out=w24, Error out=w25)
      call "Add Executable.gvi"(ExecutableDirector in=w24, Executable=w4, Error in=w25) -> (ExecutableDirector out=w26, Error out=w27)
      $ExecutableDirector <- w26
      Merge Errors(w27, w15, w11, w5) -> (error out=w1)
    }
  }
  $"Error Out" <- w1
