vi "Build Waveform Executables.gvi"   [LabVIEW NXG 5.0.0]
inputs:
  "Instrument Name": string  # The name of the instrument whose Id shoudl be fetched.
  "Function": u16
  "Error in": error
outputs:
  "Error out": error
  "ExecutableProcessor": "ExecutableProcessor.gtype"
  "IDs": string[]
uses:
  Hardware Abstraction Framework::Common::ExecutableProcessor.gtype::Add Director.gvi
diagram:
  # We find the right Driver and set up the necessary executables to be processed.
  #
  # The Executable Ids are used by the Main Processing Loop to correlate a Result notification to the correct command.
  case ($"Error in") {
    frame Error, Default {
      w1 = $"Error in"
      w2 = default
    }
    frame No Error {
      call "Find Driver.gvi"(Instrument Name=$"Instrument Name", Error in=$"Error in") -> (Found Driver=w3, Error out=w4)
      call "Setup Identity Executables.gvi"(Driver=w3, Error In=w4) -> (ExecutableDirector=w5, IDN Id=w6, Error Out=w7)
      call "Add Director.gvi"(ExecutableProcessor in="ExecutableProcessor.gtype" constant, ExecutableDirector=w5, Error in=w7) -> (ExecutableProcessor out=w8, Error out=w9)
      call "Create Buffer.gvi"(Driver=w3, Error In=w9) -> (ExecutableDirector=w10, Error Out=w11)
      call "Add Director.gvi"(ExecutableProcessor in=w8, ExecutableDirector=w10, Error in=w11) -> (ExecutableProcessor out=w12, Error out=w13)
      call "Setup Continuous Measurement.gvi"(Driver=w3, Function=$Function, Error In=w13) -> (ExecutableDirector=w14, MEAS Id=w15, Error Out=w16)
      call "Add Director.gvi"(ExecutableProcessor in=w12, ExecutableDirector=w14, Error in=w16) -> (ExecutableProcessor out=w2, Error out=w1)
      Build Array(w6, w15) -> w17
      $IDs <- w17
    }
  }
  $ExecutableProcessor <- w2
  $"Error out" <- w1
