vi "DAC Characterisation.gvi"   [LabVIEW NXG 5.0.0]
panel controls:
  "Start": bool
  "Stop": bool
  "Instrument Control Board": string
  "Refresh": bool
  "Error": error
  "Error_Type": error
  "Pause": bool
  "Resume": bool
  "IDs": string[]
  "DMM6500": string
  "Start Code": u16
  "Increment": u16 = 1
  "End Code": u16 = 65535
  "Logical Instrument": string = "DACA"
  "All Results": "All Results.gtype"
  "Export": bool
panel indicators:
  "Instrument Control Board Identity": string
  "Error Out": error
  "DMM6500 Identity": string
  "Characterisation": f64[]
  "Current Code": u16
  "Running": bool
types:
  T1 = cluster{"Code": u16, "Timestamp": timestamp, "Voltage": f64, "Nominal": f64}
  "All Results.gtype" = T1[]
  "All Notification Message Ids.gtype" = cluster{"Initialise": string, "Exit": string, "Error": string, "Result": string, "Done": string}
  "Event Data.gtype" = cluster{"Raiser Name": string, "Raiser Id": string}
uses:
  Hardware Abstraction Framework::Utilities::Setup Framework.gvi
  Hardware Abstraction Framework::Support::Messages::Dequeue Message.gvi
  NI::G Core::Error::Build Error Cluster.gvi
  Hardware Abstraction Framework::Support::Messages::Enqueue Message.gvi
  Hardware Abstraction Framework::Support::Helpers::Error Handling - Process Error.gvi
  Hardware Abstraction Framework::Support::Events::Raise Pause Event.gvi
  Hardware Abstraction Framework::Support::Events::Raise Resume Event.gvi
  Hardware Abstraction Framework::Utilities::Teardown Frameworkgvi.gvi
  Hardware Abstraction Framework::Common::WriteExecutable.gtype::Read Id.gvi
diagram:
  Obtain Notifier(element data type="ReadExecutable.gtype" constant, name="Results Notifier") -> (notifier out=w1)
  # Initialise the example before anything else
  # Listen for any stop event raised by the framework.  Can also raise a Stop event if the user presses Stop button.
  # The Notifications Queue is used to receive messages from the framework (typically results) but can also be used to send messages to control the processing loop following an event.
  sequence {
    frame 0 {
      call "Setup Framework.gvi"()
      $"Error Out" <- no error
      $"Instrument Control Board Identity" <- ""
      $"DMM6500 Identity" <- ""
      $Running <- FALSE
      Clear Data(reference in=reference to "Characterisation")
      w2 = T1 {"Code"=100, "Timestamp"=2021-12-07T15:51:58Z, "Voltage"=0.008057347, "Nominal"=0}
      Initialize Array(element=w2, size=0) -> w3
      $"All Results" <- w3
    }
    frame 1 {
      w4 = "Hardware Abstraction Framework::Support::Resources.grsc::Events"
      Tag Read(ref in=w4) -> (Data=w5)
      Property Node(instance in=w5) -> ("Stop Event"=w6)
      w7 = "Hardware Abstraction Framework::Support::Resources.grsc::MessageQueues"
      Tag Read(ref in=w7) -> (Data=w8)
      Property Node(instance in=w8) -> ("Notifications"=w9)
    }
  }
  w10 = $Error
  # Main Processing loop.  Waits for messages to appear on the queue and then processes it.
  # Results will be notified to the Test App so they can
  # be processed.  This example uses a Continuous Executable
  # Director which blocks the Main Processing loop from processing results until it completes (which is never!) Notification of results by the framework allows them to be displayed on the UI.
  while {
    call "Dequeue Message.gvi"(Message Queue In=w9, Error In=w10) -> (Timed Out?=w11, Message Queue Out=w12, Message Id=w13, Message Data=w14, Error Out=w15)
    # Case options should include "All Notification Messages" as a minimum
    # Waits for next message. Queue is created with Initialise message.
    case (w13) {
      frame Default {
        w18 = "Application timed-out waiting for an action to be initiated.%s"
        w19 = "An unknown message - %s -was added to the notification queue"
        Select(s=w11, t=w18, f=w19) -> w20
        # An unknown message was added to the queue or a timeout occurred
        Format Into String(formatString=w20, w13) -> w21
        call "Build Error Cluster.gvi"(code=1, description=w21) -> (error out=w16)
        w17 = default
      }
      frame "Initialise" {
        # Queue a message to refresh the System Resources
        call "Enqueue Message.gvi"(Message Queue In=w12, Message Id="Refresh", Error In=w15) -> (Error Out=w16)
        w17 = default
      }
      frame "Refresh" {
        # Build the list of resources attached to the system and load their names into the UI combo box.  Select the first value so something is displayed.
        call "Get System Resources.gvi"(Error in=w15) -> (Resources=w22, Error out=w16)
        Array Index(array=w22) -> (out0[0]=w23)
        Property Node(instance in=reference to "Instrument Control Board", "Items"=w22, "Value"=w23)
        Property Node(instance in=reference to "DMM6500", "Items"=w22, "Value"=w23)
        w17 = default
      }
      frame "Stop" {
        w24 = "All Notification Message Ids.gtype" {"Initialise"="Initialise", "Exit"="Exit", "Error"="Error", "Result"="Result", "Done"="Done"}
        # Stop processing any more messages.
        Property Node(instance in=w24) -> ("Exit"=w25)
        call "Enqueue Message.gvi"(Message Queue In=w12, Message Id=w25, Error In=w15) -> (Error Out=w16)
        w17 = default
      }
      frame "Step Codes" {
        # Step Codes requested.  Process the command through the framework (sub-VI).  The Ids passed out will be used in processing the Result message.
        call "Build Characterisation Executables.gvi"(Start Code=$"Start Code", Increment=$Increment, End Code=$"End Code", Instrument Control Board=$"Instrument Control Board", DMM6500=$DMM6500, Logical Instrument=$"Logical Instrument", Error in=w15) -> (ExecutableProcessor=w26, IDs=w27, Error out=w28)
        call "Start Stepping.gvi"(ExecutableProcessor=w26, Results Notifier=w1, Error in=w28) -> (Error out=w16)
        $IDs <- w27
        $"Current Code" <- $"Start Code"
        w29 = T1 {"Code"=100, "Timestamp"=2021-12-07T15:51:58Z, "Voltage"=0.008057347, "Nominal"=0}
        Initialize Array(element=w29, size=0) -> w30
        $"All Results" <- w30
        w17 = default
      }
      frame "Exit" {
        Variant To Data(type=no error, variant=w14) -> (data=w31, error out=w32)
        case (w32) {
          frame Error, Default {
            w16 = w15
          }
          frame No Error {
            # If exiting because of error, pass it on for display
            w16 = w31
          }
        }
        $Running <- FALSE
        w17 = TRUE
      }
      frame "Error" {
        # Handle an error.  Here nothing is done, but it could be logged as an example
        Variant To Data(type=$Error_Type, variant=w14) -> (data=w16)
        w17 = default
      }
      frame "Done" {
        $Running <- FALSE
        w16 = w15
        w17 = default
      }
    }
    call "Error Handling - Process Error.gvi"(Error to Process=w16, Exit on Error?=TRUE)
    stop if w17
  }
  Register For Events("Stop"=w6) -> (event registration refnum out=w33)
  # Event loop: loops until Stop pressed or a Stop event raised.
  # Handles UI events by sending messages to the processing loop.
  while {
    event (dynamic events = w33) {
      on "Stop" Value changed; "Window" Close {
        Property Node(instance in="Event Data.gtype" {all zero or empty}, "Raiser Name"="Waveform Measurement") -> (instance out=w36)
        # Stop button pressed. Raise Stop Event to halt further processing.
        Generate User Event(event data=w36, priority="high priority", user event=w6) -> (error out=w35)
        w34 = default
      }
      on dynamic event 0 {
        call "Enqueue Message.gvi"(Priority?=TRUE, Message Queue In=w9, Message Id="Stop") -> (Error Out=w35)
        # Stop event occurred.  Notify Main Processing Loop
        w34 = TRUE
      }
      on "Refresh" Value changed {
        # Refresh button pressed.  Notify Main Processing loop to rebuild resources
        call "Enqueue Message.gvi"(Message Queue In=w9, Message Id="Refresh") -> (Error Out=w35)
        w34 = default
      }
      on "Start" Value changed {
        $Running <- TRUE
        # Start button pressed.  Notify Main Processing Loop to step through the voltage range
        call "Enqueue Message.gvi"(Message Queue In=w9, Message Id="Step Codes") -> (Error Out=w35)
        w34 = default
      }
      on "Pause" Value changed {
        # Pause event occurred.  Notify Executable Processor
        call "Raise Pause Event.gvi"(Send Pause?=TRUE, Raiser Name="Waveform Measurement") -> (Error Out=w35)
        w34 = default
      }
      on "Resume" Value changed {
        # Resume event occurred.  Notify Executable Processor
        call "Raise Resume Event.gvi"(Send Resume?=TRUE, Raiser Name="Waveform Measurement") -> (Error Out=w35)
        w34 = default
      }
      on "Export" Value changed {
        call "ExportToCSV.gvi"(All Results=$"All Results", Panel Reference=reference to unnamed native front panel) -> (Error Out=w35)
        w34 = default
      }
    }
    call "Error Handling - Process Error.gvi"(Error to Process=w35, Exit on Error?=FALSE)
    stop if w34
  }
  # Finally, deregister from events
  Unregister For Events(error in=w35, event registration refnum=w33) -> (error out=w37)
  Merge Errors(w37, w16) -> (error out=w38)
  Release Notifier(error in (no error)=w38, notifier=w1) -> (error out=w39)
  call "Teardown Frameworkgvi.gvi"(Error In=w39) -> (Error Out=w40)
  # When Processing Errors,
  # the Main Loop will Exit as
  # the app may be in an unknown state.  The Event Loop will send an Error message to the Message Handler.
  #
  # Reset the framework to release all
  # event and notification references.
  $"Error Out" <- w40
  # Results Processing Loop.  All UI updates should be performed here.
  while {
    Wait On Notification(notifier=w1) -> (error out=w41, notification=w42)
    case (w41) {
      frame Error, Default {
        w43 = w41
      }
      frame No Error {
        call "Read Id.gvi"(Executable in=w42, Error in=w41) -> (Executable out=w44, Id=w45, Error out=w46)
        Array Index(array=$IDs) -> (out0[0]=w47)
        Is Equal(x=w45, y=w47) -> w48
        case (w48) {
          frame False, Default {
            # Do nothing
          }
          frame True {
            call "Parse Identity from Result.gvi"(Read Executable In=w44, Error In=w46) -> (Result=w49)
            $"Instrument Control Board Identity" <- w49
          }
        }
        Array Index(array=$IDs) -> (out0[1]=w50)
        Is Equal(x=w45, y=w50) -> w51
        case (w51) {
          frame False, Default {
            # Do nothing
          }
          frame True {
            call "Parse Identity from Result.gvi"(Read Executable In=w44, Error In=w46) -> (Result=w52)
            $"DMM6500 Identity" <- w52
          }
        }
        Array Index(array=$IDs) -> (out0[2]=w53)
        Is Equal(x=w45, y=w53) -> w54
        case (w54) {
          frame True {
            call "Parse Reading from Result.gvi"(Read Executable In=w44, Error In=w46) -> (Voltage Result=w55, Timestamp=w56)
            $Characterisation <- w55
            Array Index(array=w55) -> (out0[0]=w57)
            # LSB of DAC
            Multiply($"Current Code", 7.6293e-05) -> w58
            Build Cluster($"Current Code", w56, w57, w58) -> w59
            Insert Into Array(inArray=$"All Results", new=w59) -> w60
            $"All Results" <- w60
            Add($"Current Code", $Increment) -> w61
            $"Current Code" <- w61
          }
          frame False {
            # Do nothing
          }
        }
        w43 = default
      }
    }
    stop if w43
  }
