vi "Build Characterisation Executables.gvi"   [LabVIEW NXG 5.0.0]
inputs:
  "Instrument Control Board": string  # The name of the instrument whose Id shoudl be fetched.
  "DMM6500": string  # The name of the instrument whose Id shoudl be fetched.
  "Start Code": u16
  "Error in": error
  "Increment": u16 = 1
  "End Code": u16 = 65535
  "Logical Instrument": string = "DACA"
outputs:
  "ExecutableProcessor": "ExecutableProcessor.gtype"
  "IDs": string[]
  "Error out": error
uses:
  Hardware Abstraction Framework::Common::ExecutableProcessor.gtype::Add Director.gvi
diagram:
  case ($"Error in") {
    frame Error, Default {
      w1 = $"Error in"
      w2 = default
    }
    frame No Error {
      call "Find Driver.gvi"(Instrument Name=$DMM6500, Error in=$"Error in") -> (Found Driver=w3, Error out=w4)
      call "Setup Identity Executables.gvi"(Driver=w3, Error In=w4) -> (ExecutableDirector=w5, IDN Id=w6, Error Out=w7)
      call "Find Driver.gvi"(Instrument Name=$"Instrument Control Board", Error in=$"Error in") -> (Found Driver=w8, Error out=w9)
      call "Setup Identity Executables.gvi"(Driver=w8, Error In=w9) -> (ExecutableDirector=w10, IDN Id=w11, Error Out=w12)
      call "Add Director.gvi"(ExecutableProcessor in="ExecutableProcessor.gtype" constant, ExecutableDirector=w10, Error in=w12) -> (ExecutableProcessor out=w13, Error out=w14)
      call "Add Director.gvi"(ExecutableProcessor in=w13, ExecutableDirector=w5, Error in=w14) -> (ExecutableProcessor out=w15, Error out=w16)
      call "Configure DMM6500 for Accuracy.gvi"(Driver=w3, Error In=w7) -> (ExecutableDirector=w17, Error Out=w18)
      call "Add Director.gvi"(ExecutableProcessor in=w15, ExecutableDirector=w17, Error in=w16) -> (ExecutableProcessor out=w19, Error out=w20)
      Merge Errors(w20, w18) -> (error out=w21)
      call "Add Director.gvi"(ExecutableProcessor in=w19, Error in=w21) -> (ExecutableProcessor out=w22, Error out=w23)
      call "Setup Characterisation.gvi"(Start Code=$"Start Code", Increment=$Increment, End Code=$"End Code", Instrument Control Board=w8, DMM6500=w3, Logical Instrument=$"Logical Instrument", Error in=w23) -> (ExecutableDirector=w24, MEAS Id=w25, Error Out=w26)
      call "Add Director.gvi"(ExecutableProcessor in=w22, ExecutableDirector=w24, Error in=w26) -> (ExecutableProcessor out=w2, Error out=w1)
      Build Array(w11, w6, w25) -> w27
      $IDs <- w27
    }
  }
  $ExecutableProcessor <- w2
  $"Error out" <- w1
