vi "Build Results.gvi"   [LabVIEW NXG 5.0.0]
inputs:
  "Voltage": f64
  "Timestamp": timestamp
  "Current Code": u16
  "Error In": error
outputs:
  "Error Out": error
  "Result": "Result.gtype"
types:
  "Result.gtype" = cluster{"Code": u16, "Timestamp": timestamp, "Voltage": f64, "Nominal": f64, "Difference": f64, "LSBs": f64}
diagram:
  case ($"Error In") {
    frame Error, Default {
      w1 = "Result.gtype" {all zero or empty}
      w2 = $"Error In"
    }
    frame No Error {
      # LSB
      # 2.5*2*(1/65536)
      Multiply($"Current Code", 7.62939453125e-05) -> w3
      Subtract(x=$Voltage, y=w3) -> w4
      Divide(x=w4, y=7.62939453125e-05) -> w5
      Property Node(instance in="Result.gtype" {all zero or empty}, "Code"=$"Current Code", "Timestamp"=$Timestamp, "Voltage"=$Voltage, "Nominal"=w3, "Difference"=w4, "LSBs"=w5) -> (instance out=w1)
      w2 = $"Error In"
    }
  }
  $"Error Out" <- w2
  $Result <- w1
