vi "ConvertResultsToArray.gvi"   [LabVIEW NXG 5.0.0]
inputs:
  "All Results": "All Results.gtype" = [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]
  "Error In": error
outputs:
  "ResultsAsStrings": string[]
  "Error Out": error
types:
  "Result.gtype" = cluster{"Code": u16, "Timestamp": timestamp, "Voltage": f64, "Nominal": f64, "Difference": f64, "LSBs": f64}
  "All Results.gtype" = "Result.gtype"[]
diagram:
  case ($"Error In") {
    frame Error, Default {
      w1 = $"Error In"
    }
    frame No Error {
      Initialize Array(element="CODE,TIME,VOLTS,NOMINAL,DIFFERENCE,LSBs", size=1) -> w2
      s1 = w2  # shift register
      for {
        w3 = each element of $"All Results"
        Property Node(instance in=w3) -> ("Code"=w4, "Timestamp"=w5, "Voltage"=w6, "Nominal"=w7, "Difference"=w8, "LSBs"=w9)
        Number To Decimal String(number=w4) -> (decimal integer string=w10)
        Number To Fractional String(number=w6) -> (F-format string=w11)
        Number To Fractional String(number=w7) -> (F-format string=w12)
        Number To Fractional String(number=w8) -> (F-format string=w13)
        Number To Fractional String(number=w9) -> (F-format string=w14)
        Format Date Time String(time format string (%c)="%d/%m/%Y %H:%M:%S%3u", time stamp=w5) -> (date/time string=w15)
        Concatenate Strings(w10, ",", w15, ",", w11, ",", w12, ",", w13, ",", w14) -> w16
        Insert Into Array(inArray=s1, new=w16) -> w17
        next s1 = w17
      }
      $ResultsAsStrings <- s1
      w1 = $"Error In"
    }
  }
  $"Error Out" <- w1
