vi "ExportToCSV.gvi"   [LabVIEW NXG 5.0.0]
inputs:
  "All Results": "All Results.gtype"
  "Error In": error
  "Panel Reference": "FrontPanelCanvas reference"
outputs:
  "Error Out": error
types:
  "Result.gtype" = cluster{"Code": u16, "Timestamp": timestamp, "Voltage": f64, "Nominal": f64, "Difference": f64, "LSBs": f64}
  "All Results.gtype" = "Result.gtype"[]
diagram:
  Array Size(array=$"All Results") -> (size(s)=w1)
  Is Equal To 0(x=w1) -> w2
  case (w2) {
    frame False, Default {
      case ($"Error In") {
        frame Error, Default {
          w3 = $"Error In"
        }
        frame No Error {
          Set Busy(reference in=$"Panel Reference", error in=$"Error In") -> (reference out=w4, error out=w5)
          call "ConvertResultsToArray.gvi"(All Results=$"All Results", Error In=w5) -> (ResultsAsStrings=w6, Error Out=w7)
          Write To Text File(error in=w7, prompt (Choose or enter file path)="Create a new file or append to an existing one", text=w6) -> (cancelled=w8, error out=w9)
          case (w8) {
            frame False, Default {
              w10 = w9
            }
            frame True {
              w10 = no error
            }
          }
          Unset Busy(reference in=w4, error in=w10) -> (error out=w3)
        }
      }
    }
    frame True {
      One Button Dialog(message="No results to save")
      w3 = $"Error In"
    }
  }
  $"Error Out" <- w3
