vi "Get Base Command.gvi"   [LabVIEW NXG 5.0.0]
# Returns the base command whch is used to build up the overall command string – parameters will be added to this as necessary.  The framework will add the line terminator \n.
# Subclasses MUST override this member and must not add a line terminator on the end of the command; on this class an error is returned.
inputs:
  "IntegerCode in": "IntegerCode.gtype"
  "Error in": error
outputs:
  "Base Command": string  # Returns the Base Command to be run. Parameters will be added to this as necessary. The framework will add the line terminator \n.
  "IntegerCode out": "IntegerCode.gtype"
  "Error out": error
uses:
  Hardware Abstraction Framework::Command::SCPI Test::Test.gtype::Get Base Command.gvi
  IntegerCode.gtype::Read Logical Instrument.gvi
  IntegerCode.gtype::Read Code.gvi
diagram:
  call parent "Get Base Command.gvi"(Test in=$"IntegerCode in", Error in=$"Error in") -> (Test out=w1, Base Command=w2)
  $"IntegerCode out" <- w1
  call "Read Logical Instrument.gvi"(IntegerCode in=$"IntegerCode in", Error in=$"Error in") -> (Logical Instrument=w3)
  # Space added
  Concatenate Strings(w2, w3, " ") -> w4
  call "Read Code.gvi"(IntegerCode in=$"IntegerCode in", Error in=$"Error in") -> (Code=w5, Error out=w6)
  # TEST:DAC1 65535
  Number To Decimal String(number=w5, width (-)=5) -> (decimal integer string=w7)
  Concatenate Strings(w4, w7) -> w8
  $"Base Command" <- w8
  $"Error out" <- w6
