vi "Post-Exec Callout.gvi"   [LabVIEW NXG 5.0.0]
# Called at the end of the Processing of a specific executable so that additional code can be run.  The default is to do nothing and subclasses only have to override when needed.
inputs:
  "IntegerCode in": "IntegerCode.gtype"
  "Error in": error
outputs:
  "IntegerCode out": "IntegerCode.gtype"
  "Error out": error
uses:
  IntegerCode.gtype::Read Increment.gvi
  IntegerCode.gtype::Read Code.gvi
  IntegerCode.gtype::Write Code.gvi
diagram:
  case ($"Error in") {
    frame Error, Default {
      w1 = $"IntegerCode in"
      w2 = $"Error in"
    }
    frame No Error {
      call "Read Increment.gvi"(IntegerCode in=$"IntegerCode in", Error in=$"Error in") -> (IntegerCode out=w3, Increment=w4, Error out=w5)
      call "Read Code.gvi"(IntegerCode in=w3, Error in=w5) -> (IntegerCode out=w6, Code=w7, Error out=w8)
      case (w8) {
        frame Error, Default {
          w1 = w6
          w2 = w8
        }
        frame No Error {
          Add(w7, w4) -> w9
          call "Write Code.gvi"(IntegerCode in=w6, Code=w9, Error in=w8) -> (IntegerCode out=w1, Error out=w2)
        }
      }
    }
  }
  $"IntegerCode out" <- w1
  $"Error out" <- w2
