vi "Parse Reading from Result.gvi"   [LabVIEW NXG 5.0.0]
inputs:
  "Read Executable In": "ReadExecutable.gtype"
  "Error In": error
outputs:
  "Voltage Result": f64[]
  "Error Out": error
  "Timestamp": timestamp
uses:
  Hardware Abstraction Framework::Common::WriteExecutable.gtype::Read Parameters.gvi
  Hardware Abstraction Framework::Common::Parameter.gtype::Get Result as Double.gvi
  Hardware Abstraction Framework::Common::Parameter.gtype::Get Result as Timestamp.gvi
diagram:
  case ($"Error In") {
    frame Error, Default {
      w1 = $"Error In"
    }
    frame No Error {
      To More Specific Class(error in=$"Error In", reference=$"Read Executable In", target class="Measure.gtype" constant) -> (error out=w2, specific class reference=w3)
      case (w2) {
        frame Error, Default {
          w1 = w2
        }
        frame No Error {
          call "Read Parameters.gvi"(Executable in=w3, Error in=w2) -> (Parameters=w4, Error out=w5)
          Array Index(array=w4) -> (out0[0]=w6)
          call "Get Result as Double.gvi"(Parameter in=w6, Error in=w5) -> (Result=w7, Error out=w8)
          Array Index(array=w4) -> (out0[1]=w9)
          call "Get Result as Timestamp.gvi"(Parameter in=w9, Error in=w5) -> (Result=w10, Error out=w11)
          Merge Errors(w8, w11) -> (error out=w12)
          case (w12) {
            frame Error, Default {
              w1 = w12
            }
            frame No Error {
              Build Array(w7) -> w13
              $"Voltage Result" <- w13
              $Timestamp <- w10
              w1 = w12
            }
          }
        }
      }
    }
  }
  $"Error Out" <- w1
