vi "Build ADC Characterisation Executables.gvi"   [LabVIEW NXG 5.0.0]
inputs:
  "Generate Instrument Name": string  # The name of the instrument whose Id shoudl be fetched.
  "Measure Instrument Name": string  # The name of the instrument whose Id shoudl be fetched.
  "Start Volts": f32
  "Error in": error
  "Increment": f32
  "End Volts": f32
outputs:
  "ExecutableProcessor": "ExecutableProcessor.gtype"
  "IDs": string[]
  "Error out": error
uses:
  Hardware Abstraction Framework::Common::ExecutableProcessor.gtype::Add Director.gvi
  Hardware Abstraction Framework::Common::WriteExecutable.gtype::Write Driver.gvi
  Hardware Abstraction Framework::Command::SCPI Generate::Output.gtype::Write Output Switch.gvi
  Hardware Abstraction Framework::Command::SCPI Generate::Output.gtype::Write Control Master Switch.gvi
  Hardware Abstraction Framework::Command::SCPI Generate::Instrument.gtype::Write Channel.gvi
  Hardware Abstraction Framework::Common::ExecutableDirector.gtype::Add Executable.gvi
diagram:
  case ($"Error in") {
    frame Error, Default {
      w1 = $"Error in"
      w2 = default
    }
    frame No Error {
      call "Find Driver.gvi"(Instrument Name=$"Measure Instrument Name", Error in=$"Error in") -> (Found Driver=w3, Error out=w4)
      call "Setup Identity Executables.gvi"(Driver=w3, Error In=w4) -> (ExecutableDirector=w5, IDN Id=w6, Error Out=w7)
      call "Find Driver.gvi"(Instrument Name=$"Generate Instrument Name", Error in=$"Error in") -> (Found Driver=w8, Error out=w9)
      call "Setup Identity Executables.gvi"(Driver=w8, Error In=w9) -> (ExecutableDirector=w10, IDN Id=w11, Error Out=w12)
      call "Add Director.gvi"(ExecutableProcessor in="ExecutableProcessor.gtype" constant, ExecutableDirector=w10, Error in=w12) -> (ExecutableProcessor out=w13, Error out=w14)
      call "Add Director.gvi"(ExecutableProcessor in=w13, ExecutableDirector=w5, Error in=w14) -> (ExecutableProcessor out=w15, Error out=w16)
      call "Create Buffer.gvi"(Driver=w3, Error In=w7) -> (ExecutableDirector=w17, Error Out=w18)
      call "Add Director.gvi"(ExecutableProcessor in=w15, ExecutableDirector=w17, Error in=w16) -> (ExecutableProcessor out=w19, Error out=w20)
      Merge Errors(w20, w18) -> (error out=w21)
      call "Write Driver.gvi"(Executable in="Output.gtype" constant, Driver In=w8, Error in=w21) -> (Executable out=w22, Error out=w23)
      call "Write Output Switch.gvi"(Output in=w22, Output Switch=TRUE, Error in=w23) -> (Output out=w24, Error out=w25)
      call "Write Control Master Switch.gvi"(Output in=w24, Control Master Switch=TRUE, Error in=w25) -> (Output out=w26, Error out=w27)
      call "Write Driver.gvi"(Executable in="Instrument.gtype" constant, Driver In=w8, Error in=w21) -> (Executable out=w28, Error out=w29)
      call "Write Channel.gvi"(Instrument in=w28, Channel=1, Error in=w29) -> (Instrument out=w30, Error out=w31)
      Merge Errors(w31, w27) -> (error out=w32)
      call "Add Executable.gvi"(ExecutableDirector in="ExecutableDirector.gtype" constant, Executable=w30, Error in=w32) -> (ExecutableDirector out=w33, Error out=w34)
      call "Add Executable.gvi"(ExecutableDirector in=w33, Executable=w26, Error in=w34) -> (ExecutableDirector out=w35, Error out=w36)
      call "Add Director.gvi"(ExecutableProcessor in=w19, ExecutableDirector=w35, Error in=w36) -> (ExecutableProcessor out=w37, Error out=w38)
      call "Setup Step and Measure.gvi"(Increment=$Increment, End Volts=$"End Volts", Generate Driver=w8, Measure Driver=w3, Start Volts=$"Start Volts", Error in=w38) -> (ExecutableDirector=w39, MEAS Id=w40, Error Out=w41)
      call "Add Director.gvi"(ExecutableProcessor in=w37, ExecutableDirector=w39, Error in=w41) -> (ExecutableProcessor out=w2, Error out=w1)
      Build Array(w11, w6, w40) -> w42
      $IDs <- w42
    }
  }
  $ExecutableProcessor <- w2
  $"Error out" <- w1
