vi "Build ADC Results.gvi"   [LabVIEW NXG 5.0.0]
inputs:
  "Error In": error
  "ADC Voltage": f64
  "Timestamp": timestamp
  "DMM Voltage": f64
  "PSU Voltage": f32
outputs:
  "Voltages Array": f64[]
  "ADC Result": "ADCResult.gtype"
  "Error Out": error
types:
  "ADCResult.gtype" = cluster{"PSU Requested Volts": f32, "ADC Read Volts": f64, "DMM Measured Volts": f64, "Difference": f64, "Timestamp": timestamp, "LSBs": f64}
diagram:
  case ($"Error In") {
    frame Error, Default {
      w1 = $"Error In"
      w2 = default
      w3 = default
    }
    frame No Error {
      Build Array($"DMM Voltage", $"ADC Voltage") -> w2
      Subtract(x=$"ADC Voltage", y=$"DMM Voltage") -> w4
      # LSB
      # 2.5*2*(1/65536)
      Divide(x=w4, y=7.62939453125e-05) -> w5
      Property Node(instance in="ADCResult.gtype" {all zero or empty}, "PSU Requested Volts"=$"PSU Voltage", "DMM Measured Volts"=$"DMM Voltage", "Timestamp"=$Timestamp, "ADC Read Volts"=$"ADC Voltage", "Difference"=w4, "LSBs"=w5) -> (instance out=w3)
      w1 = $"Error In"
    }
  }
  $"Error Out" <- w1
  $"Voltages Array" <- w2
  $"ADC Result" <- w3
