vi "Convert ADC Results to Array.gvi"   [LabVIEW NXG 5.0.0]
inputs:
  "All ADC Results": "All ADCResults.gtype"
  "Error In": error
outputs:
  "Error Out": error
  "ResultsAsStrings": string[]
types:
  "ADCResult.gtype" = cluster{"PSU Requested Volts": f32, "ADC Read Volts": f64, "DMM Measured Volts": f64, "Difference": f64, "Timestamp": timestamp, "LSBs": f64}
  "All ADCResults.gtype" = "ADCResult.gtype"[]
diagram:
  case ($"Error In") {
    frame Error, Default {
      w1 = $"Error In"
    }
    frame No Error {
      w2 = "Timestamp, Requested Voltage, DMM Voltage, ADC Voltage, Difference, LSBs"
      Initialize Array(element=w2, size=1) -> w3
      s1 = w3  # shift register
      for {
        w4 = each element of $"All ADC Results"
        Property Node(instance in=w4) -> ("Timestamp"=w5, "PSU Requested Volts"=w6, "DMM Measured Volts"=w7, "ADC Read Volts"=w8, "Difference"=w9, "LSBs"=w10)
        Number To Fractional String(number=w6) -> (F-format string=w11)
        Number To Fractional String(number=w7) -> (F-format string=w12)
        Number To Fractional String(number=w8) -> (F-format string=w13)
        Number To Fractional String(number=w9) -> (F-format string=w14)
        Number To Fractional String(number=w10) -> (F-format string=w15)
        Format Date Time String(time format string (%c)="%d/%m/%Y %H:%M:%S%3u", time stamp=w5) -> (date/time string=w16)
        Concatenate Strings(w16, ",", w11, ",", w12, ",", w13, ",", w14, ",", w15) -> w17
        Insert Into Array(inArray=s1, new=w17) -> w18
        next s1 = w18
      }
      $ResultsAsStrings <- s1
      w1 = $"Error In"
    }
  }
  $"Error Out" <- w1
