vi "Get Instrument Identities.gvi"   [LabVIEW NXG 5.0.0]
inputs:
  "HMC8043 Name": string  # The name of the instrument whose Id shoudl be fetched.
  "DMM6500 Name": string  # The name of the instrument whose Id shoudl be fetched.
  "ICB Name": string
  "Error in": error
outputs:
  "Error out": error
  "ExecutableProcessor": "ExecutableProcessor.gtype"
  "IDs": string[]
  "ADC Drivers": "ADC Drivers.gtype"
types:
  "ADC Drivers.gtype" = cluster{"HMC8043 Driver": "Driver.gtype", "DMM6500 Driver": "Driver.gtype", "ICB Driver": "Driver.gtype"}
uses:
  Hardware Abstraction Framework::Common::ExecutableProcessor.gtype::Add Director.gvi
diagram:
  case ($"Error in") {
    frame Error, Default {
      w1 = $"Error in"
    }
    frame No Error {
      call "Find Driver.gvi"(Instrument Name=$"ICB Name", Error in=$"Error in") -> (Found Driver=w2, Error out=w3)
      call "Setup Identity Executables.gvi"(Driver=w2, Error In=w3) -> (ExecutableDirector=w4, IDN Id=w5, Error Out=w6)
      call "Find Driver.gvi"(Instrument Name=$"DMM6500 Name", Error in=$"Error in") -> (Found Driver=w7, Error out=w8)
      call "Setup Identity Executables.gvi"(Driver=w7, Error In=w8) -> (ExecutableDirector=w9, IDN Id=w10, Error Out=w11)
      call "Find Driver.gvi"(Instrument Name=$"HMC8043 Name", Error in=$"Error in") -> (Found Driver=w12, Error out=w13)
      call "Setup Identity Executables.gvi"(Driver=w12, Error In=w13) -> (ExecutableDirector=w14, IDN Id=w15, Error Out=w16)
      Merge Errors(w16, w11, w6) -> (error out=w17)
      call "Add Director.gvi"(ExecutableProcessor in="ExecutableProcessor.gtype" constant, ExecutableDirector=w14, Error in=w17) -> (ExecutableProcessor out=w18, Error out=w19)
      call "Add Director.gvi"(ExecutableProcessor in=w18, ExecutableDirector=w9, Error in=w19) -> (ExecutableProcessor out=w20, Error out=w21)
      call "Add Director.gvi"(ExecutableProcessor in=w20, ExecutableDirector=w4, Error in=w21) -> (ExecutableProcessor out=w22, Error out=w1)
      $ExecutableProcessor <- w22
      Build Array(w15, w10, w5) -> w23
      $IDs <- w23
      Property Node(instance in="ADC Drivers.gtype" {all zero or empty}, "HMC8043 Driver"=w12, "DMM6500 Driver"=w7, "ICB Driver"=w2) -> (instance out=w24)
      $"ADC Drivers" <- w24
    }
  }
  $"Error out" <- w1
