vi "Parse Result from DMM.gvi"   [LabVIEW NXG 5.0.0]
inputs:
  "Read Executable In": "ReadExecutable.gtype"
  "Error In": error
outputs:
  "DMM Voltage": f64
  "Timestamp": timestamp
  "Error Out": error
uses:
  Hardware Abstraction Framework::Common::WriteExecutable.gtype::Read Parameters.gvi
  Hardware Abstraction Framework::Common::Parameter.gtype::Get Result as Timestamp.gvi
  Hardware Abstraction Framework::Common::Parameter.gtype::Get Result as Double.gvi
diagram:
  case ($"Error In") {
    frame Error, Default {
      w1 = $"Error In"
    }
    frame No Error {
      To More Specific Class(error in=$"Error In", reference=$"Read Executable In", target class="Measure.gtype" constant) -> (error out=w2, specific class reference=w3)
      case (w2) {
        frame Error, Default {
          w1 = w2
        }
        frame No Error {
          call "Read Parameters.gvi"(Executable in=w3, Error in=w2) -> (Parameters=w4, Error out=w5)
          Array Index(array=w4) -> (out0[1]=w6)
          call "Get Result as Timestamp.gvi"(Parameter in=w6, Error in=w5) -> (Result=w7, Error out=w8)
          Array Index(array=w4) -> (out0[0]=w9)
          call "Get Result as Double.gvi"(Parameter in=w9, Error in=w5) -> (Result=w10, Error out=w11)
          Merge Errors(w11, w8) -> (error out=w12)
          case (w12) {
            frame Error, Default {
              w1 = w12
            }
            frame No Error {
              $"DMM Voltage" <- w10
              $Timestamp <- w7
              w1 = w12
            }
          }
        }
      }
    }
  }
  $"Error Out" <- w1
