vi "Parse Result from ICB.gvi"   [LabVIEW NXG 5.0.0]
inputs:
  "Read Executable In": "ReadExecutable.gtype"
  "Error In": error
outputs:
  "ICB Voltage": f64
  "Error Out": error
uses:
  Hardware Abstraction Framework::Command::SCPI Generic::User Defined Read.gtype::Get Result as Double.gvi
diagram:
  case ($"Error In") {
    frame Error, Default {
      w1 = $"Error In"
    }
    frame No Error {
      To More Specific Class(error in=$"Error In", reference=$"Read Executable In", target class="User Defined Read.gtype" constant) -> (error out=w2, specific class reference=w3)
      case (w2) {
        frame Error, Default {
          w1 = w2
        }
        frame No Error {
          call "Get Result as Double.gvi"(User Defined Read in=w3, Error in=w2) -> (Result=w4, Error out=w1)
          $"ICB Voltage" <- w4
        }
      }
    }
  }
  $"Error Out" <- w1
