vi "Configure DMM6500 for Accuracy.gvi"   [LabVIEW NXG 5.0.0]
inputs:
  "Driver": "Driver.gtype"  # Driver to obtain Id for.
  "Error In": error
outputs:
  "ExecutableDirector": "ExecutableDirector.gtype"  # Configured Executable Director (execute once) capable of running the necessary commands.
  "Error Out": error
uses:
  Hardware Abstraction Framework::Command::SCPI Generic::User Defined Write.gtype::Write Command to Execute.gvi
  Hardware Abstraction Framework::Common::WriteExecutable.gtype::Write Driver.gvi
  Hardware Abstraction Framework::Common::ExecutableDirector.gtype::Add Executable.gvi
diagram:
  case ($"Error In") {
    frame Error, Default {
      w1 = $"Error In"
    }
    frame No Error {
      call "Write Command to Execute.gvi"(User Defined Write in="User Defined Write.gtype" constant, Command to Execute="VOLT:AVER:STAT ON", Error in=$"Error In") -> (User Defined Write out=w2, Error out=w3)
      call "Write Driver.gvi"(Executable in=w2, Driver In=$Driver, Error in=w3) -> (Executable out=w4, Error out=w5)
      call "Write Command to Execute.gvi"(User Defined Write in="User Defined Write.gtype" constant, Command to Execute="VOLT:AVER:TCON REP", Error in=$"Error In") -> (User Defined Write out=w6, Error out=w7)
      call "Write Driver.gvi"(Executable in=w6, Driver In=$Driver, Error in=w7) -> (Executable out=w8, Error out=w9)
      call "Write Command to Execute.gvi"(User Defined Write in="User Defined Write.gtype" constant, Command to Execute="VOLT:AVER:COUN 10", Error in=$"Error In") -> (User Defined Write out=w10, Error out=w11)
      call "Write Driver.gvi"(Executable in=w10, Driver In=$Driver, Error in=w11) -> (Executable out=w12, Error out=w13)
      call "Write Command to Execute.gvi"(User Defined Write in="User Defined Write.gtype" constant, Command to Execute="VOLT:LINE:SYNC ON", Error in=$"Error In") -> (User Defined Write out=w14, Error out=w15)
      call "Write Driver.gvi"(Executable in=w14, Driver In=$Driver, Error in=w15) -> (Executable out=w16, Error out=w17)
      call "Write Command to Execute.gvi"(User Defined Write in="User Defined Write.gtype" constant, Command to Execute="VOLT:DEL:AUTO ON", Error in=$"Error In") -> (User Defined Write out=w18, Error out=w19)
      call "Write Driver.gvi"(Executable in=w18, Driver In=$Driver, Error in=w19) -> (Executable out=w20, Error out=w21)
      call "Write Command to Execute.gvi"(User Defined Write in="User Defined Write.gtype" constant, Command to Execute="VOLT:NPLC 2", Error in=$"Error In") -> (User Defined Write out=w22, Error out=w23)
      call "Write Driver.gvi"(Executable in=w22, Driver In=$Driver, Error in=w23) -> (Executable out=w24, Error out=w25)
      call "Write Command to Execute.gvi"(User Defined Write in="User Defined Write.gtype" constant, Command to Execute=":TRAC:MAKE \"mybuffer\", 65536, FULL", Error in=$"Error In") -> (User Defined Write out=w26, Error out=w27)
      call "Write Driver.gvi"(Executable in=w26, Driver In=$Driver, Error in=w27) -> (Executable out=w28, Error out=w29)
      call "Add Executable.gvi"(ExecutableDirector in="ExecutableDirector.gtype" constant, Executable=w28, Error in=w29) -> (ExecutableDirector out=w30, Error out=w31)
      Merge Errors(w31, w25) -> (error out=w32)
      call "Add Executable.gvi"(ExecutableDirector in=w30, Executable=w24, Error in=w32) -> (ExecutableDirector out=w33, Error out=w34)
      Merge Errors(w34, w21) -> (error out=w35)
      call "Add Executable.gvi"(ExecutableDirector in=w33, Executable=w20, Error in=w35) -> (ExecutableDirector out=w36, Error out=w37)
      Merge Errors(w37, w17) -> (error out=w38)
      call "Add Executable.gvi"(ExecutableDirector in=w36, Executable=w16, Error in=w38) -> (ExecutableDirector out=w39, Error out=w40)
      Merge Errors(w40, w13) -> (error out=w41)
      call "Add Executable.gvi"(ExecutableDirector in=w39, Executable=w12, Error in=w41) -> (ExecutableDirector out=w42, Error out=w43)
      Merge Errors(w43, w9) -> (error out=w44)
      call "Add Executable.gvi"(ExecutableDirector in=w42, Executable=w8, Error in=w44) -> (ExecutableDirector out=w45, Error out=w46)
      Merge Errors(w46, w5) -> (error out=w47)
      call "Add Executable.gvi"(ExecutableDirector in=w45, Executable=w4, Error in=w47) -> (ExecutableDirector out=w48, Error out=w1)
      $ExecutableDirector <- w48
    }
  }
  $"Error Out" <- w1
