vi "Configure HMC8043.gvi"   [LabVIEW NXG 5.0.0]
inputs:
  "HMC8043 Driver": "Driver.gtype"
  "Channel": u8 = 1
  "Error In": error
outputs:
  "ExecutableDirector": "ExecutableDirector.gtype"
  "Error Out": error
uses:
  Hardware Abstraction Framework::Common::WriteExecutable.gtype::Write Driver.gvi
  Hardware Abstraction Framework::Command::SCPI Generate::Output.gtype::Write Output Switch.gvi
  Hardware Abstraction Framework::Command::SCPI Generate::Output.gtype::Write Control Master Switch.gvi
  Hardware Abstraction Framework::Command::SCPI Generate::Instrument.gtype::Write Channel.gvi
  Hardware Abstraction Framework::Common::ExecutableDirector.gtype::Add Executable.gvi
diagram:
  case ($"Error In") {
    frame Error, Default {
      w1 = $"Error In"
    }
    frame No Error {
      call "Write Driver.gvi"(Executable in="Output.gtype" constant, Driver In=$"HMC8043 Driver", Error in=$"Error In") -> (Executable out=w2, Error out=w3)
      call "Write Output Switch.gvi"(Output in=w2, Output Switch=TRUE, Error in=w3) -> (Output out=w4, Error out=w5)
      call "Write Control Master Switch.gvi"(Output in=w4, Control Master Switch=TRUE, Error in=w5) -> (Output out=w6, Error out=w7)
      call "Write Driver.gvi"(Executable in="Instrument.gtype" constant, Driver In=$"HMC8043 Driver", Error in=$"Error In") -> (Executable out=w8, Error out=w9)
      call "Write Channel.gvi"(Instrument in=w8, Channel=$Channel, Error in=w9) -> (Instrument out=w10, Error out=w11)
      Merge Errors(w11, w7) -> (error out=w12)
      call "Add Executable.gvi"(ExecutableDirector in="ExecutableDirector.gtype" constant, Executable=w10, Error in=w12) -> (ExecutableDirector out=w13, Error out=w14)
      call "Add Executable.gvi"(ExecutableDirector in=w13, Executable=w6, Error in=w14) -> (ExecutableDirector out=w15, Error out=w1)
      $ExecutableDirector <- w15
    }
  }
  $"Error Out" <- w1
