vi "Parse Identity from Result.gvi"   [LabVIEW NXG 5.0.0]
inputs:
  "Read Executable In": "ReadExecutable.gtype", required  # The Executable that has the result embedded.
  "Error In": error
outputs:
  "Error Out": error
  "Result": string
uses:
  Hardware Abstraction Framework::Common::ReadExecutable.gtype::Build Result.gvi
diagram:
  case ($"Error In") {
    frame Error, Default {
      w1 = $"Error In"
    }
    frame No Error {
      To More Specific Class(error in=$"Error In", reference=$"Read Executable In", target class="IDN.gtype" constant) -> (error out=w2, specific class reference=w3)
      case (w2) {
        frame Error, Default {
          w1 = w2
        }
        frame No Error {
          call "Build Result.gvi"(ReadExecutable in=w3, Error in=w2) -> (Result=w4, Error out=w1)
          $Result <- w4
        }
      }
    }
  }
  $"Error Out" <- w1
