vi "Function.gvi"   [LabVIEW NXG 5.0.0]
panel indicators:
  "Variable Resistance": waveform<f64>[]
  "String Array Output": string[]
diagram:
  for (N = 100) {
    s1 = f64[] []  # shift register
    for (N = 10) {
      Random Number() -> (number (0 to 1)=w1)
      Multiply(w1, 10) -> w2
      Insert Into Array(inArray=s1, new=w2) -> w3
      Wait(time to wait=100)
      next s1 = w3
    }
    Get Current Time() -> (current time=w4)
    Build Waveform Node(Y=s1, dt=0.1, t0=w4) -> (output waveform=w5)
    Build Array(w5) -> w6
    $"Variable Resistance" <- w6
  }
  Clear Data(reference in=reference to "Variable Resistance")
  w7 = ["CHANNEL", "DATE", "EXTRA", "EXTRAFORMATTED", "EXTRAUNIT", "FORMATTED", "FRACTIONAL", "READING", "RELATIVE", "SECONDS", "STATUS", "TIME", "TSTAMP", "UNIT"]  # Buffer Elements
  Array Subset(array=w7, index0=12, length0=1) -> w8
  $"String Array Output" <- w8
