vi "Generate Voltage.gvi"   [LabVIEW NXG 5.0.0]
panel controls:
  "Generate": bool
  "Stop": bool
  "Generate Instrument": string
  "Refresh": bool
  "Error": error
  "Error_Type": error
  "Function": T1 = "[As Set]"  # The type of measurement to be measured, e.g voltage, current etc. If not specified, the current function is used (As Set.)
  "BE Names": "Buffer Elements.gtype" = ["CHANNEL", "DATE", "EXTRA", "EXTRAFORMATTED", "EXTRAUNIT", "FORMATTED", "FRACTIONAL", "READING", "RELATIVE", "SECONDS", "STATUS", "TIME", "TSTAMP", "UNIT"]
  "Buffer Elements": i32[]
  "Measure Instrument": string
  "Generate Voltage": f32 = 0.001
panel indicators:
  "Generate Identity": string
  "Error Out": error
  "Measurement": string
  "Measure Identity": string
  "Measured Voltage": f32
types:
  T1 = enum{"[As Set]", "DC Voltage", "AC Voltage", "DC Current", "AC Current", "2-wire Resistance", "4-wire Resistance", "Diode", "Capacitance", "Temperature", "Continuity", "Frequency", "Period", "DC Voltage Ratio"}
  "Buffer Elements.gtype" = string[]
  "All Notification Message Ids.gtype" = cluster{"Initialise": string, "Exit": string, "Error": string, "Result": string, "Done": string}
  "Event Data.gtype" = cluster{"Raiser Name": string, "Raiser Id": string}
uses:
  Hardware Abstraction Framework::Utilities::Setup Framework.gvi
  Hardware Abstraction Framework::Support::Messages::Dequeue Message.gvi
  NI::G Core::Error::Build Error Cluster.gvi
  Hardware Abstraction Framework::Support::Messages::Enqueue Message.gvi
  Hardware Abstraction Framework::Z_Implementation::Drivers::DMM::Select Buffer Elements.gvi
  Hardware Abstraction Framework::Support::Helpers::Error Handling - Process Error.gvi
  Hardware Abstraction Framework::Utilities::Teardown Frameworkgvi.gvi
diagram:
  # Listen for any stop event raised by the framework.  Can also raise a Stop event if the user presses Stop button.
  # Initialise the example before anything else
  # The Notifications Queue is used to receive messages from the framework (typically results) but can also be used to send messages to control the processing loop following an event.
  sequence {
    frame 0 {
      call "Setup Framework.gvi"()
      $"Error Out" <- no error
      $"Generate Identity" <- ""
      $Measurement <- ""
      Property Node(instance in=reference to "Buffer Elements", "Items"=$"BE Names")
    }
    frame 1 {
      w1 = "Hardware Abstraction Framework::Support::Resources.grsc::Events"
      Tag Read(ref in=w1) -> (Data=w2)
      Property Node(instance in=w2) -> ("Stop Event"=w3)
      w4 = "Hardware Abstraction Framework::Support::Resources.grsc::MessageQueues"
      Tag Read(ref in=w4) -> (Data=w5)
      Property Node(instance in=w5) -> ("Notifications"=w6)
    }
  }
  # IDs will hold references that can be used to tie a Result message to the Executable that was processed - in this example, *IDN? and :MEAS:. There are different ways of doing this, but using a shift-register keeps the execution visible for the example.
  w7 = string[] []  # IDs
  w8 = $Error
  # Main Processing loop.  Waits for messages to appear on the queue and then processes it.
  s1 = w7  # shift register
  while {
    call "Dequeue Message.gvi"(Message Queue In=w6, Error In=w8) -> (Timed Out?=w9, Message Queue Out=w10, Message Id=w11, Message Data=w12, Error Out=w13)
    # Case options should include "All Notification Messages" as a minimum
    # Waits for next message. Queue is created with Initialise message.
    case (w11) {
      frame Default {
        w17 = "Application timed-out waiting for an action to be initiated.%s"
        w18 = "An unknown message - %s -was added to the notification queue"
        Select(s=w9, t=w17, f=w18) -> w19
        # An unknown message was added to the queue or a timeout occurred
        Format Into String(formatString=w19, w11) -> w20
        call "Build Error Cluster.gvi"(code=1, description=w20) -> (error out=w14)
        w15 = default
        w16 = s1
      }
      frame "Initialise" {
        # Queue a message to refresh the System Resources
        call "Enqueue Message.gvi"(Message Queue In=w10, Message Id="Refresh", Error In=w13) -> (Error Out=w14)
        w15 = default
        w16 = s1
      }
      frame "Refresh" {
        # Build the list of resources attached to the system and load their names into the UI combo box.  Select the first value so something is displayed.
        call "Get System Resources.gvi"(Error in=w13) -> (Resources=w21, Error out=w14)
        Array Index(array=w21) -> (out0[0]=w22)
        Property Node(instance in=reference to "Generate Instrument", "Items"=w21, "Value"=w22)
        w15 = default
        w16 = s1
      }
      frame "Stop" {
        w23 = "All Notification Message Ids.gtype" {"Initialise"="Initialise", "Exit"="Exit", "Error"="Error", "Result"="Result", "Done"="Done"}
        # Stop processing any more messages.
        Property Node(instance in=w23) -> ("Exit"=w24)
        call "Enqueue Message.gvi"(Message Queue In=w10, Message Id=w24, Error In=w13) -> (Error Out=w14)
        w15 = default
        w16 = s1
      }
      frame "Get Measure" {
        # Get Measure requested.  Process the command through the framework (sub-VI).  The Ids passed out will be used in processing the Result message.
        call "Select Buffer Elements.gvi"(Item Indices=$"Buffer Elements", Error In=w13) -> (Selected Buffer Elements=w25, Error Out=w26)
        call "Get Measurement.gvi"(Instrument Name=$"Generate Instrument", Function=$Function, Buffer Elements=w25, Error in=w26) -> (IDs=w16, Error out=w14)
        w15 = default
      }
      frame "Exit" {
        Variant To Data(type=no error, variant=w12) -> (data=w27, error out=w28)
        case (w28) {
          frame Error, Default {
            w14 = w13
          }
          frame No Error {
            # If exiting because of error, pass it on for display
            w14 = w27
          }
        }
        w15 = TRUE
        w16 = s1
      }
      frame "Error" {
        # Handle an error.  Here nothing is done, but it could be logged as an example
        Variant To Data(type=$Error_Type, variant=w12) -> (data=w14)
        w15 = default
        w16 = s1
      }
      frame "Result" {
        Variant To Data(error in (no error)=w13, type="ReadExecutable.gtype" constant, variant=w12) -> (data=w29, error out=w30)
        case (w30) {
          frame Error, Default {
            w14 = w30
            w16 = s1
          }
          frame No Error {
            call "Parse Measurement Result.gvi"(Read Executable In=w29, IDs=s1, Error In=w30) -> (Result=w31, is Identity=w32, Error Out=w14)
            # If the message data contains a Read Executable, parse the result from it.
            case (w32) {
              frame False, Default {
                $Measurement <- w31
              }
              frame True {
                $"Generate Identity" <- w31
              }
            }
            w16 = s1
          }
        }
        w15 = default
      }
      frame "Done" {
        # Do nothing
        w14 = w13
        w15 = default
        w16 = s1
      }
    }
    call "Error Handling - Process Error.gvi"(Error to Process=w14, Exit on Error?=TRUE)
    next s1 = w16
    stop if w15
  }
  Register For Events("Stop"=w3) -> (event registration refnum out=w33)
  # Event loop: loops until Stop pressed or a Stop event raised.
  # Handles UI events by sending messages to the processing loop.
  while {
    event (dynamic events = w33) {
      on "Stop" Value changed {
        Property Node(instance in="Event Data.gtype" {all zero or empty}, "Raiser Name"="Instrument Identification") -> (instance out=w36)
        # Stop button pressed. Raise Stop Event to halt further processing.
        Generate User Event(event data=w36, priority="high priority", user event=w3) -> (error out=w35)
        w34 = default
      }
      on dynamic event 0 {
        call "Enqueue Message.gvi"(Priority?=TRUE, Message Queue In=w6, Message Id="Stop") -> (Error Out=w35)
        # Stop event occurred.  Notify Main Processing Loop
        w34 = TRUE
      }
      on "Refresh" Value changed {
        # Refresh button pressed.  Notify Main Processing loop to rebuild resources
        call "Enqueue Message.gvi"(Message Queue In=w6, Message Id="Refresh") -> (Error Out=w35)
        w34 = default
      }
      on "Generate" Value changed {
        # Get Measure button pressed.  Notify Main Processing Loop to take a measurement
        call "Enqueue Message.gvi"(Message Queue In=w6, Message Id="Get Measure") -> (Error Out=w35)
        w34 = default
      }
    }
    call "Error Handling - Process Error.gvi"(Error to Process=w35, Exit on Error?=FALSE)
    stop if w34
  }
  # Finally, deregister from events
  Unregister For Events(error in=w35, event registration refnum=w33) -> (error out=w37)
  # When Processing Errors,
  # the Main Loop will Exit as
  # the app may be in an unknown state.  The Event Loop will send an Error message to the Message Handler.
  Merge Errors(w37, w14) -> (error out=w38)
  call "Teardown Frameworkgvi.gvi"(Error In=w38) -> (Error Out=w39)
  $"Error Out" <- w39
