vi "Parse Voltage From Result.gvi"   [LabVIEW NXG 5.0.0]
inputs:
  "Read Executable In": "ReadExecutable.gtype"  # The Executable that has the result embedded.
  "Error In": error
outputs:
  "Error Out": error
  "Voltage": f32
uses:
  Hardware Abstraction Framework::Command::SCPI Acquire::Measure.gtype::Get Result as Double.gvi
diagram:
  case ($"Error In") {
    frame Error, Default {
      w1 = $"Error In"
    }
    frame No Error {
      To More Specific Class(error in=$"Error In", reference=$"Read Executable In", target class="Measure.gtype" constant) -> (error out=w2, specific class reference=w3)
      case (w2) {
        frame Error, Default {
          w1 = w2
        }
        frame No Error {
          call "Get Result as Double.gvi"(Measure in=w3, Error in=w2) -> (Result=w4, Error out=w1)
          $Voltage <- w4
        }
      }
    }
  }
  $"Error Out" <- w1
