vi "Get System Resources.gvi"   [LabVIEW NXG 5.0.0]
# Returns an array of all resources (instruments) attached to the system.
inputs:
  "Error in": error
outputs:
  "Error out": error
  "Resources": string[]  # An array containing names of all resources attached to the system. Empty, if none.
uses:
  Hardware Abstraction Framework::Utilities::AbstractResourceEnumerator.gtype::Read Enumerated Resources.gvi
diagram:
  call "Read Enumerated Resources.gvi"(AbstractDriverEnumerator in="ResourceEnumeration.gtype" constant, Refresh?=FALSE, Error in=$"Error in") -> (Enumerated Resources=w1, Error out=w2)
  case (w2) {
    frame Error, Default {
      w3 = string[] []
      w4 = w2
    }
    frame No Error {
      s1 = string[] []  # shift register
      for (iteration -> i1) {
        w5 = each element of w1
        Property Node(instance in=w5) -> ("Alias"=w6)
        Insert Into Array(inArray=s1, index0=i1, new=w6) -> w7
        next s1 = w7
      }
      w3 = s1
      w4 = w2
    }
  }
  $Resources <- w3
  $"Error out" <- w4
