vi "Id From Result.gvi"   [LabVIEW NXG 5.0.0]
inputs:
  "Read Executable In": "ReadExecutable.gtype"  # The Executable that has the result embedded.
  "IDN ID": string  # The ID of the Executable that we want a result from.
  "Error In": error
outputs:
  "Error Out": error
  "Result": string
uses:
  Hardware Abstraction Framework::Common::WriteExecutable.gtype::Read Id.gvi
  Hardware Abstraction Framework::Command::SCPI Generic::IDN.gtype::Build Result.gvi
diagram:
  # If this Read Executable's ID matches the one we are waiting for, try and build a result.
  case ($"Error In") {
    frame Error, Default {
      w1 = $"Error In"
    }
    frame No Error {
      call "Read Id.gvi"(Executable in=$"Read Executable In", Error in=$"Error In") -> (Executable out=w2, Id=w3, Error out=w4)
      Is Equal(x=$"IDN ID", y=w3) -> w5
      case (w5) {
        frame False, Default {
          # Result isn't for the expected command so ignore.
          w1 = w4
        }
        frame True {
          To More Specific Class(error in=w4, reference=w2, target class="IDN.gtype" constant) -> (error out=w6, specific class reference=w7)
          case (w6) {
            frame Error, Default {
              w1 = w6
            }
            frame No Error {
              call "Build Result.gvi"(IDN in=w7, Error in=w6) -> (Result=w8, Error out=w1)
              $Result <- w8
            }
          }
        }
      }
    }
  }
  $"Error Out" <- w1
