vi "Setup Identity Executables.gvi"   [LabVIEW NXG 5.0.0]
# Setup the Reset and IDN commands and add to a Executable Director for processing.
inputs:
  "Driver": "Driver.gtype"  # Driver to obtain Id for.
  "Error In": error
outputs:
  "ExecutableDirector": "ExecutableDirector.gtype"  # Configured Executable Director (execute once) capable of running the necessary commands.
  "Error Out": error
  "IDN Id": string  # The ID of the the *IDN? Executable which will be used to identify an incoming result.
uses:
  Hardware Abstraction Framework::Common::WriteExecutable.gtype::Write Driver.gvi
  Hardware Abstraction Framework::Common::WriteExecutable.gtype::Read Id.gvi
  Hardware Abstraction Framework::Common::ExecutableDirector.gtype::Add Executable.gvi
diagram:
  # Adds the Driver to the *RST and *IDN? commands and adds these to a Executable Director.  The Id of the IDN command is used in processing results: each result notified will contain an Id so that the user can correlate results.
  case ($"Error In") {
    frame Error, Default {
      w1 = $"Error In"
    }
    frame No Error {
      call "Write Driver.gvi"(Executable in="IDN.gtype" constant, Driver In=$Driver, Error in=$"Error In") -> (Executable out=w2, Error out=w3)
      call "Read Id.gvi"(Executable in=w2) -> (Executable out=w4, Id=w5)
      call "Write Driver.gvi"(Executable in="RST.gtype" constant, Driver In=$Driver, Error in=$"Error In") -> (Executable out=w6, Error out=w7)
      Merge Errors(w7, w3) -> (error out=w8)
      call "Add Executable.gvi"(ExecutableDirector in="ExecutableDirector.gtype" constant, Executable=w6, Error in=w8) -> (ExecutableDirector out=w9, Error out=w10)
      call "Add Executable.gvi"(ExecutableDirector in=w9, Executable=w4, Error in=w10) -> (ExecutableDirector out=w11, Error out=w1)
      $ExecutableDirector <- w11
      $"IDN Id" <- w5
    }
  }
  $"Error Out" <- w1
