vi "Parse Measurement from Result.gvi"   [LabVIEW NXG 5.0.0]
inputs:
  "Read Executable In": "ReadExecutable.gtype", required  # The Executable that has the result embedded.
  "Error In": error
outputs:
  "Error Out": error
  "Result": string
uses:
  Hardware Abstraction Framework::Common::WriteExecutable.gtype::Read Parameters.gvi
  Hardware Abstraction Framework::Common::Parameter.gtype::Read Name.gvi
  Hardware Abstraction Framework::Common::Parameter.gtype::Build Result.gvi
  Hardware Abstraction Framework::Common::ReadExecutable.gtype::Build Result.gvi
  NI::G Core::Strings::Trim Whitespace.gvi
diagram:
  case ($"Error In") {
    frame Error, Default {
      w1 = $"Error In"
      w2 = default
    }
    frame No Error {
      To More Specific Class(error in=$"Error In", reference=$"Read Executable In", target class="Measure.gtype" constant) -> (error out=w3, specific class reference=w4)
      case (w3) {
        frame Error, Default {
          w1 = w3
          w2 = default
        }
        frame No Error {
          call "Read Parameters.gvi"(Executable in=w4, Error in=w3) -> (Parameters=w5, Error out=w6)
          s1 = ""  # shift register
          for {
            w7 = each element of w5
            call "Read Name.gvi"(Parameter in=w7, Error in=w6) -> (Parameter out=w8, Name=w9, Error out=w10)
            call "Build Result.gvi"(Parameter in=w8, Error in=w10) -> (Result=w11, Error out=w12)
            Concatenate Strings(s1, w9, ": ", w11, "; ") -> w13
            next s1 = w13
          }
          call "Build Result.gvi"(ReadExecutable in=w4, Error in=w3) -> (Result=w14, Error out=w15)
          Concatenate Strings(w14, " ", s1) -> w16
          call "Trim Whitespace.gvi"(string=w16) -> (trimmed string=w2)
          Merge Errors(w15, w12) -> (error out=w1)
        }
      }
    }
  }
  $Result <- w2
  $"Error Out" <- w1
