vi "Create Buffer.gvi"   [LabVIEW NXG 5.0.0]
inputs:
  "Driver": "Driver.gtype"  # Driver to obtain Id for.
  "Error In": error
outputs:
  "ExecutableDirector": "ExecutableDirector.gtype"  # Configured Executable Director (execute once) capable of running the necessary commands.
  "Error Out": error
uses:
  Hardware Abstraction Framework::Command::SCPI Generic::User Defined Write.gtype::Write Command to Execute.gvi
  Hardware Abstraction Framework::Common::WriteExecutable.gtype::Write Driver.gvi
  Hardware Abstraction Framework::Common::ExecutableDirector.gtype::Add Executable.gvi
diagram:
  case ($"Error In") {
    frame Error, Default {
      w1 = $"Error In"
    }
    frame No Error {
      # This Executable will create a Buffer on the DMM6500 represented by the Driver
      call "Write Command to Execute.gvi"(User Defined Write in="User Defined Write.gtype" constant, Command to Execute=":TRAC:MAKE \"mybuffer\", 10000, FULL", Error in=$"Error In") -> (User Defined Write out=w2, Error out=w3)
      call "Write Driver.gvi"(Executable in=w2, Driver In=$Driver, Error in=w3) -> (Executable out=w4, Error out=w5)
      call "Add Executable.gvi"(ExecutableDirector in="ExecutableDirector.gtype" constant, Executable=w4, Error in=w5) -> (ExecutableDirector out=w6, Error out=w1)
      $ExecutableDirector <- w6
    }
  }
  $"Error Out" <- w1
