vi "Setup Continuous Measurement.gvi"   [LabVIEW NXG 5.0.0]
inputs:
  "Driver": "Driver.gtype", required  # Driver to obtain Id for.
  "Function": u16
  "Error In": error
outputs:
  "ExecutableDirector": "ExecutableDirector.gtype"  # Configured Executable Director (execute once) capable of running the necessary commands.
  "MEAS Id": string  # The ID of the the *IDN? Executable which will be used to identify an incoming result.
  "Error Out": error
uses:
  Hardware Abstraction Framework::Common::WriteExecutable.gtype::Write Driver.gvi
  Hardware Abstraction Framework::Command::SCPI Acquire::Measure.gtype::Configure.gvi
  Hardware Abstraction Framework::Support::Helpers::Parameter Builder.gvi
  Hardware Abstraction Framework::Common::WriteExecutable.gtype::Write Parameters.gvi
  Hardware Abstraction Framework::Common::WriteExecutable.gtype::Read Id.gvi
  Hardware Abstraction Framework::Common::ExecutableDirector.gtype::Add Executable.gvi
diagram:
  case ($"Error In") {
    frame Error, Default {
      w1 = $"Error In"
    }
    frame No Error {
      call "Write Driver.gvi"(Executable in="Measure.gtype" constant, Driver In=$Driver, Error in=$"Error In") -> (Executable out=w2, Error out=w3)
      call "Configure.gvi"(Measure in=w2, Function=$Function, Buffer Name="mybuffer", Error in=w3) -> (Measure out=w4, Error out=w5)
      Build Array("READING", "TSTAMP") -> w6
      call "Parameter Builder.gvi"(Names=w6) -> (Parameters=w7)
      call "Write Parameters.gvi"(Executable in=w4, Parameters=w7, Error in=w5) -> (Executable out=w8, Error out=w9)
      call "Read Id.gvi"(Executable in=w8, Error in=w9) -> (Executable out=w10, Id=w11, Error out=w12)
      call "Add Executable.gvi"(ExecutableDirector in="ContinuousDirector.gtype" constant, Executable=w10, Error in=w12) -> (ExecutableDirector out=w13, Error out=w1)
      $ExecutableDirector <- w13
      $"MEAS Id" <- w11
    }
  }
  $"Error Out" <- w1
