vi "Start Measuring.gvi"   [LabVIEW NXG 5.0.0]
# Main process for interfacing with the framework to get the selected Instrument’s identity
inputs:
  "Instrument Name": string  # The name of the instrument whose Id shoudl be fetched.
  "Error in": error
  "Function": u16
outputs:
  "Error out": error
  "IDs": string[]
uses:
  Hardware Abstraction Framework::Common::ExecutableProcessor.gtype::Add Director.gvi
  Hardware Abstraction Framework::Common::ExecutableProcessor.gtype::Process Directors.gvi
diagram:
  # We find the right Driver and set up the necessary executables to be processed.  They are only sent for processing if no error has occurred.
  #
  # The Executable Ids are used by the Main Processing Loop to correlate a Result message to the correct command.
  case ($"Error in") {
    frame Error, Default {
      w1 = $"Error in"
    }
    frame No Error {
      call "Find Driver.gvi"(Instrument Name=$"Instrument Name", Error in=$"Error in") -> (Found Driver=w2, Error out=w3)
      call "Setup Identity Executables.gvi"(Driver=w2, Error In=w3) -> (ExecutableDirector=w4, IDN Id=w5, Error Out=w6)
      call "Add Director.gvi"(ExecutableProcessor in="ExecutableProcessor.gtype" constant, ExecutableDirector=w4, Error in=w6) -> (ExecutableProcessor out=w7, Error out=w8)
      call "Create Buffer.gvi"(Driver=w2, Error In=w8) -> (ExecutableDirector=w9, Error Out=w10)
      call "Add Director.gvi"(ExecutableProcessor in=w7, ExecutableDirector=w9, Error in=w10) -> (ExecutableProcessor out=w11, Error out=w12)
      call "Setup Continuous Measurement.gvi"(Driver=w2, Function=$Function, Error In=w12) -> (ExecutableDirector=w13, MEAS Id=w14, Error Out=w15)
      call "Add Director.gvi"(ExecutableProcessor in=w11, ExecutableDirector=w13, Error in=w15) -> (ExecutableProcessor out=w16, Error out=w17)
      case (w17) {
        frame Error, Default {
          w1 = w17
        }
        frame No Error {
          call "Process Directors.gvi"(ExecutableProcessor in=w16, Wait Time=100, Error in=w17) -> (Error out=w1)
        }
      }
      Build Array(w5, w14) -> w18
      $IDs <- w18
    }
  }
  $"Error out" <- w1
