vi "Waveform Measurement.gvi"   [LabVIEW NXG 5.0.0]
panel controls:
  "Start": bool
  "Stop": bool
  "Instruments": string
  "Refresh": bool
  "Error": error
  "Error_Type": error
  "Function": T1 = "[As Set]"  # The type of measurement to be measured, e.g voltage, current etc. If not specified, the current function is used (As Set.)
  "Pause": bool
  "Resume": bool
  "IDs": string[]
panel indicators:
  "Identity": string
  "Error Out": error
  "Measurements": waveform<f64>[]
types:
  T1 = enum{"[As Set]", "DC Voltage", "AC Voltage", "DC Current", "AC Current", "2-wire Resistance", "4-wire Resistance", "Diode", "Capacitance", "Temperature", "Continuity", "Frequency", "Period", "DC Voltage Ratio"}
  "All Notification Message Ids.gtype" = cluster{"Initialise": string, "Exit": string, "Error": string, "Result": string, "Done": string}
  "Event Data.gtype" = cluster{"Raiser Name": string, "Raiser Id": string}
  "All Internal Message Ids.gtype" = cluster{"Initialise": string, "Stop": string, "Done": string, "Exit": string, "Process": string, "Continue": string, "Pause": string, "Resume": string}
uses:
  Hardware Abstraction Framework::Utilities::Setup Framework.gvi
  Hardware Abstraction Framework::Support::Messages::Dequeue Message.gvi
  NI::G Core::Error::Build Error Cluster.gvi
  Hardware Abstraction Framework::Support::Messages::Enqueue Message.gvi
  Hardware Abstraction Framework::Support::Helpers::Error Handling - Process Error.gvi
  Hardware Abstraction Framework::Utilities::Teardown Frameworkgvi.gvi
  Hardware Abstraction Framework::Common::WriteExecutable.gtype::Read Id.gvi
diagram:
  # Results will be notified to the Test App so they can
  # be processed.  This example uses a Continuous Executable
  # Director which blocks the Main Processing loop from processing results until it completes (which is never!) Notification of results by the framework allows them to be displayed on the UI.
  Obtain Notifier(element data type="ReadExecutable.gtype" constant, name="Results Notifier") -> (notifier out=w1)
  # Initialise the example before anything else
  # Listen for any stop event raised by the framework.  Can also raise a Stop event if the user presses Stop button.
  # The Notifications Queue is used to receive messages from the framework (typically results) but can also be used to send messages to control the processing loop following an event.
  sequence {
    frame 0 {
      call "Setup Framework.gvi"()
      $"Error Out" <- no error
      $Identity <- ""
      Clear Data(reference in=reference to "Measurements")
    }
    frame 1 {
      w2 = "Hardware Abstraction Framework::Support::Resources.grsc::Events"
      Tag Read(ref in=w2) -> (Data=w3)
      Property Node(instance in=w3) -> ("Stop Event"=w4)
      w5 = "Hardware Abstraction Framework::Support::Resources.grsc::MessageQueues"
      Tag Read(ref in=w5) -> (Data=w6)
      Property Node(instance in=w6) -> ("Notifications"=w7)
    }
  }
  w8 = $Error
  # Main Processing loop.  Waits for messages to appear on the queue and then processes it.
  while {
    call "Dequeue Message.gvi"(Message Queue In=w7, Error In=w8) -> (Timed Out?=w9, Message Queue Out=w10, Message Id=w11, Message Data=w12, Error Out=w13)
    # Case options should include "All Notification Messages" as a minimum
    # Waits for next message. Queue is created with Initialise message.
    case (w11) {
      frame Default {
        w16 = "Application timed-out waiting for an action to be initiated.%s"
        w17 = "An unknown message - %s -was added to the notification queue"
        Select(s=w9, t=w16, f=w17) -> w18
        # An unknown message was added to the queue or a timeout occurred
        Format Into String(formatString=w18, w11) -> w19
        call "Build Error Cluster.gvi"(code=1, description=w19) -> (error out=w14)
        w15 = default
      }
      frame "Initialise" {
        # Queue a message to refresh the System Resources
        call "Enqueue Message.gvi"(Message Queue In=w10, Message Id="Refresh", Error In=w13) -> (Error Out=w14)
        w15 = default
      }
      frame "Refresh" {
        # Build the list of resources attached to the system and load their names into the UI combo box.  Select the first value so something is displayed.
        call "Get System Resources.gvi"(Error in=w13) -> (Resources=w20, Error out=w14)
        Array Index(array=w20) -> (out0[0]=w21)
        Property Node(instance in=reference to "Instruments", "Items"=w20, "Value"=w21)
        w15 = default
      }
      frame "Stop" {
        w22 = "All Notification Message Ids.gtype" {"Initialise"="Initialise", "Exit"="Exit", "Error"="Error", "Result"="Result", "Done"="Done"}
        # Stop processing any more messages.
        Property Node(instance in=w22) -> ("Exit"=w23)
        call "Enqueue Message.gvi"(Message Queue In=w10, Message Id=w23, Error In=w13) -> (Error Out=w14)
        w15 = default
      }
      frame "Get Measure" {
        call "Build Waveform Executables.gvi"(Instrument Name=$Instruments, Function=$Function, Error in=w13) -> (ExecutableProcessor=w24, IDs=w25, Error out=w26)
        # Get Measure requested.  Process the command through the framework (sub-VI).  The Ids passed out will be used in processing the Result message.
        call "Start Measuring.gvi"(ExecutableProcessor=w24, Results Notifier=w1, Error in=w26) -> (Error out=w14)
        $IDs <- w25
        w15 = default
      }
      frame "Exit" {
        Variant To Data(type=no error, variant=w12) -> (data=w27, error out=w28)
        case (w28) {
          frame Error, Default {
            w14 = w13
          }
          frame No Error {
            # If exiting because of error, pass it on for display
            w14 = w27
          }
        }
        w15 = TRUE
      }
      frame "Error" {
        # Handle an error.  Here nothing is done, but it could be logged as an example
        Variant To Data(type=$Error_Type, variant=w12) -> (data=w14)
        w15 = default
      }
      frame "Done" {
        # Do nothing
        w14 = w13
        w15 = default
      }
    }
    call "Error Handling - Process Error.gvi"(Error to Process=w14, Exit on Error?=TRUE)
    stop if w15
  }
  Register For Events("Stop"=w4) -> (event registration refnum out=w29)
  # Event loop: loops until Stop pressed or a Stop event raised.
  # Handles UI events by sending messages to the processing loop.
  while {
    event (dynamic events = w29) {
      on "Stop" Value changed; "Window" Close {
        Property Node(instance in="Event Data.gtype" {all zero or empty}, "Raiser Name"="Instrument Identification") -> (instance out=w32)
        # Stop button pressed. Raise Stop Event to halt further processing.
        Generate User Event(event data=w32, priority="high priority", user event=w4) -> (error out=w31)
        w30 = default
      }
      on dynamic event 0 {
        call "Enqueue Message.gvi"(Priority?=TRUE, Message Queue In=w7, Message Id="Stop") -> (Error Out=w31)
        # Stop event occurred.  Notify Main Processing Loop
        w30 = TRUE
      }
      on "Refresh" Value changed {
        # Refresh button pressed.  Notify Main Processing loop to rebuild resources
        call "Enqueue Message.gvi"(Message Queue In=w7, Message Id="Refresh") -> (Error Out=w31)
        w30 = default
      }
      on "Start" Value changed {
        # Get Measure button pressed.  Notify Main Processing Loop to take a measurement
        call "Enqueue Message.gvi"(Message Queue In=w7, Message Id="Get Measure") -> (Error Out=w31)
        w30 = default
      }
      on "Pause" Value changed {
        w33 = "All Internal Message Ids.gtype" {"Initialise"="Initialise", "Stop"="Stop", "Done"="Done", "Exit"="Exit", "Process"="Process", "Continue"="Continue", "Pause"="Pause", "Resume"="Resume"}
        Property Node(instance in=w33) -> ("Pause"=w34)
        # Pause event occurred.  Notify Main Processing Loop
        call "Enqueue Message.gvi"(Priority?=TRUE, Message Queue In=w7, Message Id=w34) -> (Error Out=w31)
        w30 = default
      }
      on "Resume" Value changed {
        w35 = "All Internal Message Ids.gtype" {"Initialise"="Initialise", "Stop"="Stop", "Done"="Done", "Exit"="Exit", "Process"="Process", "Continue"="Continue", "Pause"="Pause", "Resume"="Resume"}
        Property Node(instance in=w35) -> ("Resume"=w36)
        # Resume event occurred.  Notify Main Processing Loop
        call "Enqueue Message.gvi"(Priority?=TRUE, Message Queue In=w7, Message Id=w36) -> (Error Out=w31)
        w30 = default
      }
    }
    call "Error Handling - Process Error.gvi"(Error to Process=w31, Exit on Error?=FALSE)
    stop if w30
  }
  # Finally, deregister from events
  Unregister For Events(error in=w31, event registration refnum=w29) -> (error out=w37)
  Merge Errors(w37, w14) -> (error out=w38)
  Release Notifier(error in (no error)=w38, notifier=w1) -> (error out=w39)
  call "Teardown Frameworkgvi.gvi"(Error In=w39) -> (Error Out=w40)
  # When Processing Errors,
  # the Main Loop will Exit as
  # the app may be in an unknown state.  The Event Loop will send an Error message to the Message Handler.
  #
  # Reset the framework to release all
  # event and notification references.
  $"Error Out" <- w40
  # Results Processing Loop.  All UI updates should be performed here.
  while {
    Wait On Notification(notifier=w1) -> (error out=w41, notification=w42)
    case (w41) {
      frame Error, Default {
        w43 = w41
      }
      frame No Error {
        call "Read Id.gvi"(Executable in=w42, Error in=w41) -> (Executable out=w44, Id=w45, Error out=w46)
        Array Index(array=$IDs) -> (out0[0]=w47)
        Is Equal(x=w45, y=w47) -> w48
        case (w48) {
          frame False, Default {
            call "Parse Waveform from Result.gvi"(Read Executable In=w44, Error In=w46) -> (Waveform=w49)
            $Measurements <- w49
          }
          frame True {
            call "Parse Identity from Result.gvi"(Read Executable In=w44, Error In=w46) -> (Result=w50)
            $Identity <- w50
          }
        }
        w43 = default
      }
    }
    stop if w43
  }
