vi "Commit Test.gvi"   [LabVIEW NXG 5.0.0]
inputs:
  "Driver Process Tests in": "Driver Process Tests.gtype"
  "Error in": error
outputs:
  "Driver Process Tests out": "Driver Process Tests.gtype"
  "Error out": error
panel controls:
  "FormattedTestResult": "FormattedTestResult.gtype"
types:
  "FormattedTestResult.gtype" = cluster{"Class Under Test": string, "Test ID": string, "Pass-Fail": bool, "Detail": string}
uses:
  Hardware Abstraction Framework::Common::Driver.gtype::Update Driver Settings.gvi
  Hardware Abstraction Framework::Common::Driver.gtype::Commit.gvi
  Hardware Abstraction Framework::Common::Driver.gtype::Read Driver Settings.gvi
  Hardware Abstraction Framework::Common::DriverSetting.gtype::Read Been Applied.gvi
  LabViewNXG Test Framework::Utilities::Boolean To String.gvi
  LabViewNXG Test Framework::Utilities::Set Value String.gvi
  LabViewNXG Test Framework::Common::AbstractTest.gtype::Process Result.gvi
diagram:
  case ($"Error in") {
    frame No Error {
      Property Node(instance in="ExecutableSetting.gtype" constant, "Name"="Ex Setting 1", "Value"="abc") -> (instance out=w3)
      Property Node(instance in="ExecutableSetting.gtype" constant, "Name"="Ex Setting 3", "Value"="xyz") -> (instance out=w4)
      Property Node(instance in="ExecutableSetting.gtype" constant, "Name"="Ex Setting 2", "Value"="123") -> (instance out=w5)
      Build Array(w5, w3, w4) -> w6
      call "Update Driver Settings.gvi"(Driver in="MockDriver.gtype" constant, Executable Id="UUID1", Executable Settings=w6, Error in=$"Error in") -> (Driver out=w7, Error out=w8)
      call "Commit.gvi"(Driver in=w7, Error in=w8) -> (Driver out=w9, Error out=w10)
      call "Read Driver Settings.gvi"(Driver in=w9, Error in=w10) -> (Driver Settings=w11, Error out=w12)
      Get Variant Attribute[GetAllAttributes=True](error in=w12, variant=w11) -> (error out=w13, values=w14)
      # Iterate through the Driver Settings and check
      # all have been applied.
      for {
        w15 = each element of w14
        # If any have not been applied
        # the loop will exit with false.
        Variant To Data(error in (no error)=w13, type="DriverSetting.gtype" constant, variant=w15) -> (data=w16, error out=w17)
        call "Read Been Applied.gvi"(DriverSetting in=w16, Error in=w17) -> (Been Applied=w18, Error out=w19)
        continue if w18
      }
      To Variant(anything=w18) -> w20
      call "Boolean To String.gvi"(Boolean in=w18) -> (String value=w21)
      # All should have been applied and test is for True
      call "Set Value String.gvi"(Variant with Value in=w20, String Value=w21, Error in=w19) -> (Variant with Value out=w22, Error out=w23)
      To Variant(anything=TRUE) -> w24
      call "Boolean To String.gvi"(Boolean in=TRUE) -> (String value=w25)
      call "Set Value String.gvi"(Variant with Value in=w24, String Value=w25, Error in=w23) -> (Variant with Value out=w26, Error out=w27)
      Property Node(instance in=$FormattedTestResult, "Class Under Test"="ProcessTests", "Test ID"="Verifies Commit applies all settings") -> (instance out=w28)
      call "Process Result.gvi"(Formatted Results=w28, AbstractTest in=$"Driver Process Tests in", Expected Result=w22, Actual Result=w26, Asserter="AssertTrue.gtype" constant, Error in=w27) -> (AbstractTest out=w2, Error out=w1)
    }
    frame Error {
      w1 = $"Error in"
      w2 = $"Driver Process Tests in"
    }
  }
  $"Driver Process Tests out" <- w2
  $"Error out" <- w1
