vi "Decommit Test.gvi"   [LabVIEW NXG 5.0.0]
inputs:
  "Driver Process Tests in": "Driver Process Tests.gtype"
  "Error in": error
outputs:
  "Driver Process Tests out": "Driver Process Tests.gtype"
  "Error out": error
panel controls:
  "FormattedTestResult": "FormattedTestResult.gtype"
types:
  "FormattedTestResult.gtype" = cluster{"Class Under Test": string, "Test ID": string, "Pass-Fail": bool, "Detail": string}
uses:
  Hardware Abstraction Framework::Common::Driver.gtype::Update Driver Settings.gvi
  Hardware Abstraction Framework::Common::Driver.gtype::Commit.gvi
  Hardware Abstraction Framework::Common::Driver.gtype::Decommit.gvi
  Hardware Abstraction Framework::Common::Driver.gtype::Read Driver Settings.gvi
  Hardware Abstraction Framework::Common::DriverSetting.gtype::Read Been Applied.gvi
  LabViewNXG Test Framework::Utilities::Boolean To String.gvi
  LabViewNXG Test Framework::Utilities::Set Value String.gvi
  LabViewNXG Test Framework::Common::AbstractTest.gtype::Process Result.gvi
diagram:
  case ($"Error in") {
    frame No Error {
      Property Node(instance in="ExecutableSetting.gtype" constant, "Name"="Ex Setting 1", "Value"="abc") -> (instance out=w3)
      Property Node(instance in="ExecutableSetting.gtype" constant, "Name"="Ex Setting 3", "Value"="xyz") -> (instance out=w4)
      Property Node(instance in="ExecutableSetting.gtype" constant, "Name"="Ex Setting 2", "Value"="123") -> (instance out=w5)
      Build Array(w5, w3, w4) -> w6
      call "Update Driver Settings.gvi"(Driver in="MockDriver.gtype" constant, Executable Id="UUID1", Executable Settings=w6, Error in=$"Error in") -> (Driver out=w7, Error out=w8)
      call "Commit.gvi"(Driver in=w7, Error in=w8) -> (Driver out=w9, Error out=w10)
      call "Decommit.gvi"(Driver in=w9, Error in=w10) -> (Driver out=w11, Error out=w12)
      call "Read Driver Settings.gvi"(Driver in=w11, Error in=w12) -> (Driver Settings=w13, Error out=w14)
      Get Variant Attribute[GetAllAttributes=True](error in=w14, variant=w13) -> (error out=w15, values=w16)
      # Iterate through the Driver Settings and check
      # none are still applied.
      for {
        w17 = each element of w16
        # If any are still applied
        # the loop will exit with true.
        Variant To Data(error in (no error)=w15, type="DriverSetting.gtype" constant, variant=w17) -> (data=w18, error out=w19)
        call "Read Been Applied.gvi"(DriverSetting in=w18, Error in=w19) -> (Been Applied=w20, Error out=w21)
        stop if w20
      }
      To Variant(anything=w20) -> w22
      call "Boolean To String.gvi"(Boolean in=w20) -> (String value=w23)
      # All should have been cleared and test is for False
      call "Set Value String.gvi"(Variant with Value in=w22, String Value=w23, Error in=w21) -> (Variant with Value out=w24, Error out=w25)
      To Variant(anything=FALSE) -> w26
      call "Boolean To String.gvi"(Boolean in=FALSE) -> (String value=w27)
      call "Set Value String.gvi"(Variant with Value in=w26, String Value=w27, Error in=w25) -> (Variant with Value out=w28, Error out=w29)
      Property Node(instance in=$FormattedTestResult, "Class Under Test"="ProcessTests", "Test ID"="Verifies Decommit clears all settings") -> (instance out=w30)
      call "Process Result.gvi"(Formatted Results=w30, AbstractTest in=$"Driver Process Tests in", Expected Result=w24, Actual Result=w28, Asserter="AssertFalse.gtype" constant, Error in=w29) -> (AbstractTest out=w2, Error out=w1)
    }
    frame Error {
      w1 = $"Error in"
      w2 = $"Driver Process Tests in"
    }
  }
  $"Driver Process Tests out" <- w2
  $"Error out" <- w1
