vi "Map Executable Settings Test.gvi"   [LabVIEW NXG 5.0.0]
inputs:
  "Driver Process Tests in": "Driver Process Tests.gtype"
  "Error in": error
outputs:
  "Driver Process Tests out": "Driver Process Tests.gtype"
  "Error out": error
panel controls:
  "FormattedTestResult_2": "FormattedTestResult.gtype"
  "FormattedTestResult_3": "FormattedTestResult.gtype"
types:
  "FormattedTestResult.gtype" = cluster{"Class Under Test": string, "Test ID": string, "Pass-Fail": bool, "Detail": string}
  "Valid Data Types.gtype" = cluster{"U8": string, "U16": string, "U32": string, "U64": string, "I8": string, "I16": string, "I32": string, "I64": string, "SGL": string, "DBL": string, "String": string, "Boolean": string}
uses:
  MockDriver.gtype::Mock Map Executable Settings.gvi
  LabViewNXG Test Framework::Utilities::Set Value String.gvi
  LabViewNXG Test Framework::Common::AbstractTest.gtype::Process Result.gvi
diagram:
  case ($"Error in") {
    frame No Error {
      call "Mock Map Executable Settings.gvi"(MockDriver in="MockDriver.gtype" constant, Executable Setting Name="Ex Setting 2", Error in=$"Error in") -> (Mapped Driver Name=w3, Setting Data Type=w4, Error out=w5)
      To Variant(anything=w3) -> w6
      call "Set Value String.gvi"(Variant with Value in=w6, String Value=w3, Error in=w5) -> (Variant with Value out=w7, Error out=w8)
      To Variant(anything="Dvr Setting 2") -> w9
      call "Set Value String.gvi"(Variant with Value in=w9, String Value="Dvr Setting 2", Error in=w8) -> (Variant with Value out=w10, Error out=w11)
      w12 = "Verifies Map Executable Settings returns correct Driver Setting Name"
      Property Node(instance in=$FormattedTestResult_2, "Class Under Test"="ProcessTests", "Test ID"=w12) -> (instance out=w13)
      call "Process Result.gvi"(Formatted Results=w13, AbstractTest in=$"Driver Process Tests in", Expected Result=w7, Actual Result=w10, Asserter="AssertEqual.gtype" constant, Error in=w11) -> (AbstractTest out=w14, Error out=w15)
      To Variant(anything=w4) -> w16
      call "Set Value String.gvi"(Variant with Value in=w16, String Value=w4, Error in=w15) -> (Variant with Value out=w17, Error out=w18)
      w19 = "Valid Data Types.gtype" {"U8"="U8", "U16"="U16", "U32"="U32", "U64"="U64", "I8"="I8", "I16"="I16", "I32"="I32", "I64"="I64", "SGL"="SGL", "DBL"="DBL", "String"="String", "Boolean"="Boolean"}
      Cluster To Array(cluster=w19) -> (array=w20)
      Array Index(array=w20) -> (out0[1]=w21)
      To Variant(anything=w21) -> w22
      call "Set Value String.gvi"(Variant with Value in=w22, String Value=w21, Error in=w18) -> (Variant with Value out=w23, Error out=w24)
      w25 = "Verifies Map Executable Settings returns correct Driver Data Type"
      Property Node(instance in=$FormattedTestResult_3, "Class Under Test"="ProcessTests", "Test ID"=w25) -> (instance out=w26)
      call "Process Result.gvi"(Formatted Results=w26, AbstractTest in=w14, Expected Result=w17, Actual Result=w23, Asserter="AssertEqual.gtype" constant, Error in=w24) -> (AbstractTest out=w2, Error out=w1)
    }
    frame Error {
      w1 = $"Error in"
      w2 = $"Driver Process Tests in"
    }
  }
  $"Driver Process Tests out" <- w2
  $"Error out" <- w1
