vi "Remove Settings Test.gvi"   [LabVIEW NXG 5.0.0]
inputs:
  "Driver Process Tests in": "Driver Process Tests.gtype"
  "Error in": error
outputs:
  "Driver Process Tests out": "Driver Process Tests.gtype"
  "Error out": error
panel controls:
  "FormattedTestResult": "FormattedTestResult.gtype"
  "FormattedTestResult_2": "FormattedTestResult.gtype"
types:
  "FormattedTestResult.gtype" = cluster{"Class Under Test": string, "Test ID": string, "Pass-Fail": bool, "Detail": string}
uses:
  Hardware Abstraction Framework::Support::Helpers::Generate UUID.gvi
  Hardware Abstraction Framework::Common::Driver.gtype::Write Driver Settings.gvi
  Hardware Abstraction Framework::Common::Driver.gtype::Remove Driver Settings.gvi
  LabViewNXG Test Framework::Utilities::Set Value String.gvi
  LabViewNXG Test Framework::Common::AbstractTest.gtype::Process Result.gvi
  Hardware Abstraction Framework::Common::Driver.gtype::Read Driver Settings.gvi
diagram:
  case ($"Error in") {
    frame No Error {
      call "Generate UUID.gvi"() -> (UUID=w3)
      Property Node(instance in="ExecutableSetting.gtype" constant, "Name"="Setting 2") -> (instance out=w4)
      Build Array(w4) -> w5
      call "Generate UUID.gvi"() -> (UUID=w6)
      Concatenate Strings(w6, "Setting 3") -> w7
      Concatenate Strings(w3, "Setting 2") -> w8
      call "Generate UUID.gvi"() -> (UUID=w9)
      Concatenate Strings(w9, "Setting 1") -> w10
      To Variant(anything="Settings") -> w11
      Set Variant Attribute(name=w10, value="DriverSetting.gtype" constant, variant=w11) -> (variant out=w12)
      Set Variant Attribute(name=w8, value="DriverSetting.gtype" constant, variant=w12) -> (variant out=w13)
      Set Variant Attribute(name=w7, value="DriverSetting.gtype" constant, variant=w13) -> (variant out=w14)
      call "Write Driver Settings.gvi"(Driver in="Driver.gtype" constant, Driver Settings=w14, Error in=$"Error in") -> (Driver out=w15, Error out=w16)
      call "Remove Driver Settings.gvi"(Driver in=w15, Executable Id=w3, Executable Settings=w5, Error in=w16) -> (Driver out=w17, Removed Count=w18, Error out=w19)
      Number To Decimal String(number=w18) -> (decimal integer string=w20)
      # Removed count should be 1
      To Variant(anything=w18) -> w21
      call "Set Value String.gvi"(Variant with Value in=w21, String Value=w20, Error in=w19) -> (Variant with Value out=w22, Error out=w23)
      Number To Decimal String(number=1) -> (decimal integer string=w24)
      To Variant(anything=1) -> w25
      call "Set Value String.gvi"(Variant with Value in=w25, String Value=w24, Error in=w23) -> (Variant with Value out=w26, Error out=w27)
      Property Node(instance in=$FormattedTestResult_2, "Class Under Test"="ProcessTests", "Test ID"="Verifies RemoveSettings removes 1 setting") -> (instance out=w28)
      call "Process Result.gvi"(Formatted Results=w28, AbstractTest in=$"Driver Process Tests in", Expected Result=w22, Actual Result=w26, Asserter="AssertEqual.gtype" constant, Error in=w27) -> (AbstractTest out=w29, Error out=w30)
      call "Read Driver Settings.gvi"(Driver in=w17, Error in=w30) -> (Driver Settings=w31, Error out=w32)
      Get Variant Attribute[GetAllAttributes=True](error in=w32, variant=w31) -> (error out=w33, names=w34)
      Search 1D Array(1D array=w34, element=w7) -> (index of element=w35)
      Number To Decimal String(number=w35) -> (decimal integer string=w36)
      # Array should contain one of the remaining settings
      To Variant(anything=w35) -> w37
      call "Set Value String.gvi"(Variant with Value in=w37, String Value=w36, Error in=w33) -> (Variant with Value out=w38, Error out=w39)
      To Variant(anything=-1) -> w40
      Number To Decimal String(number=-1) -> (decimal integer string=w41)
      call "Set Value String.gvi"(Variant with Value in=w40, String Value=w41, Error in=w39) -> (Variant with Value out=w42, Error out=w43)
      Property Node(instance in=$FormattedTestResult, "Class Under Test"="ProcessTests", "Test ID"="Verifies RemoveSettings removes the correct entry") -> (instance out=w44)
      call "Process Result.gvi"(Formatted Results=w44, AbstractTest in=w29, Expected Result=w38, Actual Result=w42, Asserter="AssertUnequal.gtype" constant, Error in=w43) -> (AbstractTest out=w2, Error out=w1)
    }
    frame Error {
      w1 = $"Error in"
      w2 = $"Driver Process Tests in"
    }
  }
  $"Driver Process Tests out" <- w2
  $"Error out" <- w1
