vi "Run All Tests.gvi"   [LabVIEW NXG 5.0.0]
# A framework method that must be overridden by each concrete test class and which exercises the code under test.
# If this method is not overridden it will raise error 100.
# See examples for variations of implementation of this method.
inputs:
  "Driver Process Tests in": "Driver Process Tests.gtype"
  "Error in": error
outputs:
  "Driver Process Tests out": "Driver Process Tests.gtype"
  "Error out": error
uses:
  Driver Process Tests.gtype::Remove Settings Test.gvi
  Driver Process Tests.gtype::Map Executable Settings Test.gvi
  Driver Process Tests.gtype::Update Settings Test.gvi
  Driver Process Tests.gtype::Commit Test.gvi
  Driver Process Tests.gtype::Decommit Test.gvi
diagram:
  call "Remove Settings Test.gvi"(Driver Process Tests in=$"Driver Process Tests in", Error in=$"Error in") -> (Driver Process Tests out=w1, Error out=w2)
  call "Map Executable Settings Test.gvi"(Driver Process Tests in=w1, Error in=w2) -> (Driver Process Tests out=w3, Error out=w4)
  call "Update Settings Test.gvi"(Driver Process Tests in=w3, Error in=w4) -> (Driver Process Tests out=w5, Error out=w6)
  call "Commit Test.gvi"(Driver Process Tests in=w5, Error in=w6) -> (Driver Process Tests out=w7, Error out=w8)
  call "Decommit Test.gvi"(Driver Process Tests in=w7, Error in=w8) -> (Driver Process Tests out=w9, Error out=w10)
  $"Driver Process Tests out" <- w9
  $"Error out" <- w10
