vi "Update Settings Test.gvi"   [LabVIEW NXG 5.0.0]
inputs:
  "Driver Process Tests in": "Driver Process Tests.gtype"
  "Error in": error
outputs:
  "Driver Process Tests out": "Driver Process Tests.gtype"
  "Error out": error
panel controls:
  "FormattedTestResult": "FormattedTestResult.gtype"
  "FormattedTestResult_2": "FormattedTestResult.gtype"
  "FormattedTestResult_3": "FormattedTestResult.gtype"
types:
  "FormattedTestResult.gtype" = cluster{"Class Under Test": string, "Test ID": string, "Pass-Fail": bool, "Detail": string}
uses:
  Hardware Abstraction Framework::Common::Driver.gtype::Update Driver Settings.gvi
  LabViewNXG Test Framework::Utilities::Set Value String.gvi
  LabViewNXG Test Framework::Common::AbstractTest.gtype::Process Result.gvi
  Hardware Abstraction Framework::Common::Driver.gtype::Read Driver Settings.gvi
diagram:
  case ($"Error in") {
    frame No Error {
      Property Node(instance in="ExecutableSetting.gtype" constant, "Name"="Ex Setting 1", "Value"="abc") -> (instance out=w3)
      Property Node(instance in="ExecutableSetting.gtype" constant, "Name"="Ex Setting 3", "Value"="xyz") -> (instance out=w4)
      Property Node(instance in="ExecutableSetting.gtype" constant, "Name"="Ex Setting 2", "Value"="123") -> (instance out=w5)
      Build Array(w5, w3, w4) -> w6
      call "Update Driver Settings.gvi"(Driver in="MockDriver.gtype" constant, Executable Id="UUID1", Executable Settings=w6, Error in=$"Error in") -> (Driver out=w7, Settings Added=w8, Error out=w9)
      To Variant(anything=w8) -> w10
      Number To Decimal String(number=w8) -> (decimal integer string=w11)
      # Added count should be 3
      call "Set Value String.gvi"(Variant with Value in=w10, String Value=w11, Error in=w9) -> (Variant with Value out=w12, Error out=w13)
      To Variant(anything=3) -> w14
      Number To Decimal String(number=3) -> (decimal integer string=w15)
      call "Set Value String.gvi"(Variant with Value in=w14, String Value=w15, Error in=w13) -> (Variant with Value out=w16, Error out=w17)
      Property Node(instance in=$FormattedTestResult_2, "Class Under Test"="ProcessTests", "Test ID"="Verifies Update Settings adds 3 settings") -> (instance out=w18)
      call "Process Result.gvi"(Formatted Results=w18, AbstractTest in=$"Driver Process Tests in", Expected Result=w12, Actual Result=w16, Asserter="AssertEqual.gtype" constant, Error in=w17) -> (AbstractTest out=w19, Error out=w20)
      Property Node(instance in="ExecutableSetting.gtype" constant, "Name"="Ex Setting 1", "Value"="cba") -> (instance out=w21)
      Property Node(instance in="ExecutableSetting.gtype" constant, "Name"="Ex Setting 2", "Value"="321") -> (instance out=w22)
      Build Array(w22, w21) -> w23
      call "Update Driver Settings.gvi"(Driver in=w7, Executable Id="UUID1", Executable Settings=w23, Error in=w20) -> (Driver out=w24, Settings Updated=w25)
      Number To Decimal String(number=w25) -> (decimal integer string=w26)
      # Updated count should be 2
      To Variant(anything=w25) -> w27
      call "Set Value String.gvi"(Variant with Value in=w27, String Value=w26) -> (Variant with Value out=w28, Error out=w29)
      To Variant(anything=2) -> w30
      Number To Decimal String(number=2) -> (decimal integer string=w31)
      call "Set Value String.gvi"(Variant with Value in=w30, String Value=w31, Error in=w29) -> (Variant with Value out=w32, Error out=w33)
      Property Node(instance in=$FormattedTestResult, "Class Under Test"="ProcessTests", "Test ID"="Verifies Update Settings updates 2 entries") -> (instance out=w34)
      call "Process Result.gvi"(Formatted Results=w34, AbstractTest in=w19, Expected Result=w28, Actual Result=w32, Asserter="AssertEqual.gtype" constant, Error in=w33) -> (AbstractTest out=w35, Error out=w36)
      call "Read Driver Settings.gvi"(Driver in=w24, Error in=w36) -> (Driver Settings=w37, Error out=w38)
      Get Variant Attribute(error in=w38, name="UUID1Ex Setting 2", variant=w37) -> (error out=w39, value=w40)
      # Check one of the values was actually changed.
      Variant To Data(error in (no error)=w39, type="DriverSetting.gtype" constant, variant=w40) -> (data=w41, error out=w42)
      Property Node(instance in=w41) -> ("Value"=w43)
      To Variant(anything=w43) -> w44
      call "Set Value String.gvi"(Variant with Value in=w44, String Value=w43, Error in=w42) -> (Variant with Value out=w45, Error out=w46)
      To Variant(anything="321") -> w47
      call "Set Value String.gvi"(Variant with Value in=w47, String Value="321", Error in=w46) -> (Variant with Value out=w48, Error out=w49)
      Property Node(instance in=$FormattedTestResult_3, "Class Under Test"="ProcessTests", "Test ID"="Verifies Update Settings updates values") -> (instance out=w50)
      call "Process Result.gvi"(Formatted Results=w50, AbstractTest in=w35, Expected Result=w45, Actual Result=w48, Asserter="AssertEqual.gtype" constant, Error in=w49) -> (AbstractTest out=w2, Error out=w1)
    }
    frame Error {
      w1 = $"Error in"
      w2 = $"Driver Process Tests in"
    }
  }
  $"Driver Process Tests out" <- w2
  $"Error out" <- w1
