vi "Driver Settings Test.gvi"   [LabVIEW NXG 5.0.0]
inputs:
  "Driver Property Tests in": "Driver Property Tests.gtype"
  "Error in": error
outputs:
  "Driver Property Tests out": "Driver Property Tests.gtype"
  "Error out": error
panel controls:
  "FormattedTestResult": "FormattedTestResult.gtype"
types:
  "FormattedTestResult.gtype" = cluster{"Class Under Test": string, "Test ID": string, "Pass-Fail": bool, "Detail": string}
uses:
  Hardware Abstraction Framework::Common::Driver.gtype::Write Driver Settings.gvi
  Hardware Abstraction Framework::Common::Driver.gtype::Read Driver Settings.gvi
  LabViewNXG Test Framework::Utilities::Set Value String.gvi
  LabViewNXG Test Framework::Common::AbstractTest.gtype::Process Result.gvi
diagram:
  case ($"Error in") {
    frame No Error {
      To Variant(anything="Settings") -> w3
      Set Variant Attribute(name="Setting 1", value="DriverSetting.gtype" constant, variant=w3) -> (variant out=w4)
      Set Variant Attribute(name="Setting 2", value="DriverSetting.gtype" constant, variant=w4) -> (variant out=w5)
      Set Variant Attribute(name="Setting 3", value="DriverSetting.gtype" constant, variant=w5) -> (variant out=w6)
      call "Write Driver Settings.gvi"(Driver in="Driver.gtype" constant, Driver Settings=w6, Error in=$"Error in") -> (Driver out=w7, Error out=w8)
      call "Read Driver Settings.gvi"(Driver in=w7, Error in=w8) -> (Driver Settings=w9, Error out=w10)
      Get Variant Attribute[GetAllAttributes=True](error in=w10, variant=w9) -> (names=w11)
      Array Size(array=w11) -> (size(s)=w12)
      Format Into String(formatString="Array of %u DriverSettings", w12) -> w13
      call "Set Value String.gvi"(Variant with Value in=w9, String Value=w13) -> (Variant with Value out=w14, Error out=w15)
      call "Set Value String.gvi"(Variant with Value in=w6, String Value="Array of 3 DriverSettings", Error in=w15) -> (Variant with Value out=w16, Error out=w17)
      Property Node(instance in=$FormattedTestResult, "Class Under Test"="PropertyTests", "Test ID"="Verifies DriverSettings is set") -> (instance out=w18)
      call "Process Result.gvi"(Formatted Results=w18, AbstractTest in=$"Driver Property Tests in", Expected Result=w14, Actual Result=w16, Asserter="AssertEqual.gtype" constant, Error in=w17) -> (AbstractTest out=w2, Error out=w1)
    }
    frame Error {
      w1 = $"Error in"
      w2 = $"Driver Property Tests in"
    }
  }
  $"Driver Property Tests out" <- w2
  $"Error out" <- w1
