vi "Build Driver Setting Mappings.gvi"   [LabVIEW NXG 5.0.0]
# Builds the array of Driver Setting mappings.  Must be implemented by sub classes as this member will raise an error.
inputs:
  "MockDriver in": "MockDriver.gtype"
  "Error in": error
outputs:
  "Driver Setting Mappings": "Setting Map Structure.gtype"[]
  "MockDriver out": "MockDriver.gtype"
  "Error out": error
panel controls:
  "Setting Map Structure": "Setting Map Structure.gtype"
  "Setting Map Structure_2": "Setting Map Structure.gtype"
  "Setting Map Structure_3": "Setting Map Structure.gtype"
types:
  "Setting Map Structure.gtype" = cluster{"Executable Setting Name": string, "Driver Setting Name": string, "Driver Setting Data Type": string}
  "Valid Data Types.gtype" = cluster{"U8": string, "U16": string, "U32": string, "U64": string, "I8": string, "I16": string, "I32": string, "I64": string, "SGL": string, "DBL": string, "String": string, "Boolean": string}
diagram:
  $"MockDriver out" <- $"MockDriver in"
  $"Error out" <- $"Error in"
  w1 = "Valid Data Types.gtype" {"U8"="U8", "U16"="U16", "U32"="U32", "U64"="U64", "I8"="I8", "I16"="I16", "I32"="I32", "I64"="I64", "SGL"="SGL", "DBL"="DBL", "String"="String", "Boolean"="Boolean"}
  Cluster To Array(cluster=w1) -> (array=w2)
  Array Index(array=w2) -> (out0[0]=w3)
  Property Node(instance in=$"Setting Map Structure", "Executable Setting Name"="Ex Setting 1", "Driver Setting Name"="Dvr Setting 1", "Driver Setting Data Type"=w3) -> (instance out=w4)
  w5 = "Valid Data Types.gtype" {"U8"="U8", "U16"="U16", "U32"="U32", "U64"="U64", "I8"="I8", "I16"="I16", "I32"="I32", "I64"="I64", "SGL"="SGL", "DBL"="DBL", "String"="String", "Boolean"="Boolean"}
  Cluster To Array(cluster=w5) -> (array=w6)
  Array Index(array=w6) -> (out0[1]=w7)
  Property Node(instance in=$"Setting Map Structure_2", "Executable Setting Name"="Ex Setting 2", "Driver Setting Name"="Dvr Setting 2", "Driver Setting Data Type"=w7) -> (instance out=w8)
  w9 = "Valid Data Types.gtype" {"U8"="U8", "U16"="U16", "U32"="U32", "U64"="U64", "I8"="I8", "I16"="I16", "I32"="I32", "I64"="I64", "SGL"="SGL", "DBL"="DBL", "String"="String", "Boolean"="Boolean"}
  Cluster To Array(cluster=w9) -> (array=w10)
  Array Index(array=w10) -> (out0[3]=w11)
  Property Node(instance in=$"Setting Map Structure_3", "Executable Setting Name"="Ex Setting 3", "Driver Setting Name"="Dvr Setting 3", "Driver Setting Data Type"=w11) -> (instance out=w12)
  Build Array(w4, w8, w12) -> w13
  $"Driver Setting Mappings" <- w13
