vi "Add Executable At Index Test.gvi"   [LabVIEW NXG 5.0.0]
inputs:
  "Add Executable Test in": "Add Executable Test.gtype"
  "Error in": error
outputs:
  "Add Executable Test out": "Add Executable Test.gtype"
  "Error out": error
panel controls:
  "FormattedTestResult": "FormattedTestResult.gtype"
types:
  "FormattedTestResult.gtype" = cluster{"Class Under Test": string, "Test ID": string, "Pass-Fail": bool, "Detail": string}
uses:
  Hardware Abstraction Framework::Common::ExecutableDirector.gtype::Add Executable.gvi
  Hardware Abstraction Framework::Common::WriteExecutable.gtype::Read Id.gvi
  Hardware Abstraction Framework::Common::ExecutableDirector.gtype::Read Executables.gvi
  LabViewNXG Test Framework::Utilities::Set Value String.gvi
  LabViewNXG Test Framework::Common::AbstractTest.gtype::Process Result.gvi
diagram:
  case ($"Error in") {
    frame Error, Default {
      w1 = $"Add Executable Test in"
      w2 = $"Error in"
    }
    frame No Error {
      # idx 1
      # idx 0
      call "Add Executable.gvi"(ExecutableDirector in="ExecutableDirector.gtype" constant, Executable="WriteExecutable.gtype" constant, Error in=$"Error in") -> (ExecutableDirector out=w3, Error out=w4)
      call "Add Executable.gvi"(ExecutableDirector in=w3, Executable="WriteExecutable.gtype" constant, Error in=w4) -> (ExecutableDirector out=w5, Error out=w6)
      # idx 2
      call "Add Executable.gvi"(ExecutableDirector in=w5, Executable="WriteExecutable.gtype" constant, Error in=w6) -> (ExecutableDirector out=w7, Error out=w8)
      # add at 1
      call "Read Id.gvi"(Executable in="WriteExecutable.gtype" constant, Error in=w8) -> (Executable out=w9, Id=w10, Error out=w11)
      call "Add Executable.gvi"(ExecutableDirector in=w7, Executable=w9, Index=1, Error in=w11) -> (ExecutableDirector out=w12, Error out=w13)
      call "Read Executables.gvi"(ExecutableDirector in=w12, Error in=w13) -> (Executables=w14, Error out=w15)
      Array Index(array=w14) -> (out0[1]=w16)
      call "Read Id.gvi"(Executable in=w16, Error in=w15) -> (Id=w17, Error out=w18)
      To Variant(anything=w17) -> w19
      call "Set Value String.gvi"(Variant with Value in=w19, String Value=w17, Error in=w18) -> (Variant with Value out=w20, Error out=w21)
      To Variant(anything=w10) -> w22
      call "Set Value String.gvi"(Variant with Value in=w22, String Value=w10, Error in=w21) -> (Variant with Value out=w23, Error out=w24)
      Property Node(instance in=$FormattedTestResult, "Class Under Test"="AddExecutableAtIndexTest", "Test ID"="Verifies an Executable can be added at a specific index") -> (instance out=w25)
      call "Process Result.gvi"(Formatted Results=w25, AbstractTest in=$"Add Executable Test in", Expected Result=w20, Actual Result=w23, Asserter="AssertEqual.gtype" constant, Error in=w24) -> (AbstractTest out=w1, Error out=w2)
    }
  }
  $"Add Executable Test out" <- w1
  $"Error out" <- w2
