vi "Add Executable.gvi"   [LabVIEW NXG 5.0.0]
inputs:
  "Add Executable Test in": "Add Executable Test.gtype"
  "Error in": error
outputs:
  "Add Executable Test out": "Add Executable Test.gtype"
  "Error out": error
panel controls:
  "FormattedTestResult": "FormattedTestResult.gtype"
types:
  "FormattedTestResult.gtype" = cluster{"Class Under Test": string, "Test ID": string, "Pass-Fail": bool, "Detail": string}
uses:
  Hardware Abstraction Framework::Common::ExecutableDirector.gtype::Add Executable.gvi
  Hardware Abstraction Framework::Common::ExecutableDirector.gtype::Read Executables.gvi
  LabViewNXG Test Framework::Utilities::Set Value String.gvi
  LabViewNXG Test Framework::Common::AbstractTest.gtype::Process Result.gvi
diagram:
  case ($"Error in") {
    frame Error, Default {
      w1 = $"Add Executable Test in"
      w2 = $"Error in"
    }
    frame No Error {
      call "Add Executable.gvi"(ExecutableDirector in="ExecutableDirector.gtype" constant, Executable="WriteExecutable.gtype" constant, Error in=$"Error in") -> (ExecutableDirector out=w3, Error out=w4)
      call "Read Executables.gvi"(ExecutableDirector in=w3, Error in=w4) -> (Executables=w5, Error out=w6)
      Array Size(array=w5) -> (size(s)=w7)
      To Variant(anything=w7) -> w8
      Number To Decimal String(number=w7) -> (decimal integer string=w9)
      call "Set Value String.gvi"(Variant with Value in=w8, String Value=w9, Error in=w6) -> (Variant with Value out=w10, Error out=w11)
      Number To Decimal String(number=1) -> (decimal integer string=w12)
      To Variant(anything=1) -> w13
      call "Set Value String.gvi"(Variant with Value in=w13, String Value=w12, Error in=w11) -> (Variant with Value out=w14, Error out=w15)
      Property Node(instance in=$FormattedTestResult, "Class Under Test"="AddExecutableTest", "Test ID"="Verifies an Executable can be added") -> (instance out=w16)
      call "Process Result.gvi"(Formatted Results=w16, AbstractTest in=$"Add Executable Test in", Expected Result=w10, Actual Result=w14, Asserter="AssertEqual.gtype" constant, Error in=w15) -> (AbstractTest out=w1, Error out=w2)
    }
  }
  $"Add Executable Test out" <- w1
  $"Error out" <- w2
