vi "Run All Tests.gvi"   [LabVIEW NXG 5.0.0]
# A framework method that must be overridden by each concrete test class and which exercises the code under test.
# If this method is not overridden it will raise error 100.
# See examples for variations of implementation of this method.
inputs:
  "Add Executable Test in": "Add Executable Test.gtype"
  "Error in": error
outputs:
  "Add Executable Test out": "Add Executable Test.gtype"
  "Error out": error
uses:
  Add Executable Test.gtype::Add Executable.gvi
  Add Executable Test.gtype::Add Executable At Index Test.gvi
diagram:
  call "Add Executable.gvi"(Add Executable Test in=$"Add Executable Test in", Error in=$"Error in") -> (Add Executable Test out=w1, Error out=w2)
  call "Add Executable At Index Test.gvi"(Add Executable Test in=w1, Error in=w2) -> (Add Executable Test out=w3, Error out=w4)
  $"Add Executable Test out" <- w3
  $"Error out" <- w4
