vi "Run All Tests.gvi"   [LabVIEW NXG 5.0.0]
# A framework method that must be overridden by each concrete test class and which exercises the code under test.
# If this method is not overridden it will raise error 100.
# See examples for variations of implementation of this method.
inputs:
  "Property Tests in": "Executable Director Property Tests.gtype"
  "Error in": error
outputs:
  "Property Tests out": "Executable Director Property Tests.gtype"
  "Error out": error
uses:
  Executable Director Property Tests.gtype::Wait Time Test.gvi
  Executable Director Property Tests.gtype::Times Repeat Test.gvi
  Executable Director Property Tests.gtype::Duration Test.gvi
diagram:
  call "Wait Time Test.gvi"(Property Tests in=$"Property Tests in", Error in=$"Error in") -> (Property Tests out=w1, Error out=w2)
  call "Times Repeat Test.gvi"(Property Tests in=w1, Error in=w2) -> (Property Tests out=w3, Error out=w4)
  call "Duration Test.gvi"(Property Tests in=w3, Error in=w4) -> (Property Tests out=w5, Error out=w6)
  $"Property Tests out" <- w5
  $"Error out" <- w6
