vi "Times Repeat Test.gvi"   [LabVIEW NXG 5.0.0]
inputs:
  "Property Tests in": "Executable Director Property Tests.gtype"
  "Error in": error
outputs:
  "Property Tests out": "Executable Director Property Tests.gtype"
  "Error out": error
panel controls:
  "FormattedTestResult": "FormattedTestResult.gtype"
types:
  "FormattedTestResult.gtype" = cluster{"Class Under Test": string, "Test ID": string, "Pass-Fail": bool, "Detail": string}
uses:
  Hardware Abstraction Framework::Common::RepeatingDirector.gtype::Write Times Repeat.gvi
  Hardware Abstraction Framework::Common::RepeatingDirector.gtype::Read Times Repeat.gvi
  LabViewNXG Test Framework::Utilities::Set Value String.gvi
  LabViewNXG Test Framework::Common::AbstractTest.gtype::Process Result.gvi
diagram:
  case ($"Error in") {
    frame Error, Default {
      w1 = $"Property Tests in"
      w2 = $"Error in"
    }
    frame No Error {
      call "Write Times Repeat.gvi"(RepeatingDirector in="RepeatingDirector.gtype" constant, Times Repeat=99, Error in=$"Error in") -> (RepeatingDirector out=w3, Error out=w4)
      call "Read Times Repeat.gvi"(RepeatingDirector in=w3, Error in=w4) -> (Times Repeat=w5, Error out=w6)
      To Variant(anything=w5) -> w7
      Number To Decimal String(number=w5) -> (decimal integer string=w8)
      call "Set Value String.gvi"(Variant with Value in=w7, String Value=w8, Error in=w6) -> (Variant with Value out=w9, Error out=w10)
      Number To Decimal String(number=99) -> (decimal integer string=w11)
      To Variant(anything=99) -> w12
      call "Set Value String.gvi"(Variant with Value in=w12, String Value=w11, Error in=w10) -> (Variant with Value out=w13, Error out=w14)
      Property Node(instance in=$FormattedTestResult, "Class Under Test"="PropertyTests", "Test ID"="Verifies Times Repeat is set") -> (instance out=w15)
      call "Process Result.gvi"(Formatted Results=w15, AbstractTest in=$"Property Tests in", Expected Result=w9, Actual Result=w13, Asserter="AssertEqual.gtype" constant, Error in=w14) -> (AbstractTest out=w1, Error out=w2)
    }
  }
  $"Property Tests out" <- w1
  $"Error out" <- w2
