vi "CD Should Always Continue.gvi"   [LabVIEW NXG 5.0.0]
inputs:
  "Should Continue Test in": "Should Continue Test.gtype"
  "Error in": error
outputs:
  "Should Continue Test out": "Should Continue Test.gtype"
  "Error out": error
panel controls:
  "FormattedTestResult": "FormattedTestResult.gtype"
types:
  "FormattedTestResult.gtype" = cluster{"Class Under Test": string, "Test ID": string, "Pass-Fail": bool, "Detail": string}
uses:
  Hardware Abstraction Framework::Common::ContinuousDirector.gtype::Should Continue.gvi
  LabViewNXG Test Framework::Utilities::Boolean To String.gvi
  LabViewNXG Test Framework::Utilities::Set Value String.gvi
  LabViewNXG Test Framework::Common::AbstractTest.gtype::Process Result.gvi
diagram:
  case ($"Error in") {
    frame Error, Default {
      w1 = $"Should Continue Test in"
      w2 = $"Error in"
    }
    frame No Error {
      call "Should Continue.gvi"(ContinuousDirector in="ContinuousDirector.gtype" constant, Error in=$"Error in") -> (Should Continue?=w3, Error out=w4)
      To Variant(anything=w3) -> w5
      call "Boolean To String.gvi"(Boolean in=w3) -> (String value=w6)
      call "Set Value String.gvi"(Variant with Value in=w5, String Value=w6, Error in=w4) -> (Variant with Value out=w7, Error out=w8)
      To Variant(anything=TRUE) -> w9
      call "Boolean To String.gvi"(Boolean in=TRUE) -> (String value=w10)
      call "Set Value String.gvi"(Variant with Value in=w9, String Value=w10, Error in=w8) -> (Variant with Value out=w11, Error out=w12)
      Property Node(instance in=$FormattedTestResult, "Class Under Test"="ShouldContinueTest", "Test ID"="Verifies the CD always continues") -> (instance out=w13)
      call "Process Result.gvi"(Formatted Results=w13, AbstractTest in=$"Should Continue Test in", Expected Result=w7, Actual Result=w11, Asserter="AssertTrue.gtype" constant, Error in=w12) -> (AbstractTest out=w1, Error out=w2)
    }
  }
  $"Should Continue Test out" <- w1
  $"Error out" <- w2
