vi "ED Should Never Continue.gvi"   [LabVIEW NXG 5.0.0]
inputs:
  "Should Continue Test in": "Should Continue Test.gtype"
  "Error in": error
outputs:
  "Should Continue Test out": "Should Continue Test.gtype"
  "Error out": error
panel controls:
  "FormattedTestResult": "FormattedTestResult.gtype"
types:
  "FormattedTestResult.gtype" = cluster{"Class Under Test": string, "Test ID": string, "Pass-Fail": bool, "Detail": string}
uses:
  Hardware Abstraction Framework::Common::ExecutableDirector.gtype::Increment Run Count.gvi
  Hardware Abstraction Framework::Common::ExecutableDirector.gtype::Should Continue.gvi
  LabViewNXG Test Framework::Utilities::Boolean To String.gvi
  LabViewNXG Test Framework::Utilities::Set Value String.gvi
  LabViewNXG Test Framework::Common::AbstractTest.gtype::Process Result.gvi
diagram:
  case ($"Error in") {
    frame Error, Default {
      w1 = $"Should Continue Test in"
      w2 = $"Error in"
    }
    frame No Error {
      call "Increment Run Count.gvi"(ExecutableDirector in="ExecutableDirector.gtype" constant, Error in=$"Error in") -> (ExecutableDirector out=w3, Error out=w4)
      call "Should Continue.gvi"(ExecutableDirector in=w3, Error in=w4) -> (Should Continue?=w5, Error out=w6)
      To Variant(anything=w5) -> w7
      call "Boolean To String.gvi"(Boolean in=w5) -> (String value=w8)
      call "Set Value String.gvi"(Variant with Value in=w7, String Value=w8, Error in=w6) -> (Variant with Value out=w9, Error out=w10)
      To Variant(anything=FALSE) -> w11
      call "Boolean To String.gvi"(Boolean in=FALSE) -> (String value=w12)
      call "Set Value String.gvi"(Variant with Value in=w11, String Value=w12, Error in=w10) -> (Variant with Value out=w13, Error out=w14)
      Property Node(instance in=$FormattedTestResult, "Class Under Test"="EDShouldContinueTest", "Test ID"="Verifies the ED should never continue") -> (instance out=w15)
      call "Process Result.gvi"(Formatted Results=w15, AbstractTest in=$"Should Continue Test in", Expected Result=w9, Actual Result=w13, Asserter="AssertFalse.gtype" constant, Error in=w14) -> (AbstractTest out=w1, Error out=w2)
    }
  }
  $"Should Continue Test out" <- w1
  $"Error out" <- w2
