vi "RD Should Continue For Repeats.gvi"   [LabVIEW NXG 5.0.0]
inputs:
  "Should Continue Test in": "Should Continue Test.gtype"
  "Error in": error
outputs:
  "Should Continue Test out": "Should Continue Test.gtype"
  "Error out": error
panel controls:
  "FormattedTestResult": "FormattedTestResult.gtype"
types:
  "FormattedTestResult.gtype" = cluster{"Class Under Test": string, "Test ID": string, "Pass-Fail": bool, "Detail": string}
uses:
  Hardware Abstraction Framework::Common::RepeatingDirector.gtype::Write Times Repeat.gvi
  Hardware Abstraction Framework::Common::RepeatingDirector.gtype::Should Continue.gvi
  LabViewNXG Test Framework::Utilities::Boolean To String.gvi
  LabViewNXG Test Framework::Utilities::Set Value String.gvi
  LabViewNXG Test Framework::Common::AbstractTest.gtype::Process Result.gvi
diagram:
  case ($"Error in") {
    frame Error, Default {
      w1 = $"Should Continue Test in"
      w2 = $"Error in"
    }
    frame No Error {
      call "Write Times Repeat.gvi"(RepeatingDirector in="RepeatingDirector.gtype" constant, Times Repeat=3, Error in=$"Error in") -> (RepeatingDirector out=w3, Error out=w4)
      # Loop should exit
      # when it shouldn't
      # continue and counter
      # < 5
      s1 = w3  # shift register
      s2 = 0  # shift register
      while {
        call "Should Continue.gvi"(RepeatingDirector in=s1, Error in=w4) -> (RepeatingDirector out=w5, Should Continue?=w6, Error out=w7)
        # Don't repeat forever!
        Increment(x=s2) -> w8
        Is Less(x=w8, y=5) -> w9
        Logical And(w6, w9) -> w10
        next s1 = w5
        next s2 = w8
        continue if w10
      }
      Is Equal(x=5, y=s2) -> w11
      Logical Or(w11, w6) -> w12
      To Variant(anything=w12) -> w13
      call "Boolean To String.gvi"(Boolean in=w12) -> (String value=w14)
      call "Set Value String.gvi"(Variant with Value in=w13, String Value=w14, Error in=w7) -> (Variant with Value out=w15, Error out=w16)
      To Variant(anything=FALSE) -> w17
      call "Boolean To String.gvi"(Boolean in=FALSE) -> (String value=w18)
      call "Set Value String.gvi"(Variant with Value in=w17, String Value=w18, Error in=w16) -> (Variant with Value out=w19, Error out=w20)
      Property Node(instance in=$FormattedTestResult, "Class Under Test"="ShouldContinueTest", "Test ID"="Verifies the RD Repeats correctly") -> (instance out=w21)
      call "Process Result.gvi"(Formatted Results=w21, AbstractTest in=$"Should Continue Test in", Expected Result=w15, Actual Result=w19, Asserter="AssertFalse.gtype" constant, Error in=w20) -> (AbstractTest out=w1, Error out=w2)
    }
  }
  $"Should Continue Test out" <- w1
  $"Error out" <- w2
