vi "Run All Tests.gvi"   [LabVIEW NXG 5.0.0]
# A framework method that must be overridden by each concrete test class and which exercises the code under test.
# If this method is not overridden it will raise error 100.
# See examples for variations of implementation of this method.
inputs:
  "ED Should Continue Test in": "Should Continue Test.gtype"
  "Error in": error
outputs:
  "ED Should Continue Test out": "Should Continue Test.gtype"
  "Error out": error
uses:
  Should Continue Test.gtype::ED Should Never Continue.gvi
  Should Continue Test.gtype::CD Should Always Continue.gvi
  Should Continue Test.gtype::RD Should Continue For Repeats.gvi
  Should Continue Test.gtype::TD Should Continue for Duration.gvi
diagram:
  call "ED Should Never Continue.gvi"(Should Continue Test in=$"ED Should Continue Test in", Error in=$"Error in") -> (Should Continue Test out=w1, Error out=w2)
  call "CD Should Always Continue.gvi"(Should Continue Test in=w1, Error in=w2) -> (Should Continue Test out=w3, Error out=w4)
  call "RD Should Continue For Repeats.gvi"(Should Continue Test in=w3, Error in=w4) -> (Should Continue Test out=w5, Error out=w6)
  call "TD Should Continue for Duration.gvi"(Should Continue Test in=w5, Error in=w6) -> (Should Continue Test out=w7, Error out=w8)
  $"ED Should Continue Test out" <- w7
  $"Error out" <- w8
