vi "TD Should Continue for Duration.gvi"   [LabVIEW NXG 5.0.0]
inputs:
  "Should Continue Test in": "Should Continue Test.gtype"
  "Error in": error
outputs:
  "Should Continue Test out": "Should Continue Test.gtype"
  "Error out": error
panel controls:
  "FormattedTestResult": "FormattedTestResult.gtype"
types:
  "FormattedTestResult.gtype" = cluster{"Class Under Test": string, "Test ID": string, "Pass-Fail": bool, "Detail": string}
uses:
  Hardware Abstraction Framework::Common::TimedDirector.gtype::Initialise.gvi
  Hardware Abstraction Framework::Common::TimedDirector.gtype::Write Duration.gvi
  Hardware Abstraction Framework::Common::TimedDirector.gtype::Should Continue.gvi
  NI::G Core::Timing::Elapsed Timer.gvi
  LabViewNXG Test Framework::Utilities::Boolean To String.gvi
  LabViewNXG Test Framework::Utilities::Set Value String.gvi
  LabViewNXG Test Framework::Common::AbstractTest.gtype::Process Result.gvi
diagram:
  case ($"Error in") {
    frame Error, Default {
      w1 = $"Should Continue Test in"
      w2 = $"Error in"
    }
    frame No Error {
      call "Initialise.gvi"(TimedDirector in="TimedDirector.gtype" constant, Error in=$"Error in") -> (TimedDirector out=w3, Error out=w4)
      call "Write Duration.gvi"(TimedDirector in=w3, Duration=3000, Error in=w4) -> (TimedDirector out=w5, Error out=w6)
      # This assumes that
      # between initialise and
      # the loop < 3 secs has
      # passed in execution time
      # Loop should exit
      # when it shouldn't
      # continue and timer did
      # not elapse
      s1 = w5  # shift register
      while {
        call "Should Continue.gvi"(TimedDirector in=s1, Error in=w6) -> (TimedDirector out=w7, Should Continue?=w8, Error out=w9)
        call "Elapsed Timer.gvi"(target time=5) -> (time has elapsed=w10)
        Not(x=w10) -> w11
        # Don't repeat forever!
        Logical And(w8, w11) -> w12
        next s1 = w7
        continue if w12
      }
      Logical Or(w10, w8) -> w13
      To Variant(anything=w13) -> w14
      call "Boolean To String.gvi"(Boolean in=w13) -> (String value=w15)
      call "Set Value String.gvi"(Variant with Value in=w14, String Value=w15, Error in=w9) -> (Variant with Value out=w16, Error out=w17)
      To Variant(anything=FALSE) -> w18
      call "Boolean To String.gvi"(Boolean in=FALSE) -> (String value=w19)
      call "Set Value String.gvi"(Variant with Value in=w18, String Value=w19, Error in=w17) -> (Variant with Value out=w20, Error out=w21)
      Property Node(instance in=$FormattedTestResult, "Class Under Test"="ShouldContinueTest", "Test ID"="Verifies the TD Repeats correctly") -> (instance out=w22)
      call "Process Result.gvi"(Formatted Results=w22, AbstractTest in=$"Should Continue Test in", Expected Result=w16, Actual Result=w20, Asserter="AssertFalse.gtype" constant, Error in=w21) -> (AbstractTest out=w1, Error out=w2)
    }
  }
  $"Should Continue Test out" <- w1
  $"Error out" <- w2
