vi "Add Director At Index.gvi"   [LabVIEW NXG 5.0.0]
inputs:
  "Add Director Test in": "Add Director Test.gtype"
  "Error in": error
outputs:
  "Add Director Test out": "Add Director Test.gtype"
  "Error out": error
panel controls:
  "FormattedTestResult": "FormattedTestResult.gtype"
types:
  "FormattedTestResult.gtype" = cluster{"Class Under Test": string, "Test ID": string, "Pass-Fail": bool, "Detail": string}
uses:
  Hardware Abstraction Framework::Common::ExecutableProcessor.gtype::Add Director.gvi
  Hardware Abstraction Framework::Common::ExecutableDirector.gtype::Read Id.gvi
  Hardware Abstraction Framework::Common::ExecutableProcessor.gtype::Read Directors.gvi
  LabViewNXG Test Framework::Utilities::Set Value String.gvi
  LabViewNXG Test Framework::Common::AbstractTest.gtype::Process Result.gvi
diagram:
  case ($"Error in") {
    frame Error, Default {
      w1 = $"Add Director Test in"
      w2 = $"Error in"
    }
    frame No Error {
      # idx 1
      # idx 0
      call "Add Director.gvi"(ExecutableProcessor in="ExecutableProcessor.gtype" constant, ExecutableDirector="ExecutableDirector.gtype" constant, Error in=$"Error in") -> (ExecutableProcessor out=w3, Error out=w4)
      call "Add Director.gvi"(ExecutableProcessor in=w3, ExecutableDirector="ExecutableDirector.gtype" constant, Error in=w4) -> (ExecutableProcessor out=w5, Error out=w6)
      # idx 2
      call "Add Director.gvi"(ExecutableProcessor in=w5, ExecutableDirector="ExecutableDirector.gtype" constant, Error in=w6) -> (ExecutableProcessor out=w7, Error out=w8)
      # add at 1
      call "Read Id.gvi"(ExecutableDirector in="ExecutableDirector.gtype" constant, Error in=w8) -> (ExecutableDirector out=w9, Id=w10, Error out=w11)
      call "Add Director.gvi"(ExecutableProcessor in=w7, ExecutableDirector=w9, Index=1, Error in=w11) -> (ExecutableProcessor out=w12)
      call "Read Directors.gvi"(ExecutableProcessor in=w12) -> (Directors=w13, Error out=w14)
      Array Index(array=w13) -> (out0[1]=w15)
      call "Read Id.gvi"(ExecutableDirector in=w15, Error in=w14) -> (Id=w16, Error out=w17)
      To Variant(anything=w16) -> w18
      call "Set Value String.gvi"(Variant with Value in=w18, String Value=w16, Error in=w17) -> (Variant with Value out=w19, Error out=w20)
      To Variant(anything=w10) -> w21
      call "Set Value String.gvi"(Variant with Value in=w21, String Value=w10, Error in=w20) -> (Variant with Value out=w22, Error out=w23)
      Property Node(instance in=$FormattedTestResult, "Class Under Test"="AddDirectorAtIndex", "Test ID"="Verifies a Director can be added at a specific index") -> (instance out=w24)
      call "Process Result.gvi"(Formatted Results=w24, AbstractTest in=$"Add Director Test in", Expected Result=w19, Actual Result=w22, Asserter="AssertEqual.gtype" constant, Error in=w23) -> (AbstractTest out=w1, Error out=w2)
    }
  }
  $"Add Director Test out" <- w1
  $"Error out" <- w2
