vi "Run All Tests.gvi"   [LabVIEW NXG 5.0.0]
# A framework method that must be overridden by each concrete test class and which exercises the code under test.
# If this method is not overridden it will raise error 100.
# See examples for variations of implementation of this method.
inputs:
  "Add Director Test in": "Add Director Test.gtype"
  "Error in": error
outputs:
  "Add Director Test out": "Add Director Test.gtype"
  "Error out": error
uses:
  Add Director Test.gtype::Add Director.gvi
  Add Director Test.gtype::Add Director At Index.gvi
diagram:
  call "Add Director.gvi"(Add Director Test in=$"Add Director Test in", Error in=$"Error in") -> (Add Director Test out=w1, Error out=w2)
  call "Add Director At Index.gvi"(Add Director Test in=w1, Error in=w2) -> (Add Director Test out=w3, Error out=w4)
  $"Add Director Test out" <- w3
  $"Error out" <- w4
