vi "Run Tests With Display.gvi"   [LabVIEW NXG 5.0.0]
# Runs all the Tests for the Test Suite and displays the results in the panel elements.
inputs:
  "ExecutableProcessorTestSuite in": "ExecutableProcessorTestSuite.gtype"
  "Error in": error
outputs:
  "Overall Result": bool  # The overall result of the Test Suite. True only if all individual Tests passed.
  "ExecutableProcessorTestSuite out": "ExecutableProcessorTestSuite.gtype"
  "Error out": error
  "Results": "FormattedTestResult.gtype"[]  # Results of each individual test.
  "Tests Passed": u32  # The number of Tests that have passed.
  "Tests Failed": u32  # The number of Tests that have failed.
panel controls:
  "FormattedTestResult": "FormattedTestResult.gtype"
types:
  "FormattedTestResult.gtype" = cluster{"Class Under Test": string, "Test ID": string, "Pass-Fail": bool, "Detail": string}
uses:
  LabViewNXG Test Framework::Common::AbstractTestSuite.gtype::Run Tests With Display.gvi
diagram:
  sequence {
    frame 0 {
      $"Overall Result" <- TRUE
      Initialize Array(element=$FormattedTestResult, size=0) -> w1
      $Results <- w1
      $"Tests Passed" <- 0
      $"Tests Failed" <- 0
    }
  }
  call parent "Run Tests With Display.gvi"(AbstractTestSuite in=$"ExecutableProcessorTestSuite in", Error in=$"Error in") -> (Results=w2, AbstractTestSuite out=w3, Overall Result=w4, Tests Passed=w5, Tests Failed=w6, Error out=w7)
  $"ExecutableProcessorTestSuite out" <- w3
  $"Overall Result" <- w4
  $"Tests Passed" <- w5
  $"Tests Failed" <- w6
  $"Error out" <- w7
  $Results <- w2
