vi "Run All Tests.gvi"   [LabVIEW NXG 5.0.0]
# A framework method that must be overridden by each concrete test class and which exercises the code under test.
# If this method is not overridden it will raise error 100.
# See examples for variations of implementation of this method.
inputs:
  "Remove Director Test in": "Remove Director Test.gtype"
  "Error in": error
outputs:
  "Remove Director Test out": "Remove Director Test.gtype"
  "Error out": error
panel controls:
  "FormattedTestResult": "FormattedTestResult.gtype"
  "FormattedTestResult_2": "FormattedTestResult.gtype"
types:
  "FormattedTestResult.gtype" = cluster{"Class Under Test": string, "Test ID": string, "Pass-Fail": bool, "Detail": string}
uses:
  Hardware Abstraction Framework::Common::ExecutableProcessor.gtype::Add Director.gvi
  Hardware Abstraction Framework::Common::ExecutableDirector.gtype::Read Id.gvi
  Hardware Abstraction Framework::Common::ExecutableProcessor.gtype::RemoveDirector.gvi
  Hardware Abstraction Framework::Common::ExecutableProcessor.gtype::Read Directors.gvi
  LabViewNXG Test Framework::Utilities::Boolean To String.gvi
  LabViewNXG Test Framework::Utilities::Set Value String.gvi
  LabViewNXG Test Framework::Common::AbstractTest.gtype::Process Result.gvi
  NI::G Core::Error::Multiplex Errors.gvi
diagram:
  case ($"Error in") {
    frame Error, Default {
      w1 = $"Remove Director Test in"
      w2 = $"Error in"
    }
    frame No Error {
      # idx 2
      # idx 0
      call "Add Director.gvi"(ExecutableProcessor in="ExecutableProcessor.gtype" constant, ExecutableDirector="ExecutableDirector.gtype" constant, Error in=$"Error in") -> (ExecutableProcessor out=w3, Error out=w4)
      # idx 1
      call "Read Id.gvi"(ExecutableDirector in="ExecutableDirector.gtype" constant) -> (ExecutableDirector out=w5, Id=w6)
      call "Add Director.gvi"(ExecutableProcessor in=w3, ExecutableDirector=w5, Error in=w4) -> (ExecutableProcessor out=w7, Error out=w8)
      call "Add Director.gvi"(ExecutableProcessor in=w7, ExecutableDirector="ExecutableDirector.gtype" constant, Error in=w8) -> (ExecutableProcessor out=w9, Error out=w10)
      call "RemoveDirector.gvi"(ExecutableProcessor in=w9, Executable Director Id=w6, Error in=w10) -> (ExecutableProcessor out=w11, Executable Director Removed=w12, Removed?=w13, Error out=w14)
      call "Read Directors.gvi"(ExecutableProcessor in=w11, Error in=w10) -> (Directors=w15, Error out=w16)
      Array Size(array=w15) -> (size(s)=w17)
      # Also, test that the collection
      # has reduced in size.
      Is Equal(x=w17, y=2) -> w18
      To Variant(anything=w18) -> w19
      call "Boolean To String.gvi"(Boolean in=w18) -> (String value=w20)
      call "Set Value String.gvi"(Variant with Value in=w19, String Value=w20, Error in=w16) -> (Variant with Value out=w21, Error out=w22)
      call "Read Id.gvi"(ExecutableDirector in=w12, Error in=w14) -> (Id=w23, Error out=w24)
      Is Equal(x=w23, y=w6) -> w25
      Logical And(w25, w13) -> w26
      To Variant(anything=w26) -> w27
      call "Boolean To String.gvi"(Boolean in=w26) -> (String value=w28)
      call "Set Value String.gvi"(Variant with Value in=w27, String Value=w28, Error in=w24) -> (Variant with Value out=w29, Error out=w30)
      # Test a Director was
      # removed and that it
      # was the right one.
      To Variant(anything=TRUE) -> w31
      call "Boolean To String.gvi"(Boolean in=TRUE) -> (String value=w32)
      call "Set Value String.gvi"(Variant with Value in=w31, String Value=w32, Error in=w30) -> (Variant with Value out=w33, Error out=w34)
      Property Node(instance in=$FormattedTestResult, "Class Under Test"="RemoveDirectorTest", "Test ID"="Verifies a Director can be removed") -> (instance out=w35)
      call "Process Result.gvi"(Formatted Results=w35, AbstractTest in=$"Remove Director Test in", Expected Result=w29, Actual Result=w33, Asserter="AssertTrue.gtype" constant, Error in=w34) -> (AbstractTest out=w36, Error out=w37)
      To Variant(anything=TRUE) -> w38
      call "Boolean To String.gvi"(Boolean in=TRUE) -> (String value=w39)
      call "Set Value String.gvi"(Variant with Value in=w38, String Value=w39, Error in=w22) -> (Variant with Value out=w40, Error out=w41)
      Property Node(instance in=$FormattedTestResult_2, "Class Under Test"="RemoveDirectorTest", "Test ID"="Verifies the Director collection is reduced") -> (instance out=w42)
      call "Multiplex Errors.gvi"(error in 1=w37, error in 2=w41) -> (error out=w43)
      call "Process Result.gvi"(Formatted Results=w42, AbstractTest in=w36, Expected Result=w21, Actual Result=w40, Asserter="AssertTrue.gtype" constant, Error in=w43) -> (AbstractTest out=w1, Error out=w2)
    }
  }
  $"Remove Director Test out" <- w1
  $"Error out" <- w2
