vi "Build Command Test.gvi"   [LabVIEW NXG 5.0.0]
inputs:
  "Executable Process Tests in": "Executable Process Tests.gtype"
  "Error in": error
outputs:
  "Executable Process Tests out": "Executable Process Tests.gtype"
  "Error out": error
panel controls:
  "FormattedTestResult": "FormattedTestResult.gtype"
types:
  "FormattedTestResult.gtype" = cluster{"Class Under Test": string, "Test ID": string, "Pass-Fail": bool, "Detail": string}
uses:
  MockExecutable.gtype::Mock Build Command.gvi
  LabViewNXG Test Framework::Utilities::Set Value String.gvi
  LabViewNXG Test Framework::Common::AbstractTest.gtype::Process Result.gvi
diagram:
  case ($"Error in") {
    frame No Error {
      Property Node(instance in=$"Executable Process Tests in") -> ("MockExecutable"=w3, instance out=w4)
      call "Mock Build Command.gvi"(Executable in=w3, Error in=$"Error in") -> (Command=w5, Error out=w6)
      To Variant(anything=w5) -> w7
      call "Set Value String.gvi"(Variant with Value in=w7, String Value=w5, Error in=w6) -> (Variant with Value out=w8, Error out=w9)
      To Variant(anything="MockIt\n") -> w10
      call "Set Value String.gvi"(Variant with Value in=w10, String Value="MockIt\n", Error in=w9) -> (Variant with Value out=w11, Error out=w12)
      Property Node(instance in=$FormattedTestResult, "Class Under Test"="Process Tests", "Test ID"="Verifies Build Command without Parameters") -> (instance out=w13)
      call "Process Result.gvi"(Formatted Results=w13, AbstractTest in=w4, Expected Result=w8, Actual Result=w11, Asserter="AssertEqual.gtype" constant, Error in=w12) -> (AbstractTest out=w2, Error out=w1)
    }
    frame Error {
      w1 = $"Error in"
      w2 = $"Executable Process Tests in"
    }
  }
  $"Executable Process Tests out" <- w2
  $"Error out" <- w1
