vi "Build Command With Parameters Test.gvi"   [LabVIEW NXG 5.0.0]
inputs:
  "Executable Process Tests in": "Executable Process Tests.gtype"
  "Error in": error
outputs:
  "Executable Process Tests out": "Executable Process Tests.gtype"
  "Error out": error
panel controls:
  "FormattedTestResult": "FormattedTestResult.gtype"
types:
  "FormattedTestResult.gtype" = cluster{"Class Under Test": string, "Test ID": string, "Pass-Fail": bool, "Detail": string}
uses:
  Hardware Abstraction Framework::Common::Parameter.gtype::Write Name.gvi
  Hardware Abstraction Framework::Common::WriteExecutable.gtype::Write Parameters.gvi
  MockExecutable.gtype::Mock Build Command.gvi
  LabViewNXG Test Framework::Utilities::Set Value String.gvi
  LabViewNXG Test Framework::Common::AbstractTest.gtype::Process Result.gvi
diagram:
  case ($"Error in") {
    frame No Error {
      Property Node(instance in=$"Executable Process Tests in") -> ("MockExecutable"=w3, instance out=w4)
      call "Write Name.gvi"(Parameter in="Parameter.gtype" constant, Name="Parm1") -> (Parameter out=w5)
      call "Write Name.gvi"(Parameter in="Parameter.gtype" constant, Name="Parm2") -> (Parameter out=w6)
      call "Write Name.gvi"(Parameter in="Parameter.gtype" constant, Name="Parm3") -> (Parameter out=w7)
      Build Array(w5, w6, w7) -> w8
      call "Write Parameters.gvi"(Executable in=w3, Parameters=w8, Error in=$"Error in") -> (Executable out=w9, Error out=w10)
      call "Mock Build Command.gvi"(Executable in=w9, Error in=w10) -> (Command=w11, Error out=w12)
      To Variant(anything=w11) -> w13
      call "Set Value String.gvi"(Variant with Value in=w13, String Value=w11, Error in=w12) -> (Variant with Value out=w14, Error out=w15)
      To Variant(anything="MockIt Parm1, Parm2, Parm3\n") -> w16
      call "Set Value String.gvi"(Variant with Value in=w16, String Value="MockIt Parm1, Parm2, Parm3\n", Error in=w15) -> (Variant with Value out=w17, Error out=w18)
      Property Node(instance in=$FormattedTestResult, "Class Under Test"="Process Tests", "Test ID"="Verifies Build Command with Parameters") -> (instance out=w19)
      call "Process Result.gvi"(Formatted Results=w19, AbstractTest in=w4, Expected Result=w14, Actual Result=w17, Asserter="AssertEqual.gtype" constant, Error in=w18) -> (AbstractTest out=w2, Error out=w1)
    }
    frame Error {
      w1 = $"Error in"
      w2 = $"Executable Process Tests in"
    }
  }
  $"Executable Process Tests out" <- w2
  $"Error out" <- w1
