vi "Remove Settings Test.gvi"   [LabVIEW NXG 5.0.0]
inputs:
  "Executable Process Tests in": "Executable Process Tests.gtype"
  "Error in": error
outputs:
  "Executable Process Tests out": "Executable Process Tests.gtype"
  "Error out": error
panel controls:
  "FormattedTestResult_3": "FormattedTestResult.gtype"
  "FormattedTestResult_4": "FormattedTestResult.gtype"
types:
  "FormattedTestResult.gtype" = cluster{"Class Under Test": string, "Test ID": string, "Pass-Fail": bool, "Detail": string}
uses:
  Hardware Abstraction Framework::Common::Setting.gtype::Write Name.gvi
  Hardware Abstraction Framework::Common::WriteExecutable.gtype::Write Executable Settings.gvi
  Hardware Abstraction Framework::Common::WriteExecutable.gtype::Remove Settings.gvi
  Hardware Abstraction Framework::Common::WriteExecutable.gtype::Read Executable Settings.gvi
  Hardware Abstraction Framework::Common::Setting.gtype::Read Name.gvi
  LabViewNXG Test Framework::Utilities::Set Value String.gvi
  LabViewNXG Test Framework::Common::AbstractTest.gtype::Process Result.gvi
diagram:
  case ($"Error in") {
    frame No Error {
      # Set up initial Settings, then remove 2 and 4
      Property Node(instance in=$"Executable Process Tests in") -> ("MockExecutable"=w3, instance out=w4)
      call "Write Name.gvi"(Setting in="ExecutableSetting.gtype" constant, Name="Setting 1") -> (Setting out=w5)
      call "Write Name.gvi"(Setting in="ExecutableSetting.gtype" constant, Name="Setting 2") -> (Setting out=w6)
      call "Write Name.gvi"(Setting in="ExecutableSetting.gtype" constant, Name="Setting 3") -> (Setting out=w7)
      call "Write Name.gvi"(Setting in="ExecutableSetting.gtype" constant, Name="Setting 4") -> (Setting out=w8)
      Build Array(w5, w6, w7, w8) -> w9
      call "Write Executable Settings.gvi"(Executable in=w3, Executable Settings=w9, Error in=$"Error in") -> (Executable out=w10, Error out=w11)
      call "Write Name.gvi"(Setting in="ExecutableSetting.gtype" constant, Name="Setting 2") -> (Setting out=w12)
      call "Write Name.gvi"(Setting in="ExecutableSetting.gtype" constant, Name="Setting 4") -> (Setting out=w13)
      Build Array(w12, w13) -> w14
      call "Remove Settings.gvi"(Executable in=w10, Executable Settings=w14, Error in=w11) -> (Executable out=w15, Removed Count=w16, Error out=w17)
      call "Read Executable Settings.gvi"(Executable in=w15) -> (Executable Settings=w18, Error out=w19)
      # Check the name of parameter at index 1
      Array Index(array=w18) -> (out0[1]=w20)
      call "Read Name.gvi"(Setting in=w20, Error in=w19) -> (Name=w21, Error out=w22)
      To Variant(anything=w21) -> w23
      call "Set Value String.gvi"(Variant with Value in=w23, String Value=w21, Error in=w22) -> (Variant with Value out=w24, Error out=w25)
      To Variant(anything=w16) -> w26
      Number To Decimal String(number=w16) -> (decimal integer string=w27)
      # Removed count should be 2
      call "Set Value String.gvi"(Variant with Value in=w26, String Value=w27, Error in=w17) -> (Variant with Value out=w28, Error out=w29)
      To Variant(anything=2) -> w30
      call "Set Value String.gvi"(Variant with Value in=w30, String Value="2", Error in=w29) -> (Variant with Value out=w31, Error out=w32)
      Property Node(instance in=$FormattedTestResult_4, "Class Under Test"="Process Tests", "Test ID"="Verifies Remove Settings removes the correct number") -> (instance out=w33)
      call "Process Result.gvi"(Formatted Results=w33, AbstractTest in=w4, Expected Result=w28, Actual Result=w31, Asserter="AssertEqual.gtype" constant, Error in=w32) -> (AbstractTest out=w34)
      To Variant(anything="Setting 3") -> w35
      call "Set Value String.gvi"(Variant with Value in=w35, String Value="Setting 3", Error in=w25) -> (Variant with Value out=w36, Error out=w37)
      Property Node(instance in=$FormattedTestResult_3, "Class Under Test"="Process Tests", "Test ID"="Verifies Remove Settings removes Settings correctly") -> (instance out=w38)
      call "Process Result.gvi"(Formatted Results=w38, AbstractTest in=w34, Expected Result=w24, Actual Result=w36, Asserter="AssertEqual.gtype" constant, Error in=w37) -> (AbstractTest out=w2, Error out=w1)
    }
    frame Error {
      w1 = $"Error in"
      w2 = $"Executable Process Tests in"
    }
  }
  $"Executable Process Tests out" <- w2
  $"Error out" <- w1
