vi "Run All Tests.gvi"   [LabVIEW NXG 5.0.0]
# A framework method that must be overridden by each concrete test class and which exercises the code under test.
# If this method is not overridden it will raise error 100.
# See examples for variations of implementation of this method.
inputs:
  "Executable Process Tests in": "Executable Process Tests.gtype"
  "Error in": error
outputs:
  "Executable Process Tests out": "Executable Process Tests.gtype"
  "Error out": error
uses:
  Executable Process Tests.gtype::Build Command Test.gvi
  Executable Process Tests.gtype::Build Command With Parameters Test.gvi
  Executable Process Tests.gtype::Update Parameters Test.gvi
  Executable Process Tests.gtype::Update Settings Test.gvi
  Executable Process Tests.gtype::Remove Parameters Test.gvi
  Executable Process Tests.gtype::Remove Settings Test.gvi
diagram:
  call "Build Command Test.gvi"(Executable Process Tests in=$"Executable Process Tests in", Error in=$"Error in") -> (Executable Process Tests out=w1, Error out=w2)
  call "Build Command With Parameters Test.gvi"(Executable Process Tests in=w1, Error in=w2) -> (Executable Process Tests out=w3, Error out=w4)
  call "Update Parameters Test.gvi"(Executable Process Tests in=w3, Error in=w4) -> (Executable Process Tests out=w5, Error out=w6)
  call "Update Settings Test.gvi"(Executable Process Tests in=w5, Error in=w6) -> (Executable Process Tests out=w7, Error out=w8)
  call "Remove Parameters Test.gvi"(Executable Process Tests in=w7, Error in=w8) -> (Executable Process Tests out=w9, Error out=w10)
  call "Remove Settings Test.gvi"(Executable Process Tests in=w9, Error in=w10) -> (Executable Process Tests out=w11, Error out=w12)
  $"Executable Process Tests out" <- w11
  $"Error out" <- w12
