vi "Setup Test.gvi"   [LabVIEW NXG 5.0.0]
# Used to setup any test data needed by the Test itself.  The default implementation is to initialise the Test Results array so must be called by any Test that overrides it.
inputs:
  "Executable Process Tests in": "Executable Process Tests.gtype"
  "Error in": error
outputs:
  "Executable Process Tests out": "Executable Process Tests.gtype"
  "Error out": error
uses:
  LabViewNXG Test Framework::Common::AbstractTest.gtype::Setup Test.gvi
diagram:
  call parent "Setup Test.gvi"(AbstractTest in=$"Executable Process Tests in", Error in=$"Error in") -> (AbstractTest out=w1, Error out=w2)
  Property Node(instance in=w1, "MockExecutable"="MockExecutable.gtype" constant) -> (instance out=w3)
  $"Executable Process Tests out" <- w3
  $"Error out" <- w2
