vi "Update Settings Test.gvi"   [LabVIEW NXG 5.0.0]
inputs:
  "Executable Process Tests in": "Executable Process Tests.gtype"
  "Error in": error
outputs:
  "Executable Process Tests out": "Executable Process Tests.gtype"
  "Error out": error
panel controls:
  "FormattedTestResult": "FormattedTestResult.gtype"
  "FormattedTestResult_2": "FormattedTestResult.gtype"
  "FormattedTestResult_3": "FormattedTestResult.gtype"
types:
  "FormattedTestResult.gtype" = cluster{"Class Under Test": string, "Test ID": string, "Pass-Fail": bool, "Detail": string}
uses:
  Hardware Abstraction Framework::Common::Setting.gtype::Write Name.gvi
  Hardware Abstraction Framework::Common::WriteExecutable.gtype::Write Executable Settings.gvi
  Hardware Abstraction Framework::Common::WriteExecutable.gtype::Update Executable Settings.gvi
  Hardware Abstraction Framework::Common::WriteExecutable.gtype::Read Executable Settings.gvi
  Hardware Abstraction Framework::Common::Setting.gtype::Read Value.gvi
  LabViewNXG Test Framework::Utilities::Set Value String.gvi
  LabViewNXG Test Framework::Common::AbstractTest.gtype::Process Result.gvi
diagram:
  case ($"Error in") {
    frame No Error {
      # Set up initial settings , then update 1 and add 2
      Property Node(instance in=$"Executable Process Tests in") -> ("MockExecutable"=w3, instance out=w4)
      call "Write Name.gvi"(Setting in="ExecutableSetting.gtype" constant, Name="Setting 1") -> (Setting out=w5)
      call "Write Name.gvi"(Setting in="ExecutableSetting.gtype" constant, Name="Setting 2") -> (Setting out=w6)
      call "Write Name.gvi"(Setting in="ExecutableSetting.gtype" constant, Name="Setting 3") -> (Setting out=w7)
      call "Write Name.gvi"(Setting in="ExecutableSetting.gtype" constant, Name="Setting 4") -> (Setting out=w8)
      Build Array(w5, w6, w7, w8) -> w9
      call "Write Executable Settings.gvi"(Executable in=w3, Executable Settings=w9, Error in=$"Error in") -> (Executable out=w10, Error out=w11)
      call "Write Name.gvi"(Setting in="ExecutableSetting.gtype" constant, Name="Setting 5") -> (Setting out=w12)
      call "Write Name.gvi"(Setting in="ExecutableSetting.gtype" constant, Name="Setting 6") -> (Setting out=w13)
      Property Node(instance in="ExecutableSetting.gtype" constant, "Name"="Setting 2", "Value"="A value") -> (instance out=w14)
      Build Array(w14, w12, w13) -> w15
      call "Update Executable Settings.gvi"(Executable in=w10, Executable Settings=w15, Error in=w11) -> (Executable out=w16, Added Count=w17, Updated Count=w18, Error out=w19)
      call "Read Executable Settings.gvi"(Executable in=w16) -> (Executable Settings=w20, Error out=w21)
      Array Index(array=w20) -> (out0[1]=w22)
      call "Read Value.gvi"(Setting in=w22, Error in=w21) -> (Value=w23, Error out=w24)
      To Variant(anything=w23) -> w25
      call "Set Value String.gvi"(Variant with Value in=w25, String Value=w23, Error in=w24) -> (Variant with Value out=w26, Error out=w27)
      To Variant(anything=w18) -> w28
      Number To Decimal String(number=w18) -> (decimal integer string=w29)
      call "Set Value String.gvi"(Variant with Value in=w28, String Value=w29, Error in=w19) -> (Variant with Value out=w30, Error out=w31)
      To Variant(anything=1) -> w32
      call "Set Value String.gvi"(Variant with Value in=w32, String Value="1", Error in=w31) -> (Variant with Value out=w33, Error out=w34)
      Property Node(instance in=$FormattedTestResult_2, "Class Under Test"="Process Tests", "Test ID"="Verifies Update Settings counts updates correctly") -> (instance out=w35)
      # Added count should be 2
      To Variant(anything=w17) -> w36
      Number To Decimal String(number=w17) -> (decimal integer string=w37)
      # Updated Count should be 1
      call "Set Value String.gvi"(Variant with Value in=w36, String Value=w37, Error in=w19) -> (Variant with Value out=w38, Error out=w39)
      To Variant(anything=2) -> w40
      call "Set Value String.gvi"(Variant with Value in=w40, String Value="2", Error in=w39) -> (Variant with Value out=w41, Error out=w42)
      Property Node(instance in=$FormattedTestResult, "Class Under Test"="Process Tests", "Test ID"="Verifies Update Settings counts adds correctly") -> (instance out=w43)
      call "Process Result.gvi"(Formatted Results=w43, AbstractTest in=w4, Expected Result=w38, Actual Result=w41, Asserter="AssertEqual.gtype" constant, Error in=w42) -> (AbstractTest out=w44)
      call "Process Result.gvi"(Formatted Results=w35, AbstractTest in=w44, Expected Result=w30, Actual Result=w33, Asserter="AssertEqual.gtype" constant, Error in=w34) -> (AbstractTest out=w45)
      To Variant(anything="A value") -> w46
      call "Set Value String.gvi"(Variant with Value in=w46, String Value="A value", Error in=w27) -> (Variant with Value out=w47, Error out=w48)
      Property Node(instance in=$FormattedTestResult_3, "Class Under Test"="Process Tests", "Test ID"="Verifies Update Settings changes value correctly") -> (instance out=w49)
      call "Process Result.gvi"(Formatted Results=w49, AbstractTest in=w45, Expected Result=w26, Actual Result=w47, Asserter="AssertEqual.gtype" constant, Error in=w48) -> (AbstractTest out=w2, Error out=w1)
    }
    frame Error {
      w1 = $"Error in"
      w2 = $"Executable Process Tests in"
    }
  }
  $"Executable Process Tests out" <- w2
  $"Error out" <- w1
