vi "Block on Wait Test.gvi"   [LabVIEW NXG 5.0.0]
inputs:
  "Executable Property Tests in": "Executable Property Tests.gtype"
  "Error in": error
outputs:
  "Executable Property Tests out": "Executable Property Tests.gtype"
  "Error out": error
panel controls:
  "FormattedTestResult": "FormattedTestResult.gtype"
types:
  "FormattedTestResult.gtype" = cluster{"Class Under Test": string, "Test ID": string, "Pass-Fail": bool, "Detail": string}
uses:
  Hardware Abstraction Framework::Common::WriteExecutable.gtype::Write Block on Wait.gvi
  Hardware Abstraction Framework::Common::WriteExecutable.gtype::Read Block on Wait.gvi
  LabViewNXG Test Framework::Utilities::Boolean To String.gvi
  LabViewNXG Test Framework::Utilities::Set Value String.gvi
  LabViewNXG Test Framework::Common::AbstractTest.gtype::Process Result.gvi
diagram:
  case ($"Error in") {
    frame No Error {
      call "Write Block on Wait.gvi"(WriteExecutable in="WriteExecutable.gtype" constant, Block on Wait=TRUE, Error in=$"Error in") -> (WriteExecutable out=w3, Error out=w4)
      call "Read Block on Wait.gvi"(WriteExecutable in=w3, Error in=w4) -> (Block on Wait=w5, Error out=w6)
      To Variant(anything=w5) -> w7
      call "Boolean To String.gvi"(Boolean in=w5) -> (String value=w8)
      call "Set Value String.gvi"(Variant with Value in=w7, String Value=w8, Error in=w6) -> (Variant with Value out=w9, Error out=w10)
      call "Boolean To String.gvi"(Boolean in=TRUE) -> (String value=w11)
      To Variant(anything=TRUE) -> w12
      call "Set Value String.gvi"(Variant with Value in=w12, String Value=w11, Error in=w10) -> (Variant with Value out=w13, Error out=w14)
      Property Node(instance in=$FormattedTestResult, "Class Under Test"="PropertyTests", "Test ID"="Verifies Block on Wait is set") -> (instance out=w15)
      call "Process Result.gvi"(Formatted Results=w15, AbstractTest in=$"Executable Property Tests in", Expected Result=w9, Actual Result=w13, Asserter="AssertTrue.gtype" constant, Error in=w14) -> (AbstractTest out=w2, Error out=w1)
    }
    frame Error {
      w1 = $"Error in"
      w2 = $"Executable Property Tests in"
    }
  }
  $"Executable Property Tests out" <- w2
  $"Error out" <- w1
