vi "Driver Test.gvi"   [LabVIEW NXG 5.0.0]
inputs:
  "PropertyTests in": "Executable Property Tests.gtype"
  "Error in": error
outputs:
  "PropertyTests out": "Executable Property Tests.gtype"
  "Error out": error
panel controls:
  "FormattedTestResult": "FormattedTestResult.gtype"
types:
  "FormattedTestResult.gtype" = cluster{"Class Under Test": string, "Test ID": string, "Pass-Fail": bool, "Detail": string}
uses:
  Hardware Abstraction Framework::Common::WriteExecutable.gtype::Write Driver.gvi
  Hardware Abstraction Framework::Common::WriteExecutable.gtype::Read Driver.gvi
  LabViewNXG Test Framework::Utilities::Set Value String.gvi
  LabViewNXG Test Framework::Common::AbstractTest.gtype::Process Result.gvi
diagram:
  case ($"Error in") {
    frame No Error {
      call "Write Driver.gvi"(Executable in="WriteExecutable.gtype" constant, Driver="Driver.gtype" constant, Error in=$"Error in") -> (Executable out=w3, Error out=w4)
      call "Read Driver.gvi"(Executable in=w3, Error in=w4) -> (Driver=w5, Error out=w6)
      To Variant(anything=w5) -> w7
      call "Set Value String.gvi"(Variant with Value in=w7, String Value="Driver instance", Error in=w6) -> (Variant with Value out=w8, Error out=w9)
      To Variant(anything="Driver.gtype" constant) -> w10
      call "Set Value String.gvi"(Variant with Value in=w10, String Value="Driver instance", Error in=w9) -> (Variant with Value out=w11, Error out=w12)
      Property Node(instance in=$FormattedTestResult, "Class Under Test"="PropertyTests", "Test ID"="Verifies Driver is set") -> (instance out=w13)
      call "Process Result.gvi"(Formatted Results=w13, AbstractTest in=$"PropertyTests in", Expected Result=w8, Actual Result=w11, Asserter="AssertEqual.gtype" constant, Error in=w12) -> (AbstractTest out=w2, Error out=w1)
    }
    frame Error {
      w1 = $"Error in"
      w2 = $"PropertyTests in"
    }
  }
  $"PropertyTests out" <- w2
  $"Error out" <- w1
