vi "ExecutableSettings Test.gvi"   [LabVIEW NXG 5.0.0]
inputs:
  "PropertyTests in": "Executable Property Tests.gtype"
  "Error in": error
outputs:
  "PropertyTests out": "Executable Property Tests.gtype"
  "Error out": error
panel controls:
  "FormattedTestResult": "FormattedTestResult.gtype"
types:
  "FormattedTestResult.gtype" = cluster{"Class Under Test": string, "Test ID": string, "Pass-Fail": bool, "Detail": string}
uses:
  Hardware Abstraction Framework::Common::WriteExecutable.gtype::Write Executable Settings.gvi
  Hardware Abstraction Framework::Common::WriteExecutable.gtype::Read Executable Settings.gvi
  LabViewNXG Test Framework::Utilities::Set Value String.gvi
  LabViewNXG Test Framework::Common::AbstractTest.gtype::Process Result.gvi
diagram:
  case ($"Error in") {
    frame No Error {
      Build Array("ExecutableSetting.gtype" constant, "ExecutableSetting.gtype" constant, "ExecutableSetting.gtype" constant) -> w3
      call "Write Executable Settings.gvi"(Executable in="WriteExecutable.gtype" constant, Executable Settings=w3, Error in=$"Error in") -> (Executable out=w4, Error out=w5)
      call "Read Executable Settings.gvi"(Executable in=w4, Error in=w5) -> (Executable Settings=w6, Error out=w7)
      To Variant(anything=w6) -> w8
      Array Size(array=w6) -> (size(s)=w9)
      Format Into String(formatString="Array of %u ExecutableSettings", w9) -> w10
      call "Set Value String.gvi"(Variant with Value in=w8, String Value=w10, Error in=w7) -> (Variant with Value out=w11, Error out=w12)
      To Variant(anything=w3) -> w13
      call "Set Value String.gvi"(Variant with Value in=w13, String Value="Array of 3 ExecutableSettings", Error in=w12) -> (Variant with Value out=w14, Error out=w15)
      Property Node(instance in=$FormattedTestResult, "Class Under Test"="PropertyTests", "Test ID"="Verifies ExecutableSettings is set") -> (instance out=w16)
      call "Process Result.gvi"(Formatted Results=w16, AbstractTest in=$"PropertyTests in", Expected Result=w11, Actual Result=w14, Asserter="AssertEqual.gtype" constant, Error in=w15) -> (AbstractTest out=w2, Error out=w1)
    }
    frame Error {
      w1 = $"Error in"
      w2 = $"PropertyTests in"
    }
  }
  $"PropertyTests out" <- w2
  $"Error out" <- w1
