vi "Run All Tests.gvi"   [LabVIEW NXG 5.0.0]
# A framework method that must be overridden by each concrete test class and which exercises the code under test.
# If this method is not overridden it will raise error 100.
# See examples for variations of implementation of this method.
inputs:
  "PropertyTests in": "Executable Property Tests.gtype"
  "Error in": error
outputs:
  "PropertyTests out": "Executable Property Tests.gtype"
  "Error out": error
uses:
  Executable Property Tests.gtype::Timeout Test.gvi
  Executable Property Tests.gtype::Can Overlap Test.gvi
  Executable Property Tests.gtype::Byte Count Test.gvi
  Executable Property Tests.gtype::Parameters Test.gvi
  Executable Property Tests.gtype::ExecutableSettings Test.gvi
  Executable Property Tests.gtype::Driver Test.gvi
  Executable Property Tests.gtype::Raw Result Test.gvi
  Executable Property Tests.gtype::Block on Wait Test.gvi
diagram:
  call "Timeout Test.gvi"(PropertyTests in=$"PropertyTests in", Error in=$"Error in") -> (PropertyTests out=w1, Error out=w2)
  call "Can Overlap Test.gvi"(PropertyTests in=w1, Error in=w2) -> (PropertyTests out=w3, Error out=w4)
  call "Byte Count Test.gvi"(PropertyTests in=w3, Error in=w4) -> (PropertyTests out=w5, Error out=w6)
  call "Parameters Test.gvi"(PropertyTests in=w5, Error in=w6) -> (PropertyTests out=w7, Error out=w8)
  call "ExecutableSettings Test.gvi"(PropertyTests in=w7, Error in=w8) -> (PropertyTests out=w9, Error out=w10)
  call "Driver Test.gvi"(PropertyTests in=w9, Error in=w10) -> (PropertyTests out=w11, Error out=w12)
  call "Raw Result Test.gvi"(PropertyTests in=w11, Error in=w12) -> (PropertyTests out=w13, Error out=w14)
  call "Block on Wait Test.gvi"(Executable Property Tests in=w13, Error in=w14) -> (Executable Property Tests out=w15, Error out=w16)
  $"PropertyTests out" <- w15
  $"Error out" <- w16
