vi "Initialise Tests.gvi"   [LabVIEW NXG 5.0.0]
# This builds an array of all Test instances to run in this suite.  Update this method with an instance of the Test to add in the array.
# AbstractTest is used as an example and must be removed.
inputs:
  "Test Suite in": "ExecutablesTestSuite.gtype"
  "Error in": error
outputs:
  "Test Suite out": "ExecutablesTestSuite.gtype"
  "Error out": error
uses:
  LabViewNXG Test Framework::Common::AbstractTestSuite.gtype::Write Tests To Run.gvi
diagram:
  case ($"Error in") {
    frame No Error {
      Build Array("Executable Property Tests.gtype" constant, "Id Generation Test.gtype" constant, "Executable Process Tests.gtype" constant) -> w3
      call "Write Tests To Run.gvi"(AbstractTestSuite in=$"Test Suite in", Tests To Run=w3, Error in=$"Error in") -> (AbstractTestSuite out=w2, Error out=w1)
    }
    frame Error {
      w1 = $"Error in"
      w2 = $"Test Suite in"
    }
  }
  $"Error out" <- w1
  $"Test Suite out" <- w2
