vi "Initialise Test Suites.gvi"   [LabVIEW NXG 5.0.0]
# Overriden by concrete Test Coordinators to build a collection of Test Suites to run.  Each Test Suite class shuld be added to the “Build Array” node.  AbstractTestSuite is an example and must be removed.
inputs:
  "TestCoordinator in": "HAFTestCoordinator.gtype"
  "Error in": error
outputs:
  "TestCoordinator out": "HAFTestCoordinator.gtype"
  "Error out": error
uses:
  LabViewNXG Test Framework::Common::AbstractTestCoordinator.gtype::Write Test Suites To Run.gvi
diagram:
  case ($"Error in") {
    frame No Error {
      Build Array("MessagesTestSuite.gtype" constant, "SettingTestSuite.gtype" constant, "HelpersTestSuite.gtype" constant, "ExecutableProcessorTestSuite.gtype" constant, "ExecutableDirectorTestSuite.gtype" constant, "ExecutablesTestSuite.gtype" constant, "ParameterTestSuite.gtype" constant, "DriverTestSuite.gtype" constant) -> w3
      call "Write Test Suites To Run.gvi"(AbstractTestCoordinator in=$"TestCoordinator in", Test Suites To Run=w3, Error in=$"Error in") -> (AbstractTestCoordinator out=w2, Error out=w1)
    }
    frame Error {
      w1 = $"Error in"
      w2 = $"TestCoordinator in"
    }
  }
  $"TestCoordinator out" <- w2
  $"Error out" <- w1
