vi "Run All Tests.gvi"   [LabVIEW NXG 5.0.0]
# A framework method that must be overridden by each concrete test class and which exercises the code under test.
# If this method is not overridden it will raise error 100.
# See examples for variations of implementation of this method.
inputs:
  "GenerateUUIDTest in": "GenerateUUIDTest.gtype"
  "Error in": error
outputs:
  "GenerateUUIDTest out": "GenerateUUIDTest.gtype"
  "Error out": error
panel controls:
  "FormattedTestResult": "FormattedTestResult.gtype"
types:
  "FormattedTestResult.gtype" = cluster{"Class Under Test": string, "Test ID": string, "Pass-Fail": bool, "Detail": string}
uses:
  Hardware Abstraction Framework::Support::Helpers::Generate UUID.gvi
  LabViewNXG Test Framework::Utilities::Set Value String.gvi
  LabViewNXG Test Framework::Common::AbstractTest.gtype::Process Result.gvi
diagram:
  w1 = "([a-fA-F0-9]{8}-[a-fA-F0-9]{4}-[a-fA-F0-9]{4}-[a-fA-F0-9]{4}-[a-fA-F0-9]{12}){1}"
  case ($"Error in") {
    frame Error, Default {
      w2 = $"GenerateUUIDTest in"
      w3 = $"Error in"
    }
    frame No Error {
      call "Generate UUID.gvi"(Error In=$"Error in") -> (UUID=w4, Error Out=w5)
      Match Regular Expression(inputString=w4, regExpression=w1, errorIn=w5) -> (offsetPastMatch=w6, errorOut=w7)
      To Variant(anything=w6) -> w8
      Number To Decimal String(number=w6) -> (decimal integer string=w9)
      call "Set Value String.gvi"(Variant with Value in=w8, String Value=w9, Error in=w7) -> (Variant with Value out=w10, Error out=w11)
      Number To Decimal String(number=36) -> (decimal integer string=w12)
      To Variant(anything=36) -> w13
      call "Set Value String.gvi"(Variant with Value in=w13, String Value=w12, Error in=w11) -> (Variant with Value out=w14, Error out=w15)
      Property Node(instance in=$FormattedTestResult, "Class Under Test"="GenerateUUIDTest", "Test ID"="Verifies the UUID is the correct structure") -> (instance out=w16)
      call "Process Result.gvi"(Formatted Results=w16, AbstractTest in=$"GenerateUUIDTest in", Expected Result=w10, Actual Result=w14, Asserter="AssertEqual.gtype" constant, Error in=w15) -> (AbstractTest out=w2, Error out=w3)
    }
  }
  $"GenerateUUIDTest out" <- w2
  $"Error out" <- w3
