vi "Run All Tests.gvi"   [LabVIEW NXG 5.0.0]
# A framework method that must be overridden by each concrete test class and which exercises the code under test.
# If this method is not overridden it will raise error 100.
# See examples for variations of implementation of this method.
inputs:
  "CreateAllMessageQueuesTest in": "CreateAllMessageQueuesTest.gtype"
  "Error in": error
outputs:
  "CreateAllMessageQueuesTest out": "CreateAllMessageQueuesTest.gtype"
  "Error out": error
panel controls:
  "FormattedTestResult": "FormattedTestResult.gtype"
  "FormattedTestResult_2": "FormattedTestResult.gtype"
types:
  "FormattedTestResult.gtype" = cluster{"Class Under Test": string, "Test ID": string, "Pass-Fail": bool, "Detail": string}
uses:
  Hardware Abstraction Framework::Support::Messages::Create All Message Queues.gvi
  Hardware Abstraction Framework::Support::Messages::Dequeue Message.gvi
  LabViewNXG Test Framework::Utilities::Set Value String.gvi
  LabViewNXG Test Framework::Common::AbstractTest.gtype::Process Result.gvi
  NI::G Core::Error::Multiplex Errors.gvi
diagram:
  case ($"Error in") {
    frame Error, Default {
      w1 = $"CreateAllMessageQueuesTest in"
      w2 = $"Error in"
    }
    frame No Error {
      call "Create All Message Queues.gvi"(Error In=$"Error in") -> (Message Queues=w3, Error Out=w4)
      Property Node(instance in=w3) -> ("Internal"=w5, "Notifications"=w6)
      call "Dequeue Message.gvi"(Message Queue In=w5, Error In=w4) -> (Message Id=w7, Error Out=w8)
      To Variant(anything=w7) -> w9
      call "Set Value String.gvi"(Variant with Value in=w9, String Value=w7, Error in=w8) -> (Variant with Value out=w10, Error out=w11)
      Property Node(instance in=$FormattedTestResult, "Class Under Test"="CreateAllMessageQueues", "Test ID"="Returns initialised Internal Q") -> (instance out=w12)
      To Variant(anything="Initialise") -> w13
      call "Set Value String.gvi"(Variant with Value in=w13, String Value="Initialise", Error in=w11) -> (Variant with Value out=w14, Error out=w15)
      call "Process Result.gvi"(Formatted Results=w12, AbstractTest in=$"CreateAllMessageQueuesTest in", Expected Result=w10, Actual Result=w14, Asserter="AssertEqual.gtype" constant, Error in=w15) -> (AbstractTest out=w16, Error out=w17)
      call "Dequeue Message.gvi"(Message Queue In=w6, Error In=w4) -> (Message Id=w18, Error Out=w19)
      To Variant(anything=w18) -> w20
      call "Set Value String.gvi"(Variant with Value in=w20, String Value=w18, Error in=w19) -> (Variant with Value out=w21, Error out=w22)
      Property Node(instance in=$FormattedTestResult_2, "Class Under Test"="CreateAllMessageQueues", "Test ID"="Returns initialised Notification Q") -> (instance out=w23)
      To Variant(anything="Initialise") -> w24
      call "Set Value String.gvi"(Variant with Value in=w24, String Value="Initialise", Error in=w22) -> (Variant with Value out=w25, Error out=w26)
      call "Process Result.gvi"(Formatted Results=w23, AbstractTest in=w16, Expected Result=w21, Actual Result=w25, Asserter="AssertEqual.gtype" constant, Error in=w26) -> (AbstractTest out=w1, Error out=w27)
      call "Multiplex Errors.gvi"(error in 1=w17, error in 2=w27) -> (error out=w2)
    }
  }
  $"CreateAllMessageQueuesTest out" <- w1
  $"Error out" <- w2
