vi "Run All Tests.gvi"   [LabVIEW NXG 5.0.0]
# A framework method that must be overridden by each concrete test class and which exercises the code under test.
# If this method is not overridden it will raise error 100.
# See examples for variations of implementation of this method.
inputs:
  "EnqueueDequeueMessageTest in": "EnqueueDequeueMessageTest.gtype"
  "Error in": error
outputs:
  "EnqueueDequeueMessageTest out": "EnqueueDequeueMessageTest.gtype"
  "Error out": error
panel controls:
  "FormattedTestResult": "FormattedTestResult.gtype"
  "FormattedTestResult_2": "FormattedTestResult.gtype"
types:
  "FormattedTestResult.gtype" = cluster{"Class Under Test": string, "Test ID": string, "Pass-Fail": bool, "Detail": string}
uses:
  Hardware Abstraction Framework::Support::Messages::Create All Message Queues.gvi
  Hardware Abstraction Framework::Support::Messages::Dequeue Message.gvi
  Hardware Abstraction Framework::Support::Messages::Enqueue Message.gvi
  LabViewNXG Test Framework::Utilities::Set Value String.gvi
  LabViewNXG Test Framework::Common::AbstractTest.gtype::Process Result.gvi
  NI::G Core::Error::Multiplex Errors.gvi
diagram:
  case ($"Error in") {
    frame Error, Default {
      w1 = $"EnqueueDequeueMessageTest in"
      w2 = $"Error in"
    }
    frame No Error {
      # Dequeue initialise
      # message
      call "Create All Message Queues.gvi"(Error In=$"Error in") -> (Message Queues=w3, Error Out=w4)
      Property Node(instance in=w3) -> ("Internal"=w5)
      call "Dequeue Message.gvi"(Message Queue In=w5, Error In=w4) -> (Message Queue Out=w6, Error Out=w7)
      To Variant(anything=999) -> w8
      call "Enqueue Message.gvi"(Message Queue In=w6, Message Id="Test Message", Message Data=w8, Error In=w7) -> (Message Queue Out=w9, Error Out=w10)
      call "Dequeue Message.gvi"(Message Queue In=w9, Error In=w10) -> (Message Id=w11, Message Data=w12, Error Out=w13)
      To Variant(anything=w11) -> w14
      call "Set Value String.gvi"(Variant with Value in=w14, String Value=w11, Error in=w13) -> (Variant with Value out=w15, Error out=w16)
      Property Node(instance in=$FormattedTestResult, "Class Under Test"="EnequeueDequeueMessageTest", "Test ID"="Dequeues the same message id") -> (instance out=w17)
      To Variant(anything="Test Message") -> w18
      call "Set Value String.gvi"(Variant with Value in=w18, String Value="Test Message", Error in=w16) -> (Variant with Value out=w19, Error out=w20)
      call "Process Result.gvi"(Formatted Results=w17, AbstractTest in=$"EnqueueDequeueMessageTest in", Expected Result=w15, Actual Result=w19, Asserter="AssertEqual.gtype" constant, Error in=w20) -> (AbstractTest out=w21, Error out=w22)
      Variant To Data(type=i32 999, variant=w12) -> (data=w23)
      Number To Decimal String(number=w23) -> (decimal integer string=w24)
      call "Set Value String.gvi"(Variant with Value in=w12, String Value=w24, Error in=w13) -> (Variant with Value out=w25, Error out=w26)
      Property Node(instance in=$FormattedTestResult_2, "Class Under Test"="EnequeueDequeueMessageTest", "Test ID"="Dequeues the same message id") -> (instance out=w27)
      call "Set Value String.gvi"(Variant with Value in=w8, String Value="999", Error in=w26) -> (Variant with Value out=w28, Error out=w29)
      call "Process Result.gvi"(Formatted Results=w27, AbstractTest in=w21, Expected Result=w25, Actual Result=w28, Asserter="AssertEqual.gtype" constant, Error in=w29) -> (AbstractTest out=w1, Error out=w30)
      call "Multiplex Errors.gvi"(error in 1=w22, error in 2=w30) -> (error out=w2)
    }
  }
  $"EnqueueDequeueMessageTest out" <- w1
  $"Error out" <- w2
