vi "Run All Tests.gvi"   [LabVIEW NXG 5.0.0]
# A framework method that must be overridden by each concrete test class and which exercises the code under test.
# If this method is not overridden it will raise error 100.
# See examples for variations of implementation of this method.
inputs:
  "EnqueuePriorityMessage in": "EnqueuePriorityMessage.gtype"
  "Error in": error
outputs:
  "EnqueuePriorityMessage out": "EnqueuePriorityMessage.gtype"
  "Error out": error
panel controls:
  "FormattedTestResult": "FormattedTestResult.gtype"
types:
  "FormattedTestResult.gtype" = cluster{"Class Under Test": string, "Test ID": string, "Pass-Fail": bool, "Detail": string}
uses:
  Hardware Abstraction Framework::Support::Messages::Create All Message Queues.gvi
  Hardware Abstraction Framework::Support::Messages::Enqueue Message.gvi
  Hardware Abstraction Framework::Support::Messages::Dequeue Message.gvi
  LabViewNXG Test Framework::Utilities::Set Value String.gvi
  LabViewNXG Test Framework::Common::AbstractTest.gtype::Process Result.gvi
diagram:
  case ($"Error in") {
    frame Error, Default {
      w1 = $"EnqueuePriorityMessage in"
      w2 = $"Error in"
    }
    frame No Error {
      # Do not dequeue
      # initialise message
      call "Create All Message Queues.gvi"(Error In=$"Error in") -> (Message Queues=w3, Error Out=w4)
      Property Node(instance in=w3) -> ("Internal"=w5)
      call "Enqueue Message.gvi"(Priority?=TRUE, Message Queue In=w5, Message Id="Test Message", Error In=w4) -> (Message Queue Out=w6, Error Out=w7)
      call "Dequeue Message.gvi"(Message Queue In=w6, Error In=w7) -> (Message Id=w8, Error Out=w9)
      To Variant(anything=w8) -> w10
      call "Set Value String.gvi"(Variant with Value in=w10, String Value=w8, Error in=w9) -> (Variant with Value out=w11, Error out=w12)
      Property Node(instance in=$FormattedTestResult, "Class Under Test"="EnequeuePriorityMessageTest", "Test ID"="Dequeues the first message in the queue") -> (instance out=w13)
      To Variant(anything="Test Message") -> w14
      call "Set Value String.gvi"(Variant with Value in=w14, String Value="Test Message", Error in=w12) -> (Variant with Value out=w15, Error out=w16)
      call "Process Result.gvi"(Formatted Results=w13, AbstractTest in=$"EnqueuePriorityMessage in", Expected Result=w11, Actual Result=w15, Asserter="AssertEqual.gtype" constant, Error in=w16) -> (AbstractTest out=w1, Error out=w2)
    }
  }
  $"EnqueuePriorityMessage out" <- w1
  $"Error out" <- w2
