vi "Raw Result Test.gvi"   [LabVIEW NXG 5.0.0]
inputs:
  "Parameter Property Tests in": "Parameter Property Tests.gtype"
  "Error in": error
outputs:
  "Parameter Property Tests out": "Parameter Property Tests.gtype"
  "Error out": error
panel controls:
  "FormattedTestResult": "FormattedTestResult.gtype"
types:
  "FormattedTestResult.gtype" = cluster{"Class Under Test": string, "Test ID": string, "Pass-Fail": bool, "Detail": string}
uses:
  Hardware Abstraction Framework::Common::Parameter.gtype::Write Raw Result.gvi
  Hardware Abstraction Framework::Common::Parameter.gtype::Read Raw Result.gvi
  LabViewNXG Test Framework::Utilities::Set Value String.gvi
  LabViewNXG Test Framework::Common::AbstractTest.gtype::Process Result.gvi
diagram:
  case ($"Error in") {
    frame No Error {
      call "Write Raw Result.gvi"(Parameter in="Parameter.gtype" constant, Raw Result="a result", Error in=$"Error in") -> (Parameter out=w3, Error out=w4)
      call "Read Raw Result.gvi"(Parameter in=w3, Error in=w4) -> (Raw Result=w5, Error out=w6)
      To Variant(anything=w5) -> w7
      call "Set Value String.gvi"(Variant with Value in=w7, String Value=w5, Error in=w6) -> (Variant with Value out=w8, Error out=w9)
      To Variant(anything="a result") -> w10
      call "Set Value String.gvi"(Variant with Value in=w10, String Value="a result", Error in=w9) -> (Variant with Value out=w11, Error out=w12)
      Property Node(instance in=$FormattedTestResult, "Class Under Test"="Property Tests", "Test ID"="Verifies Raw Result is set") -> (instance out=w13)
      call "Process Result.gvi"(Formatted Results=w13, AbstractTest in=$"Parameter Property Tests in", Expected Result=w8, Actual Result=w11, Asserter="AssertEqual.gtype" constant, Error in=w12) -> (AbstractTest out=w2, Error out=w1)
    }
    frame Error {
      w1 = $"Error in"
      w2 = $"Parameter Property Tests in"
    }
  }
  $"Parameter Property Tests out" <- w2
  $"Error out" <- w1
