vi "Run All Tests.gvi"   [LabVIEW NXG 5.0.0]
# A framework method that must be overridden by each concrete test class and which exercises the code under test.
# If this method is not overridden it will raise error 100.
# See examples for variations of implementation of this method.
inputs:
  "Parameter Property Tests in": "Parameter Property Tests.gtype"
  "Error in": error
outputs:
  "Parameter Property Tests out": "Parameter Property Tests.gtype"
  "Error out": error
uses:
  Parameter Property Tests.gtype::Raw Result Test.gvi
  Parameter Property Tests.gtype::Name Test.gvi
diagram:
  call "Raw Result Test.gvi"(Parameter Property Tests in=$"Parameter Property Tests in", Error in=$"Error in") -> (Parameter Property Tests out=w1, Error out=w2)
  call "Name Test.gvi"(Parameter Property Tests in=w1, Error in=w2) -> (Parameter Property Tests out=w3, Error out=w4)
  $"Parameter Property Tests out" <- w3
  $"Error out" <- w4
