vi "Can Read Been Applied.gvi"   [LabVIEW NXG 5.0.0]
inputs:
  "DriverSettingTest in": "DriverSettingTest.gtype", required
  "Error in": error
outputs:
  "DriverSettingTest out": "DriverSettingTest.gtype"
  "Error out": error
panel controls:
  "FormattedTestResult": "FormattedTestResult.gtype"
types:
  "FormattedTestResult.gtype" = cluster{"Class Under Test": string, "Test ID": string, "Pass-Fail": bool, "Detail": string}
uses:
  Hardware Abstraction Framework::Common::DriverSetting.gtype::Write Been Applied.gvi
  LabViewNXG Test Framework::Utilities::Boolean To String.gvi
  LabViewNXG Test Framework::Utilities::Set Value String.gvi
  Hardware Abstraction Framework::Common::DriverSetting.gtype::Read Been Applied.gvi
  LabViewNXG Test Framework::Common::AbstractTest.gtype::Process Result.gvi
diagram:
  case ($"Error in") {
    frame No Error {
      Property Node(instance in=$"DriverSettingTest in") -> ("DriverSetting"=w4, instance out=w5)
      call "Write Been Applied.gvi"(DriverSetting in=w4, Been Applied=TRUE, Error in=$"Error in") -> (DriverSetting out=w6, Error out=w1)
      Property Node(instance in=w5, "DriverSetting"=w6) -> (instance out=w2)
      w3 = TRUE
    }
    frame Error {
      w1 = $"Error in"
      w2 = $"DriverSettingTest in"
      w3 = FALSE
    }
  }
  case (w1) {
    frame Error, Default {
      w7 = w2
      w8 = w1
    }
    frame No Error {
      call "Boolean To String.gvi"(Boolean in=w3) -> (String value=w9)
      To Variant(anything=w3) -> w10
      call "Set Value String.gvi"(Variant with Value in=w10, String Value=w9) -> (Variant with Value out=w11)
      Property Node(instance in=w2) -> ("DriverSetting"=w12)
      call "Read Been Applied.gvi"(DriverSetting in=w12, Error in=w1) -> (Been Applied=w13, Error out=w14)
      To Variant(anything=w13) -> w15
      call "Boolean To String.gvi"(Boolean in=w13) -> (String value=w16)
      call "Set Value String.gvi"(Variant with Value in=w15, String Value=w16, Error in=w14) -> (Variant with Value out=w17, Error out=w18)
      Property Node(instance in=$FormattedTestResult, "Class Under Test"="DriverSetting", "Test ID"="Can Read Been Applied") -> (instance out=w19)
      call "Process Result.gvi"(Formatted Results=w19, AbstractTest in=w2, Expected Result=w11, Actual Result=w17, Asserter="AssertTrue.gtype" constant, Error in=w18) -> (AbstractTest out=w7, Error out=w8)
    }
  }
  $"DriverSettingTest out" <- w7
  $"Error out" <- w8
