vi "Can Set Valid Value Type.gvi"   [LabVIEW NXG 5.0.0]
inputs:
  "DriverSettingTest in": "DriverSettingTest.gtype", required
  "Error in": error
outputs:
  "DriverSettingTest out": "DriverSettingTest.gtype"
  "Error out": error
panel controls:
  "FormattedTestResult": "FormattedTestResult.gtype"
types:
  "FormattedTestResult.gtype" = cluster{"Class Under Test": string, "Test ID": string, "Pass-Fail": bool, "Detail": string}
uses:
  Hardware Abstraction Framework::Common::DriverSetting.gtype::Write Value Type.gvi
  LabViewNXG Test Framework::Utilities::Set Value String.gvi
  Hardware Abstraction Framework::Common::DriverSetting.gtype::Read Value Type.gvi
  LabViewNXG Test Framework::Common::AbstractTest.gtype::Process Result.gvi
diagram:
  case ($"Error in") {
    frame No Error {
      Property Node(instance in=$"DriverSettingTest in") -> ("DriverSetting"=w4, instance out=w5)
      call "Write Value Type.gvi"(DriverSetting in=w4, Value Type="DBL", Error in=$"Error in") -> (DriverSetting out=w6, Error out=w1)
      Property Node(instance in=w5, "DriverSetting"=w6) -> (instance out=w2)
      w3 = "DBL"
    }
    frame Error {
      w1 = $"Error in"
      w2 = $"DriverSettingTest in"
      w3 = ""
    }
  }
  case (w1) {
    frame Error, Default {
      w7 = w2
      w8 = w1
    }
    frame No Error {
      To Variant(anything="DBL") -> w9
      call "Set Value String.gvi"(Variant with Value in=w9, String Value="DBL") -> (Variant with Value out=w10)
      Property Node(instance in=w2) -> ("DriverSetting"=w11)
      call "Read Value Type.gvi"(DriverSetting in=w11, Error in=w1) -> (Value Type=w12, Error out=w13)
      To Variant(anything=w12) -> w14
      call "Set Value String.gvi"(Variant with Value in=w14, String Value=w12, Error in=w13) -> (Variant with Value out=w15, Error out=w16)
      Property Node(instance in=$FormattedTestResult, "Class Under Test"="DriverSetting", "Test ID"="Can Set Valid Value Type") -> (instance out=w17)
      call "Process Result.gvi"(Formatted Results=w17, AbstractTest in=w2, Expected Result=w10, Actual Result=w15, Asserter="AssertEqual.gtype" constant, Error in=w16) -> (AbstractTest out=w7, Error out=w8)
    }
  }
  $"DriverSettingTest out" <- w7
  $"Error out" <- w8
