vi "Cannot Set Invalid Value Type.gvi"   [LabVIEW NXG 5.0.0]
inputs:
  "DriverSettingTest in": "DriverSettingTest.gtype", required
  "Error in": error
outputs:
  "DriverSettingTest out": "DriverSettingTest.gtype"
  "Error out": error
panel controls:
  "FormattedTestResult": "FormattedTestResult.gtype"
types:
  "FormattedTestResult.gtype" = cluster{"Class Under Test": string, "Test ID": string, "Pass-Fail": bool, "Detail": string}
uses:
  Hardware Abstraction Framework::Common::DriverSetting.gtype::Write Value Type.gvi
  NI::G Core::Error::Read Error Code.gvi
  LabViewNXG Test Framework::Utilities::Set Value String.gvi
  NI::G Core::Error::Build Error Cluster.gvi
  LabViewNXG Test Framework::Common::AbstractTest.gtype::Process Result.gvi
diagram:
  case ($"Error in") {
    frame No Error {
      Property Node(instance in=$"DriverSettingTest in") -> ("DriverSetting"=w3, instance out=w4)
      call "Write Value Type.gvi"(DriverSetting in=w3, Value Type="INV", Error in=$"Error in") -> (DriverSetting out=w5, Error out=w1)
      Property Node(instance in=w4, "DriverSetting"=w5) -> (instance out=w2)
    }
    frame Error {
      w1 = $"Error in"
      w2 = $"DriverSettingTest in"
    }
  }
  To Variant(anything=w1) -> w6
  call "Read Error Code.gvi"(error in=w1) -> (code=w7)
  Number To Decimal String(number=w7) -> (decimal integer string=w8)
  Concatenate Strings("Actual Error Code: ", w8) -> w9
  call "Set Value String.gvi"(Variant with Value in=w6, String Value=w9) -> (Variant with Value out=w10)
  Property Node(instance in=$FormattedTestResult, "Class Under Test"="DriverSetting", "Test ID"="Cannot Set Invalid Value Type") -> (instance out=w11)
  call "Build Error Cluster.gvi"(code=201, description="Exp. Error Code: 201") -> (error out=w12)
  To Variant(anything=w12) -> w13
  call "Set Value String.gvi"(Variant with Value in=w13, String Value="Exp. Error Code: 201") -> (Variant with Value out=w14)
  call "Process Result.gvi"(Formatted Results=w11, AbstractTest in=w2, Expected Result=w14, Actual Result=w10, Asserter="AssertErrorRaised.gtype" constant) -> (AbstractTest out=w15, Error out=w16)
  $"DriverSettingTest out" <- w15
  $"Error out" <- w16
