vi "GetDriverSetting.gvi"   [LabVIEW NXG 5.0.0]
inputs:
  "DriverSettingTest in": "DriverSettingTest.gtype", required
  "Error in": error
outputs:
  "DriverSettingRef": DataValueReference<"DriverSetting.gtype">
  "DriverSettingTest out": "DriverSettingTest.gtype"
  "Error out": error
diagram:
  case ($"Error in") {
    frame No Error {
      Property Node(instance in=$"DriverSettingTest in") -> ("DriverSetting"=w4, instance out=w2)
      New Data Value Reference(data value=w4, error in (no error)=$"Error in") -> (data value reference=w3, error out=w1)
    }
    frame Error {
      w1 = $"Error in"
      w2 = $"DriverSettingTest in"
      w3 = DataValueReference<"DriverSetting.gtype"> constant
    }
  }
  $"DriverSettingTest out" <- w2
  $DriverSettingRef <- w3
  $"Error out" <- w1
