vi "Run All Tests.gvi"   [LabVIEW NXG 5.0.0]
inputs:
  "DriverSettingTest in": "DriverSettingTest.gtype"
  "Error in": error
outputs:
  "DriverSettingTest out": "DriverSettingTest.gtype"
  "Error out": error
uses:
  DriverSettingTest.gtype::CanReadName.gvi
  DriverSettingTest.gtype::Can Read Value.gvi
  DriverSettingTest.gtype::Can Read Been Applied.gvi
  DriverSettingTest.gtype::Can Set Valid Value Type.gvi
  DriverSettingTest.gtype::Cannot Set Invalid Value Type.gvi
diagram:
  call "CanReadName.gvi"(DriverSettingTest in=$"DriverSettingTest in", Error in=$"Error in") -> (DriverSettingTest out=w1, Error out=w2)
  call "Can Read Value.gvi"(DriverSettingTest in=w1, Error in=w2) -> (DriverSettingTest out=w3, Error out=w4)
  call "Can Read Been Applied.gvi"(DriverSettingTest in=w3, Error in=w4) -> (DriverSettingTest out=w5, Error out=w6)
  call "Can Set Valid Value Type.gvi"(DriverSettingTest in=w5, Error in=w6) -> (DriverSettingTest out=w7, Error out=w8)
  call "Cannot Set Invalid Value Type.gvi"(DriverSettingTest in=w7, Error in=w8) -> (DriverSettingTest out=w9, Error out=w10)
  $"DriverSettingTest out" <- w9
  $"Error out" <- w10
