vi "Setup Test.gvi"   [LabVIEW NXG 5.0.0]
inputs:
  "DriverSettingTest in": "DriverSettingTest.gtype"
  "Error in": error
outputs:
  "DriverSettingTest out": "DriverSettingTest.gtype"
  "Error out": error
uses:
  LabViewNXG Test Framework::Common::AbstractTest.gtype::Setup Test.gvi
diagram:
  call parent "Setup Test.gvi"(AbstractTest in=$"DriverSettingTest in", Error in=$"Error in") -> (AbstractTest out=w1, Error out=w2)
  # Create new, default instance of DriverSetting
  Property Node(instance in="DriverSetting.gtype" constant, "Name"="", "Value"="", "Been Applied"=FALSE, "Value Type"="SGL", error in=w2) -> (error out=w3, instance out=w4)
  Property Node(instance in=w1, "DriverSetting"=w4) -> (instance out=w5)
  $"DriverSettingTest out" <- w5
  $"Error out" <- w3
