vi "Get Base Command.gvi"   [LabVIEW NXG 5.0.0]
# Returns the base command whch is used to build up the overall command string – parameters will be added to this as necessary.  The framework will add the line terminator \n.
inputs:
  "Measure in": "Measure.gtype"
  "Error in": error
outputs:
  "Base Command": string  # Returns the Base Command to be run. Parameters will be added to this as necessary. The framework will add the line terminator \n.
  "Measure out": "Measure.gtype"
  "Error out": error
uses:
  Hardware Abstraction Framework::Command::SCPI Acquire::Measure.gtype::Get Function.gvi
  Hardware Abstraction Framework::Command::SCPI Acquire::Measure.gtype::Get Buffer.gvi
diagram:
  case ($"Error in") {
    frame Error, Default {
      w1 = $"Error in"
      w2 = $"Measure in"
      w3 = default
    }
    frame No Error {
      call "Get Function.gvi"(Measure in=$"Measure in", Error in=$"Error in") -> (Measure out=w4, Function=w5, Error out=w6)
      Concatenate Strings(":MEAS", w5, "?") -> w7
      call "Get Buffer.gvi"(Measure in=w4, Error in=w6) -> (Measure out=w2, Buffer=w8, Error out=w1)
      Concatenate Strings(w7, w8) -> w3
    }
  }
  $"Measure out" <- w2
  $"Error out" <- w1
  $"Base Command" <- w3
