vi "Get Buffer.gvi"   [LabVIEW NXG 5.0.0]
# Returns the name of the buffer to be used by the Instrument to save the measured value.
inputs:
  "Measure in": "Measure.gtype"
  "Error in": error
outputs:
  "Buffer": string  # The name of the buffer results are to be saved to on the instrument.
  "Measure out": "Measure.gtype"
  "Error out": error
uses:
  Hardware Abstraction Framework::Common::Driver.gtype::Uses Buffer.gvi
  Hardware Abstraction Framework::Common::Driver.gtype::Get Default Buffer.gvi
  NI::G Core::Strings::Trim Whitespace.gvi
diagram:
  case ($"Error in") {
    frame No Error {
      Property Node(instance in=$"Measure in") -> ("Driver"=w4, instance out=w5)
      call "Uses Buffer.gvi"(Driver in=w4, Error in=$"Error in") -> (Driver out=w6, Uses Buffer=w7, Error out=w8)
      case (w7) {
        frame False, Default {
          # Buffers not used, so nothing to return
          w3 = ""
          w2 = w5
          w1 = w8
        }
        frame True {
          # Create the buffer parameter.  Add a final comma in case there are parameters: any redundant comma is removed by the framework.
          call "Get Default Buffer.gvi"(Driver in=w6, Error in=w8) -> (Buffer=w9, Error out=w1)
          Property Node(instance in=w5) -> ("Buffer Name"=w10, instance out=w2)
          call "Trim Whitespace.gvi"(string=w10) -> (trimmed string=w11)
          Is Empty String Or Path(string/path=w11) -> w12
          Not(x=w12) -> w13
          Select(s=w13, t=w11, f=w9) -> w14
          Concatenate Strings(" \"", w14, "\"", ",") -> w3
        }
      }
    }
    frame Error {
      w1 = $"Error in"
      w2 = $"Measure in"
      w3 = ""
    }
  }
  $"Measure out" <- w2
  $Buffer <- w3
  $"Error out" <- w1
