vi "Get Function.gvi"   [LabVIEW NXG 5.0.0]
# Returns a function name to insert into the command.  If none has been configured, then an empty string will be returned.
inputs:
  "Measure in": "Measure.gtype"
  "Error in": error
outputs:
  "Function": string  # The Function name to add into the Command.
  "Measure out": "Measure.gtype"
  "Error out": error
diagram:
  case ($"Error in") {
    frame No Error {
      w4 = ["", ":VOLT:DC", ":VOLT:AC", ":CURR:DC", ":CURR:AC", ":RES", ":FRES", ":DIOD", ":CAP", ":TEMP", ":CONT", ":FREQ", ":PER", ":VOLT:RAT"]
      Property Node(instance in=$"Measure in") -> ("Function"=w5, instance out=w2)
      Array Index(array=w4) -> (out0[w5]=w3)
      w1 = $"Error in"
    }
    frame Error {
      w1 = $"Error in"
      w2 = $"Measure in"
      w3 = default
    }
  }
  $Function <- w3
  $"Measure out" <- w2
  $"Error out" <- w1
