vi "Get Result as Double.gvi"   [LabVIEW NXG 5.0.0]
# Returns the Raw Result as a Double.  If the Raw Result is not compatible, then an error is raised.
inputs:
  "Measure in": "Measure.gtype"
  "Error in": error
outputs:
  "Measure out": "Measure.gtype"
  "Error out": error
panel indicators:
  "Result": f64  # The Raw Result converted to a Double.
uses:
  Hardware Abstraction Framework::Common::ReadExecutable.gtype::Read Raw Result.gvi
  Hardware Abstraction Framework::Support::Data Types::String To Double.gvi
diagram:
  case ($"Error in") {
    frame No Error {
      call "Read Raw Result.gvi"(ReadExecutable in=$"Measure in", Error in=$"Error in") -> (ReadExecutable out=w2, Raw Result=w4, Error out=w5)
      call "String To Double.gvi"(Value To Convert=w4, Error In=w5) -> (Double Value=w3, Error Out=w1)
    }
    frame Error {
      w1 = $"Error in"
      w2 = $"Measure in"
      w3 = default
    }
  }
  $"Measure out" <- w2
  $Result <- w3
  $"Error out" <- w1
