vi "Get Store.gvi"   [LabVIEW NXG 5.0.0]
# Returns the name of the Store to be used by the Instrument to save the measured value.
inputs:
  "Measure in": "Measure.gtype"
  "Error in": error
outputs:
  "Store": string  # The name of the store results are to be saved to on the instrument.
  "Measure out": "Measure.gtype"
  "Error out": error
uses:
  NI::G Core::Strings::Trim Whitespace.gvi
diagram:
  case ($"Error in") {
    frame No Error {
      Property Node(instance in=$"Measure in") -> ("Store Name"=w4, instance out=w2)
      call "Trim Whitespace.gvi"(string=w4) -> (trimmed string=w5)
      Is Empty String Or Path(string/path=w5) -> w6
      case (w6) {
        frame False, Default {
          # Create the name
          Concatenate Strings(" \"", w5, "\"") -> w3
        }
        frame True {
          # Nothing to do
          w3 = w5
        }
      }
      w1 = $"Error in"
    }
    frame Error {
      w1 = $"Error in"
      w2 = $"Measure in"
      w3 = default
    }
  }
  $"Measure out" <- w2
  $Store <- w3
  $"Error out" <- w1
