vi "Get Base Command.gvi"   [LabVIEW NXG 5.0.0]
# Returns the base command whch is used to build up the overall command string – parameters will be added to this as necessary.  The framework will add the line terminator \n.
# Subclasses MUST override this member and must not add a line terminator on the end of the command; on this class an error is returned.
inputs:
  "Instrument in": "Instrument.gtype"
  "Error in": error
outputs:
  "Base Command": string  # Returns the Base Command to be run. Parameters will be added to this as necessary. The framework will add the line terminator \n.
  "Instrument out": "Instrument.gtype"
  "Error out": error
uses:
  Hardware Abstraction Framework::Command::SCPI Generate::Instrument.gtype::Read Channel.gvi
diagram:
  call "Read Channel.gvi"(Instrument in=$"Instrument in", Error in=$"Error in") -> (Instrument out=w1, Channel=w2, Error out=w3)
  $"Instrument out" <- w1
  Format Into String(formatString="INST OUT%u", errIn=w3, w2) -> (outString=w4, errOut=w5)
  $"Base Command" <- w4
  $"Error out" <- w5
