vi "Get Base Command.gvi"   [LabVIEW NXG 5.0.0]
# Returns the base command whch is used to build up the overall command string – parameters will be added to this as necessary.  The framework will add the line terminator \n.
# Subclasses MUST override this member and must not add a line terminator on the end of the command; on this class an error is returned.
inputs:
  "Output in": "Output.gtype"
  "Error in": error
outputs:
  "Base Command": string  # Returns the Base Command to be run. Parameters will be added to this as necessary. The framework will add the line terminator \n.
  "Output out": "Output.gtype"
  "Error out": error
uses:
  Hardware Abstraction Framework::Command::SCPI Generate::Output.gtype::Read Control Master Switch.gvi
  Hardware Abstraction Framework::Command::SCPI Generate::Output.gtype::Read Output Switch.gvi
diagram:
  call "Read Control Master Switch.gvi"(Output in=$"Output in", Error in=$"Error in") -> (Control Master Switch=w1)
  Select(s=w1, t="OUTP ", f="OUTP:MAST  ") -> w2
  call "Read Output Switch.gvi"(Output in=$"Output in", Error in=$"Error in") -> (Output Switch=w3)
  Select(s=w3, t="ON", f="OFF") -> w4
  Concatenate Strings(w2, w4) -> w5
  $"Base Command" <- w5
  $"Output out" <- $"Output in"
  $"Error out" <- $"Error in"
