vi "Get Base Command.gvi"   [LabVIEW NXG 5.0.0]
# Returns the base command whch is used to build up the overall command string – parameters will be added to this as necessary.  The framework will add the line terminator \n.
# Subclasses MUST override this member and must not add a line terminator on the end of the command; on this class an error is returned.
inputs:
  "Voltage in": "Voltage.gtype"
  "Error in": error
outputs:
  "Base Command": string  # Returns the Base Command to be run. Parameters will be added to this as necessary. The framework will add the line terminator \n.
  "Voltage out": "Voltage.gtype"
  "Error out": error
uses:
  Hardware Abstraction Framework::Command::SCPI Generate::Voltage.gtype::Read Volts.gvi
diagram:
  call "Read Volts.gvi"(Voltage in=$"Voltage in", Error in=$"Error in") -> (Voltage out=w1, Volts=w2, Error out=w3)
  $"Voltage out" <- w1
  Format Into String(formatString="VOLT %f", errIn=w3, w2) -> (outString=w4, errOut=w5)
  $"Base Command" <- w4
  $"Error out" <- w5
