vi "Post-Exec Callout.gvi"   [LabVIEW NXG 5.0.0]
# Called at the end of the Processing of a specific executable so that additional code can be run.  The current value of Volts is incremented by Increment ready for the next Process of the command
inputs:
  "Voltage in": "Voltage.gtype"
  "Error in": error
outputs:
  "Voltage out": "Voltage.gtype"
  "Error out": error
uses:
  Hardware Abstraction Framework::Command::SCPI Generate::Voltage.gtype::Read Increment.gvi
  Hardware Abstraction Framework::Command::SCPI Generate::Voltage.gtype::Read Volts.gvi
  Hardware Abstraction Framework::Command::SCPI Generate::Voltage.gtype::Write Volts.gvi
diagram:
  case ($"Error in") {
    frame Error, Default {
      w1 = $"Error in"
      w2 = $"Voltage in"
    }
    frame No Error {
      call "Read Increment.gvi"(Voltage in=$"Voltage in", Error in=$"Error in") -> (Voltage out=w3, Increment=w4, Error out=w5)
      call "Read Volts.gvi"(Voltage in=w3, Error in=w5) -> (Voltage out=w6, Volts=w7, Error out=w8)
      case (w8) {
        frame Error, Default {
          w2 = w6
          w1 = w8
        }
        frame No Error {
          Add(w7, w4) -> w9
          call "Write Volts.gvi"(Voltage in=w6, Volts=w9, Error in=w8) -> (Voltage out=w2, Error out=w1)
        }
      }
    }
  }
  $"Voltage out" <- w2
  $"Error out" <- w1
