vi "Post-Exec Callout.gvi"   [LabVIEW NXG 5.0.0]
# Called at the end of the Processing of a specific executable so that additional code can be run.
# When the Reset command is run, any Driver Settings that were applied to the Instrument are also reset.  Need to reflect that back in the Driver Settings so that any follow-on commands can Commit them.
inputs:
  "RST in": "RST.gtype"
  "Error in": error
outputs:
  "RST out": "RST.gtype"
  "Error out": error
uses:
  Hardware Abstraction Framework::Common::WriteExecutable.gtype::Read Driver.gvi
  Hardware Abstraction Framework::Common::Driver.gtype::Decommit.gvi
  Hardware Abstraction Framework::Common::WriteExecutable.gtype::Write Driver.gvi
diagram:
  call "Read Driver.gvi"(Executable in=$"RST in", Error in=$"Error in") -> (Executable out=w1, Driver=w2, Error out=w3)
  call "Decommit.gvi"(Driver in=w2, Error in=w3) -> (Driver out=w4, Error out=w5)
  call "Write Driver.gvi"(Executable in=w1, Driver In=w4, Error in=w5) -> (Executable out=w6, Error out=w7)
  $"RST out" <- w6
  $"Error out" <- w7
