vi "Get Result as Double.gvi"   [LabVIEW NXG 5.0.0]
inputs:
  "User Defined Read in": "User Defined Read.gtype"
  "Error in": error
outputs:
  "Result": f64
  "User Defined Read out": "User Defined Read.gtype"
  "Error out": error
uses:
  Hardware Abstraction Framework::Common::ReadExecutable.gtype::Read Raw Result.gvi
  Hardware Abstraction Framework::Support::Data Types::String To Double.gvi
diagram:
  case ($"Error in") {
    frame No Error {
      call "Read Raw Result.gvi"(ReadExecutable in=$"User Defined Read in", Error in=$"Error in") -> (ReadExecutable out=w2, Raw Result=w4, Error out=w5)
      call "String To Double.gvi"(Value To Convert=w4, Error In=w5) -> (Double Value=w3, Error Out=w1)
    }
    frame Error {
      w1 = $"Error in"
      w2 = $"User Defined Read in"
      w3 = default
    }
  }
  $"User Defined Read out" <- w2
  $Result <- w3
  $"Error out" <- w1
