vi "Close.gvi"   [LabVIEW NXG 5.0.0]
# Close the Driver ensuring a clean disconnect / tidyup of Resource connections.
inputs:
  "Driver in": "Driver.gtype"
  "Error in": error
outputs:
  "Driver out": "Driver.gtype"
  "Error out": error
uses:
  Hardware Abstraction Framework::Common::Driver.gtype::Read VISA Session.gvi
  NI::VISA::Close (Instr).gvi
  Hardware Abstraction Framework::Common::Driver.gtype::Write Been Initialised.gvi
diagram:
  case ($"Error in") {
    frame No Error {
      call "Read VISA Session.gvi"(Driver in=$"Driver in", Error in=$"Error in") -> (Driver out=w3, VISA Session=w4, Error out=w5)
      call "Close (Instr).gvi"(session in=w4, error in=w5) -> (error out=w6)
      call "Write Been Initialised.gvi"(Driver in=w3, Been Initialised=FALSE, Error in=w6) -> (Driver out=w2, Error out=w1)
    }
    frame Error {
      w1 = $"Error in"
      w2 = $"Driver in"
    }
  }
  $"Driver out" <- w2
  $"Error out" <- w1
