vi "Commit.gvi"   [LabVIEW NXG 5.0.0]
# Iterates through Driver Settings for a specific Executable applying any that haven’t yet been applied.
inputs:
  "Driver in": "Driver.gtype"
  "Error in": error
outputs:
  "Driver out": "Driver.gtype"
  "Error out": error
uses:
  Hardware Abstraction Framework::Common::Driver.gtype::Read Driver Settings.gvi
  Hardware Abstraction Framework::Common::DriverSetting.gtype::Read Been Applied.gvi
  Hardware Abstraction Framework::Common::DriverSetting.gtype::Write Been Applied.gvi
  Hardware Abstraction Framework::Common::Driver.gtype::Write Driver Settings.gvi
diagram:
  case ($"Error in") {
    frame No Error {
      call "Read Driver Settings.gvi"(Driver in=$"Driver in", Error in=$"Error in") -> (Driver out=w3, Driver Settings=w4, Error out=w5)
      Get Variant Attribute[GetAllAttributes=True](error in=w5, variant=w4) -> (error out=w6, names=w7, values=w8, variant out=w9)
      s1 = w9  # shift register
      for {
        w10 = each element of w8
        w11 = each element of w7
        Variant To Data(error in (no error)=w6, type="DriverSetting.gtype" constant, variant=w10) -> (data=w12, error out=w13)
        call "Read Been Applied.gvi"(DriverSetting in=w12, Error in=w13) -> (DriverSetting out=w14, Been Applied=w15, Error out=w16)
        case (w15) {
          frame False, Default {
            # apply settings.
            call "Write Been Applied.gvi"(DriverSetting in=w14, Been Applied=TRUE, Error in=w16) -> (DriverSetting out=w17, Error out=w18)
          }
          frame True {
            # Do nothing as
            # already applied
            w17 = w14
            w18 = w16
          }
        }
        Set Variant Attribute(error in=w18, name=w11, value=w17, variant=s1) -> (error out=w19, variant out=w20)
        next s1 = w20
      }
      call "Write Driver Settings.gvi"(Driver in=w3, Driver Settings=s1, Error in=w19) -> (Driver out=w2, Error out=w1)
    }
    frame Error {
      w1 = $"Error in"
      w2 = $"Driver in"
    }
  }
  $"Driver out" <- w2
  $"Error out" <- w1
