vi "Decommit.gvi"   [LabVIEW NXG 5.0.0]
# Sets the status of all Driver Settings for this Driver to not applied.
inputs:
  "Driver in": "Driver.gtype"
  "Error in": error
outputs:
  "Driver out": "Driver.gtype"
  "Error out": error
uses:
  Hardware Abstraction Framework::Common::Driver.gtype::Read Driver Settings.gvi
  Hardware Abstraction Framework::Common::DriverSetting.gtype::Write Been Applied.gvi
  Hardware Abstraction Framework::Common::Driver.gtype::Write Driver Settings.gvi
diagram:
  case ($"Error in") {
    frame No Error {
      call "Read Driver Settings.gvi"(Driver in=$"Driver in", Error in=$"Error in") -> (Driver out=w3, Driver Settings=w4, Error out=w5)
      Get Variant Attribute[GetAllAttributes=True](error in=w5, variant=w4) -> (error out=w6, names=w7, values=w8, variant out=w9)
      s1 = w9  # shift register
      for {
        w10 = each element of w8
        w11 = each element of w7
        Variant To Data(error in (no error)=w6, type="DriverSetting.gtype" constant, variant=w10) -> (data=w12, error out=w13)
        call "Write Been Applied.gvi"(DriverSetting in=w12, Been Applied=FALSE, Error in=w13) -> (DriverSetting out=w14, Error out=w15)
        Set Variant Attribute(error in=w15, name=w11, value=w14, variant=s1) -> (error out=w16, variant out=w17)
        next s1 = w17
      }
      call "Write Driver Settings.gvi"(Driver in=w3, Driver Settings=s1, Error in=w16) -> (Driver out=w2, Error out=w1)
    }
    frame Error {
      w1 = $"Error in"
      w2 = $"Driver in"
    }
  }
  $"Driver out" <- w2
  $"Error out" <- w1
