vi "Execute Write Query.gvi"   [LabVIEW NXG 5.0.0]
# Using the passed Executable, sends a command to the Instrument.
# There are two methods for this:
# 	Immediate: the command is sent straight to the Instrument.  This is only possible for Executables that Can Overlap
# 	When Able: the Instrument is checked for already running commands and if any, the command is delayed until the running commands finish.
inputs:
  "Executable In": "WriteExecutable.gtype"  # The Executable to use for the Query.
  "Driver in": "Driver.gtype"
  "Error in": error
outputs:
  "Executable Out": "WriteExecutable.gtype"  # The Executable post Query execution.
  "Driver out": "Driver.gtype"
  "Error out": error
uses:
  Hardware Abstraction Framework::Common::WriteExecutable.gtype::Read Can Overlap.gvi
  Hardware Abstraction Framework::Common::Driver.gtype::Read VISA Session.gvi
  Hardware Abstraction Framework::Common::WriteExecutable.gtype::Read Block on Wait.gvi
  Hardware Abstraction Framework::Common::WriteExecutable.gtype::Read Timeout.gvi
  Hardware Abstraction Framework::Support::Query::Wait For Completion.gvi
  Hardware Abstraction Framework::Common::WriteExecutable.gtype::Build Command.gvi
  NI::VISA::Write (Instr, String).gvi
diagram:
  # If Executables can't overlap, then check that the last command has completed first before writing
  # the query.
  case ($"Error in") {
    frame No Error {
      call "Read Can Overlap.gvi"(Executable in=$"Executable In") -> (Executable out=w4, Can Overlap=w5)
      call "Read VISA Session.gvi"(Driver in=$"Driver in", Error in=$"Error in") -> (VISA Session=w6, Error out=w7)
      case (w5) {
        frame False, Default {
          call "Read Block on Wait.gvi"(WriteExecutable in=w4) -> (WriteExecutable out=w9, Block on Wait=w11)
          # "When Able"
          call "Read Timeout.gvi"(Executable in=w4) -> (Timeout=w12)
          call "Wait For Completion.gvi"(Session In=w6, BlockOnWait=w11, Timeout=w12, Error In=w7) -> (Session Out=w10, Error Out=w8)
        }
        frame True {
          # "Immediate" - no need to wait
          w8 = w7
          w9 = w4
          w10 = w6
        }
      }
      # Here, we could if necessary, map an 'Executable Command' to one specific to an instrument.  This would allow Executables to be generic across all Drivers, similar to Executable Settings.
      call "Build Command.gvi"(Executable in=w9, Error in=w8) -> (Executable out=w3, Command=w13, Error out=w14)
      call "Write (Instr, String).gvi"(session in=w10, error in=w14, write buffer=w13) -> (error out=w1)
      w2 = $"Driver in"
    }
    frame Error {
      w1 = $"Error in"
      w2 = $"Driver in"
      w3 = $"Executable In"
    }
  }
  $"Driver out" <- w2
  $"Error out" <- w1
  $"Executable Out" <- w3
