vi "Execute Write Read Query.gvi"   [LabVIEW NXG 5.0.0]
# Using the passed Executable, sends a command to the Instrument and reads the result.  Results are parsed into an Executable result and Parameter results depending upon how the Executable was configured to be processed.
inputs:
  "Read Executable In": "ReadExecutable.gtype"  # The Executable to use for the Query.
  "Driver in": "Driver.gtype"
  "Error in": error
outputs:
  "Raw Result": string  # The result returned from the Instrument without any processing.
  "Driver out": "Driver.gtype"
  "Error out": error
  "Read Executable Out": "ReadExecutable.gtype"  # The Executable post Query execution.
  "Raw Parameter Results": string[]  # A collection of results for Parameters used on the Executable.
uses:
  Hardware Abstraction Framework::Common::Driver.gtype::Execute Write Query.gvi
  Hardware Abstraction Framework::Common::Driver.gtype::Read VISA Session.gvi
  Hardware Abstraction Framework::Common::ReadExecutable.gtype::Read Byte Count.gvi
  NI::VISA::Read (Instr, String).gvi
  Hardware Abstraction Framework::Common::WriteExecutable.gtype::Read Parameters.gvi
  Hardware Abstraction Framework::Common::Driver.gtype::Parse Result.gvi
diagram:
  case ($"Error in") {
    frame No Error {
      call "Execute Write Query.gvi"(Driver in=$"Driver in", Executable In=$"Read Executable In", Error in=$"Error in") -> (Driver out=w6, Error out=w7)
      call "Read VISA Session.gvi"(Driver in=w6, Error in=w7) -> (Driver out=w8, VISA Session=w9, Error out=w10)
      call "Read Byte Count.gvi"(ReadExecutable in=$"Read Executable In") -> (ReadExecutable out=w11, Byte Count=w12)
      call "Read (Instr, String).gvi"(session in=w9, error in=w10, byte count=w12) -> (error out=w13, read buffer=w14)
      call "Read Parameters.gvi"(Executable in=w11) -> (Executable out=w4, Parameters=w15)
      Array Size(array=w15) -> (size(s)=w16)
      call "Parse Result.gvi"(Driver in=w8, Raw Result=w14, Number of Parameters=w16, Error in=w13) -> (Driver out=w2, Executable Raw Result=w3, Parameter Raw Result=w5, Error out=w1)
    }
    frame Error {
      w1 = $"Error in"
      w2 = $"Driver in"
      w3 = default
      w4 = $"Read Executable In"
      w5 = default
    }
  }
  $"Driver out" <- w2
  $"Raw Result" <- w3
  $"Error out" <- w1
  $"Raw Parameter Results" <- w5
  $"Read Executable Out" <- w4
