vi "Initialise.gvi"   [LabVIEW NXG 5.0.0]
# Configures the Driver to be ready to send commands to the Instrument.
inputs:
  "Driver in": "Driver.gtype"
  "Error in": error
outputs:
  "Driver out": "Driver.gtype"
  "Error out": error
panel controls:
  "Timeout": u32 = 2000  # Timeout, in milliseconds, to use for executing commands via the Driver. Defaults to 2000ms.
uses:
  Hardware Abstraction Framework::Common::Driver.gtype::Read Been Initialised.gvi
  Hardware Abstraction Framework::Common::Driver.gtype::Initiate Session.gvi
  Hardware Abstraction Framework::Common::Driver.gtype::Read VISA Session.gvi
  Hardware Abstraction Framework::Common::Driver.gtype::Write VISA Session.gvi
  Hardware Abstraction Framework::Common::Driver.gtype::Write Been Initialised.gvi
diagram:
  case ($"Error in") {
    frame No Error {
      call "Read Been Initialised.gvi"(Driver in=$"Driver in", Error in=$"Error in") -> (Driver out=w3, Been Initialised=w4, Error out=w5)
      case (w4) {
        frame False, Default {
          call "Initiate Session.gvi"(Driver in=w3, Error in=w5) -> (Driver out=w6, Error out=w7)
          call "Read VISA Session.gvi"(Driver in=w6, Error in=w7) -> (Driver out=w8, VISA Session=w9, Error out=w10)
          Property Node(instance in=w9, "Timeout"=$Timeout, error in=w10) -> (error out=w11, instance out=w12)
          call "Write VISA Session.gvi"(Driver in=w8, VISA Session=w12, Error in=w11) -> (Driver out=w13, Error out=w14)
          call "Write Been Initialised.gvi"(Driver in=w13, Been Initialised=TRUE, Error in=w14) -> (Driver out=w2, Error out=w1)
        }
        frame True {
          # Already initialised, do nothing.
          w2 = w3
          w1 = w5
        }
      }
    }
    frame Error {
      w1 = $"Error in"
      w2 = $"Driver in"
    }
  }
  $"Driver out" <- w2
  $"Error out" <- w1
