vi "Initiate Session.gvi"   [LabVIEW NXG 5.0.0]
# Creates a session for the Instrument that will be communicated with.
inputs:
  "Driver in": "Driver.gtype"
  "Error in": error
outputs:
  "Driver out": "Driver.gtype"
  "Error out": error
uses:
  Hardware Abstraction Framework::Common::Driver.gtype::Get Instrument Alias.gvi
  NI::VISA::Open (Instr).gvi
  Hardware Abstraction Framework::Common::Driver.gtype::Write VISA Session.gvi
diagram:
  case ($"Error in") {
    frame No Error {
      call "Get Instrument Alias.gvi"(Driver in=$"Driver in", Error in=$"Error in") -> (Instrument Alias=w3, Error out=w4)
      call "Open (Instr).gvi"(resource name=w3, error in=w4) -> (session out=w5, error out=w6)
      call "Write VISA Session.gvi"(Driver in=$"Driver in", VISA Session=w5, Error in=w6) -> (Driver out=w2, Error out=w1)
    }
    frame Error {
      w1 = $"Error in"
      w2 = $"Driver in"
    }
  }
  $"Driver out" <- w2
  $"Error out" <- w1
