vi "Map Executable Setting.gvi"   [LabVIEW NXG 5.0.0]
# Converts a passed Executable Setting Name to a Driver Setting Name that is recognisable by the Driver itself.  If not recognised by the Driver, “Ignored” is returned.
# Subclasses must create the mapping structure in order for this to work.
inputs:
  "Executable Setting Name": string  # Name of the Executable Setting to be mapped to the Drive Setting Name
  "Driver in": "Driver.gtype"
  "Error in": error
outputs:
  "Mapped Driver Name": string  # Driver Setting Name understood by this Driver. If not understood, it will read “Ignored”.
  "Driver out": "Driver.gtype"
  "Error out": error
  "Setting Data Type": string  # The data type for the Driver Setting
types:
  "Valid Data Types.gtype" = cluster{"U8": string, "U16": string, "U32": string, "U64": string, "I8": string, "I16": string, "I32": string, "I64": string, "SGL": string, "DBL": string, "String": string, "Boolean": string}
uses:
  Hardware Abstraction Framework::Common::Driver.gtype::Read Driver Setting Mappings.gvi
diagram:
  case ($"Error in") {
    frame No Error {
      call "Read Driver Setting Mappings.gvi"(Driver in=$"Driver in", Error in=$"Error in") -> (Driver out=w2, Driver Setting Mappings=w5, Error out=w1)
      # Iterates through the mapping structure until a match is found.  If no match, then "Ignore" is returned.
      for {
        w6 = each element of w5
        Property Node(instance in=w6) -> ("Driver Setting Name"=w7, "Driver Setting Data Type"=w8, "Executable Setting Name"=w9)
        Is Equal(x=w9, y=$"Executable Setting Name") -> w10
        case (w10) {
          frame False, Default {
            w11 = "Valid Data Types.gtype" {"U8"="U8", "U16"="U16", "U32"="U32", "U64"="U64", "I8"="I8", "I16"="I16", "I32"="I32", "I64"="I64", "SGL"="SGL", "DBL"="DBL", "String"="String", "Boolean"="Boolean"}
            Property Node(instance in=w11) -> ("String"=w4)
            w3 = "Ignore"
          }
          frame True {
            w3 = w7
            w4 = w8
          }
        }
        stop if w10
      }
    }
    frame Error {
      w1 = $"Error in"
      w2 = $"Driver in"
      w3 = "ERROR"
      w4 = "ERROR"
    }
  }
  $"Driver out" <- w2
  $"Mapped Driver Name" <- w3
  $"Setting Data Type" <- w4
  $"Error out" <- w1
