vi "Parse Result.gvi"   [LabVIEW NXG 5.0.0]
# Parses a result from an Instrument into its Executable and Parameter(s) constituents.  Subclasses should override this where instrument specific variation occurs.
# The parent implementation assumes the following:
# 	If no parameters are used then the result is solely for the Executable
# 	The result is tokenised on “,”
# 	If parameters are used, and the number of tokens = num parameters, result is solely for the parameters
# 	If the number of tokens = num parameters + 1, the first token is for the executable and the reminaing for parameters.
# 	Parameter tokens are loaded, in order, to a parameter array.
# The Executable is responsible for dealing with the Executable Raw Result and Parameter Raw Result array.
inputs:
  "Raw Result": string  # The unprocessed raw result from the command execution.
  "Driver in": "Driver.gtype"
  "Error in": error
  "Number of Parameters": u32
outputs:
  "Executable Raw Result": string
  "Driver out": "Driver.gtype"
  "Error out": error
  "Parameter Raw Result": string[]
uses:
  Hardware Abstraction Framework::Utilities::Tokenise String.gvi
diagram:
  # If no parameters are used then the result is solely for the Executable
  #
  # The result is tokenised on “,”
  #
  # If parameters are used, and the number of tokens = num parameters, result is solely for the parameters
  #
  # If the number of tokens = num parameters + 1, the first token is for the executable and the remaining for parameters.
  #
  # Otherwise, they are all for Parameters and let the user's test app work it out.
  #
  # Parameter tokens are loaded, in order, to a parameter array.
  case ($"Error in") {
    frame No Error {
      Is Equal To 0(x=$"Number of Parameters") -> w5
      case (w5) {
        frame False, Default {
          call "Tokenise String.gvi"(String to Parse=$"Raw Result", Error In=$"Error in") -> (Tokens=w6, Token Count=w7, Error Out=w1)
          Is Equal(x=$"Number of Parameters", y=w7) -> w8
          # Result includes parameters
          case (w8) {
            frame False, Default {
              Increment(x=$"Number of Parameters") -> w9
              Is Equal(x=w9, y=w7) -> w10
              case (w10) {
                frame False, Default {
                  # Unknown, all for Parameters
                  w3 = ""
                  w4 = w6
                }
                frame True {
                  # Result incl. Executable and Parameters
                  Split 1D Array(array=w6, index=1) -> (first subarray=w11, second subarray=w4)
                  Array Index(array=w11) -> (out0[0]=w3)
                }
              }
            }
            frame True {
              # All Parameter results
              w4 = w6
              w3 = ""
            }
          }
        }
        frame True {
          # Result if solely for Executable
          w3 = $"Raw Result"
          w4 = string[] []
          w1 = $"Error in"
        }
      }
      w2 = $"Driver in"
    }
    frame Error {
      w1 = $"Error in"
      w2 = $"Driver in"
      w3 = ""
      w4 = string[] []
    }
  }
  $"Driver out" <- w2
  $"Executable Raw Result" <- w3
  $"Parameter Raw Result" <- w4
  $"Error out" <- w1
