vi "Read Driver Setting Mappings.gvi"   [LabVIEW NXG 5.0.0]
# Returns the current set of Driver Setting mappings.  Builds this if an empty array.
inputs:
  "Driver in": "Driver.gtype"
  "Error in": error
outputs:
  "Driver Setting Mappings": "Setting Map Structure.gtype"[]  # The currently set Driver Setting Mappings array.
  "Driver out": "Driver.gtype"
  "Error out": error
types:
  "Setting Map Structure.gtype" = cluster{"Executable Setting Name": string, "Driver Setting Name": string, "Driver Setting Data Type": string}
uses:
  Hardware Abstraction Framework::Common::Driver.gtype::Build Driver Setting Mappings.gvi
  Hardware Abstraction Framework::Common::Driver.gtype::Write Driver Setting Mappings.gvi
diagram:
  case ($"Error in") {
    frame No Error {
      Property Node(instance in=$"Driver in") -> ("Driver Setting Mappings"=w4, instance out=w5)
      Array Size(array=w4) -> (size(s)=w6)
      Is Equal To 0(x=w6) -> w7
      case (w7) {
        frame False, Default {
          w3 = w4
          w2 = w5
          w1 = $"Error in"
        }
        frame True {
          call "Build Driver Setting Mappings.gvi"(Driver in=w5, Error in=$"Error in") -> (Driver out=w8, Driver Setting Mappings=w3, Error out=w9)
          call "Write Driver Setting Mappings.gvi"(Driver in=w8, Driver Setting Mappings=w3, Error in=w9) -> (Driver out=w2, Error out=w1)
        }
      }
    }
    frame Error {
      w1 = $"Error in"
      w2 = $"Driver in"
      w3 = default
    }
  }
  $"Driver Setting Mappings" <- w3
  $"Driver out" <- w2
  $"Error out" <- w1
