vi "Read Driver Settings.gvi"   [LabVIEW NXG 5.0.0]
# Returns all the Driver Settings held by this Driver.  If the Driver Settings has not been set up, then initialises the Variant.
# Driver Settings acts like a Dictionary data type.  The entries are stored as named attributes.
inputs:
  "Driver in": "Driver.gtype"
  "Error in": error
outputs:
  "Driver Settings": variant  # The collection of Driver Settings.
  "Driver out": "Driver.gtype"
  "Error out": error
uses:
  NI::G Core::Data Type::Get Type Information.gvi
  Hardware Abstraction Framework::Common::Driver.gtype::Write Driver Settings.gvi
diagram:
  case ($"Error in") {
    frame No Error {
      Property Node(instance in=$"Driver in") -> ("Driver Settings"=w4, instance out=w5)
      call "Get Type Information.gvi"(variant=w4, error in=$"Error in") -> (type=w6, error out=w7)
      Is Equal(x=w6, y="String") -> w8
      case (w8) {
        frame True {
          w2 = w5
          w1 = w7
          w3 = w4
        }
        frame False {
          To Variant(anything="Driver Settings") -> w9
          # Need to set up the base variant.
          call "Write Driver Settings.gvi"(Driver in=w5, Driver Settings=w9, Error in=w7) -> (Driver out=w10, Error out=w1)
          Property Node(instance in=w10) -> ("Driver Settings"=w3, instance out=w2)
        }
      }
    }
    frame Error {
      w1 = $"Error in"
      w2 = $"Driver in"
      w3 = default
    }
  }
  $"Driver out" <- w2
  $"Driver Settings" <- w3
  $"Error out" <- w1
