vi "Remove Driver Settings.gvi"   [LabVIEW NXG 5.0.0]
# Removes the Driver Settings for the given Executable Settings from the collection.  The number removed is returned.
inputs:
  "Executable Id": string  # Id of the Executable that uses the Driver setting.
  "Driver in": "Driver.gtype"
  "Error in": error
  "Executable Settings": "ExecutableSetting.gtype"[]  # One or more Executable Setting objects to be removed from the collection of Driver Settings.
outputs:
  "Removed Count": u32  # The total number of Settings removed.
  "Driver out": "Driver.gtype"
  "Error out": error
uses:
  Hardware Abstraction Framework::Common::Driver.gtype::Read Driver Settings.gvi
  Hardware Abstraction Framework::Common::Setting.gtype::Read Name.gvi
  Hardware Abstraction Framework::Common::Driver.gtype::Write Driver Settings.gvi
diagram:
  case ($"Error in") {
    frame No Error {
      call "Read Driver Settings.gvi"(Driver in=$"Driver in", Error in=$"Error in") -> (Driver out=w3, Driver Settings=w4, Error out=w5)
      w6 = 0  # Removed Count
      s1 = w4  # shift register
      s2 = w6  # shift register
      for {
        w7 = each element of $"Executable Settings"
        call "Read Name.gvi"(Setting in=w7) -> (Name=w8)
        Concatenate Strings($"Executable Id", w8) -> w9
        Delete Variant Attribute(error in=w5, name=w9, variant in=s1) -> (error out=w10, found=w11, variant out=w12)
        Select(s=w11, t=1, f=0) -> w13
        Add(w13, s2) -> w14
        next s1 = w12
        next s2 = w14
      }
      call "Write Driver Settings.gvi"(Driver in=w3, Driver Settings=s1, Error in=w10) -> (Driver out=w2, Error out=w1)
      $"Removed Count" <- s2
    }
    frame Error {
      w1 = $"Error in"
      w2 = $"Driver in"
    }
  }
  $"Driver out" <- w2
  $"Error out" <- w1
