vi "Update Driver Settings.gvi"   [LabVIEW NXG 5.0.0]
# Updates the Driver Settings collection from the given Executable Settings.  These are mapped first.  Reports on the number added or updated.
inputs:
  "Executable Id": string, required  # Id of the Executable that uses this setting.
  "Driver in": "Driver.gtype"
  "Error in": error
  "Executable Settings": "ExecutableSetting.gtype"[], required  # One or more Executable Setting objects that will be used to configure the Driver.
outputs:
  "Settings Added": u32  # The total number of Settings Added.
  "Driver out": "Driver.gtype"
  "Error out": error
  "Settings Updated": u32  # Total number of Settings updated.
uses:
  Hardware Abstraction Framework::Common::Driver.gtype::Map Executable Setting.gvi
  Hardware Abstraction Framework::Common::Driver.gtype::Read Driver Settings.gvi
  Hardware Abstraction Framework::Common::Driver.gtype::Write Driver Settings.gvi
diagram:
  # Loops around all Executable Settings, mapping each to a Driver Setting including type.
  # A count is kept of all those Driver Settings replaced; the total Executable Settings minus
  # the number replaced is the number Added.
  case ($"Error in") {
    frame No Error {
      s1 = $"Driver in"  # shift register
      s2 = 0  # shift register
      for {
        w4 = each element of $"Executable Settings"
        Property Node(instance in=w4) -> ("Name"=w5, "Value"=w6)
        call "Map Executable Setting.gvi"(Driver in=s1, Executable Setting Name=w5, Error in=$"Error in") -> (Driver out=w7, Mapped Driver Name=w8, Setting Data Type=w9, Error out=w10)
        case (w10) {
          frame Error, Default {
            w1 = w10
            w11 = s2
            w12 = w7
          }
          frame No Error {
            call "Read Driver Settings.gvi"(Driver in=w7, Error in=w10) -> (Driver out=w13, Driver Settings=w14, Error out=w15)
            Property Node(instance in="DriverSetting.gtype" constant, "Name"=w8, "Value Type"=w9, "Value"=w6, "Been Applied"=FALSE) -> (instance out=w16)
            Concatenate Strings($"Executable Id", w5) -> w17
            Set Variant Attribute(error in=w15, name=w17, value=w16, variant=w14) -> (error out=w18, replaced=w19, variant out=w20)
            call "Write Driver Settings.gvi"(Driver in=w13, Driver Settings=w20, Error in=w18) -> (Driver out=w12, Error out=w1)
            Select(s=w19, t=1, f=0) -> w21
            Add(w21, s2) -> w11
          }
        }
        next s1 = w12
        next s2 = w11
      }
      w2 = s1
      w3 = s2
    }
    frame Error {
      w1 = $"Error in"
      w2 = $"Driver in"
      w3 = 0
    }
  }
  $"Driver out" <- w2
  $"Error out" <- w1
  $"Settings Updated" <- w3
  Array Size(array=$"Executable Settings") -> (size(s)=w22)
  Subtract(x=w22, y=w3) -> w23
  $"Settings Added" <- w23
