vi "Is Value Type Valid.gvi"   [LabVIEW NXG 5.0.0]
# Returns True if the passed value is in the list of valid Value Types for the Data Setting.  If the value passed is just whitespace, it checks against the stored Value Type property.
inputs:
  "Value Type to Check": string  # The Value Type value to check for validity. If whitespace, then the check is performed on the property Value Type
  "DriverSetting in": "DriverSetting.gtype"
  "Error in": error
outputs:
  "Is Valid": bool  # Returns true if the passed value type is in the list of acceptable Types.
  "DriverSetting out": "DriverSetting.gtype"
  "Error out": error
types:
  "Valid Data Types.gtype" = cluster{"U8": string, "U16": string, "U32": string, "U64": string, "I8": string, "I16": string, "I32": string, "I64": string, "SGL": string, "DBL": string, "String": string, "Boolean": string}
uses:
  NI::G Core::Strings::Trim Whitespace.gvi
diagram:
  case ($"Error in") {
    frame No Error {
      call "Trim Whitespace.gvi"(string=$"Value Type to Check") -> (trimmed string=w4)
      Is Empty String Or Path(string/path=w4) -> w5
      # Valid Data Types as array
      case (w5) {
        frame False, Default {
          w2 = $"DriverSetting in"
          w6 = w4
        }
        frame True {
          Property Node(instance in=$"DriverSetting in") -> ("Value Type"=w6, instance out=w2)
        }
      }
      w7 = "Valid Data Types.gtype" {"U8"="U8", "U16"="U16", "U32"="U32", "U64"="U64", "I8"="I8", "I16"="I16", "I32"="I32", "I64"="I64", "SGL"="SGL", "DBL"="DBL", "String"="String", "Boolean"="Boolean"}
      Cluster To Array(cluster=w7) -> (array=w8)
      Search 1D Array(1D array=w8, element=w6) -> (index of element=w9)
      Is Not Equal(x=w9, y=-1) -> w3
      w1 = $"Error in"
    }
    frame Error {
      w1 = $"Error in"
      w2 = $"DriverSetting in"
      w3 = default
    }
  }
  $"DriverSetting out" <- w2
  $"Is Valid" <- w3
  $"Error out" <- w1
