vi "Write Value Type.gvi"   [LabVIEW NXG 5.0.0]
# Saves a new data type for the value of this Driver Setting.  The data type must be in the list of Valid Data Types otherwise an error is raised.
inputs:
  "Value Type": string, required  # Saves a new data type for the value of this Driver Setting.
  "DriverSetting in": "DriverSetting.gtype"
  "Error in": error
outputs:
  "DriverSetting out": "DriverSetting.gtype"
  "Error out": error
uses:
  Hardware Abstraction Framework::Common::DriverSetting.gtype::Is Value Type Valid.gvi
  NI::G Core::Error::Build Error Cluster.gvi
  NI::G Core::Error::Multiplex Errors.gvi
diagram:
  case ($"Error in") {
    frame No Error {
      call "Is Value Type Valid.gvi"(DriverSetting in=$"DriverSetting in", Value Type to Check=$"Value Type", Error in=$"Error in") -> (DriverSetting out=w3, Is Valid=w4, Error out=w5)
      case (w4) {
        frame False, Default {
          call "Build Error Cluster.gvi"(code=201, description="Invalid Value Type on Driver Setting") -> (error out=w6)
          call "Multiplex Errors.gvi"(error in 1=w6, error in 2=w5) -> (error out=w1)
          w2 = w3
        }
        frame True {
          Property Node(instance in=w3, "Value Type"=$"Value Type") -> (instance out=w2)
          w1 = w5
        }
      }
    }
    frame Error {
      w1 = $"Error in"
      w2 = $"DriverSetting in"
    }
  }
  $"DriverSetting out" <- w2
  $"Error out" <- w1
