vi "Add Executable.gvi"   [LabVIEW NXG 5.0.0]
# Adds an Executable to the end of the current collection.
inputs:
  "Executable": "WriteExecutable.gtype"  # The Executable instance to add.
  "ExecutableDirector in": "ExecutableDirector.gtype"
  "Error in": error
  "Index": i32 = -1  # The index position to add into the collection. If 0 then adds at the end.
outputs:
  "ExecutableDirector out": "ExecutableDirector.gtype"
  "Error out": error
diagram:
  case ($"Error in") {
    frame No Error {
      Property Node(instance in=$"ExecutableDirector in") -> ("Executables"=w3, instance out=w4)
      case ($Index) {
        frame -1 {
          Insert Into Array(inArray=w3, new=$Executable) -> w5
        }
        frame 0, Default {
          Insert Into Array(inArray=w3, index0=$Index, new=$Executable) -> w5
        }
      }
      Property Node(instance in=w4, "Executables"=w5) -> (instance out=w2)
      w1 = $"Error in"
    }
    frame Error {
      w1 = $"Error in"
      w2 = $"ExecutableDirector in"
    }
  }
  $"ExecutableDirector out" <- w2
  $"Error out" <- w1
