vi "Has Run Once.gvi"   [LabVIEW NXG 5.0.0]
# Returns True if the Executable Director has run its Executables at least once
inputs:
  "ExecutableDirector in": "ExecutableDirector.gtype"
  "Error in": error
outputs:
  "Has Run Once?": bool  # Returns True if the Executable Director has run its Executables at least once.
  "ExecutableDirector out": "ExecutableDirector.gtype"
  "Error out": error
diagram:
  case ($"Error in") {
    frame No Error {
      Property Node(instance in=$"ExecutableDirector in") -> ("Run Count"=w4, instance out=w2)
      Is Greater(x=w4, y=0) -> w3
      w1 = $"Error in"
    }
    frame Error {
      w1 = $"Error in"
      w2 = $"ExecutableDirector in"
      w3 = default
    }
  }
  $"ExecutableDirector out" <- w2
  $"Has Run Once?" <- w3
  $"Error out" <- w1
