vi "Increment Run Count.gvi"   [LabVIEW NXG 5.0.0]
# Increments the run count which keeps track of how many times the Executable Director has processed its Executables.
inputs:
  "ExecutableDirector in": "ExecutableDirector.gtype"
  "Error in": error
outputs:
  "ExecutableDirector out": "ExecutableDirector.gtype"
  "Error out": error
diagram:
  case ($"Error in") {
    frame No Error {
      Property Node(instance in=$"ExecutableDirector in") -> ("Run Count"=w3, instance out=w4)
      Increment(x=w3) -> w5
      Property Node(instance in=w4, "Run Count"=w5) -> (instance out=w2)
      w1 = $"Error in"
    }
    frame Error {
      w1 = $"Error in"
      w2 = $"ExecutableDirector in"
    }
  }
  $"ExecutableDirector out" <- w2
  $"Error out" <- w1
