vi "Process Executables.gvi"   [LabVIEW NXG 5.0.0]
# Processes each Executable in turn.  If a Wait Time is set, delays that many milliseconds between each Executable – not before the first command or after the last command.
inputs:
  "Results Notifier": Notifier<"ReadExecutable.gtype">  # Notifier for returning results to the Test Application.
  "ExecutableDirector in": "ExecutableDirector.gtype"
  "Error in": error
outputs:
  "ExecutableDirector out": "ExecutableDirector.gtype"
  "Error out": error
uses:
  Hardware Abstraction Framework::Common::WriteExecutable.gtype::Process.gvi
  Hardware Abstraction Framework::Common::ExecutableDirector.gtype::Write Executables.gvi
  Hardware Abstraction Framework::Common::ExecutableDirector.gtype::Increment Run Count.gvi
diagram:
  case ($"Error in") {
    frame No Error {
      Property Node(instance in=$"ExecutableDirector in") -> ("Executables"=w3, "Wait Time"=w4)
      Array Size(array=w3) -> (size(s)=w5)
      Decrement(x=w5) -> w6
      # Process each Executable.  Excepting the last Executable, wait the given amount of time
      # before processing the next one.
      s1 = w3  # shift register
      for (iteration -> i1) {
        w7 = each element of w3
        call "Process.gvi"(WriteExecutable in=w7, Results Notifier=$"Results Notifier", Error in=$"Error in") -> (WriteExecutable out=w8, Error out=w9)
        Replace Array Subset(inArray=s1, index=i1, new=w8) -> w10
        Is Equal(x=w6, y=i1) -> w11
        case (w11) {
          frame False, Default {
            Wait(time to wait=w4)
          }
          frame True {
            Wait(time to wait=100)
          }
        }
        next s1 = w10
      }
      call "Write Executables.gvi"(ExecutableDirector in=$"ExecutableDirector in", Executables=s1, Error in=w9) -> (ExecutableDirector out=w12, Error out=w13)
      # As NXG works by-value, need to collect the updated Executables and write them back to the Director.
      call "Increment Run Count.gvi"(ExecutableDirector in=w12, Error in=w13) -> (ExecutableDirector out=w2, Error out=w1)
    }
    frame Error {
      w1 = $"Error in"
      w2 = $"ExecutableDirector in"
    }
  }
  $"ExecutableDirector out" <- w2
  $"Error out" <- w1
