vi "Read Id.gvi"   [LabVIEW NXG 5.0.0]
# Returns the Director’s Id.  If blank, the sets a new one based on a generated UUID.
inputs:
  "ExecutableDirector in": "ExecutableDirector.gtype"
  "Error in": error
outputs:
  "Id": string  # The Director’s Id.
  "ExecutableDirector out": "ExecutableDirector.gtype"
  "Error out": error
uses:
  Hardware Abstraction Framework::Support::Helpers::Generate UUID.gvi
  Hardware Abstraction Framework::Common::ExecutableDirector.gtype::Write Id.gvi
diagram:
  case ($"Error in") {
    frame No Error {
      Property Node(instance in=$"ExecutableDirector in") -> ("Id"=w4)
      Is Empty String Or Path(string/path=w4) -> w5
      case (w5) {
        frame False, Default {
          w1 = $"Error in"
          w3 = w4
          w2 = $"ExecutableDirector in"
        }
        frame True {
          call "Generate UUID.gvi"(Error In=$"Error in") -> (UUID=w3, Error Out=w6)
          call "Write Id.gvi"(ExecutableDirector in=$"ExecutableDirector in", Id=w3, Error in=w6) -> (ExecutableDirector out=w2, Error out=w1)
        }
      }
    }
    frame Error {
      w1 = $"Error in"
      w2 = $"ExecutableDirector in"
      w3 = default
    }
  }
  $"ExecutableDirector out" <- w2
  $Id <- w3
  $"Error out" <- w1
