vi "Remove Executable.gvi"   [LabVIEW NXG 5.0.0]
# Given an Id, finds and removes the Executable from the collection that this Director holds. Returns an indication of whether the Executable was found or not and if it was, the Executable itself.
inputs:
  "Executable Id": string  # Id of the Executable to remove.
  "ExecutableDirector in": "ExecutableDirector.gtype"
  "Error in": error
outputs:
  "Executable Removed": "WriteExecutable.gtype"  # The Executable that was removed.
  "ExecutableDirector out": "ExecutableDirector.gtype"
  "Error out": error
  "Removed?": bool  # Indicates if the Executable was found and removed.
diagram:
  case ($"Error in") {
    frame No Error {
      Property Node(instance in=$"ExecutableDirector in") -> ("Executables"=w3, instance out=w4)
      for (iteration -> i1) {
        w5 = each element of w3
        Property Node(instance in=w5) -> ("Id"=w6, instance out=w7)
        Is Equal(x=w6, y=$"Executable Id") -> w8
        case (w8) {
          frame False, Default {
            w9 = FALSE
            w10 = w3
          }
          frame True {
            $"Executable Removed" <- w7
            Delete From Array(inArray=w3, index0=i1) -> w10
            $"Removed?" <- TRUE
            w9 = TRUE
          }
        }
        stop if w9
      }
      Property Node(instance in=w4, "Executables"=w10) -> (instance out=w2)
      w1 = $"Error in"
    }
    frame Error {
      w1 = $"Error in"
      w2 = $"ExecutableDirector in"
    }
  }
  $"ExecutableDirector out" <- w2
  $"Error out" <- w1
