vi "Should Continue.gvi"   [LabVIEW NXG 5.0.0]
# Returns True if the Director should continue to process Executables.  Subclasses should implement their own version.
# Typically, it will return True if the set of executables should be processed again.  It is called by the framework at the end of one complete run through of Executables.
# For the ExecutableDirector, it will return false after it has run through its Executables once.
inputs:
  "ExecutableDirector in": "ExecutableDirector.gtype"
  "Error in": error
outputs:
  "Should Continue?": bool  # Returns False when this Director has processed its Executables once.
  "ExecutableDirector out": "ExecutableDirector.gtype"
  "Error out": error
uses:
  Hardware Abstraction Framework::Common::ExecutableDirector.gtype::Has Run Once.gvi
diagram:
  case ($"Error in") {
    frame No Error {
      call "Has Run Once.gvi"(ExecutableDirector in=$"ExecutableDirector in", Error in=$"Error in") -> (Has Run Once?=w3, Error out=w1)
      Not(x=w3) -> w4
      $"Should Continue?" <- w4
      w2 = $"ExecutableDirector in"
    }
    frame Error {
      w1 = $"Error in"
      w2 = $"ExecutableDirector in"
    }
  }
  $"ExecutableDirector out" <- w2
  $"Error out" <- w1
