vi "Add Director.gvi"   [LabVIEW NXG 5.0.0]
# Adds an Executable Director into the collection for processing.  The Director can be added in at a specific index if required.
inputs:
  "ExecutableDirector": "ExecutableDirector.gtype"  # The Executable Director to add into the collection.
  "ExecutableProcessor in": "ExecutableProcessor.gtype"
  "Error in": error
  "Index": i32 = -1  # The index into the collection to add the Director. Use -1 to add to the end (default)
outputs:
  "ExecutableProcessor out": "ExecutableProcessor.gtype"
  "Error out": error
diagram:
  case ($"Error in") {
    frame No Error {
      Property Node(instance in=$"ExecutableProcessor in") -> ("Directors"=w3)
      case ($Index) {
        frame -1 {
          Insert Into Array(inArray=w3, new=$ExecutableDirector) -> w4
        }
        frame 0, Default {
          Insert Into Array(inArray=w3, index0=$Index, new=$ExecutableDirector) -> w4
        }
      }
      Property Node(instance in=$"ExecutableProcessor in", "Directors"=w4) -> (instance out=w2)
      w1 = $"Error in"
    }
    frame Error {
      w1 = $"Error in"
      w2 = $"ExecutableProcessor in"
    }
  }
  $"ExecutableProcessor out" <- w2
  $"Error out" <- w1
