vi "Background Process Directors.gvi"   [LabVIEW NXG 5.0.0]
# Calls the Process Directors member asynchronously, without waiting for a result (Process Director notifies results.)  Using this approach means the User Test Application UI isn’t blocked by long-running Executables and can remain responsive to result notifications.
inputs:
  "Wait Time": u32  # The wait time, in milliseconds, between each Executable Director. Default is not to wait at all.
  "ExecutableProcessor in": "ExecutableProcessor.gtype"
  "Error in": error
outputs:
  "ExecutableProcessor out": "ExecutableProcessor.gtype"
  "Error out": error
diagram:
  case ($"Error in") {
    frame No Error {
      w3 = "Hardware Abstraction Framework::Common::ExecutableProcessor.gtype::Process Directors.gvi"
      Open VI Reference[CallOptions=AsynchronousCallWithoutWait](error in=$"Error in", type specifier VI reference=StrictVIRefnum<"function Process Directors.gvi"> constant, vi name=w3) -> (error out=w4, vi reference=w5)
      Call By Reference[CallByReferenceLoadType=0, CallByReferenceStyle=1](L0=$"ExecutableProcessor in", L1=$"Wait Time", L3=w4, error in=w4, #ri=w5) -> (error out=w1)
      w2 = $"ExecutableProcessor in"
    }
    frame Error {
      w1 = $"Error in"
      w2 = $"ExecutableProcessor in"
    }
  }
  $"Error out" <- w1
  $"ExecutableProcessor out" <- w2
