vi "Process Directors.gvi"   [LabVIEW NXG 5.0.0]
# Processes all Executable Directors until they complete.  This member will respond to events to Pause, Resume, and Stop.  Results will be notified on the Notification queue.
inputs:
  "Wait Time": u32  # The wait time, in milliseconds, between each Executable Director. Default is not to wait at all.
  "ExecutableProcessor in": "ExecutableProcessor.gtype", required
  "Error in": error
  "Results Notifier": Notifier<"ReadExecutable.gtype">  # Notifier for returning results to the Test Application.
outputs:
  "ExecutableProcessor out": "ExecutableProcessor.gtype"
  "Error out": error
types:
  "All Internal Message Ids.gtype" = cluster{"Initialise": string, "Stop": string, "Done": string, "Exit": string, "Process": string, "Continue": string, "Pause": string, "Resume": string}
  "All Notification Message Ids.gtype" = cluster{"Initialise": string, "Exit": string, "Error": string, "Result": string, "Done": string}
uses:
  Hardware Abstraction Framework::Support::Messages::Reset Message Queue.gvi
  Hardware Abstraction Framework::Support::Messages::Dequeue Message.gvi
  NI::G Core::Error::Build Error Cluster.gvi
  Hardware Abstraction Framework::Common::ExecutableDirector.gtype::Initialise.gvi
  Hardware Abstraction Framework::Support::Messages::Enqueue Message.gvi
  Hardware Abstraction Framework::Common::ExecutableDirector.gtype::Should Continue.gvi
  Hardware Abstraction Framework::Common::ExecutableDirector.gtype::Process Executables.gvi
  Hardware Abstraction Framework::Support::Events::Raise Done Event.gvi
  Hardware Abstraction Framework::Common::ExecutableDirector.gtype::Read Executables.gvi
  Hardware Abstraction Framework::Common::WriteExecutable.gtype::Cleanup.gvi
  Hardware Abstraction Framework::Support::Helpers::Error Handling - Process Error.gvi
diagram:
  w1 = "Hardware Abstraction Framework::Support::Resources.grsc::MessageQueues"
  Tag Read(ref in=w1) -> (Data=w2)
  # The Executable Processor will listen for Stop events to discontinue processing.  It using the Internal queue for framework messages and Notifications queue to send messages to the calling application (typically, results.)
  Property Node(instance in=w2) -> ("Internal"=w3, "Notifications"=w4)
  call "Reset Message Queue.gvi"(Message Queue In=w3) -> (Message Queue Out=w5)
  # Main Processing loop.  Waits for messages to appear on the queue and then processes it.  In many respects, it resembles a State Machine in that each processed message, adds another to the queue so that processing will continue in the next iteration.
  s1 = $"ExecutableProcessor in"  # shift register
  while {
    call "Dequeue Message.gvi"(Message Queue In=w5, Error In=$"Error in") -> (Timed Out?=w6, Message Queue Out=w7, Message Id=w8, Message Data=w9, Error Out=w10)
    # Case options should include "All Internal Messages" as a minimum
    # Waits for next message. Queue is reset with Initialise message.
    case (w8) {
      frame Default {
        w14 = "Framework timed-out waiting for an action to be initiated. %s"
        w15 = "An unknown message - %s -was added to the internal queue used by the framework."
        Select(s=w6, t=w14, f=w15) -> w16
        # An unknown message was added to the queue
        Format Into String(initString=w16, w8) -> w17
        call "Build Error Cluster.gvi"(code=203, description=w17) -> (error out=w12)
        w11 = default
        w13 = s1
      }
      frame "Initialise" {
        w18 = "All Internal Message Ids.gtype" {"Initialise"="Initialise", "Stop"="Stop", "Done"="Done", "Exit"="Exit", "Process"="Process", "Continue"="Continue", "Pause"="Pause", "Resume"="Resume"}
        Property Node(instance in=w18) -> ("Process"=w19)
        Property Node(instance in=s1) -> ("Directors"=w20)
        # Initialises all Executable Directors
        for {
          w21 = each element of w20
          call "Initialise.gvi"(ExecutableDirector in=w21, Error in=w10) -> (Error out=w23)
          append w23 to w22
        }
        Merge Errors(w10, w22) -> (error out=w24)
        call "Enqueue Message.gvi"(Message Queue In=w7, Message Id=w19, Error In=w24) -> (Error Out=w12)
        w11 = default
        w13 = s1
      }
      frame "Process" {
        Property Node(instance in=s1) -> ("Directors"=w25)
        s2 = w25  # shift register
        for (iteration -> i1) {
          w26 = each element of w25
          call "Should Continue.gvi"(ExecutableDirector in=w26, Error in=w10) -> (ExecutableDirector out=w27, Should Continue?=w28, Error out=w29)
          # Should Continue? is checked here, as well as state "Continue" in case there are Directors that have completed before others - these shouldn't be processed.
          case (w28) {
            frame False, Default {
              # This particular Director has Done so do nothing.
              w30 = w29
              w31 = w27
            }
            frame True {
              call "Process Executables.gvi"(ExecutableDirector in=w27, Results Notifier=$"Results Notifier", Error in=w29) -> (ExecutableDirector out=w31, Error out=w30)
              Array Size(array=w25) -> (size(s)=w32)
              Decrement(x=w32) -> w33
              Is Equal(x=w33, y=i1) -> w34
              # Process each Executable Director in turn, once.  If it isn't the last, wait as requested before running the next one.
              case (w34) {
                frame False, Default {
                  Wait(time to wait=$"Wait Time")
                }
                frame True { }
              }
            }
          }
          Replace Array Subset(inArray=s2, index=i1, new=w31) -> w35
          next s2 = w35
        }
        w36 = "All Internal Message Ids.gtype" {"Initialise"="Initialise", "Stop"="Stop", "Done"="Done", "Exit"="Exit", "Process"="Process", "Continue"="Continue", "Pause"="Pause", "Resume"="Resume"}
        Property Node(instance in=w36) -> ("Continue"=w37)
        call "Enqueue Message.gvi"(Message Queue In=w7, Message Id=w37, Error In=w10) -> (Error Out=w38)
        Merge Errors(w38, w30) -> (error out=w12)
        # Because of NXG object processing by value, then changes to Executable Directors must be collected and written back to the Processor.
        Property Node(instance in=s1, "Directors"=s2) -> (instance out=w13)
        w11 = default
      }
      frame "Continue" {
        Property Node(instance in=s1) -> ("Directors"=w39)
        # Ask all Exectuable Directors if they should continue; when all respond false then we're done.  Any that are done will not get processed just because one or more are not yet finished.
        # An incoming stop message that occurs during processing will prevent this state executing as it will be 'higher' in the queue.  So a Stop message is only handled once all ED Executables have processed.
        s3 = FALSE  # shift register
        for {
          w40 = each element of w39
          call "Should Continue.gvi"(ExecutableDirector in=w40, Error in=w10) -> (Should Continue?=w42, Error out=w43)
          Logical Or(s3, w42) -> w44
          append w43 to w41
          next s3 = w44
        }
        Merge Errors(w10, w41) -> (error out=w45)
        w46 = "All Internal Message Ids.gtype" {"Initialise"="Initialise", "Stop"="Stop", "Done"="Done", "Exit"="Exit", "Process"="Process", "Continue"="Continue", "Pause"="Pause", "Resume"="Resume"}
        Property Node(instance in=w46) -> ("Process"=w47)
        w48 = "All Internal Message Ids.gtype" {"Initialise"="Initialise", "Stop"="Stop", "Done"="Done", "Exit"="Exit", "Process"="Process", "Continue"="Continue", "Pause"="Pause", "Resume"="Resume"}
        Property Node(instance in=w48) -> ("Done"=w49)
        Select(s=s3, t=w47, f=w49) -> w50
        call "Enqueue Message.gvi"(Message Queue In=w7, Message Id=w50, Error In=w45) -> (Error Out=w12)
        w11 = default
        w13 = s1
      }
      frame "Done" {
        w51 = "All Notification Message Ids.gtype" {"Initialise"="Initialise", "Exit"="Exit", "Error"="Error", "Result"="Result", "Done"="Done"}
        Property Node(instance in=w51) -> ("Done"=w52)
        # Need to signal the Done event so that the Framework starts the processing shutdown cleanly.  Adds a Done message to the Notification Queue so the application knows as well.
        call "Enqueue Message.gvi"(Message Queue In=w4, Message Id=w52, Error In=w10) -> (Error Out=w53)
        call "Raise Done Event.gvi"(Send Done?=TRUE, Raiser Name="Process Directors", Error In=w53) -> (Error Out=w54)
        w55 = "All Internal Message Ids.gtype" {"Initialise"="Initialise", "Stop"="Stop", "Done"="Done", "Exit"="Exit", "Process"="Process", "Continue"="Continue", "Pause"="Pause", "Resume"="Resume"}
        Property Node(instance in=w55) -> ("Stop"=w56)
        call "Enqueue Message.gvi"(Priority?=TRUE, Message Queue In=w7, Message Id=w56, Error In=w54) -> (Error Out=w12)
        w11 = default
        w13 = s1
      }
      frame "Pause" {
        # Clear the internal queue and wait for a Resume message to appear.  The queue is reset as Pause messages are raised at the front of the queue (high priority) and we don't want to process any messages that were in the queue originally.
        #
        # Note that the processing only pauses after the current run through of Executable Directors completes.
        Flush Queue(error in=w10, queue=w7) -> (error out=w12)
        w11 = default
        w13 = s1
      }
      frame "Resume" {
        w57 = "All Internal Message Ids.gtype" {"Initialise"="Initialise", "Stop"="Stop", "Done"="Done", "Exit"="Exit", "Process"="Process", "Continue"="Continue", "Pause"="Pause", "Resume"="Resume"}
        # On a Resume, continue processing.
        Property Node(instance in=w57) -> ("Continue"=w58)
        call "Enqueue Message.gvi"(Message Queue In=w7, Message Id=w58, Error In=w10) -> (Error Out=w12)
        w11 = default
        w13 = s1
      }
      frame "Stop" {
        w59 = "All Internal Message Ids.gtype" {"Initialise"="Initialise", "Stop"="Stop", "Done"="Done", "Exit"="Exit", "Process"="Process", "Continue"="Continue", "Pause"="Pause", "Resume"="Resume"}
        Property Node(instance in=w59) -> ("Exit"=w60)
        # Processing should Stop.  Send an Exit message to ensure clean shutdown.
        call "Enqueue Message.gvi"(Priority?=TRUE, Message Queue In=w7, Message Id=w60, Error In=w10) -> (Error Out=w12)
        w11 = default
        w13 = s1
      }
      frame "Exit" {
        Property Node(instance in=s1) -> ("Directors"=w61)
        # Processing will exit.  Ensure a clean shutdown.  All Executables are asked to cleanup which performs a controlled shutdown of Drivers.
        for {
          w62 = each element of w61
          call "Read Executables.gvi"(ExecutableDirector in=w62, Error in=w10) -> (Executables=w63, Error out=w64)
          for {
            w65 = each element of w63
            call "Cleanup.gvi"(WriteExecutable in=w65, Error in=w64) -> (Error out=w12)
          }
        }
        w11 = TRUE
        w13 = s1
      }
    }
    call "Error Handling - Process Error.gvi"(Error to Process=w12, Exit on Error?=TRUE)
    next s1 = w13
    stop if w11
  }
  w66 = "Hardware Abstraction Framework::Support::Resources.grsc::Events"
  Tag Read(ref in=w66) -> (Data=w67)
  Property Node(instance in=w67) -> ("Stop Event"=w68, "Done Event"=w69, "Pause Event"=w70, "Resume Event"=w71)
  # Listen for the named events raised by the framework or application.
  Register For Events("Stop"=w68, "Done"=w69, "Pause"=w70, "Resume"=w71) -> (event registration refnum out=w72)
  # Event loop: loops until Stop event raised.
  # When Processing Errors,
  # the Main Loop will Exit as
  # the app may be in an unknown state.  The Event Loop will send an Error message to the Message Handler.
  while {
    event (dynamic events = w72) {
      on dynamic event 0 {
        w75 = "All Internal Message Ids.gtype" {"Initialise"="Initialise", "Stop"="Stop", "Done"="Done", "Exit"="Exit", "Process"="Process", "Continue"="Continue", "Pause"="Pause", "Resume"="Resume"}
        Property Node(instance in=w75) -> ("Stop"=w76)
        call "Enqueue Message.gvi"(Priority?=TRUE, Message Queue In=w5, Message Id=w76) -> (Error Out=w74)
        # Stop event occurred.  Notify Main Processing Loop
        w73 = TRUE
      }
      on dynamic event 1 {
        # When Done is notified, then the event loop can stop.  Note that the Main Processing Loop is already stopping of its own accord and doesn't need notifying.  It also notifies the using application.
        w73 = TRUE
        w74 = default
      }
      on dynamic event 2 {
        w77 = "All Internal Message Ids.gtype" {"Initialise"="Initialise", "Stop"="Stop", "Done"="Done", "Exit"="Exit", "Process"="Process", "Continue"="Continue", "Pause"="Pause", "Resume"="Resume"}
        Property Node(instance in=w77) -> ("Pause"=w78)
        # Pause event occurred.  Notify Main Processing Loop
        call "Enqueue Message.gvi"(Priority?=TRUE, Message Queue In=w5, Message Id=w78) -> (Error Out=w74)
        w73 = default
      }
      on dynamic event 3 {
        w79 = "All Internal Message Ids.gtype" {"Initialise"="Initialise", "Stop"="Stop", "Done"="Done", "Exit"="Exit", "Process"="Process", "Continue"="Continue", "Pause"="Pause", "Resume"="Resume"}
        Property Node(instance in=w79) -> ("Resume"=w80)
        # Resume event occurred, notify Main Processing Loop
        call "Enqueue Message.gvi"(Priority?=TRUE, Message Queue In=w5, Message Id=w80) -> (Error Out=w74)
        w73 = default
      }
    }
    call "Error Handling - Process Error.gvi"(Error to Process=w74, Exit on Error?=FALSE)
    stop if w73
  }
  # Finally, deregister from events
  Unregister For Events(error in=w74, event registration refnum=w72) -> (error out=w81)
  Merge Errors(w81, w12) -> (error out=w82)
  $"Error out" <- w82
  $"ExecutableProcessor out" <- s1
