vi "RemoveDirector.gvi"   [LabVIEW NXG 5.0.0]
# Given an Id, finds and removes the Executable Director from the collection that this Processor holds. Returns an indication of whether the Executable Director was found or not and if it was, the Executable Director itself.
inputs:
  "Executable Director Id": string  # Id of the Executable Director to remove.
  "ExecutableProcessor in": "ExecutableProcessor.gtype"
  "Error in": error
outputs:
  "Executable Director Removed": "ExecutableDirector.gtype"  # If found, the Executable Director removed.
  "ExecutableProcessor out": "ExecutableProcessor.gtype"
  "Error out": error
  "Removed?": bool  # Indicates if the Executable Director was found and removed.
diagram:
  case ($"Error in") {
    frame No Error {
      Property Node(instance in=$"ExecutableProcessor in") -> ("Directors"=w3, instance out=w4)
      for (iteration -> i1) {
        w5 = each element of w3
        Property Node(instance in=w5) -> ("Id"=w6, instance out=w7)
        Is Equal(x=w6, y=$"Executable Director Id") -> w8
        case (w8) {
          frame False, Default {
            w9 = FALSE
            w10 = w3
          }
          frame True {
            $"Executable Director Removed" <- w7
            Delete From Array(inArray=w3, index0=i1) -> w10
            $"Removed?" <- TRUE
            w9 = TRUE
          }
        }
        stop if w9
      }
      Property Node(instance in=w4, "Directors"=w10) -> (instance out=w2)
      w1 = $"Error in"
    }
    frame Error {
      w1 = $"Error in"
      w2 = $"ExecutableProcessor in"
    }
  }
  $"ExecutableProcessor out" <- w2
  $"Error out" <- w1
