vi "Get Result as Date.gvi"   [LabVIEW NXG 5.0.0]
# Returns the Raw Result as a Date-only Timestamp.  If the Raw Result is not compatible, then an error is raised.
inputs:
  "Parameter in": "Parameter.gtype"
  "Error in": error
outputs:
  "Result": timestamp  # The Raw Result converted to a Date only timestamp.
  "Parameter out": "Parameter.gtype"
  "Error out": error
uses:
  Hardware Abstraction Framework::Common::Parameter.gtype::Read Raw Result.gvi
  Hardware Abstraction Framework::Support::Data Types::String To Date.gvi
diagram:
  case ($"Error in") {
    frame No Error {
      call "Read Raw Result.gvi"(Parameter in=$"Parameter in", Error in=$"Error in") -> (Parameter out=w2, Raw Result=w4, Error out=w5)
      call "String To Date.gvi"(Value To Convert=w4, Error In=w5) -> (Date Value=w3, Error Out=w1)
    }
    frame Error {
      w1 = $"Error in"
      w2 = $"Parameter in"
      w3 = default
    }
  }
  $"Parameter out" <- w2
  $Result <- w3
  $"Error out" <- w1
