vi "Get Result as Timestamp.gvi"   [LabVIEW NXG 5.0.0]
# Returns the Raw Result as a Timestamp.  If the Raw Result is not compatible, then an error is raised.
# Milliseconds can be provided if requested; the result will always have a millisecond component although it will be zero if not requested.
inputs:
  "Parameter in": "Parameter.gtype"
  "Error in": error
outputs:
  "Result": timestamp  # The Raw Result converted to a Timestamp, with or without milliseconds.
  "Parameter out": "Parameter.gtype"
  "Error out": error
panel controls:
  "Use Milliseconds": bool = TRUE  # If set to True, then a millisecond value will be converted out of the String.
uses:
  Hardware Abstraction Framework::Common::Parameter.gtype::Read Raw Result.gvi
  Hardware Abstraction Framework::Support::Data Types::String To Timestamp.gvi
diagram:
  case ($"Error in") {
    frame No Error {
      call "Read Raw Result.gvi"(Parameter in=$"Parameter in", Error in=$"Error in") -> (Parameter out=w2, Raw Result=w4, Error out=w5)
      call "String To Timestamp.gvi"(Value To Convert=w4, Use Milliseconds=$"Use Milliseconds", Error In=w5) -> (Timestamp Value=w3, Error Out=w1)
    }
    frame Error {
      w1 = $"Error in"
      w2 = $"Parameter in"
      w3 = default
    }
  }
  $"Parameter out" <- w2
  $Result <- w3
  $"Error out" <- w1
