vi "Post Result.gvi"   [LabVIEW NXG 5.0.0]
# Posts the result (complete Executable with Raw Result set) onto the Notification Queue so that clients can pick it up and process it.
inputs:
  "Results Notifier": Notifier<"ReadExecutable.gtype">  # Notifier for returning results to the Test Application.
  "ReadExecutable in": "ReadExecutable.gtype"
  "Error in": error
outputs:
  "ReadExecutable out": "ReadExecutable.gtype"
  "Error out": error
types:
  "All Notification Message Ids.gtype" = cluster{"Initialise": string, "Exit": string, "Error": string, "Result": string, "Done": string}
uses:
  Hardware Abstraction Framework::Support::Messages::Enqueue Message.gvi
diagram:
  case ($"Error in") {
    frame No Error {
      Get Notifier Status(error in (no error)=$"Error in", notifier=$"Results Notifier") -> (error out=w3, notifier out=w4, number waiting=w5)
      Is Equal To 0(x=w5) -> w6
      Logical Or(w6, w3) -> w7
      case (w7) {
        frame True {
          w8 = "Hardware Abstraction Framework::Support::Resources.grsc::MessageQueues"
          Tag Read(ref in=w8) -> (Data=w9)
          Property Node(instance in=w9) -> ("Notifications"=w10)
          w11 = "All Notification Message Ids.gtype" {"Initialise"="Initialise", "Exit"="Exit", "Error"="Error", "Result"="Result", "Done"="Done"}
          Property Node(instance in=w11) -> ("Result"=w12)
          # No notification exists so post as message.
          To Variant(anything=$"ReadExecutable in") -> w13
          call "Enqueue Message.gvi"(Message Queue In=w10, Message Id=w12, Message Data=w13) -> (Error Out=w1)
        }
        frame False {
          # Notification exists so post as notification
          Send Notification(notification=$"ReadExecutable in", notifier=w4) -> (error out=w1)
        }
      }
      w2 = $"ReadExecutable in"
    }
    frame Error {
      w1 = $"Error in"
      w2 = $"ReadExecutable in"
    }
  }
  $"ReadExecutable out" <- w2
  $"Error out" <- w1
