vi "Process.gvi"   [LabVIEW NXG 5.0.0]
# Processes the Read Executable against the specified Driver for the Exectuable.  A result is loaded into the Executable.
# The Driver will ensure it is initialised and process the Executable Settings; it is responsible for interacting with the Instrument.
inputs:
  "Results Notifier": Notifier<"ReadExecutable.gtype">  # Notifier for returning results to the Test Application.
  "ReadExecutable in": "ReadExecutable.gtype"
  "Error in": error
outputs:
  "ReadExecutable out": "ReadExecutable.gtype"
  "Error out": error
uses:
  Hardware Abstraction Framework::Common::WriteExecutable.gtype::Pre-Exec Callout.gvi
  Hardware Abstraction Framework::Common::Driver.gtype::Update Driver Settings.gvi
  Hardware Abstraction Framework::Common::Driver.gtype::Initialise.gvi
  Hardware Abstraction Framework::Common::Driver.gtype::Commit.gvi
  Hardware Abstraction Framework::Common::WriteExecutable.gtype::Write Driver.gvi
  Hardware Abstraction Framework::Common::Driver.gtype::Execute Write Read Query.gvi
  Hardware Abstraction Framework::Common::ReadExecutable.gtype::Write Raw Result.gvi
  Hardware Abstraction Framework::Common::WriteExecutable.gtype::Write Parameter Values.gvi
  Hardware Abstraction Framework::Common::ReadExecutable.gtype::Post Result.gvi
  Hardware Abstraction Framework::Common::WriteExecutable.gtype::Post-Exec Callout.gvi
diagram:
  case ($"Error in") {
    frame No Error {
      call "Pre-Exec Callout.gvi"(WriteExecutable in=$"ReadExecutable in", Error in=$"Error in") -> (WriteExecutable out=w3, Error out=w4)
      Property Node(instance in=w3, error in=w4) -> ("Driver"=w5, "Id"=w6, "Executable Settings"=w7, error out=w8)
      call "Update Driver Settings.gvi"(Driver in=w5, Executable Id=w6, Executable Settings=w7, Error in=w8) -> (Driver out=w9, Error out=w10)
      call "Initialise.gvi"(Driver in=w9, Error in=w10) -> (Driver out=w11, Error out=w12)
      call "Commit.gvi"(Driver in=w11, Error in=w12) -> (Driver out=w13, Error out=w14)
      call "Write Driver.gvi"(Executable in=w3, Driver In=w13, Error in=w14) -> (Executable out=w15, Error out=w16)
      # General flow for a Write Read - send a command to the Driver, read result - is shown here.
      call "Execute Write Read Query.gvi"(Driver in=w13, Read Executable In=w15, Error in=w16) -> (Raw Parameter Results=w17, Raw Result=w18, Error out=w19)
      call "Write Raw Result.gvi"(ReadExecutable in=w15, Raw Result=w18, Error in=w19) -> (ReadExecutable out=w20, Error out=w21)
      call "Write Parameter Values.gvi"(WriteExecutable in=w20, Parameter Values=w17, Error in=w21) -> (WriteExecutable out=w22, Error out=w23)
      call "Post Result.gvi"(ReadExecutable in=w22, Results Notifier=$"Results Notifier", Error in=w23) -> (ReadExecutable out=w24, Error out=w25)
      call "Post-Exec Callout.gvi"(WriteExecutable in=w24, Error in=w25) -> (WriteExecutable out=w2, Error out=w1)
    }
    frame Error {
      w1 = $"Error in"
      w2 = $"ReadExecutable in"
    }
  }
  $"ReadExecutable out" <- w2
  $"Error out" <- w1
