vi "Read Byte Count.gvi"   [LabVIEW NXG 5.0.0]
# Returns the currently set Byte Count value.  If 0, returns 1024 as a default.
inputs:
  "ReadExecutable in": "ReadExecutable.gtype"
  "Error in": error
outputs:
  "Byte Count": u32  # The currently set Byte Count. Defaults to 1024 if zero.
  "ReadExecutable out": "ReadExecutable.gtype"
  "Error out": error
diagram:
  case ($"Error in") {
    frame No Error {
      Property Node(instance in=$"ReadExecutable in") -> ("Byte Count"=w4)
      Is Equal To 0(x=w4) -> w5
      Select(s=w5, t=1024, f=w4) -> w3
      w1 = $"Error in"
      w2 = $"ReadExecutable in"
    }
    frame Error {
      w1 = $"Error in"
      w2 = $"ReadExecutable in"
      w3 = default
    }
  }
  $"ReadExecutable out" <- w2
  $"Byte Count" <- w3
  $"Error out" <- w1
