vi "Should Continue.gvi"   [LabVIEW NXG 5.0.0]
# Returns True when the Repeat Count equals the Times to Repeat.
inputs:
  "RepeatingDirector in": "RepeatingDirector.gtype"
  "Error in": error
outputs:
  "Should Continue?": bool  # True when the Repeat Count equals the Times to Repeat.
  "RepeatingDirector out": "RepeatingDirector.gtype"
  "Error out": error
diagram:
  case ($"Error in") {
    frame Error, Default {
      w1 = $"RepeatingDirector in"
      w2 = $"Error in"
    }
    frame No Error {
      Property Node(instance in=$"RepeatingDirector in") -> ("Times Repeat"=w3, "Repeat Count"=w4, instance out=w5)
      # Less Than because this member is called at the start of the run so 'repeat count' will be set to 1 before anything actually has run.
      Increment(x=w4) -> w6
      Is Less(x=w3, y=w6) -> w7
      case (w7) {
        frame False, Default {
          w8 = w6
          w9 = TRUE
        }
        frame True {
          # Reset the Repeat Count when
          # done in case this Director is
          # reused.
          w8 = 0
          w9 = FALSE
        }
      }
      Property Node(instance in=w5, "Repeat Count"=w8) -> (instance out=w1)
      $"Should Continue?" <- w9
      w2 = $"Error in"
    }
  }
  $"RepeatingDirector out" <- w1
  $"Error out" <- w2
