vi "Initiate Session.gvi"   [LabVIEW NXG 5.0.0]
# Creates a Serial session for the Instrument that will be communicated with.
inputs:
  "SerialDriver in": "SerialDriver.gtype"
  "Error in": error
outputs:
  "SerialDriver out": "SerialDriver.gtype"
  "Error out": error
uses:
  Hardware Abstraction Framework::Common::Driver.gtype::Initiate Session.gvi
  Hardware Abstraction Framework::Common::Driver.gtype::Read VISA Session.gvi
  Hardware Abstraction Framework::Common::SerialDriver.gtype::Read Serial Port Attributes.gvi
  NI::VISA::Configure Serial Port (Instr).gvi
  Hardware Abstraction Framework::Common::Driver.gtype::Write VISA Session.gvi
diagram:
  case ($"Error in") {
    frame No Error {
      call parent "Initiate Session.gvi"(Driver in=$"SerialDriver in", Error in=$"Error in") -> (Driver out=w3, Error out=w4)
      call "Read VISA Session.gvi"(Driver in=w3, Error in=w4) -> (Driver out=w5, VISA Session=w6, Error out=w7)
      call "Read Serial Port Attributes.gvi"(SerialDriver in=w5, Error in=w7) -> (Serial Port Attributes=w8)
      Property Node(instance in=w8) -> ("Baud Rate"=w9, "Data Bits"=w10, "Parity"=w11, "Stop Bits"=w12, "Data Flow"=w13, "Establish Wait"=w14)
      call "Configure Serial Port (Instr).gvi"(stop bits=w12, flow control=w13, session in=w6, baud rate=w9, data bits=w10, parity=w11) -> (session out=w15, error out=w16)
      while {
        Wait(time to wait=w14)
        stop if TRUE
      }
      call "Write VISA Session.gvi"(Driver in=w5, VISA Session=w15, Error in=w16) -> (Driver out=w2, Error out=w1)
    }
    frame Error {
      w1 = $"Error in"
      w2 = $"SerialDriver in"
    }
  }
  $"SerialDriver out" <- w2
  $"Error out" <- w1
