vi "Initialise.gvi"   [LabVIEW NXG 5.0.0]
# Set the StartMilliseconds value.
inputs:
  "TimedDirector in": "TimedDirector.gtype"
  "Error in": error
outputs:
  "TimedDirector out": "TimedDirector.gtype"
  "Error out": error
uses:
  Hardware Abstraction Framework::Common::ExecutableDirector.gtype::Initialise.gvi
diagram:
  case ($"Error in") {
    frame Error, Default {
      w1 = $"Error in"
      w2 = $"TimedDirector in"
    }
    frame No Error {
      call parent "Initialise.gvi"(ExecutableDirector in=$"TimedDirector in", Error in=$"Error in") -> (ExecutableDirector out=w3, Error out=w1)
      Tick Count() -> (timer value=w4)
      Property Node(instance in=w3, "Start Milliseconds"=w4) -> (instance out=w2)
    }
  }
  $"TimedDirector out" <- w2
  $"Error out" <- w1
