vi "Should Continue.gvi"   [LabVIEW NXG 5.0.0]
# Returns True when the processing time has exceeded the duration.
inputs:
  "TimedDirector in": "TimedDirector.gtype"
  "Error in": error
outputs:
  "Should Continue?": bool  # Returns True when the processing time has exceeded the duration.
  "TimedDirector out": "TimedDirector.gtype"
  "Error out": error
diagram:
  case ($"Error in") {
    frame Error, Default {
      w1 = $"TimedDirector in"
      w2 = $"Error in"
    }
    frame No Error {
      # Need to check if the millisecond timer has wrapped and calculate an elapsed
      # time taking that into accout.
      # Unlikely as it will run for over 49 days from computer start. Still....
      Property Node(instance in=$"TimedDirector in") -> ("Start Milliseconds"=w3, "Duration"=w4)
      Tick Count() -> (timer value=w5)
      Is Less(x=w5, y=w3) -> w6
      case (w6) {
        frame False, Default {
          Subtract(x=w5, y=w3) -> w8
          Is Less(x=w8, y=w4) -> w7
        }
        frame True {
          # As the timer wrapped, we need to calculate the elapsed time taking that into account.  Timer wraps at (2^32) -1
          Subtract(x=4294967295, y=w3) -> w9
          Add(w5, w9) -> w10
          Is Less(x=w10, y=w4) -> w7
        }
      }
      $"Should Continue?" <- w7
      w1 = $"TimedDirector in"
      w2 = $"Error in"
    }
  }
  $"TimedDirector out" <- w1
  $"Error out" <- w2
