vi "Build Command.gvi"   [LabVIEW NXG 5.0.0]
# Builds a command string up for execution on the Instrument by the Driver.  The command consists of a Base command plus any parameters that should be applied.
# This function MUST be overridden by subclasses.  The base function will return an error.
inputs:
  "Executable in": "WriteExecutable.gtype"
  "Error in": error
outputs:
  "Command": string  # Returns a properly formatted command to be sent to a Driver for execution on an Instrument.
  "Executable out": "WriteExecutable.gtype"
  "Error out": error
uses:
  Hardware Abstraction Framework::Common::WriteExecutable.gtype::Get Base Command.gvi
  Hardware Abstraction Framework::Common::WriteExecutable.gtype::Read Parameters.gvi
diagram:
  case ($"Error in") {
    frame No Error {
      call "Get Base Command.gvi"(WriteExecutable in=$"Executable in", Error in=$"Error in") -> (WriteExecutable out=w4, Base Command=w5, Error out=w6)
      call "Read Parameters.gvi"(Executable in=w4, Error in=w6) -> (Executable out=w2, Parameters=w7, Error out=w1)
      Array Size(array=w7) -> (size(s)=w8)
      Decrement(x=w8) -> w9
      s1 = w5  # shift register
      for (iteration -> i1) {
        w10 = each element of w7
        Is Equal(x=w9, y=i1) -> w11
        # Add a comma if not the last parameter
        Select(s=w11, t="", f=",") -> w12
        Property Node(instance in=w10) -> ("Name"=w13)
        Concatenate Strings(s1, " ", w13) -> w14
        Concatenate Strings(w14, w12) -> w15
        next s1 = w15
      }
      # Add a new line
      Concatenate Strings(s1, "\n") -> w3
    }
    frame Error {
      w1 = $"Error in"
      w2 = $"Executable in"
      w3 = default
    }
  }
  $"Executable out" <- w2
  $"Error out" <- w1
  $Command <- w3
