vi "Cleanup.gvi"   [LabVIEW NXG 5.0.0]
# Ensures a clean and controlled stop of the Executable’s Driver.
inputs:
  "WriteExecutable in": "WriteExecutable.gtype"
  "Error in": error
outputs:
  "WriteExecutable out": "WriteExecutable.gtype"
  "Error out": error
uses:
  Hardware Abstraction Framework::Common::WriteExecutable.gtype::Read Driver.gvi
  Hardware Abstraction Framework::Common::Driver.gtype::Close.gvi
diagram:
  call "Read Driver.gvi"(Executable in=$"WriteExecutable in", Error in=$"Error in") -> (Executable out=w1, Driver=w2, Error out=w3)
  $"WriteExecutable out" <- w1
  call "Close.gvi"(Driver in=w2, Error in=w3) -> (Error out=w4)
  $"Error out" <- w4
