vi "Process.gvi"   [LabVIEW NXG 5.0.0]
# Processes the Write Executable against the specified Driver for the Executable.
# The Driver will ensure it is initialised and process the Executable Settings; it is responsible for interacting with the Instrument.
inputs:
  "Results Notifier": Notifier<"ReadExecutable.gtype">  # Notifier for returning results to the Test Application. Ignored on the Write Executable.
  "WriteExecutable in": "WriteExecutable.gtype"
  "Error in": error
outputs:
  "WriteExecutable out": "WriteExecutable.gtype"
  "Error out": error
uses:
  Hardware Abstraction Framework::Common::WriteExecutable.gtype::Pre-Exec Callout.gvi
  Hardware Abstraction Framework::Common::Driver.gtype::Update Driver Settings.gvi
  Hardware Abstraction Framework::Common::Driver.gtype::Initialise.gvi
  Hardware Abstraction Framework::Common::Driver.gtype::Commit.gvi
  Hardware Abstraction Framework::Common::WriteExecutable.gtype::Write Driver.gvi
  Hardware Abstraction Framework::Common::Driver.gtype::Execute Write Query.gvi
  Hardware Abstraction Framework::Common::WriteExecutable.gtype::Post-Exec Callout.gvi
diagram:
  case ($"Error in") {
    frame No Error {
      call "Pre-Exec Callout.gvi"(WriteExecutable in=$"WriteExecutable in", Error in=$"Error in") -> (WriteExecutable out=w3, Error out=w4)
      # General flow for a Write - send a command to the Driver - is shown here.
      Property Node(instance in=w3, error in=w4) -> ("Driver"=w5, "Id"=w6, "Executable Settings"=w7, error out=w8)
      call "Update Driver Settings.gvi"(Driver in=w5, Executable Id=w6, Executable Settings=w7, Error in=w8) -> (Driver out=w9, Error out=w10)
      call "Initialise.gvi"(Driver in=w9, Error in=w10) -> (Driver out=w11, Error out=w12)
      call "Commit.gvi"(Driver in=w11, Error in=w12) -> (Driver out=w13, Error out=w14)
      call "Write Driver.gvi"(Executable in=w3, Driver In=w13, Error in=w14) -> (Executable out=w15, Error out=w16)
      call "Execute Write Query.gvi"(Driver in=w13, Executable In=w15, Error in=w16) -> (Error out=w17)
      call "Post-Exec Callout.gvi"(WriteExecutable in=w15, Error in=w17) -> (WriteExecutable out=w2, Error out=w1)
    }
    frame Error {
      w1 = $"Error in"
      w2 = $"WriteExecutable in"
    }
  }
  $"WriteExecutable out" <- w2
  $"Error out" <- w1
