vi "Read Id.gvi"   [LabVIEW NXG 5.0.0]
# Returns a UUID for the Executable.  If it doesn’t have one, creates it.
inputs:
  "Executable in": "WriteExecutable.gtype"
  "Error in": error
outputs:
  "Id": string  # Returns the Executable’s Id. Creates one if currently blank.
  "Executable out": "WriteExecutable.gtype"
  "Error out": error
uses:
  Hardware Abstraction Framework::Support::Helpers::Generate UUID.gvi
  Hardware Abstraction Framework::Common::WriteExecutable.gtype::Write Id.gvi
diagram:
  case ($"Error in") {
    frame No Error {
      Property Node(instance in=$"Executable in") -> ("Id"=w4)
      Is Empty String Or Path(string/path=w4) -> w5
      case (w5) {
        frame False, Default {
          w1 = $"Error in"
          w3 = w4
          w2 = $"Executable in"
        }
        frame True {
          call "Generate UUID.gvi"(Error In=$"Error in") -> (UUID=w3, Error Out=w6)
          call "Write Id.gvi"(Executable in=$"Executable in", Id=w3, Error in=w6) -> (Executable out=w2, Error out=w1)
        }
      }
    }
    frame Error {
      w1 = $"Error in"
      w2 = $"Executable in"
      w3 = default
    }
  }
  $"Executable out" <- w2
  $Id <- w3
  $"Error out" <- w1
