vi "Read Timeout.gvi"   [LabVIEW NXG 5.0.0]
# Returns the currently set value for Timeout of commands, in milliseconds.
inputs:
  "Executable in": "WriteExecutable.gtype"
  "Error in": error
outputs:
  "Timeout": u32  # Returns the currently set timeout for an Executable. Default is 5seconds
  "Executable out": "WriteExecutable.gtype"
  "Error out": error
diagram:
  case ($"Error in") {
    frame No Error {
      Property Node(instance in=$"Executable in") -> ("Timeout"=w4)
      Is Equal To 0(x=w4) -> w5
      Select(s=w5, t=5000, f=w4) -> w3
      w1 = $"Error in"
      w2 = $"Executable in"
    }
    frame Error {
      w1 = $"Error in"
      w2 = $"Executable in"
      w3 = default
    }
  }
  $"Executable out" <- w2
  $Timeout <- w3
  $"Error out" <- w1
