vi "Remove Settings.gvi"   [LabVIEW NXG 5.0.0]
# Removes the passed Executable Settings from the collection currently held by the Executable and returns a count of those removed.
inputs:
  "Executable Settings": "ExecutableSetting.gtype"[]  # The array of Executable Settings to remove.
  "Executable in": "WriteExecutable.gtype"
  "Error in": error
outputs:
  "Removed Count": u32  # The number of Executable Settings actually removed.
  "Executable out": "WriteExecutable.gtype"
  "Error out": error
uses:
  Hardware Abstraction Framework::Common::WriteExecutable.gtype::Read Executable Settings.gvi
  Hardware Abstraction Framework::Common::Setting.gtype::Read Name.gvi
  Hardware Abstraction Framework::Common::WriteExecutable.gtype::Write Executable Settings.gvi
diagram:
  case ($"Error in") {
    frame No Error {
      call "Read Executable Settings.gvi"(Executable in=$"Executable in", Error in=$"Error in") -> (Executable out=w3, Executable Settings=w4, Error out=w5)
      w6 = 0  # RemovedCounter
      # Iterate through the passed Settings, and compare name against existing Settings.
      # If a match is found, remove it otherwise ignore it.
      s1 = w6  # shift register
      s2 = w4  # shift register
      for {
        w7 = each element of $"Executable Settings"
        call "Read Name.gvi"(Setting in=w7) -> (Name=w8)
        for (iteration -> i1) {
          w9 = each element of s2
          call "Read Name.gvi"(Setting in=w9) -> (Name=w10)
          Is Equal(x=w10, y=w8) -> w11
          stop if w11
        }
        case (w11) {
          frame True {
            # Match, so remove
            Delete From Array(inArray=s2, index0=i1) -> w12
            Increment(x=s1) -> w13
          }
          frame False {
            # No match, so ignore
            w12 = s2
            w13 = s1
          }
        }
        next s1 = w13
        next s2 = w12
      }
      call "Write Executable Settings.gvi"(Executable in=w3, Executable Settings=s2, Error in=w5) -> (Executable out=w2, Error out=w1)
      $"Removed Count" <- s1
    }
    frame Error {
      w1 = $"Error in"
      w2 = $"Executable in"
    }
  }
  $"Executable out" <- w2
  $"Error out" <- w1
