vi "Update Parameters.gvi"   [LabVIEW NXG 5.0.0]
# Adds to, or updates, existing Parameters on the Executable.  Returns the number updated and added.
inputs:
  "Parameters": "Parameter.gtype"[]  # The array of Parameters to update on the Executable.
  "Executable in": "WriteExecutable.gtype"
  "Error in": error
outputs:
  "Added Count": u32  # The number of Parameters added.
  "Executable out": "WriteExecutable.gtype"
  "Error out": error
  "Updated Count": u32  # The number of Parameters updated.
uses:
  Hardware Abstraction Framework::Common::WriteExecutable.gtype::Read Parameters.gvi
  Hardware Abstraction Framework::Common::Parameter.gtype::Read Name.gvi
  Hardware Abstraction Framework::Common::WriteExecutable.gtype::Write Parameters.gvi
diagram:
  case ($"Error in") {
    frame No Error {
      call "Read Parameters.gvi"(Executable in=$"Executable in", Error in=$"Error in") -> (Executable out=w3, Parameters=w4, Error out=w5)
      w6 = 0  # Added Counter
      w7 = 0  # Updated Counter
      # Iterate through the passed Parameters, and compare name against existing Parameters.
      # If a match is found, update it otherwise add it into the array.
      s1 = w6  # shift register
      s2 = w7  # shift register
      s3 = w4  # shift register
      s4 = "Parameter.gtype"[] []  # shift register
      for {
        w8 = each element of $Parameters
        call "Read Name.gvi"(Parameter in=w8) -> (Name=w9)
        for (iteration -> i1) {
          w10 = each element of s3
          call "Read Name.gvi"(Parameter in=w10) -> (Name=w11)
          Is Equal(x=w11, y=w9) -> w12
          stop if w12
        }
        case (w12) {
          frame True {
            # Match, so update
            Replace Array Subset(inArray=s3, index=i1, new=w8) -> w14
            Increment(x=s2) -> w13
            w15 = s1
            w16 = s4
          }
          frame False {
            # No match, so accumulate to add
            Build Array(w8, s4) -> w16
            Increment(x=s1) -> w15
            w13 = s2
            w14 = s3
          }
        }
        next s1 = w15
        next s2 = w13
        next s3 = w14
        next s4 = w16
      }
      Insert Into Array(inArray=s3, new=s4) -> w17
      call "Write Parameters.gvi"(Executable in=w3, Parameters=w17, Error in=w5) -> (Executable out=w2, Error out=w1)
      $"Added Count" <- s1
      $"Updated Count" <- s2
    }
    frame Error {
      w1 = $"Error in"
      w2 = $"Executable in"
    }
  }
  $"Executable out" <- w2
  $"Error out" <- w1
