vi "Write Parameter Values.gvi"   [LabVIEW NXG 5.0.0]
# Adds a collection of raw execution results into the Parameters in order.
inputs:
  "Parameter Values": string[]  # The collection of raw values to add to Parameters.
  "WriteExecutable in": "WriteExecutable.gtype"
  "Error in": error
outputs:
  "WriteExecutable out": "WriteExecutable.gtype"
  "Error out": error
uses:
  Hardware Abstraction Framework::Common::WriteExecutable.gtype::Read Parameters.gvi
  Hardware Abstraction Framework::Common::Parameter.gtype::Write Raw Result.gvi
  Hardware Abstraction Framework::Common::WriteExecutable.gtype::Write Parameters.gvi
diagram:
  case ($"Error in") {
    frame No Error {
      call "Read Parameters.gvi"(Executable in=$"WriteExecutable in", Error in=$"Error in") -> (Executable out=w3, Parameters=w4, Error out=w5)
      for {
        w6 = each element of $"Parameter Values"
        w7 = each element of w4
        call "Write Raw Result.gvi"(Parameter in=w7, Raw Result=w6, Error in=w5) -> (Parameter out=w9, Error out=w10)
        append w9 to w8
      }
      call "Write Parameters.gvi"(Executable in=w3, Parameters=w8, Error in=w10) -> (Executable out=w2, Error out=w1)
    }
    frame Error {
      w1 = $"Error in"
      w2 = $"WriteExecutable in"
    }
  }
  $"WriteExecutable out" <- w2
  $"Error out" <- w1
