vi "String To Date.gvi"   [LabVIEW NXG 5.0.0]
# Converts the passed String value to a Date only Timestamp – the time portion is set to midnight.  The passed string must be in format dd/mm/yyyy otherwise an invalid conversion may be returned (dd and mm can be single digits; year must be 4 digits.)
inputs:
  "Value To Convert": string  # The String value to convert to a Date.
  "Error In": error
outputs:
  "Error Out": error
  "Date Value": timestamp  # The Date representation of the passed String value.
uses:
  NI::G Core::Strings::Trim Whitespace.gvi
  NI::G Core::Error::Build Error Cluster.gvi
diagram:
  case ($"Error In") {
    frame Error, Default {
      w1 = $"Error In"
      w2 = default
    }
    frame No Error {
      call "Trim Whitespace.gvi"(string=$"Value To Convert") -> (trimmed string=w3)
      Search And Replace String(error in (no error)=$"Error In", ignore case (F)=TRUE, input string=w3, replace all (F)=TRUE, replace string ("")="", search string=",") -> (error out=w4, result string=w5)
      # Strip commas and whitespace.
      Scan From String(formatString="%<%d/%m/%Y>T", inputString=w5, errIn=w4, default=1904-01-01T00:00:00Z) -> (errOut=w6, out0=w7)
      case (w6) {
        frame No Error {
          w1 = w6
          w2 = w7
        }
        frame Error {
          # If an error occurred during the conversion, raise a framework error.
          Format Into String(formatString="cannot convert %s to DD/MM/YYYY", initString="Data Type Conversion Error: ", w5) -> w8
          call "Build Error Cluster.gvi"(code=205, description=w8) -> (error out=w1)
          w2 = default
        }
      }
    }
  }
  $"Error Out" <- w1
  $"Date Value" <- w2
