vi "String To I64.gvi"   [LabVIEW NXG 5.0.0]
# Given a String representation of an Integer, returns it as a 64-bit signed Integer.  If it can’t be converted to a signed integer, an error is raised.
inputs:
  "Value To Convert": string  # The String value to convert to a 64-bit Signed Integer.
  "Error In": error
outputs:
  "Error Out": error
  "I64 Value": i64  # The I64 representation of the passed String value.
uses:
  NI::G Core::Strings::Trim Whitespace.gvi
  NI::G Core::Error::Build Error Cluster.gvi
diagram:
  case ($"Error In") {
    frame Error, Default {
      w1 = $"Error In"
      w2 = default
    }
    frame No Error {
      call "Trim Whitespace.gvi"(string=$"Value To Convert") -> (trimmed string=w3)
      Search And Replace String(ignore case (F)=TRUE, input string=w3, replace all (F)=TRUE, replace string ("")="", search string=",") -> (result string=w4)
      # Strip commas and whitespace.
      Decimal String To Number(default (0 I32)=0, string=w4) -> (number=w5, offset past number=w6)
      String Length(string=w4) -> (length=w7)
      Is Not Equal(x=w7, y=w6) -> w8
      case (w8) {
        frame False, Default {
          w9 = default
          w2 = w5
        }
        frame True {
          # If the String length is not the same as the offset, then there are unconvertible characters so raise an error.
          Format Into String(formatString="cannot convert %s to a 64-bit Signed Integer", initString="Data Type Conversion Error: ", w4) -> w10
          call "Build Error Cluster.gvi"(code=205, description=w10) -> (error out=w9)
          w2 = default
        }
      }
      Merge Errors(w9, $"Error In") -> (error out=w1)
    }
  }
  $"Error Out" <- w1
  $"I64 Value" <- w2
