vi "String To Time.gvi"   [LabVIEW NXG 5.0.0]
# Converts the passed String value to a Time only Timestamp (the date will be set to 01/01/1904.)  The passed string must be in format HH:MM:SS otherwise an invalid conversion or error may be returned.  If milliseconds are passed in, they will be dropped.
inputs:
  "Value To Convert": string  # The String value to convert to a Time.
  "Error In": error
outputs:
  "Error Out": error
  "Time Value": timestamp  # The Timestamp representation of the passed String value.
uses:
  NI::G Core::Strings::Trim Whitespace.gvi
  NI::G Core::Error::Build Error Cluster.gvi
diagram:
  case ($"Error In") {
    frame Error, Default {
      w1 = $"Error In"
      w2 = default
    }
    frame No Error {
      call "Trim Whitespace.gvi"(string=$"Value To Convert") -> (trimmed string=w3)
      Search And Replace String(error in (no error)=$"Error In", ignore case (F)=TRUE, input string=w3, replace all (F)=TRUE, replace string ("")="", search string=",") -> (error out=w4, result string=w5)
      # Strip commas and whitespace.
      Scan From String(formatString="%<%H:%M:%S>T", inputString=w5, errIn=w4, default=1904-01-01T00:00:00Z) -> (errOut=w6, out0=w7)
      case (w6) {
        frame No Error {
          w1 = w6
          w2 = w7
        }
        frame Error {
          # If an error occurred during the conversion, raise a framework error.
          Format Into String(formatString="cannot convert %s to DD/MM/YYYY HH:MM:SS.sss", initString="Data Type Conversion Error: ", w5) -> w8
          call "Build Error Cluster.gvi"(code=205, description=w8) -> (error out=w1)
          w2 = default
        }
      }
    }
  }
  $"Error Out" <- w1
  $"Time Value" <- w2
