vi "String To Timestamp.gvi"   [LabVIEW NXG 5.0.0]
# Converts the passed String value to a Timestamp.  The passed string must be in format dd/mm/yyyy HH:MM:SS (don’t use milliseconds) or dd/mm/yyyy HH:MM:SS.fff (use milliseconds) otherwise an invalid conversion or error may be returned (dd and mm can be single digits; year must be 4 digits; fff can be longer than 3 digits but it will be truncated to milliseconds.)
# The result will always have a milliseconds value: if Use Milliseconds was set to False, then the millisecond value will be 000.
inputs:
  "Value To Convert": string  # The String value to convert to a Timestamp.
  "Error In": error
  "Use Milliseconds": bool = TRUE  # If set to True, then a millisecond value will be converted out of the String.
outputs:
  "Error Out": error
  "Timestamp Value": timestamp  # The Timestamp representation of the passed String value.
uses:
  NI::G Core::Strings::Trim Whitespace.gvi
  NI::G Core::Error::Build Error Cluster.gvi
diagram:
  Select(s=$"Use Milliseconds", t="%<%m/%d/%Y %H:%M:%S%6u>T", f="%<%m/%d/%Y %H:%M:%S>T") -> w1
  case ($"Error In") {
    frame Error, Default {
      w2 = $"Error In"
      w3 = default
    }
    frame No Error {
      call "Trim Whitespace.gvi"(string=$"Value To Convert") -> (trimmed string=w4)
      # Strip commas and whitespace.
      Search And Replace String(error in (no error)=$"Error In", ignore case (F)=TRUE, input string=w4, replace all (F)=TRUE, replace string ("")="", search string=",") -> (error out=w5, result string=w6)
      Scan From String(formatString=w1, inputString=w6, errIn=w5, default=1904-01-01T00:00:00Z) -> (errOut=w7, out0=w8)
      case (w7) {
        frame No Error {
          w2 = w7
          w3 = w8
        }
        frame Error {
          # If an error occurred during the conversion, raise a framework error.
          Format Into String(formatString="cannot convert %s to DD/MM/YYYY HH:MM:SS.sss", initString="Data Type Conversion Error: ", w6) -> w9
          call "Build Error Cluster.gvi"(code=205, description=w9) -> (error out=w2)
          w3 = default
        }
      }
    }
  }
  $"Error Out" <- w2
  $"Timestamp Value" <- w3
