vi "Create All Events.gvi"   [LabVIEW NXG 5.0.0]
# Creates an instance of each Event understood by the framework: Stop, Pause, Resume.
inputs:
  "Error In": error
outputs:
  "Events": "All Events.gtype"  # The collection of events understood by the framework.
  "Error Out": error
types:
  "Stop Event.gtype" = "event Stop"
  "Pause Event.gtype" = "event Pause"
  "Resume Event.gtype" = "event Resume"
  "Done Event.gtype" = "event Done"
  "All Events.gtype" = cluster{"Stop Event": "Stop Event.gtype", "Pause Event": "Pause Event.gtype", "Resume Event": "Resume Event.gtype", "Done Event": "Done Event.gtype"}
  "Event Data.gtype" = cluster{"Raiser Name": string, "Raiser Id": string}
diagram:
  case ($"Error In") {
    frame Error, Default {
      w1 = default
      w2 = $"Error In"
    }
    frame No Error {
      Create User Event[EventName=Stop](error in=$"Error In", user event data type="Event Data.gtype" {all zero or empty}) -> (error out=w3, user event out=w4)  # Create User Event: Stop
      Create User Event[EventName=Pause](error in=w3, user event data type="Event Data.gtype" {all zero or empty}) -> (error out=w5, user event out=w6)  # Create User Event: Pause
      Create User Event[EventName=Resume](error in=w5, user event data type="Event Data.gtype" {all zero or empty}) -> (error out=w7, user event out=w8)  # Create User Event: Resume
      Create User Event[EventName=Done](error in=w7, user event data type="Event Data.gtype" {all zero or empty}) -> (error out=w2, user event out=w9)  # Create User Event: Done
      Property Node(instance in="All Events.gtype" {all zero or empty}, "Stop Event"=w4, "Pause Event"=w6, "Resume Event"=w8, "Done Event"=w9) -> (instance out=w1)
    }
  }
  $Events <- w1
  $"Error Out" <- w2
