vi "Raise Done Event.gvi"   [LabVIEW NXG 5.0.0]
# Helper member to send a Done Event if the passed boolean is True.  It is sent at the requested priority.
inputs:
  "Send Done?": bool = TRUE  # Indicator to send Done Event if True.
  "Raiser Name": string  # Name to identify the raiser of the Event.
  "Raiser Id": string  # Id of the Raiser.
  "Error In": error
  "Priority": enum{"high priority", "normal priority"} = "normal priority"  # The priority of the Done Event.
outputs:
  "Error Out": error
types:
  "Event Data.gtype" = cluster{"Raiser Name": string, "Raiser Id": string}
diagram:
  case ($"Send Done?") {
    frame False, Default {
      w1 = $"Error In"
      w2 = default
    }
    frame True {
      w3 = "Hardware Abstraction Framework::Support::Resources.grsc::Events"
      Tag Read(ref in=w3) -> (Data=w4)
      Property Node(instance in=w4) -> ("Done Event"=w5)
      Property Node(instance in="Event Data.gtype" {all zero or empty}, "Raiser Name"=$"Raiser Name", "Raiser Id"=$"Raiser Id") -> (instance out=w6)
      Generate User Event(event data=w6, priority=$Priority, user event=w5) -> (error out=w2)
      w1 = $"Error In"
    }
  }
  Merge Errors(w2, w1) -> (error out=w7)
  $"Error Out" <- w7
