vi "Release All Events.gvi"   [LabVIEW NXG 5.0.0]
# Destroys all Event references making them invalid.
inputs:
  "Error In": error
  "All Events": "All Events.gtype"  # The collection of events understood by the framework.
outputs:
  "Error Out": error
types:
  "Stop Event.gtype" = "event Stop"
  "Pause Event.gtype" = "event Pause"
  "Resume Event.gtype" = "event Resume"
  "Done Event.gtype" = "event Done"
  "All Events.gtype" = cluster{"Stop Event": "Stop Event.gtype", "Pause Event": "Pause Event.gtype", "Resume Event": "Resume Event.gtype", "Done Event": "Done Event.gtype"}
diagram:
  $"Error Out" <- $"Error In"
  Property Node(instance in=$"All Events") -> ("Stop Event"=w1, "Pause Event"=w2, "Resume Event"=w3, "Done Event"=w4)
  Destroy User Event(user event=w1)
  Destroy User Event(user event=w2)
  Destroy User Event(user event=w3)
  Destroy User Event(user event=w4)
