vi "Error Handling - Process Error.gvi"   [LabVIEW NXG 5.0.0]
# Processes the error passed in.  If on the ignore list, then nothiing happens, otherwise it places a message on the Notification queue so that an appropriate action can be taken.  If an error was passed in and not ignored, then the Error flag is set for output otherwise it is flagged as no error.
inputs:
  "Error to Process": error
  "Exit on Error?": bool  # Flag to indicate whether an Exit message should be sent if the error is not ignored. If false, then an Error message is sent
  "Ignore Errors": i32[]  # Array of Error Ids to ignore. If the Error to Process is in this list, it is classed as no error occurred.
outputs:
  "Error?": bool  # Indicates whether an error was processed. If the error was on the ignore list, then this is false.
types:
  "All Notification Message Ids.gtype" = cluster{"Initialise": string, "Exit": string, "Error": string, "Result": string, "Done": string}
uses:
  NI::G Core::Error::Read Error Code.gvi
  Hardware Abstraction Framework::Support::Messages::Enqueue Message.gvi
  Hardware Abstraction Framework::Support::Events::Raise Stop Event.gvi
diagram:
  w1 = "Hardware Abstraction Framework::Support::Resources.grsc::MessageQueues"
  Tag Read(ref in=w1) -> (Data=w2)
  Property Node(instance in=w2) -> ("Notifications"=w3)
  case ($"Error to Process") {
    frame No Error {
      w4 = FALSE
    }
    frame Error {
      call "Read Error Code.gvi"(error in=$"Error to Process") -> (code=w5)
      Search 1D Array(1D array=$"Ignore Errors", element=w5) -> (index of element=w6)
      case (w6) {
        frame Default {
          w4 = FALSE
        }
        frame -1 {
          w7 = "All Notification Message Ids.gtype" {"Initialise"="Initialise", "Exit"="Exit", "Error"="Error", "Result"="Result", "Done"="Done"}
          Property Node(instance in=w7) -> ("Exit"=w8, "Error"=w9)
          Select(s=$"Exit on Error?", t=w8, f=w9) -> w10
          call "Enqueue Message.gvi"(Priority?=$"Exit on Error?", Message Queue In=w3, Message Id=w10, Message Data=$"Error to Process")
          # The error wasn't in the ignore list so send
          # an Exit or Error message.
          call "Raise Stop Event.gvi"(Send Stop?=$"Exit on Error?", Raiser Name="Error Processing")
          w4 = TRUE
        }
      }
    }
  }
  $"Error?" <- w4
