vi "Generate UUID.gvi"   [LabVIEW NXG 5.0.0]
# Generates a UUID 0x8-0x4-0x4-0x4-0x12.  Guaranteed to be unique.
inputs:
  "Error In": error
outputs:
  "Error Out": error
  "UUID": string  # The generated UUID.
uses:
  NI::G Core::Numeric::Random Number (Range) U64.gvi
diagram:
  case ($"Error In") {
    frame Error, Default {
      w1 = $"Error In"
    }
    frame No Error {
      while {
        w2 = "Hardware Abstraction Framework::Support::Resources.grsc::GeneratedUUIDs"
        # Check for uniqueness and regenerate if not.
        Tag Read(data in=variant(), ref in=w2) -> (Data=w3, ref out=w4)
        s1 = ""  # shift register
        for (N = 8) {
          call "Random Number (Range) U64.gvi"(upper bound=15) -> (number=w5)
          Number To Hexadecimal String(number=w5) -> (hex integer string=w6)
          Concatenate Strings(s1, w6) -> w7
          next s1 = w7
        }
        s2 = ""  # shift register
        for (N = 4) {
          call "Random Number (Range) U64.gvi"(upper bound=15) -> (number=w8)
          Number To Hexadecimal String(number=w8) -> (hex integer string=w9)
          Concatenate Strings(s2, w9) -> w10
          next s2 = w10
        }
        s3 = ""  # shift register
        for (N = 4) {
          call "Random Number (Range) U64.gvi"(upper bound=15) -> (number=w11)
          Number To Hexadecimal String(number=w11) -> (hex integer string=w12)
          Concatenate Strings(s3, w12) -> w13
          next s3 = w13
        }
        s4 = ""  # shift register
        for (N = 4) {
          call "Random Number (Range) U64.gvi"(upper bound=15) -> (number=w14)
          Number To Hexadecimal String(number=w14) -> (hex integer string=w15)
          Concatenate Strings(s4, w15) -> w16
          next s4 = w16
        }
        s5 = ""  # shift register
        for (N = 12) {
          call "Random Number (Range) U64.gvi"(upper bound=15) -> (number=w17)
          Number To Hexadecimal String(number=w17) -> (hex integer string=w18)
          Concatenate Strings(s5, w18) -> w19
          next s5 = w19
        }
        Concatenate Strings(s1, "-", s2, "-", s3, "-", s4, "-", s5) -> w20
        Set Variant Attribute(name=w20, value=TRUE, variant=w3) -> (replaced=w21, variant out=w22)
        Tag Write(Data=w22, ref in=w4)
        continue if w21
      }
      $UUID <- w20
      w1 = $"Error In"
    }
  }
  $"Error Out" <- w1
