vi "Parameter Builder.gvi"   [LabVIEW NXG 5.0.0]
# Given an array of names, returns an array of Parameters with the given name
inputs:
  "Names": string[]  # The array of names.
  "Error In": error
outputs:
  "Error Out": error
  "Parameters": "Parameter.gtype"[]  # The resulting array of Parameter instances.
uses:
  Hardware Abstraction Framework::Common::Parameter.gtype::Write Name.gvi
diagram:
  Initialize Array(element="Parameter.gtype" constant) -> w1
  case ($"Error In") {
    frame Error, Default {
      w2 = $"Error In"
      w3 = default
    }
    frame No Error {
      s1 = w1  # shift register
      for {
        w4 = each element of $Names
        call "Write Name.gvi"(Parameter in="Parameter.gtype" constant, Name=w4, Error in=$"Error In") -> (Parameter out=w5, Error out=w2)
        Insert Into Array(inArray=s1, new=w5) -> w6
        next s1 = w6
      }
      w3 = s1
    }
  }
  $Parameters <- w3
  $"Error Out" <- w2
