vi "Create All Message Queues.gvi"   [LabVIEW NXG 5.0.0]
# Creates and initialises instances of the message queues used by the framework.
inputs:
  "Error In": error
outputs:
  "Error Out": error
  "Message Queues": "All Message Queues.gtype"  # Container for all message queues.
types:
  "All Message Queues.gtype" = cluster{"Internal": Queue<"Message.gtype">, "Notifications": Queue<"Message.gtype">}
  "All Internal Message Ids.gtype" = cluster{"Initialise": string, "Stop": string, "Done": string, "Exit": string, "Process": string, "Continue": string, "Pause": string, "Resume": string}
  "All Notification Message Ids.gtype" = cluster{"Initialise": string, "Exit": string, "Error": string, "Result": string, "Done": string}
uses:
  Hardware Abstraction Framework::Support::Messages::Obtain Message Queue.gvi
  Hardware Abstraction Framework::Support::Messages::Enqueue Message.gvi
diagram:
  case ($"Error In") {
    frame No Error {
      call "Obtain Message Queue.gvi"(Error In=$"Error In") -> (Queue Out=w3, Error Out=w4)
      w5 = "All Internal Message Ids.gtype" {"Initialise"="Initialise", "Stop"="Stop", "Done"="Done", "Exit"="Exit", "Process"="Process", "Continue"="Continue", "Pause"="Pause", "Resume"="Resume"}
      Property Node(instance in=w5) -> ("Initialise"=w6)
      call "Enqueue Message.gvi"(Message Queue In=w3, Message Id=w6, Error In=w4) -> (Error Out=w7)
      call "Obtain Message Queue.gvi"(Error In=w7) -> (Queue Out=w8, Error Out=w9)
      Property Node(instance in="All Message Queues.gtype" {all zero or empty}, "Internal"=w3, "Notifications"=w8) -> (instance out=w2)
      w10 = "All Notification Message Ids.gtype" {"Initialise"="Initialise", "Exit"="Exit", "Error"="Error", "Result"="Result", "Done"="Done"}
      # Enqueue an Initialise Message to allow any consumer to do any initialisation
      # necessary before processing further messages.
      Property Node(instance in=w10) -> ("Initialise"=w11)
      call "Enqueue Message.gvi"(Message Queue In=w8, Message Id=w11, Error In=w9) -> (Error Out=w1)
    }
    frame Error {
      w1 = $"Error In"
      w2 = default
    }
  }
  $"Message Queues" <- w2
  $"Error Out" <- w1
