vi "Dequeue Message.gvi"   [LabVIEW NXG 5.0.0]
# Removes a message from the queue.  If no message found in Timeout then returns nothing – default is to wait 60 seconds.
inputs:
  "Error In": error
  "Message Queue In": Queue<"Message.gtype">
  "Timeout": i32 = 60000  # Timout in milliseconds. The dequeue will only wait this long.
outputs:
  "Message Queue Out": Queue<"Message.gtype">
  "Message Id": string  # The message identifier dequeued.
  "Message Data": variant  # The data dequeued. The receiver must know how to decode the variant.
  "Error Out": error
  "Timed Out?": bool  # Indiciation of whether or not the dequeue timed out.
types:
  "Message.gtype" = cluster{"Message Id": string, "Message Data": variant}
diagram:
  $"Message Queue Out" <- $"Message Queue In"
  Dequeue Element(queue=$"Message Queue In", timeout in ms=$Timeout) -> (element=w1, error out=w2, timed out?=w3)
  Property Node(instance in=w1) -> ("Message Id"=w4, "Message Data"=w5)
  $"Message Id" <- w4
  $"Message Data" <- w5
  $"Timed Out?" <- w3
  Merge Errors($"Error In", w2) -> (error out=w6)
  $"Error Out" <- w6
