vi "Enqueue Message.gvi"   [LabVIEW NXG 5.0.0]
# Places a message on the queue; at the front if it’s high priority
inputs:
  "Message Queue In": Queue<"Message.gtype">
  "Message Id": string  # The message identifier to enqueue.
  "Message Data": variant  # The data to enqueue.
  "Error In": error
  "Priority?": bool  # Treat as a priority message? If yes, then the message is enqueued at the front of the queue.
outputs:
  "Message Queue Out": Queue<"Message.gtype">
  "Error Out": error
types:
  "Message.gtype" = cluster{"Message Id": string, "Message Data": variant}
diagram:
  $"Message Queue Out" <- $"Message Queue In"
  Property Node(instance in="Message.gtype" {all zero or empty}, "Message Id"=$"Message Id", "Message Data"=$"Message Data") -> (instance out=w1)
  case ($"Priority?") {
    frame False, Default {
      Enqueue Element(element=w1, error in=$"Error In", queue=$"Message Queue In") -> (error out=w2)
    }
    frame True {
      Enqueue Element At Opposite End(element=w1, error in=$"Error In", queue=$"Message Queue In") -> (error out=w2)
    }
  }
  $"Error Out" <- w2
