vi "Release All Message Queues.gvi"   [LabVIEW NXG 5.0.0]
# Destroys all message queues, invalidating references and removing any existing messages on the queues.
inputs:
  "Message Queues": "All Message Queues.gtype"  # Container for all message queues.
  "Error In": error
outputs:
  "Error Out": error
types:
  "All Message Queues.gtype" = cluster{"Internal": Queue<"Message.gtype">, "Notifications": Queue<"Message.gtype">}
diagram:
  $"Error Out" <- $"Error In"
  Property Node(instance in=$"Message Queues") -> ("Internal"=w1, "Notifications"=w2)
  Release Queue(force destroy=TRUE, queue=w1)
  Release Queue(force destroy=TRUE, queue=w2)
