vi "Reset Message Queue.gvi"   [LabVIEW NXG 5.0.0]
# Empties the queue of any existing messages and adds an Initialise message.  This will create a known, good start point for processing.
inputs:
  "Message Queue In": Queue<"Message.gtype">
  "Error In": error
outputs:
  "Message Queue Out": Queue<"Message.gtype">
  "Error Out": error
types:
  "Message.gtype" = cluster{"Message Id": string, "Message Data": variant}
  "All Internal Message Ids.gtype" = cluster{"Initialise": string, "Stop": string, "Done": string, "Exit": string, "Process": string, "Continue": string, "Pause": string, "Resume": string}
uses:
  Hardware Abstraction Framework::Support::Messages::Enqueue Message.gvi
diagram:
  w1 = "All Internal Message Ids.gtype" {"Initialise"="Initialise", "Stop"="Stop", "Done"="Done", "Exit"="Exit", "Process"="Process", "Continue"="Continue", "Pause"="Pause", "Resume"="Resume"}
  Property Node(instance in=w1) -> ("Initialise"=w2)
  Flush Queue(error in=$"Error In", queue=$"Message Queue In") -> (error out=w3, queue out=w4)
  call "Enqueue Message.gvi"(Message Queue In=w4, Message Id=w2, Error In=w3) -> (Message Queue Out=w5, Error Out=w6)
  $"Message Queue Out" <- w5
  $"Error Out" <- w6
