vi "Operation Complete.gvi"   [LabVIEW NXG 5.0.0]
# Checks to see if any existing operations being executed on an instrument have finished.
inputs:
  "Session In": "VISA Instr"  # Session identifier for the Instrument under control.
  "Error In": error
outputs:
  "Error Out": error
  "Operation Complete": bool  # Set to true if the previous operations have completed.
  "Session Out": "VISA Instr"  # Session identifier for the Instrument under control.
uses:
  NI::VISA::Write (Instr, String).gvi
  NI::VISA::Read (Instr, String).gvi
diagram:
  case ($"Error In") {
    frame Error, Default {
      # On error in, command can't complete
      w1 = $"Error In"
      w2 = TRUE
      w3 = $"Session In"
    }
    frame No Error {
      # Byte count must be (at least) 2 bytes for
      # some instruments to not error.  Some manuals
      # imply the return for *ESR? is one byte!
      call "Write (Instr, String).gvi"(session in=$"Session In", error in=$"Error In", write buffer="*ESR?\n") -> (session out=w4, error out=w5)
      call "Read (Instr, String).gvi"(session in=w4, error in=w5, byte count=2) -> (session out=w3, error out=w1, read buffer=w6)
      Decimal String To Number(string=w6) -> (number=w7)
      Logical And(w7, 1) -> w8
      Is Equal(x=w8, y=1) -> w2
    }
  }
  $"Session Out" <- w3
  $"Error Out" <- w1
  $"Operation Complete" <- w2
