vi "Wait For Completion.gvi"   [LabVIEW NXG 5.0.0]
# Checks with the Instrument for any running commands, waiting for them to complete.  If Block on Wait is True, then all other processing is blocked until the commands are finished; if False then the processing.
# In either case, the wait will timeout as requested, or after 5 seconds by default.
inputs:
  "Session In": "VISA Instr"  # Session identifier for the instrument under control.
  "BlockOnWait": bool  # Set to true if the application should block execution whilst waiting for the previous command to finish
  "Timeout": u32 = 5000  # Timeout for waiting, defaults to 5 seconds.
  "Error In": error
outputs:
  "Error Out": error
  "Session Out": "VISA Instr"  # Session identifier for the Instrument under control.
uses:
  NI::VISA::Write (Instr, String).gvi
  NI::G Core::Timing::Elapsed Timer.gvi
  Hardware Abstraction Framework::Support::Query::Operation Complete.gvi
diagram:
  # Sends a query to the instrument, waiting for previous commands to complete.
  #
  # Event Status Register is cleared then an Operation Complete command sent.  The instrument is
  # checked for an ESR bit 0 = 1 which indicates that all operations are complete before continuing.
  #
  # It will timeout after the requested time and raise an error if commands do not complete.
  case ($"Error In") {
    frame Error, Default {
      w1 = $"Error In"
      w2 = $"Session In"
    }
    frame No Error {
      case ($BlockOnWait) {
        frame False, Default {
          call "Write (Instr, String).gvi"(session in=$"Session In", error in=$"Error In", write buffer="*CLS\n") -> (session out=w3, error out=w4)
          call "Write (Instr, String).gvi"(session in=w3, error in=w4, write buffer="*OPC\n") -> (session out=w5, error out=w6)
          To Double Precision Float(number=$Timeout) -> w7
          while {
            call "Elapsed Timer.gvi"(target time=w7) -> (time has elapsed=w8)
            call "Elapsed Timer.gvi"(target time=0.05) -> (elapsed time=w9, time has elapsed=w10)
            case (w10) {
              frame False, Default {
                w13 = error {"status"=TRUE, "code"=204, "source"="Timeout occurred waiting for command to complete"}
                Select(s=w8, t=w13, f=w6) -> w12
                w11 = w8
                w2 = w5
              }
              frame True {
                w14 = error {"status"=TRUE, "code"=204, "source"="Timeout occurred waiting for command to complete"}
                # Check if complete every
                # 50ms and no timeout
                Select(s=w8, t=w14, f=w6) -> w15
                call "Operation Complete.gvi"(Session In=w5, Error In=w15) -> (Session Out=w2, Operation Complete=w11, Error Out=w12)
              }
            }
            Property Node(instance in=w12) -> ("status"=w16, instance out=w1)
            Logical Or(w11, w16) -> w17
            stop if w17
          }
        }
        frame True {
          # This will block until a response is received
          # or the command timesout
          call "Write (Instr, String).gvi"(session in=$"Session In", error in=$"Error In", write buffer="*OPC?\n") -> (session out=w2, error out=w1)
        }
      }
    }
  }
  $"Session Out" <- w2
  $"Error Out" <- w1
