vi "Find Connected Resources.gvi"   [LabVIEW NXG 5.0.0]
# Builds a collection of Resources currently attached to the system.
inputs:
  "Expression In": string  # Search expression string. See Find Resource help for more details.
  "AbstractResourceEnumerator in": "AbstractResourceEnumerator.gtype"
  "Error in": error
  "Return Aliases?": bool = TRUE  # Returns the resource alias name if available, rather than canonical name.
outputs:
  "Found Resources": string[]  # Array of resource names.
  "AbstractResourceEnumerator out": "AbstractResourceEnumerator.gtype"
  "Error out": error
uses:
  NI::VISA::Find Resource (Search Resources).gvi
  NI::G Core::Error::Filter Error Code.gvi
  NI::G Core::Error::Multiplex Errors.gvi
diagram:
  $"AbstractResourceEnumerator out" <- $"AbstractResourceEnumerator in"
  call "Find Resource (Search Resources).gvi"(expression=$"Expression In", return aliases if available?=$"Return Aliases?") -> (found resources=w1, error out=w2)
  case (w2) {
    frame No Error {
      w3 = w2
      w4 = w1
    }
    frame Error {
      # Error raised if no resources connected; ignore this and
      # return an empty array instead.
      call "Filter Error Code.gvi"(error in=w2, code to clear=-1073807343) -> (error out=w3)
      w4 = string[] []
    }
  }
  $"Found Resources" <- w4
  call "Multiplex Errors.gvi"(error in 1=$"Error in", error in 2=w3) -> (error out=w5)
  $"Error out" <- w5
