vi "Read Enumerated Resources.gvi"   [LabVIEW NXG 5.0.0]
# Returns the collection of Resources connected to the System.  This collection can be refreshed before return.  If the collection is empty, Resources will be enumerated first.
inputs:
  "Refresh?": bool  # Refreshes the enumerated Resource collection before returning the collection.
  "AbstractDriverEnumerator in": "AbstractResourceEnumerator.gtype"
  "Error in": error
outputs:
  "Enumerated Resources": "ResourceStructure.gtype"[]  # Collection of enumerated Resources connected to the System
  "AbstractDriverEnumerator out": "AbstractResourceEnumerator.gtype"
  "Error out": error
types:
  "ResourceStructure.gtype" = cluster{"Alias": string, "Canonical": string}
uses:
  Hardware Abstraction Framework::Utilities::AbstractResourceEnumerator.gtype::Refresh.gvi
diagram:
  case ($"Error in") {
    frame No Error {
      Property Node(instance in=$"AbstractDriverEnumerator in") -> ("Enumerated Resources"=w4, instance out=w5)
      Array Size(array=w4) -> (size(s)=w6)
      Is Equal To 0(x=w6) -> w7
      Logical Or(w7, $"Refresh?") -> w8
      case (w8) {
        frame False, Default {
          w9 = w5
          w1 = $"Error in"
        }
        frame True {
          call "Refresh.gvi"(AbstractResourceEnumerator in=w5, Error in=$"Error in") -> (AbstractResourceEnumerator out=w9, Error out=w1)
        }
      }
      Property Node(instance in=w9) -> ("Enumerated Resources"=w3, instance out=w2)
    }
    frame Error {
      w1 = $"Error in"
      w2 = $"AbstractDriverEnumerator in"
      w3 = default
    }
  }
  $"AbstractDriverEnumerator out" <- w2
  $"Enumerated Resources" <- w3
  $"Error out" <- w1
