vi "Refresh.gvi"   [LabVIEW NXG 5.0.0]
# Rebuilds the collection of enumerated Resources connected to the system.
inputs:
  "AbstractResourceEnumerator in": "AbstractResourceEnumerator.gtype"
  "Error in": error
outputs:
  "AbstractResourceEnumerator out": "AbstractResourceEnumerator.gtype"
  "Error out": error
panel controls:
  "DriverStructure": "ResourceStructure.gtype"
types:
  "ResourceStructure.gtype" = cluster{"Alias": string, "Canonical": string}
uses:
  Hardware Abstraction Framework::Utilities::AbstractResourceEnumerator.gtype::Find Connected Resources.gvi
  NI::VISA::Open (GPIB Interface).gvi
  NI::VISA::Close (GPIB Interface).gvi
  Hardware Abstraction Framework::Utilities::AbstractResourceEnumerator.gtype::Write Enumerated Resources.gvi
diagram:
  case ($"Error in") {
    frame No Error {
      call "Find Connected Resources.gvi"(AbstractResourceEnumerator in=$"AbstractResourceEnumerator in", Expression In="?*", Return Aliases?=TRUE, Error in=$"Error in") -> (Found Resources=w3, Error out=w4)
      s1 = w4  # shift register
      s2 = "ResourceStructure.gtype"[] []  # shift register
      for (iteration -> i1) {
        w5 = each element of w3
        call "Open (GPIB Interface).gvi"(resource name=w5, error in=s1, duplicate session=TRUE) -> (session out=w6, error out=w7)
        case (w7) {
          frame Error, Default {
            w8 = w7
            w9 = s2
          }
          frame No Error {
            Property Node(instance in=w6, error in=w7) -> ("Rsrc Name"=w10, error out=w11, instance out=w12)
            call "Close (GPIB Interface).gvi"(session in=w12, error in=w11) -> (error out=w8)
            Property Node(instance in=$DriverStructure, "Canonical"=w10, "Alias"=w5) -> (instance out=w13)
            Insert Into Array(inArray=s2, index0=i1, new=w13) -> w9
          }
        }
        next s1 = w8
        next s2 = w9
      }
      call "Write Enumerated Resources.gvi"(AbstractResourceEnumerator in=$"AbstractResourceEnumerator in", Enumerated Resources=s2, Error in=s1) -> (AbstractResourceEnumerator out=w2, Error out=w1)
    }
    frame Error {
      w1 = $"Error in"
      w2 = $"AbstractResourceEnumerator in"
    }
  }
  $"AbstractResourceEnumerator out" <- w2
  $"Error out" <- w1
