vi "Reset Framework.gvi"   [LabVIEW NXG 5.0.0]
# Resets the framework back to an initial state.  Specifically, it resets TAGs to a start state.
types:
  "All Message Queues.gtype" = cluster{"Internal": Queue<"Message.gtype">, "Notifications": Queue<"Message.gtype">}
uses:
  Hardware Abstraction Framework::Support::Messages::Create All Message Queues.gvi
  Hardware Abstraction Framework::Support::Events::Release All Events.gvi
  Hardware Abstraction Framework::Support::Events::Create All Events.gvi
diagram:
  w1 = "Hardware Abstraction Framework::Support::Resources.grsc::GeneratedUUIDs"
  # Resets any previously generated UUIDs
  Tag Read(data in=variant(), ref in=w1) -> (Data=w2, ref out=w3)
  Delete Variant Attribute(variant in=w2) -> (variant out=w4)
  Tag Write(Data=w4, ref in=w3)
  w5 = "Hardware Abstraction Framework::Support::Resources.grsc::MessageQueues"
  # Creates new Message Queues
  Tag Read(data in="All Message Queues.gtype" {all zero or empty}, ref in=w5) -> (ref out=w6)
  call "Create All Message Queues.gvi"() -> (Message Queues=w7)
  Tag Write(Data=w7, ref in=w6)
  # Releases any existing events and creates new ones
  sequence {
    frame 0 {
      w8 = "Hardware Abstraction Framework::Support::Resources.grsc::Events"
      Tag Read(ref in=w8) -> (Data=w9, ref out=w10)
      call "Release All Events.gvi"(All Events=w9)
    }
    frame 1 {
      call "Create All Events.gvi"() -> (Events=w11)
      Tag Write(Data=w11, ref in=w10)
    }
  }
