vi "Setup Framework.gvi"   [LabVIEW NXG 5.0.0]
# Set up the framework to an initial state.  Specifically, it sets the event and messages TAGs to an initial state.
types:
  "All Message Queues.gtype" = cluster{"Internal": Queue<"Message.gtype">, "Notifications": Queue<"Message.gtype">}
uses:
  Hardware Abstraction Framework::Support::Messages::Create All Message Queues.gvi
  Hardware Abstraction Framework::Support::Events::Create All Events.gvi
diagram:
  w1 = "Hardware Abstraction Framework::Support::Resources.grsc::MessageQueues"
  # Creates new Message Queues
  Tag Read(data in="All Message Queues.gtype" {all zero or empty}, ref in=w1) -> (ref out=w2)
  call "Create All Message Queues.gvi"() -> (Message Queues=w3)
  Tag Write(Data=w3, ref in=w2)
  w4 = "Hardware Abstraction Framework::Support::Resources.grsc::Events"
  # Creates new Events
  Tag Read(ref in=w4) -> (ref out=w5)
  call "Create All Events.gvi"() -> (Events=w6)
  Tag Write(Data=w6, ref in=w5)
