vi "Teardown Frameworkgvi.gvi"   [LabVIEW NXG 5.0.0]
# Releases any resources the framework used.  Specifically, it releases events and message queues.
inputs:
  "Error In": error
outputs:
  "Error Out": error
types:
  "All Message Queues.gtype" = cluster{"Internal": Queue<"Message.gtype">, "Notifications": Queue<"Message.gtype">}
uses:
  Hardware Abstraction Framework::Support::Messages::Release All Message Queues.gvi
  Hardware Abstraction Framework::Support::Events::Release All Events.gvi
diagram:
  w1 = "Hardware Abstraction Framework::Support::Resources.grsc::GeneratedUUIDs"
  # Resets any previously generated UUIDs
  Tag Read(data in=variant(), ref in=w1) -> (Data=w2, ref out=w3)
  Delete Variant Attribute(variant in=w2) -> (variant out=w4)
  Tag Write(Data=w4, ref in=w3)
  w5 = "Hardware Abstraction Framework::Support::Resources.grsc::MessageQueues"
  # Releases Message Queues
  Tag Read(data in="All Message Queues.gtype" {all zero or empty}, ref in=w5) -> (Data=w6)
  call "Release All Message Queues.gvi"(Message Queues=w6)
  w7 = "Hardware Abstraction Framework::Support::Resources.grsc::Events"
  # Releases any existing events and notifiers and creates new ones
  Tag Read(ref in=w7) -> (Data=w8)
  call "Release All Events.gvi"(All Events=w8)
  $"Error Out" <- $"Error In"
