vi "Tokenise String.gvi"   [LabVIEW NXG 5.0.0]
# Given a String and a delimiter, returns an array of tokens parsed from the String along with a count of tokens.  If there are no delimited tokens, then the input string will be returned as the only token and token count will be 1.
# An empty string is a valid input and will be returned with count of 1.
# Tokens found is only true if tokens were actually found – i.e. if the tokens array doesn’t just contain the input string.
inputs:
  "String to Parse": string  # The String to parse into tokens.
  "Delimiter": string = ","  # The delimiter to identify tokens.
  "Error In": error
outputs:
  "Error Out": error
  "Tokens": string[]  # The tokens parsed from the String.
  "Token Count": i32  # A count of the number of tokens found.
  "Tokens Found?": bool  # An indicator set to true if tokens were actually found.
uses:
  NI::G Core::Strings::Trim Whitespace.gvi
diagram:
  case ($"Error In") {
    frame Error, Default {
      w1 = default
      w2 = default
      w3 = default
      w4 = $"Error In"
    }
    frame No Error {
      Build Array($Delimiter) -> w5
      s1 = 0  # shift register
      while {
        Scan String For Tokens(allow empty tokens=TRUE, delimiters=w5, input string=$"String to Parse", offset=s1) -> (offset past token=w7, token index=w8, token string=w9)
        call "Trim Whitespace.gvi"(string=w9) -> (trimmed string=w10)
        Is Equal(x=w8, y=-2) -> w11
        append w10 to w6
        next s1 = w7
        stop if w11
      }
      Array Size(array=w6) -> (size(s)=w12)
      Decrement(x=w12) -> w2
      # Delete last entry as it
      # will be an empty string.
      Delete From Array(inArray=w6, index0=w2) -> w1
      Is Greater(x=w2, y=1) -> w3
      w4 = $"Error In"
    }
  }
  $Tokens <- w1
  $"Tokens Found?" <- w3
  $"Token Count" <- w2
  $"Error Out" <- w4
