vi "Build Driver Setting Mappings.gvi"   [LabVIEW NXG 5.0.0]
# Builds the array of Driver Setting mappings.  Must be implemented by sub classes as this member will raise an error.
inputs:
  "DMM6500 in": "DMM6500.gtype"
  "Error in": error
outputs:
  "Driver Setting Mappings": "Setting Map Structure.gtype"[]
  "DMM6500 out": "DMM6500.gtype"
  "Error out": error
types:
  "Setting Map Structure.gtype" = cluster{"Executable Setting Name": string, "Driver Setting Name": string, "Driver Setting Data Type": string}
uses:
  Hardware Abstraction Framework::Common::Driver.gtype::Write Driver Setting Mappings.gvi
diagram:
  case ($"Error in") {
    frame Error, Default {
      w1 = $"DMM6500 in"
      w2 = $"Error in"
    }
    frame No Error {
      # No settings
      Initialize Array(element="Setting Map Structure.gtype" {all zero or empty}) -> w3
      call "Write Driver Setting Mappings.gvi"(Driver in=$"DMM6500 in", Driver Setting Mappings=w3, Error in=$"Error in") -> (Driver out=w1, Error out=w2)
      $"Driver Setting Mappings" <- w3
    }
  }
  $"DMM6500 out" <- w1
  $"Error out" <- w2
