vi "Select Buffer Elements.gvi"   [LabVIEW NXG 5.0.0]
inputs:
  "Item Indices": i32[]
  "Error In": error
outputs:
  "Error Out": error
  "Selected Buffer Elements": string[]
diagram:
  w1 = ["CHANNEL", "DATE", "EXTRA", "EXTRAFORMATTED", "EXTRAUNIT", "FORMATTED", "FRACTIONAL", "READING", "RELATIVE", "SECONDS", "STATUS", "TIME", "TSTAMP", "UNIT"]
  case ($"Error In") {
    frame Error, Default {
      w2 = $"Error In"
    }
    frame No Error {
      s1 = string[] []  # shift register
      for {
        w3 = each element of $"Item Indices"
        Array Index(array=w1) -> (out0[w3]=w4)
        Insert Into Array(inArray=s1, new=w4) -> w5
        next s1 = w5
      }
      $"Selected Buffer Elements" <- s1
      w2 = $"Error In"
    }
  }
  $"Error Out" <- w2
