vi "Map To Driver.gvi"   [LabVIEW NXG 5.0.0]
# Passed an alias or canonical name returns a specific Driver instance based on my instruments.
inputs:
  "Driver Name": string  # The alias or resource name of the Driver to be mapped.
  "ResourceEnumeration in": "ResourceEnumerator.gtype"
  "Error in": error
  "Refresh Resources?": bool = TRUE  # Should the enumerated Resources be refreshed?
  "Search by Alias?": bool = TRUE  # If True, then the mapping will use an alias name, otherwise the canonical name.
outputs:
  "Driver": "Driver.gtype"  # A Driver instance mapped from an alias or resource name.
  "ResourceEnumeration out": "ResourceEnumerator.gtype"
  "Error out": error
uses:
  Hardware Abstraction Framework::Utilities::AbstractResourceEnumerator.gtype::Read Enumerated Resources.gvi
  NI::G Core::Error::Build Error Cluster.gvi
diagram:
  case ($"Error in") {
    frame Error, Default {
      w1 = $"ResourceEnumeration in"
      w2 = $"Error in"
    }
    frame No Error {
      call "Read Enumerated Resources.gvi"(AbstractDriverEnumerator in=$"ResourceEnumeration in", Refresh?=$"Refresh Resources?", Error in=$"Error in") -> (AbstractDriverEnumerator out=w1, Enumerated Resources=w3, Error out=w4)
      for {
        w5 = each element of w3
        Property Node(instance in=w5) -> ("Alias"=w6)
        Property Node(instance in=w5) -> ("Canonical"=w7)
        Select(s=$"Search by Alias?", t=w6, f=w7) -> w8
        Is Equal(x=w8, y=$"Driver Name") -> w9
        Select(s=w9, t=w8, f="Next") -> w10
        case (w10) {
          frame "DMM6500" {
            w11 = TRUE
            w12 = "DMM6500.gtype" constant
          }
          frame "PSU-HMC8043" {
            w11 = TRUE
            w12 = "HMC8043.gtype" constant
          }
          frame "Scope-SDS1204X-E" {
            w11 = TRUE
            w12 = "SDS1204X-E.gtype" constant
          }
          frame "AWG-SDG1062X" {
            w11 = TRUE
            w12 = "SDG1062X.gtype" constant
          }
          frame "ArduinoUNOR3" {
            w11 = TRUE
            w12 = "ArduinoUnoR3.gtype" constant
          }
          frame "ArduinoMega2560" {
            w11 = TRUE
            w12 = "ArduinoMega2560.gtype" constant
          }
          frame "InstrumentControlBoard" {
            w11 = TRUE
            w12 = "InstrumentControlBoard.gtype" constant
          }
          frame "Next", Default {
            # No match, skip to next
            w11 = FALSE
            w12 = default
          }
        }
        $Driver <- w12
        stop if w11
      }
      case (w11) {
        frame False, Default {
          call "Build Error Cluster.gvi"(code=202, description="No Resource found") -> (error out=w2)
        }
        frame True {
          # Driver found
          w2 = w4
        }
      }
    }
  }
  $"ResourceEnumeration out" <- w1
  $"Error out" <- w2
