vi "Read Serial Port Attributes.gvi"   [LabVIEW NXG 5.0.0]
# Returns the attributes to use to configure the Serial Port used by this Driver.
inputs:
  "ArduinoMega2560 in": "ArduinoMega2560.gtype"
  "Error in": error
outputs:
  "Serial Port Attributes": "SerialPortAttributes.gtype"
  "ArduinoMega2560 out": "ArduinoMega2560.gtype"
  "Error out": error
types:
  "SerialPortAttributes.gtype" = cluster{"Baud Rate": u32, "Data Bits": u16, "Parity": u16, "Data Flow": u16, "Stop Bits": u16, "Establish Wait": u32}
uses:
  Hardware Abstraction Framework::Common::SerialDriver.gtype::Read Serial Port Attributes.gvi
diagram:
  call parent "Read Serial Port Attributes.gvi"(SerialDriver in=$"ArduinoMega2560 in", Error in=$"Error in") -> (SerialDriver out=w1, Serial Port Attributes=w2, Error out=w3)
  $"ArduinoMega2560 out" <- w1
  Property Node(instance in=w2, "Baud Rate"=115200, "Establish Wait"=2000) -> (instance out=w4)
  $"Serial Port Attributes" <- w4
  $"Error out" <- w3
