vi "Assert.gvi"   [LabVIEW NXG 5.0.0]
# This member actually undertakes the comparison of the expected result and actual result parameters passed in.  It returns a result boolean – true if pass, false if fail – and a message detailing the result if a fail.
# Raises error 101 if this member is not overridden by sub classes.
inputs:
  "Expected Result": variant  # Variant containing the expected result of a test. This variant should contain attribute “String Value” with a string representation of the result if the assertion message is to contain its data – see Utilities>Set String Value.
  "Assertion in": "AbstractAssertion.gtype"
  "Error in": error
  "Actual Result": variant  # Variant containing the actual result of a test. This variant should contain attribute “String Value” with a string representation of the result if the assertion message is to contain its data – see Utilities>Set String Value.
outputs:
  "Result": bool  # Result of the assertion.
  "Assertion out": "AbstractAssertion.gtype"
  "Error out": error
  "Message": string  # A message related to the assertion result, e.g. “Asserted Equal” or “Expected X, got Y”.
uses:
  NI::G Core::Error::Build Error Cluster.gvi
  NI::G Core::Error::Multiplex Errors.gvi
diagram:
  $"Assertion out" <- $"Assertion in"
  $Result <- FALSE
  w1 = "Incorrectly using the Assertion base class which does nothing"
  $Message <- w1
  # This class should not be used to actually perform an assertion
  call "Build Error Cluster.gvi"(code=101, description="Assertion must not use the base class Assert method") -> (error out=w2)
  call "Multiplex Errors.gvi"(error in 1=w2, error in 2=$"Error in") -> (error out=w3)
  $"Error out" <- w3
