vi "Assertion Message.gvi"   [LabVIEW NXG 5.0.0]
# Builds a message to return to the caller describing a failed assertion result.  If message base contains %s then a value from the results variants will be embedded.  There should be a %s substring for each of the Expected and Actual results and will be applied in that order; to switch order use %1$s and %2$s to represent the Expected and Actual results.
inputs:
  "Expected Result in": variant  # Variant containing a value that represents the Expected test result. The value should be of an appropriate type to work with the Assertion itself; conversion helper VIs are provided in namespace Utilities. It should also have an attribute named “String Value” which represents a pre-formatted representation of the value to appear in any result message.
  "AbstractAssertion in": "AbstractAssertion.gtype"
  "Error in": error
  "Actual Result in": variant  # Variant containing a value that represents the Actual test result. The value should be of an appropriate type to work with the Assertion itself; conversion helper VIs are provided in namespace Utilities. It should also have an attribute named “String Value” which represents a pre-formatted representation of the value to appear in any result message.
  "Message Base": string  # The message to be used if the assertion fails. It can contain placeholders, %s, to hold the Expected and Actual values. Each placeholder is updated in order. If a different order is required, use placeholders %1$s and %2$s to represent Expected and Actual results respectively.
  "Result": bool  # The result of the assertion.
outputs:
  "Message": string  # Formatted message that details the result of the assertion.
  "AbstractAssertion out": "AbstractAssertion.gtype"
  "Error out": error
uses:
  LabViewNXG Test Framework::Utilities::Get Value String.gvi
  NI::G Core::Error::Multiplex Errors.gvi
diagram:
  case ($"Error in") {
    frame Error, Default {
      w1 = $"AbstractAssertion in"
      w2 = $"Error in"
      w3 = "Test Errored"
    }
    frame No Error {
      case ($Result) {
        frame True {
          w2 = $"Error in"
          w3 = "Test Successful"
        }
        frame False, Default {
          call "Get Value String.gvi"(Variant with Value in=$"Expected Result in", Error in=$"Error in") -> (Value as String=w4, Error out=w5)
          call "Get Value String.gvi"(Variant with Value in=$"Actual Result in") -> (Value as String=w6, Error out=w7)
          call "Multiplex Errors.gvi"(error in 1=w5, error in 2=w7, error in 3=$"Error in") -> (error out=w8)
          Format Into String(formatString=$"Message Base", initString="", errIn=w8, w4, w6) -> (outString=w3, errOut=w2)
        }
      }
      w1 = $"AbstractAssertion in"
    }
  }
  $"AbstractAssertion out" <- w1
  $Message <- w3
  $"Error out" <- w2
