vi "Assert.gvi"   [LabVIEW NXG 5.0.0]
inputs:
  "Expected Result": variant
  "Assertion in": "AssertContainedIn.gtype"
  "Error in": error
  "Actual Result": variant
outputs:
  "Result": bool  # Result of the assertion.
  "Assertion out": "AssertContainedIn.gtype"
  "Error out": error
  "Message": string  # A message related to the assertion result, e.g. “Asserted Equal” or “Expected X, got Y”
uses:
  LabViewNXG Test Framework::Utilities::Get Value Array.gvi
  LabViewNXG Test Framework::Assertions::AbstractAssertion.gtype::Assertion Message.gvi
diagram:
  case ($"Error in") {
    frame Error, Default {
      w1 = $"Assertion in"
      w2 = "Errpr occurred asserting equal"
      w3 = FALSE
      w4 = $"Error in"
    }
    frame No Error {
      call "Get Value Array.gvi"(Variant with Value in=$"Expected Result", Error In=$"Error in") -> (Variant with Value out=w5, Value as Array=w6, Error Out=w7)
      call "Get Value Array.gvi"(Variant with Value in=$"Actual Result", Error In=w7) -> (Variant with Value out=w8, Value as Array=w9, Error Out=w10)
      case (w10) {
        frame Error, Default {
          call "Assertion Message.gvi"(Result=FALSE, AbstractAssertion in=$"Assertion in", Expected Result in=w5, Actual Result in=w8, Message Base="At least one value is not an Array: %s and %s") -> (AbstractAssertion out=w1, Message=w2)
          w3 = FALSE
          w4 = $"Error in"
        }
        frame No Error {
          # Iterates through Actual result and for each element attempts
          # to find it in Expected result.  Inner loop terminates as soon as
          # it is found; outer loop terminates if a value is not found.
          for {
            w11 = each element of w9
            for {
              w12 = each element of w6
              Is Equal(x=w12, y=w11) -> w3
              stop if w3
            }
            continue if w3
          }
          w13 = "Actual value()s, %2$s, not (all) found in Expected Array, %1$s"
          call "Assertion Message.gvi"(Result=w3, AbstractAssertion in=$"Assertion in", Expected Result in=w5, Actual Result in=w8, Message Base=w13, Error in=$"Error in") -> (AbstractAssertion out=w1, Message=w2, Error out=w4)
        }
      }
    }
  }
  $"Assertion out" <- w1
  $Message <- w2
  $Result <- w3
  $"Error out" <- w4
