vi "Assert.gvi"   [LabVIEW NXG 5.0.0]
inputs:
  "Expected Result": variant
  "Assertion in": "AssertEqual.gtype"
  "Error in": error
  "Actual Result": variant
outputs:
  "Result": bool  # Result of the assertion.
  "Assertion out": "AssertEqual.gtype"
  "Error out": error
  "Message": string  # A message related to the assertion result, e.g. “Asserted Equal” or “Expected X, got Y”
uses:
  LabViewNXG Test Framework::Assertions::AbstractAssertion.gtype::Assertion Message.gvi
diagram:
  case ($"Error in") {
    frame Error, Default {
      w1 = $"Assertion in"
      w2 = "Errpr occurred asserting equal"
      w3 = FALSE
      w4 = $"Error in"
    }
    frame No Error {
      Is Equal(x=$"Expected Result", y=$"Actual Result") -> w3
      call "Assertion Message.gvi"(Result=w3, AbstractAssertion in=$"Assertion in", Expected Result in=$"Expected Result", Actual Result in=$"Actual Result", Message Base="Values should be equal: %s and %s", Error in=$"Error in") -> (AbstractAssertion out=w1, Message=w2, Error out=w4)
    }
  }
  $"Assertion out" <- w1
  $Message <- w2
  $Result <- w3
  $"Error out" <- w4
