vi "Assert.gvi"   [LabVIEW NXG 5.0.0]
inputs:
  "Expected Result": variant
  "Assertion in": "AssertErrorRaised.gtype"
  "Error in": error
  "Actual Result": variant
outputs:
  "Result": bool  # Result of the assertion.
  "Assertion out": "AssertErrorRaised.gtype"
  "Error out": error
  "Message": string  # A message related to the assertion result, e.g. “Asserted Equal” or “Expected X, got Y”
uses:
  LabViewNXG Test Framework::Utilities::Get Value Error.gvi
  LabViewNXG Test Framework::Assertions::AbstractAssertion.gtype::Assertion Message.gvi
  NI::G Core::Error::Read Error Code.gvi
  NI::G Core::Error::Is Error.gvi
  NI::G Core::Error::Filter Error Code.gvi
diagram:
  case ($"Error in") {
    frame Error, Default {
      w1 = $"Assertion in"
      w2 = "Errpr occurred asserting equal"
      w3 = FALSE
      w4 = $"Error in"
    }
    frame No Error {
      call "Get Value Error.gvi"(Variant with Value in=$"Expected Result", Error In=$"Error in") -> (Variant with Value out=w5, Value as Error=w6, Error Out=w7)
      call "Get Value Error.gvi"(Variant with Value in=$"Actual Result", Error In=w7) -> (Variant with Value out=w8, Value as Error=w9, Error Out=w10)
      case (w10) {
        frame Error, Default {
          call "Assertion Message.gvi"(Result=FALSE, AbstractAssertion in=$"Assertion in", Expected Result in=w5, Actual Result in=w8, Message Base="At least one Result is not an error type: %1$s and %2$s") -> (AbstractAssertion out=w1, Message=w2)
          w3 = FALSE
          w4 = $"Error in"
        }
        frame No Error {
          call "Read Error Code.gvi"(error in=w6) -> (code=w11)
          case (w11) {
            frame 0 {
              # any error
              call "Is Error.gvi"(error in=w9) -> (error?=w3)
            }
            frame 1, Default {
              # Specific error code
              call "Filter Error Code.gvi"(error in=w9, code to clear=w11) -> (error out=w12, error cleared?=w3)
            }
          }
          call "Assertion Message.gvi"(Result=w3, AbstractAssertion in=$"Assertion in", Expected Result in=w5, Actual Result in=w8, Message Base="Actual Result was not a (matching) Error: %s and %s", Error in=$"Error in") -> (AbstractAssertion out=w1, Message=w2, Error out=w4)
        }
      }
    }
  }
  $"Assertion out" <- w1
  $Message <- w2
  $Result <- w3
  $"Error out" <- w4
