vi "Assert.gvi"   [LabVIEW NXG 5.0.0]
inputs:
  "Expected Result": variant
  "Assertion in": "AssertFalse.gtype"
  "Error in": error
  "Actual Result": variant
outputs:
  "Result": bool  # Result of the assertion.
  "Assertion out": "AssertFalse.gtype"
  "Error out": error
  "Message": string  # A message related to the assertion result, e.g. “Asserted Equal” or “Expected X, got Y”
uses:
  LabViewNXG Test Framework::Utilities::Get Value Boolean.gvi
  LabViewNXG Test Framework::Assertions::AbstractAssertion.gtype::Assertion Message.gvi
diagram:
  case ($"Error in") {
    frame Error, Default {
      w1 = $"Assertion in"
      w2 = "Errpr occurred asserting equal"
      w3 = FALSE
      w4 = $"Error in"
    }
    frame No Error {
      call "Get Value Boolean.gvi"(Variant with Value in=$"Expected Result", Error In=$"Error in") -> (Variant with Value out=w5, Value as Boolean=w6, Error Out=w7)
      call "Get Value Boolean.gvi"(Variant with Value in=$"Actual Result", Error In=w7) -> (Variant with Value out=w8, Value as Boolean=w9, Error Out=w10)
      case (w10) {
        frame Error, Default {
          call "Assertion Message.gvi"(Result=FALSE, AbstractAssertion in=$"Assertion in", Expected Result in=w5, Actual Result in=w8, Message Base="At least one value is not a Boolean: %s and %s") -> (AbstractAssertion out=w1, Message=w2)
          w3 = FALSE
          w4 = $"Error in"
        }
        frame No Error {
          Logical Or[output inverted](w6, w9) -> w3
          call "Assertion Message.gvi"(Result=w3, AbstractAssertion in=$"Assertion in", Expected Result in=w5, Actual Result in=w8, Message Base="Values should be False: %s and %s", Error in=$"Error in") -> (AbstractAssertion out=w1, Message=w2, Error out=w4)
        }
      }
    }
  }
  $"Assertion out" <- w1
  $Message <- w2
  $Result <- w3
  $"Error out" <- w4
