vi "Assert.gvi"   [LabVIEW NXG 5.0.0]
inputs:
  "Expected Result": variant
  "Assertion in": "AssertNoErrorRaised.gtype"
  "Error In": error
  "Actual Result": variant
outputs:
  "Result": bool  # Result of the assertion.
  "Assertion out": "AssertNoErrorRaised.gtype"
  "Error out": error
  "Message": string  # A message related to the assertion result, e.g. “Asserted Equal” or “Expected X, got Y”
uses:
  LabViewNXG Test Framework::Utilities::Get Value Error.gvi
  LabViewNXG Test Framework::Assertions::AbstractAssertion.gtype::Assertion Message.gvi
  NI::G Core::Error::Is Error.gvi
diagram:
  case ($"Error In") {
    frame Error, Default {
      w1 = $"Assertion in"
      w2 = "Errpr occurred asserting equal"
      w3 = FALSE
      w4 = $"Error In"
    }
    frame No Error {
      call "Get Value Error.gvi"(Variant with Value in=$"Actual Result", Error In=$"Error In") -> (Variant with Value out=w5, Value as Error=w6, Error Out=w7)
      case (w7) {
        frame Error, Default {
          call "Assertion Message.gvi"(Result=FALSE, AbstractAssertion in=$"Assertion in", Expected Result in=$"Expected Result", Actual Result in=w5, Message Base="Actual Result is not an error type: %s and %s") -> (AbstractAssertion out=w1, Message=w2)
          w3 = FALSE
          w4 = $"Error In"
        }
        frame No Error {
          # Result inverted because an error should
          # fail the assertion
          call "Is Error.gvi"(error in=w6) -> (error?=w8)
          Not(x=w8) -> w3
          call "Assertion Message.gvi"(Result=w3, AbstractAssertion in=$"Assertion in", Expected Result in=$"Expected Result", Actual Result in=w5, Message Base="Actual Result was an Error: %s and %s", Error in=$"Error In") -> (AbstractAssertion out=w1, Message=w2, Error out=w4)
        }
      }
    }
  }
  $"Assertion out" <- w1
  $Message <- w2
  $Result <- w3
  $"Error out" <- w4
