vi "Assert.gvi"   [LabVIEW NXG 5.0.0]
inputs:
  "Expected Result": variant
  "Assertion in": "ForceError.gtype"
  "Error in": error
  "Actual Result": variant
outputs:
  "Result": bool  # Result of the assertion.
  "Assertion out": "ForceError.gtype"
  "Error out": error
  "Message": string  # A message related to the assertion result, e.g. “Asserted Equal” or “Expected X, got Y”
uses:
  LabViewNXG Test Framework::Utilities::Get Value Error.gvi
  NI::G Core::Error::Multiplex Errors.gvi
diagram:
  $"Assertion out" <- $"Assertion in"
  $Result <- FALSE
  $Message <- "IGNORED"
  call "Get Value Error.gvi"(Variant with Value in=$"Expected Result") -> (Value as Error=w1)
  # The asserter raises the passed error
  call "Multiplex Errors.gvi"(error in 1=w1, error in 2=$"Error in") -> (error out=w2)
  $"Error out" <- w2
