vi "Add Result.gvi"   [LabVIEW NXG 5.0.0]
# Adds the passed formatted results into the Test’s collection of results.  Increments number of passes/fails as appropriate.
# Normally called by the framework rather than user test code.
inputs:
  "Test Formatter": "FormattedTestResult.gtype"  # Result to add to the Test’s collection of results. Consists of a formatted cluster to aid display.
  "AbstractTest in": "AbstractTest.gtype"
  "Error in": error
outputs:
  "AbstractTest out": "AbstractTest.gtype"
  "Error out": error
types:
  "FormattedTestResult.gtype" = cluster{"Class Under Test": string, "Test ID": string, "Pass-Fail": bool, "Detail": string}
diagram:
  case ($"Error in") {
    frame No Error {
      Property Node(instance in=$"AbstractTest in") -> ("Test Results"=w3, "Tests Passed"=w4, "Tests Failed"=w5, instance out=w6)
      Property Node(instance in=$"Test Formatter") -> ("Pass-Fail"=w7, instance out=w8)
      case (w7) {
        frame False, Default {
          Increment(x=w5) -> w10
          w9 = w4
        }
        frame True {
          Increment(x=w4) -> w9
          w10 = w5
        }
      }
      Build Array(w3, w8) -> w11
      Property Node(instance in=w6, "Test Results"=w11, "Tests Passed"=w9, "Tests Failed"=w10) -> (instance out=w2)
      w1 = $"Error in"
    }
    frame Error {
      w1 = $"Error in"
      w2 = $"AbstractTest in"
    }
  }
  $"AbstractTest out" <- w2
  $"Error out" <- w1
