vi "Process Result.gvi"   [LabVIEW NXG 5.0.0]
# Handles the assertion and storing of test results on behalf of a test.  The Expected and Actual results are passed along with an Assertion to test these.  The formatted results should be pre-populated with the Class Under Test and Test Id; this member will populate the remaining fields from the assertion result.
inputs:
  "Expected Result": variant  # The expected test result. Should also contain an attribute “String Value” which represents a printable form of the variant value.
  "AbstractTest in": "AbstractTest.gtype"
  "Error in": error
  "Actual Result": variant  # The actual test result. Should also contain an attribute “String Value” which represents a printable form of the variant value.
  "Asserter": "AbstractAssertion.gtype"  # An Assertion object used to check expected result against actual result.
  "Formatted Results": "FormattedTestResult.gtype"  # Partially populated results cluster. Should contain the Class Under Test and Test Id. Other fields will be populated post assertion.
outputs:
  "AbstractTest out": "AbstractTest.gtype"
  "Error out": error
types:
  "FormattedTestResult.gtype" = cluster{"Class Under Test": string, "Test ID": string, "Pass-Fail": bool, "Detail": string}
uses:
  LabViewNXG Test Framework::Assertions::AbstractAssertion.gtype::Assert.gvi
  LabViewNXG Test Framework::Common::AbstractTest.gtype::Add Result.gvi
diagram:
  case ($"Error in") {
    frame No Error {
      call "Assert.gvi"(Assertion in=$Asserter, Expected Result=$"Expected Result", Actual Result=$"Actual Result", Error in=$"Error in") -> (Result=w3, Message=w4, Error out=w5)
      Property Node(instance in=$"Formatted Results", "Pass-Fail"=w3, "Detail"=w4) -> (instance out=w6)
      call "Add Result.gvi"(AbstractTest in=$"AbstractTest in", Test Formatter=w6, Error in=w5) -> (AbstractTest out=w2, Error out=w1)
    }
    frame Error {
      w1 = $"Error in"
      w2 = $"AbstractTest in"
    }
  }
  $"AbstractTest out" <- w2
  $"Error out" <- w1
