vi "Read Overall Result.gvi"   [LabVIEW NXG 5.0.0]
# Returns a boolean representing the overall result status of the test.  Each test can actually execute multiple test code each with its own result.  Return True only if all results are true.
inputs:
  "AbstractTest in": "AbstractTest.gtype"
  "Error in": error
outputs:
  "Overall Result": bool  # The overall result. True if all test code passes.
  "AbstractTest out": "AbstractTest.gtype"
  "Error out": error
diagram:
  case ($"Error in") {
    frame No Error {
      Property Node(instance in=$"AbstractTest in") -> ("Tests Failed"=w4)
      Is Equal To 0(x=w4) -> w3
      w1 = $"Error in"
      w2 = $"AbstractTest in"
    }
    frame Error {
      w1 = $"Error in"
      w2 = $"AbstractTest in"
      w3 = default
    }
  }
  $"AbstractTest out" <- w2
  $"Overall Result" <- w3
  $"Error out" <- w1
