vi "Run All Tests.gvi"   [LabVIEW NXG 5.0.0]
# A framework method that must be overridden by each concrete test class and which exercises the code under test.
# If this method is not overridden it will raise error 100.
# See examples for variations of implementation of this method.
inputs:
  "AbstractTest in": "AbstractTest.gtype"
  "Error in": error
outputs:
  "AbstractTest out": "AbstractTest.gtype"
  "Error out": error
panel controls:
  "FormattedTestResult": "FormattedTestResult.gtype"
types:
  "FormattedTestResult.gtype" = cluster{"Class Under Test": string, "Test ID": string, "Pass-Fail": bool, "Detail": string}
uses:
  NI::G Core::Error::Build Error Cluster.gvi
  LabViewNXG Test Framework::Common::AbstractTest.gtype::Process Result.gvi
diagram:
  # This class should not be used as a test as it is intended to be Abstract
  #
  # See examples for ideas how to run a test.  The node Process Result expects
  # - Expected result as a variant.  This should also have an attribute "String Value"
  # - Actual result as a variant.  This should also have an attribute "String Value"
  # - An Assertion instance
  # - Partially completed Formatted Test Result instance
  #
  # "String Value" attribute should be a string representation of the variant data passed and is
  # used to include in a message if the assertion fails.  If no attribute is found, then the message
  # will still be produced but with no values with in it, e.g. "Expected , got ."
  #
  # Note: In the code here, using a Force Error assertion does not require the String Value attribute
  # as they are not used - this asserter raises an error rather than a pass/fail result.
  Property Node(instance in=$FormattedTestResult, "Class Under Test"="AbstractTest", "Test ID"="TEST ERROR - should not be used") -> (instance out=w1)
  call "Build Error Cluster.gvi"(code=100, description="Should not use AbstractTest as a concrete test") -> (error out=w2)
  To Variant(anything=w2) -> w3
  call "Process Result.gvi"(Formatted Results=w1, AbstractTest in=$"AbstractTest in", Expected Result=w3, Actual Result=w3, Asserter="ForceError.gtype" constant, Error in=$"Error in") -> (AbstractTest out=w4, Error out=w5)
  $"AbstractTest out" <- w4
  $"Error out" <- w5
