vi "Run Test.gvi"   [LabVIEW NXG 5.0.0]
# A framework method that actually runs the Test.  This calls the Setup, Run All Tests and Teardown methods.
inputs:
  "AbstractTest in": "AbstractTest.gtype", required
  "Error in": error
outputs:
  "AbstractTest out": "AbstractTest.gtype"
  "Error out": error
uses:
  LabViewNXG Test Framework::Common::AbstractTest.gtype::Setup Test.gvi
  LabViewNXG Test Framework::Common::AbstractTest.gtype::Run All Tests.gvi
  LabViewNXG Test Framework::Common::AbstractTest.gtype::Teardown Test.gvi
diagram:
  case ($"Error in") {
    frame No Error {
      call "Setup Test.gvi"(AbstractTest in=$"AbstractTest in", Error in=$"Error in") -> (AbstractTest out=w3, Error out=w4)
      call "Run All Tests.gvi"(AbstractTest in=w3, Error in=w4) -> (AbstractTest out=w5, Error out=w6)
      call "Teardown Test.gvi"(AbstractTest in=w5, Error in=w6) -> (AbstractTest out=w2, Error out=w1)
    }
    frame Error {
      w1 = $"Error in"
      w2 = $"AbstractTest in"
    }
  }
  $"AbstractTest out" <- w2
  $"Error out" <- w1
