vi "Setup Test.gvi"   [LabVIEW NXG 5.0.0]
# Used to setup any test data needed by the Test itself.  The default implementation is to initialise the Test Results array so must be called by any Test that overrides it.
inputs:
  "AbstractTest in": "AbstractTest.gtype"
  "Error in": error
outputs:
  "AbstractTest out": "AbstractTest.gtype"
  "Error out": error
panel controls:
  "FormattedTestResult": "FormattedTestResult.gtype"
types:
  "FormattedTestResult.gtype" = cluster{"Class Under Test": string, "Test ID": string, "Pass-Fail": bool, "Detail": string}
diagram:
  Initialize Array(element=$FormattedTestResult, size=0) -> w1
  Property Node(instance in=$"AbstractTest in", "Test Results"=w1) -> (instance out=w2)
  $"AbstractTest out" <- w2
  # Assume that all tests will pass.  Any that fail will change
  # the Overall Result to false.
  $"Error out" <- $"Error in"
