vi "Build Results.gvi"   [LabVIEW NXG 5.0.0]
# Iterates through each Test Suite and aggregates their individual results together for display.  Also accumulates the number of passes and failures and an overall Test Result: True only if all Test Suites have passed.
inputs:
  "TestCoordinator in": "AbstractTestCoordinator.gtype", required
  "Error in": error
outputs:
  "Overall Results": bool  # Overall Test Suite results indicator. True if all Test Suites passed.
  "TestCoordinator out": "AbstractTestCoordinator.gtype"
  "Error out": error
  "Tests Passed": u32  # Number of Test Suites that have passed.
  "Results": "FormattedTestSuiteResult.gtype"[]  # Array of Test Suite results.
  "Tests Failed": u32  # Number of Test Suites that have failed.
panel controls:
  "FormattedTestSuiteResult": "FormattedTestSuiteResult.gtype"
  "New FormattedTestSuiteResult": "FormattedTestSuiteResult.gtype"
  "Empty Results": "FormattedTestSuiteResult.gtype"
types:
  "FormattedTestSuiteResult.gtype" = cluster{"Test Suite": string, "Passes": u32, "Fails": u32, "Pass-Fail": bool}
uses:
  LabViewNXG Test Framework::Common::AbstractTestSuite.gtype::Read Overall Result.gvi
  LabViewNXG Test Framework::Common::AbstractTestSuite.gtype::Read Test Suite Name.gvi
diagram:
  case ($"Error in") {
    frame No Error {
      Property Node(instance in=$"TestCoordinator in") -> ("Test Suites To Run"=w7)
      w8 = 0  # Suites Passed
      Initialize Array(element=$FormattedTestSuiteResult, size=0) -> w9
      s1 = w9  # shift register
      s2 = TRUE  # shift register
      s3 = w8  # shift register
      s4 = 0  # shift register
      for {
        w10 = each element of w7
        Property Node(instance in=w10) -> ("Tests Passed"=w11, "Tests Failed"=w12)
        call "Read Overall Result.gvi"(TestSuite in=w10) -> (Overall Result=w13)
        call "Read Test Suite Name.gvi"(AbstractTestSuite in=w10) -> (Name=w14)
        Property Node(instance in=$"New FormattedTestSuiteResult", "Test Suite"=w14, "Passes"=w11, "Fails"=w12, "Pass-Fail"=w13) -> (instance out=w15)
        Build Array(w15, s1) -> w16
        Select(s=w13, t=s2, f=FALSE) -> w17
        Add(w11, s3) -> w18
        Add(w12, s4) -> w19
        next s1 = w16
        next s2 = w17
        next s3 = w18
        next s4 = w19
      }
      w1 = $"Error in"
      w2 = $"TestCoordinator in"
      w3 = s2
      w4 = s1
      w5 = s3
      w6 = s4
    }
    frame Error {
      Initialize Array(element=$"Empty Results", size=0) -> w4
      w1 = $"Error in"
      w2 = $"TestCoordinator in"
      w3 = FALSE
      w5 = 0
      w6 = 0
    }
  }
  $"TestCoordinator out" <- w2
  $Results <- w4
  $"Overall Results" <- w3
  $"Tests Passed" <- w5
  $"Tests Failed" <- w6
  $"Error out" <- w1
