vi "Initialise Test Suites.gvi"   [LabVIEW NXG 5.0.0]
# Overriden by concrete Test Coordinators to build a collection of Test Suites to run.  Each Test Suite class shuld be added to the “Build Array” node.  AbstractTestSuite is an example and must be removed.
inputs:
  "TestCoordinator in": "AbstractTestCoordinator.gtype"
  "Error in": error
outputs:
  "TestCoordinator out": "AbstractTestCoordinator.gtype"
  "Error out": error
diagram:
  case ($"Error in") {
    frame No Error {
      # Append a TestSuite Instance into the array.  Don't leave AbstractTestSuite in once concrete instances are used
      Build Array("AbstractTestSuite.gtype" constant) -> w3
      Property Node(instance in=$"TestCoordinator in", "Test Suites To Run"=w3) -> (instance out=w2)
      w1 = $"Error in"
    }
    frame Error {
      w1 = $"Error in"
      w2 = $"TestCoordinator in"
    }
  }
  $"Error out" <- w1
  $"TestCoordinator out" <- w2
