vi "Run Test Suites.gvi"   [LabVIEW NXG 5.0.0]
# Iterates through each Test Suite asking it to run its tests.  Once all have been run, the full set of results are built and displayed on the panel elements.
inputs:
  "TestCoordinator in": "AbstractTestCoordinator.gtype"
  "Error in": error
outputs:
  "Overall Test Result": bool  # Indicates the overall success of running all Test Suites. All tests must pass for the indicator to be green.
  "TestCoordinator out": "AbstractTestCoordinator.gtype"
  "Error out": error
  "Test Suite Results": "FormattedTestSuiteResult.gtype"[]  # Shows the results for all Test Suites.
  "Suites Passed": u32  # Number of Test Suites that passed.
  "Suites Failed": u32  # Number of Test Suites that failed.
types:
  "FormattedTestSuiteResult.gtype" = cluster{"Test Suite": string, "Passes": u32, "Fails": u32, "Pass-Fail": bool}
uses:
  LabViewNXG Test Framework::Common::AbstractTestCoordinator.gtype::Initialise Test Suites.gvi
  LabViewNXG Test Framework::Common::AbstractTestSuite.gtype::Run Tests.gvi
  LabViewNXG Test Framework::Common::AbstractTestCoordinator.gtype::Build Results.gvi
diagram:
  call "Initialise Test Suites.gvi"(TestCoordinator in=$"TestCoordinator in", Error in=$"Error in") -> (TestCoordinator out=w1, Error out=w2)
  case (w2) {
    frame No Error {
      Property Node(instance in=w1) -> ("Test Suites To Run"=w5)
      for {
        w6 = each element of w5
        call "Run Tests.gvi"(Test Suite in=w6, Error in=w2) -> (Test Suite out=w8, Error out=w3)
        append w8 to w7
      }
      Property Node(instance in=w1, "Test Suites To Run"=w7) -> (instance out=w4)
    }
    frame Error {
      w3 = w2
      w4 = w1
    }
  }
  call "Build Results.gvi"(TestCoordinator in=w4, Error in=w3) -> (Results=w9, TestCoordinator out=w10, Overall Results=w11, Tests Passed=w12, Tests Failed=w13, Error out=w14)
  $"TestCoordinator out" <- w10
  $"Overall Test Result" <- w11
  $"Suites Passed" <- w12
  $"Suites Failed" <- w13
  $"Error out" <- w14
  $"Test Suite Results" <- w9
