vi "Build Results.gvi"   [LabVIEW NXG 5.0.0]
# Aggregates each Test’s results into the Test Suite’s results and calculates the total number of passes and failures as well as an overall result for the Test Suite.
inputs:
  "TestSuite in": "AbstractTestSuite.gtype", required
  "Error in": error
outputs:
  "TestSuite out": "AbstractTestSuite.gtype"
  "Error out": error
panel controls:
  "FormattedTestResult": "FormattedTestResult.gtype"
types:
  "FormattedTestResult.gtype" = cluster{"Class Under Test": string, "Test ID": string, "Pass-Fail": bool, "Detail": string}
uses:
  LabViewNXG Test Framework::Common::AbstractTest.gtype::Read Test Results.gvi
  LabViewNXG Test Framework::Common::AbstractTest.gtype::Read Tests Passed.gvi
  LabViewNXG Test Framework::Common::AbstractTest.gtype::Read Tests Failed.gvi
diagram:
  case ($"Error in") {
    frame No Error {
      Property Node(instance in=$"TestSuite in") -> ("Tests To Run"=w6)
      w7 = 0  # Tests Failed
      w8 = 0  # Tests Passed
      Initialize Array(element=$FormattedTestResult, size=0) -> w9
      s1 = w9  # shift register
      s2 = w7  # shift register
      s3 = w8  # shift register
      for {
        w10 = each element of w6
        call "Read Test Results.gvi"(AbstractTest in=w10, Error in=$"Error in") -> (AbstractTest out=w11, Test Results=w12, Error out=w13)
        Build Array(w12, s1) -> w14
        call "Read Tests Passed.gvi"(AbstractTest in=w11, Error in=w13) -> (AbstractTest out=w15, Tests Passed=w16, Error out=w17)
        Add(w16, s3) -> w18
        call "Read Tests Failed.gvi"(AbstractTest in=w15, Error in=w17) -> (Tests Failed=w19, Error out=w2)
        Add(w19, s2) -> w20
        next s1 = w14
        next s2 = w20
        next s3 = w18
      }
      w1 = $"TestSuite in"
      w3 = s1
      w4 = s3
      w5 = s2
    }
    frame Error {
      Property Node(instance in=$"TestSuite in") -> ("Results"=w3)
      w1 = $"TestSuite in"
      w2 = $"Error in"
      w4 = 0
      w5 = 0
    }
  }
  Property Node(instance in=w1, "Results"=w3, "Tests Passed"=w4, "Tests Failed"=w5) -> (instance out=w21)
  $"TestSuite out" <- w21
  $"Error out" <- w2
