vi "Initialise Tests.gvi"   [LabVIEW NXG 5.0.0]
# This builds an array of all Test instances to run in this suite.  Update this method with an instance of the Test to add in the array.
# AbstractTest is used as an example and must be removed.
inputs:
  "Test Suite in": "AbstractTestSuite.gtype"
  "Error in": error
outputs:
  "Test Suite out": "AbstractTestSuite.gtype"
  "Error out": error
diagram:
  case ($"Error in") {
    frame No Error {
      # Append a Test Instance into the array.  Don't leave AbstractTest in once concrete instances are used
      Build Array("AbstractTest.gtype" constant) -> w3
      Property Node(instance in=$"Test Suite in", "Tests To Run"=w3) -> (instance out=w2)
      w1 = $"Error in"
    }
    frame Error {
      w1 = $"Error in"
      w2 = $"Test Suite in"
    }
  }
  $"Error out" <- w1
  $"Test Suite out" <- w2
