vi "Read Overall Result.gvi"   [LabVIEW NXG 5.0.0]
# Returns the overall result of the Test Suite.  True only if all Tests that were run passed.
inputs:
  "TestSuite in": "AbstractTestSuite.gtype"
  "Error in": error
outputs:
  "Overall Result": bool  # The overall result for the Test Suite. True if all tests executed passed.
  "TestSuite out": "AbstractTestSuite.gtype"
  "Error out": error
diagram:
  case ($"Error in") {
    frame No Error {
      Property Node(instance in=$"TestSuite in") -> ("Tests Failed"=w4)
      Is Equal To 0(x=w4) -> w3
      w1 = $"Error in"
      w2 = $"TestSuite in"
    }
    frame Error {
      w1 = $"Error in"
      w2 = $"TestSuite in"
      w3 = default
    }
  }
  $"TestSuite out" <- w2
  $"Overall Result" <- w3
  $"Error out" <- w1
