vi "Run Tests With Display.gvi"   [LabVIEW NXG 5.0.0]
# Runs all the Tests for the Test Suite and displays the results in the panel elements.
inputs:
  "AbstractTestSuite in": "AbstractTestSuite.gtype"
  "Error in": error
outputs:
  "Overall Result": bool  # The overall result of the Test Suite. True only if all individual Tests passed.
  "AbstractTestSuite out": "AbstractTestSuite.gtype"
  "Error out": error
  "Results": "FormattedTestResult.gtype"[]  # Results of each individual test.
  "Tests Passed": u32  # The number of Tests that have passed.
  "Tests Failed": u32  # The number of Tests that have failed.
panel controls:
  "FormattedTestResult": "FormattedTestResult.gtype"
types:
  "FormattedTestResult.gtype" = cluster{"Class Under Test": string, "Test ID": string, "Pass-Fail": bool, "Detail": string}
uses:
  LabViewNXG Test Framework::Common::AbstractTestSuite.gtype::Run Tests.gvi
  LabViewNXG Test Framework::Common::AbstractTestSuite.gtype::Read Overall Result.gvi
diagram:
  sequence {
    frame 0 {
      $"Overall Result" <- TRUE
      Initialize Array(element=$FormattedTestResult, size=0) -> w1
      $Results <- w1
      $"Tests Passed" <- 0
      $"Tests Failed" <- 0
    }
  }
  # Subclasses should follow this pattern and in the No Error case, extract the results and add to
  # Display elements as desired.
  #
  # It isn't mandatory to implement this method, but it allows for the Test Suite to be run
  # Seperately from a Test Coordindator and results observed.  Subclasses could just call the Parent VI
  # but will need to add in the sequence to clear existing panel values if this is required.
  case ($"Error in") {
    frame No Error {
      call "Run Tests.gvi"(Test Suite in=$"AbstractTestSuite in", Error in=$"Error in") -> (Test Suite out=w4, Error out=w5)
      case (w5) {
        frame Error, Default {
          w2 = w5
          w3 = w4
        }
        frame No Error {
          Property Node(instance in=w4) -> ("Results"=w6, "Tests Passed"=w7, "Tests Failed"=w8, instance out=w9)
          call "Read Overall Result.gvi"(TestSuite in=w9, Error in=w5) -> (TestSuite out=w3, Overall Result=w10, Error out=w2)
          $"Overall Result" <- w10
          $Results <- w6
          $"Tests Passed" <- w7
          $"Tests Failed" <- w8
        }
      }
    }
    frame Error {
      w2 = $"Error in"
      w3 = $"AbstractTestSuite in"
    }
  }
  $"AbstractTestSuite out" <- w3
  $"Error out" <- w2
