vi "Run Tests.gvi"   [LabVIEW NXG 5.0.0]
# Runs every Test in this Test Suite and builds an overall set of results for the Test Suite.
inputs:
  "Test Suite in": "AbstractTestSuite.gtype"
  "Error in": error
outputs:
  "Test Suite out": "AbstractTestSuite.gtype"
  "Error out": error
uses:
  LabViewNXG Test Framework::Common::AbstractTestSuite.gtype::Initialise Tests.gvi
  LabViewNXG Test Framework::Common::AbstractTest.gtype::Run Test.gvi
  LabViewNXG Test Framework::Common::AbstractTestSuite.gtype::Build Results.gvi
diagram:
  call "Initialise Tests.gvi"(Test Suite in=$"Test Suite in", Error in=$"Error in") -> (Test Suite out=w1, Error out=w2)
  # Build an array of all tests to run in this Suite, and then runs each of them
  case (w2) {
    frame No Error {
      Property Node(instance in=w1) -> ("Tests To Run"=w5)
      for {
        w6 = each element of w5
        call "Run Test.gvi"(AbstractTest in=w6, Error in=w2) -> (AbstractTest out=w8, Error out=w3)
        append w8 to w7
      }
      Property Node(instance in=w1, "Tests To Run"=w7) -> (instance out=w4)
    }
    frame Error {
      w3 = w2
      w4 = w1
    }
  }
  call "Build Results.gvi"(TestSuite in=w4, Error in=w3) -> (TestSuite out=w9, Error out=w10)
  $"Test Suite out" <- w9
  $"Error out" <- w10
