vi "Run All Tests.gvi"   [LabVIEW NXG 5.0.0]
inputs:
  "ArrayContainsTest in": "ArrayContainsTest.gtype"
  "Error in": error
outputs:
  "ArrayContainsTest out": "ArrayContainsTest.gtype"
  "Error out": error
panel controls:
  "FormattedTestResult": "FormattedTestResult.gtype"
  "FormattedTestResult_2": "FormattedTestResult.gtype"
types:
  "FormattedTestResult.gtype" = cluster{"Class Under Test": string, "Test ID": string, "Pass-Fail": bool, "Detail": string}
uses:
  LabViewNXG Test Framework::Utilities::Set Value String.gvi
  LabViewNXG Test Framework::Common::AbstractTest.gtype::Process Result.gvi
diagram:
  To Variant(anything=[34, 45, 78, 9]) -> w1
  call "Set Value String.gvi"(Variant with Value in=w1, String Value="Exp: 34, 45, 78, 9") -> (Variant with Value out=w2)
  To Variant(anything=[9, 45]) -> w3
  call "Set Value String.gvi"(Variant with Value in=w3, String Value="Actual: 9, 45") -> (Variant with Value out=w4)
  Property Node(instance in=$FormattedTestResult, "Class Under Test"="ArrayContains", "Test ID"="Element is contained Pass") -> (instance out=w5)
  call "Process Result.gvi"(Formatted Results=w5, AbstractTest in=$"ArrayContainsTest in", Expected Result=w2, Actual Result=w4, Asserter="AssertContainedIn.gtype" constant, Error in=$"Error in") -> (AbstractTest out=w6, Error out=w7)
  Property Node(instance in=$FormattedTestResult_2, "Class Under Test"="ArrayContains", "Test ID"="Element is not contained Fail") -> (instance out=w8)
  To Variant(anything=[34, 45, 78, 9]) -> w9
  call "Set Value String.gvi"(Variant with Value in=w9, String Value="Exp: 34, 45, 78, 9") -> (Variant with Value out=w10)
  To Variant(anything=[9, 99]) -> w11
  call "Set Value String.gvi"(Variant with Value in=w11, String Value="Actual: 9, 99") -> (Variant with Value out=w12)
  call "Process Result.gvi"(Formatted Results=w8, AbstractTest in=w6, Expected Result=w10, Actual Result=w12, Asserter="AssertContainedIn.gtype" constant, Error in=w7) -> (AbstractTest out=w13, Error out=w14)
  $"ArrayContainsTest out" <- w13
  $"Error out" <- w14
