vi "Run All Tests.gvi"   [LabVIEW NXG 5.0.0]
inputs:
  "BooleanFalseTest in": "BooleanFalseTest.gtype"
  "Error in": error
outputs:
  "BooleanFalseTest out": "BooleanFalseTest.gtype"
  "Error out": error
panel controls:
  "FormattedTestResult": "FormattedTestResult.gtype"
  "FormattedTestResult_2": "FormattedTestResult.gtype"
  "FormattedTestResult_3": "FormattedTestResult.gtype"
  "FormattedTestResult_4": "FormattedTestResult.gtype"
types:
  "FormattedTestResult.gtype" = cluster{"Class Under Test": string, "Test ID": string, "Pass-Fail": bool, "Detail": string}
uses:
  LabViewNXG Test Framework::Utilities::Boolean To String.gvi
  LabViewNXG Test Framework::Utilities::Set Value String.gvi
  LabViewNXG Test Framework::Common::AbstractTest.gtype::Process Result.gvi
diagram:
  call "Boolean To String.gvi"(Boolean in=FALSE) -> (String value=w1)
  To Variant(anything=FALSE) -> w2
  call "Set Value String.gvi"(Variant with Value in=w2, String Value=w1) -> (Variant with Value out=w3)
  call "Boolean To String.gvi"(Boolean in=FALSE) -> (String value=w4)
  To Variant(anything=FALSE) -> w5
  call "Set Value String.gvi"(Variant with Value in=w5, String Value=w4) -> (Variant with Value out=w6)
  Property Node(instance in=$FormattedTestResult, "Class Under Test"="BooleanFalse", "Test ID"="False Booleans Pass") -> (instance out=w7)
  call "Process Result.gvi"(Formatted Results=w7, AbstractTest in=$"BooleanFalseTest in", Expected Result=w3, Actual Result=w6, Asserter="AssertFalse.gtype" constant, Error in=$"Error in") -> (AbstractTest out=w8, Error out=w9)
  Property Node(instance in=$FormattedTestResult_2, "Class Under Test"="BooleanFalse", "Test ID"="True Booleans Fail") -> (instance out=w10)
  call "Boolean To String.gvi"(Boolean in=TRUE) -> (String value=w11)
  To Variant(anything=TRUE) -> w12
  call "Set Value String.gvi"(Variant with Value in=w12, String Value=w11) -> (Variant with Value out=w13)
  call "Boolean To String.gvi"(Boolean in=TRUE) -> (String value=w14)
  To Variant(anything=TRUE) -> w15
  call "Set Value String.gvi"(Variant with Value in=w15, String Value=w14) -> (Variant with Value out=w16)
  call "Process Result.gvi"(Formatted Results=w10, AbstractTest in=w8, Expected Result=w13, Actual Result=w16, Asserter="AssertFalse.gtype" constant, Error in=w9) -> (AbstractTest out=w17, Error out=w18)
  Property Node(instance in=$FormattedTestResult_3, "Class Under Test"="BooleanFalse", "Test ID"="False/True Booleans Fail") -> (instance out=w19)
  call "Boolean To String.gvi"(Boolean in=FALSE) -> (String value=w20)
  To Variant(anything=FALSE) -> w21
  call "Set Value String.gvi"(Variant with Value in=w21, String Value=w20) -> (Variant with Value out=w22)
  call "Boolean To String.gvi"(Boolean in=TRUE) -> (String value=w23)
  To Variant(anything=TRUE) -> w24
  call "Set Value String.gvi"(Variant with Value in=w24, String Value=w23) -> (Variant with Value out=w25)
  call "Process Result.gvi"(Formatted Results=w19, AbstractTest in=w17, Expected Result=w22, Actual Result=w25, Asserter="AssertFalse.gtype" constant, Error in=w18) -> (AbstractTest out=w26, Error out=w27)
  Property Node(instance in=$FormattedTestResult_4, "Class Under Test"="BooleanFalse", "Test ID"="A non-Boolean Fail") -> (instance out=w28)
  call "Boolean To String.gvi"(Boolean in=FALSE) -> (String value=w29)
  To Variant(anything=FALSE) -> w30
  call "Set Value String.gvi"(Variant with Value in=w30, String Value=w29) -> (Variant with Value out=w31)
  To Variant(anything="True") -> w32
  call "Set Value String.gvi"(Variant with Value in=w32, String Value="True") -> (Variant with Value out=w33)
  call "Process Result.gvi"(Formatted Results=w28, AbstractTest in=w26, Expected Result=w31, Actual Result=w33, Asserter="AssertFalse.gtype" constant, Error in=w27) -> (AbstractTest out=w34, Error out=w35)
  $"BooleanFalseTest out" <- w34
  $"Error out" <- w35
