vi "Run All Tests.gvi"   [LabVIEW NXG 5.0.0]
inputs:
  "BooleanTrueTest in": "BooleanTrueTest.gtype"
  "Error in": error
outputs:
  "BooleanTrueTest out": "BooleanTrueTest.gtype"
  "Error out": error
panel controls:
  "FormattedTestResult": "FormattedTestResult.gtype"
  "FormattedTestResult_2": "FormattedTestResult.gtype"
  "FormattedTestResult_3": "FormattedTestResult.gtype"
types:
  "FormattedTestResult.gtype" = cluster{"Class Under Test": string, "Test ID": string, "Pass-Fail": bool, "Detail": string}
uses:
  LabViewNXG Test Framework::Utilities::Boolean To String.gvi
  LabViewNXG Test Framework::Utilities::Set Value String.gvi
  LabViewNXG Test Framework::Common::AbstractTest.gtype::Process Result.gvi
diagram:
  call "Boolean To String.gvi"(Boolean in=TRUE) -> (String value=w1)
  To Variant(anything=TRUE) -> w2
  call "Set Value String.gvi"(Variant with Value in=w2, String Value=w1) -> (Variant with Value out=w3)
  call "Boolean To String.gvi"(Boolean in=TRUE) -> (String value=w4)
  To Variant(anything=TRUE) -> w5
  call "Set Value String.gvi"(Variant with Value in=w5, String Value=w4) -> (Variant with Value out=w6)
  Property Node(instance in=$FormattedTestResult, "Class Under Test"="BooleanTrue", "Test ID"="True Booleans Pass") -> (instance out=w7)
  call "Process Result.gvi"(Formatted Results=w7, AbstractTest in=$"BooleanTrueTest in", Expected Result=w3, Actual Result=w6, Asserter="AssertTrue.gtype" constant, Error in=$"Error in") -> (AbstractTest out=w8, Error out=w9)
  Property Node(instance in=$FormattedTestResult_2, "Class Under Test"="BooleanTrue", "Test ID"="False Booleans Fail") -> (instance out=w10)
  call "Boolean To String.gvi"(Boolean in=FALSE) -> (String value=w11)
  To Variant(anything=FALSE) -> w12
  call "Set Value String.gvi"(Variant with Value in=w12, String Value=w11) -> (Variant with Value out=w13)
  call "Boolean To String.gvi"(Boolean in=FALSE) -> (String value=w14)
  To Variant(anything=FALSE) -> w15
  call "Set Value String.gvi"(Variant with Value in=w15, String Value=w14) -> (Variant with Value out=w16)
  call "Process Result.gvi"(Formatted Results=w10, AbstractTest in=w8, Expected Result=w13, Actual Result=w16, Asserter="AssertTrue.gtype" constant, Error in=w9) -> (AbstractTest out=w17, Error out=w18)
  Property Node(instance in=$FormattedTestResult_3, "Class Under Test"="BooleanTrue", "Test ID"="False/True Booleans Fail") -> (instance out=w19)
  call "Boolean To String.gvi"(Boolean in=FALSE) -> (String value=w20)
  To Variant(anything=FALSE) -> w21
  call "Set Value String.gvi"(Variant with Value in=w21, String Value=w20) -> (Variant with Value out=w22)
  call "Boolean To String.gvi"(Boolean in=TRUE) -> (String value=w23)
  To Variant(anything=TRUE) -> w24
  call "Set Value String.gvi"(Variant with Value in=w24, String Value=w23) -> (Variant with Value out=w25)
  call "Process Result.gvi"(Formatted Results=w19, AbstractTest in=w17, Expected Result=w22, Actual Result=w25, Asserter="AssertTrue.gtype" constant, Error in=w18) -> (AbstractTest out=w26, Error out=w27)
  $"BooleanTrueTest out" <- w26
  $"Error out" <- w27
