vi "Run All Tests.gvi"   [LabVIEW NXG 5.0.0]
inputs:
  "ErrorCheckingTest in": "ErrorCheckingTest.gtype"
  "Error in": error
outputs:
  "ErrorCheckingTest out": "ErrorCheckingTest.gtype"
  "Error out": error
panel controls:
  "FormattedTestResult": "FormattedTestResult.gtype"
  "FormattedTestResult_2": "FormattedTestResult.gtype"
  "FormattedTestResult_3": "FormattedTestResult.gtype"
  "FormattedTestResult_4": "FormattedTestResult.gtype"
  "FormattedTestResult_5": "FormattedTestResult.gtype"
types:
  "FormattedTestResult.gtype" = cluster{"Class Under Test": string, "Test ID": string, "Pass-Fail": bool, "Detail": string}
uses:
  LabViewNXG Test Framework::Utilities::Set Value String.gvi
  LabViewNXG Test Framework::Common::AbstractTest.gtype::Process Result.gvi
  NI::G Core::Error::Generate Error Report.gvi
diagram:
  To Variant(anything="Expected Result is ignored") -> w1
  call "Set Value String.gvi"(Variant with Value in=w1, String Value="No Error") -> (Variant with Value out=w2)
  To Variant(anything=no error) -> w3
  call "Set Value String.gvi"(Variant with Value in=w3, String Value="No Error") -> (Variant with Value out=w4)
  # When using Error Assertion, DO NOT pass any error
  # on to the Test Framework from the code under test
  # as it will be processed as an actual error!  Instead, it
  # should be converted to a variant as the Actual Result.
  #
  # Errors raised by the Test Framework SHOULD be passed along
  # as this indicates a problem somewhere within the framework.
  #
  # In this example there is no 'code under test' just the generation
  # of Error Clusters to test the asserters.
  Property Node(instance in=$FormattedTestResult, "Class Under Test"="ErrorCheckingTest", "Test ID"="No Errors Pass") -> (instance out=w5)
  # AssertNoErrorRaised just checks the state of
  # Actual Result - any error will fail the assertion.
  call "Process Result.gvi"(Formatted Results=w5, AbstractTest in=$"ErrorCheckingTest in", Expected Result=w2, Actual Result=w4, Asserter="AssertNoErrorRaised.gtype" constant, Error in=$"Error in") -> (AbstractTest out=w6, Error out=w7)
  To Variant(anything="Expected Result is ignored") -> w8
  call "Set Value String.gvi"(Variant with Value in=w8, String Value="No Error") -> (Variant with Value out=w9)
  w10 = error {"status"=TRUE, "code"=101, "source"="Code under test"}
  To Variant(anything=w10) -> w11
  call "Generate Error Report.gvi"(error in=w10, include divider line=TRUE) -> (error report=w12)
  call "Set Value String.gvi"(Variant with Value in=w11, String Value=w12) -> (Variant with Value out=w13)
  Property Node(instance in=$FormattedTestResult_2, "Class Under Test"="ErrorCheckingTest", "Test ID"="Raised Error Fail") -> (instance out=w14)
  call "Process Result.gvi"(Formatted Results=w14, AbstractTest in=w6, Expected Result=w9, Actual Result=w13, Asserter="AssertNoErrorRaised.gtype" constant, Error in=w7) -> (AbstractTest out=w15, Error out=w16)
  To Variant(anything=error {"status"=TRUE, "code"=101, "source"="Expected error"}) -> w17
  call "Set Value String.gvi"(Variant with Value in=w17, String Value="Error 101") -> (Variant with Value out=w18)
  w19 = error {"status"=TRUE, "code"=101, "source"="Code under test"}
  To Variant(anything=w19) -> w20
  call "Generate Error Report.gvi"(error in=w19, include divider line=TRUE) -> (error report=w21)
  call "Set Value String.gvi"(Variant with Value in=w20, String Value=w21) -> (Variant with Value out=w22)
  Property Node(instance in=$FormattedTestResult_3, "Class Under Test"="ErrorCheckingTest", "Test ID"="Specific matching Error Passes") -> (instance out=w23)
  call "Process Result.gvi"(Formatted Results=w23, AbstractTest in=w15, Expected Result=w18, Actual Result=w22, Asserter="AssertErrorRaised.gtype" constant, Error in=w16) -> (AbstractTest out=w24, Error out=w25)
  To Variant(anything=error {"status"=TRUE, "code"=0, "source"="Expected error"}) -> w26
  call "Set Value String.gvi"(Variant with Value in=w26, String Value="Error 0 (any)") -> (Variant with Value out=w27)
  w28 = error {"status"=TRUE, "code"=456, "source"="Code under test"}
  To Variant(anything=w28) -> w29
  call "Generate Error Report.gvi"(error in=w28, include divider line=TRUE) -> (error report=w30)
  call "Set Value String.gvi"(Variant with Value in=w29, String Value=w30) -> (Variant with Value out=w31)
  Property Node(instance in=$FormattedTestResult_4, "Class Under Test"="ErrorCheckingTest", "Test ID"="Any matching Error Passes") -> (instance out=w32)
  call "Process Result.gvi"(Formatted Results=w32, AbstractTest in=w24, Expected Result=w27, Actual Result=w31, Asserter="AssertErrorRaised.gtype" constant, Error in=w25) -> (AbstractTest out=w33, Error out=w34)
  To Variant(anything=error {"status"=TRUE, "code"=101, "source"="Expected error"}) -> w35
  call "Set Value String.gvi"(Variant with Value in=w35, String Value="Error 101") -> (Variant with Value out=w36)
  w37 = error {"status"=TRUE, "code"=456, "source"="Code under test"}
  To Variant(anything=w37) -> w38
  call "Generate Error Report.gvi"(error in=w37, include divider line=TRUE) -> (error report=w39)
  call "Set Value String.gvi"(Variant with Value in=w38, String Value=w39) -> (Variant with Value out=w40)
  Property Node(instance in=$FormattedTestResult_5, "Class Under Test"="ErrorCheckingTest", "Test ID"="Non matching Error Fails") -> (instance out=w41)
  call "Process Result.gvi"(Formatted Results=w41, AbstractTest in=w33, Expected Result=w36, Actual Result=w40, Asserter="AssertErrorRaised.gtype" constant, Error in=w34) -> (AbstractTest out=w42, Error out=w43)
  $"ErrorCheckingTest out" <- w42
  $"Error out" <- w43
