vi "Initialise Test Suites.gvi"   [LabVIEW NXG 5.0.0]
inputs:
  "TestCoordinator in": "ExampleTestCoordinator.gtype"
  "Error in": error
outputs:
  "TestCoordinator out": "ExampleTestCoordinator.gtype"
  "Error out": error
uses:
  LabViewNXG Test Framework::Common::AbstractTestCoordinator.gtype::Write Test Suites To Run.gvi
  NI::G Core::Error::Multiplex Errors.gvi
diagram:
  case ($"Error in") {
    frame No Error {
      Build Array("NumericsTestSuite.gtype" constant, "StringTestSuite.gtype" constant, "BooleanTestSuite.gtype" constant, "ArrayTestSuite.gtype" constant, "ErrorTestSuite.gtype" constant) -> w3
      call "Write Test Suites To Run.gvi"(AbstractTestCoordinator in=$"TestCoordinator in", Test Suites To Run=w3) -> (AbstractTestCoordinator out=w2, Error out=w4)
      call "Multiplex Errors.gvi"(error in 1=$"Error in", error in 2=w4) -> (error out=w1)
    }
    frame Error {
      w1 = $"Error in"
      w2 = $"TestCoordinator in"
    }
  }
  $"Error out" <- w1
  $"TestCoordinator out" <- w2
