vi "Run All Tests.gvi"   [LabVIEW NXG 5.0.0]
inputs:
  "NumericsComparisonTest in": "NumericsComparisonTest.gtype"
  "Error in": error
outputs:
  "NumericsComparisonTest out": "NumericsComparisonTest.gtype"
  "Error out": error
panel controls:
  "FormattedTestResult": "FormattedTestResult.gtype"
  "FormattedTestResult_2": "FormattedTestResult.gtype"
  "FormattedTestResult_3": "FormattedTestResult.gtype"
  "FormattedTestResult_4": "FormattedTestResult.gtype"
types:
  "FormattedTestResult.gtype" = cluster{"Class Under Test": string, "Test ID": string, "Pass-Fail": bool, "Detail": string}
uses:
  LabViewNXG Test Framework::Utilities::Set Value String.gvi
  LabViewNXG Test Framework::Common::AbstractTest.gtype::Process Result.gvi
diagram:
  To Variant(anything=15) -> w1
  call "Set Value String.gvi"(Variant with Value in=w1, String Value="15") -> (Variant with Value out=w2)
  To Variant(anything=10) -> w3
  call "Set Value String.gvi"(Variant with Value in=w3, String Value="10") -> (Variant with Value out=w4)
  Property Node(instance in=$FormattedTestResult, "Class Under Test"="NumericComparison <", "Test ID"="Actual < Expected Pass") -> (instance out=w5)
  call "Process Result.gvi"(Formatted Results=w5, AbstractTest in=$"NumericsComparisonTest in", Expected Result=w2, Actual Result=w4, Asserter="AssertLessThan.gtype" constant, Error in=$"Error in") -> (AbstractTest out=w6, Error out=w7)
  To Variant(anything=10) -> w8
  call "Set Value String.gvi"(Variant with Value in=w8, String Value="10") -> (Variant with Value out=w9)
  To Variant(anything=10) -> w10
  call "Set Value String.gvi"(Variant with Value in=w10, String Value="10") -> (Variant with Value out=w11)
  Property Node(instance in=$FormattedTestResult_2, "Class Under Test"="NumericComparison <", "Test ID"="Actual = Expected Fail") -> (instance out=w12)
  call "Process Result.gvi"(Formatted Results=w12, AbstractTest in=w6, Expected Result=w9, Actual Result=w11, Asserter="AssertLessThan.gtype" constant, Error in=w7) -> (AbstractTest out=w13, Error out=w14)
  To Variant(anything=10) -> w15
  call "Set Value String.gvi"(Variant with Value in=w15, String Value="10") -> (Variant with Value out=w16)
  To Variant(anything=10) -> w17
  call "Set Value String.gvi"(Variant with Value in=w17, String Value="10") -> (Variant with Value out=w18)
  Property Node(instance in=$FormattedTestResult_3, "Class Under Test"="NumericComparison <=", "Test ID"="Actual = Expected Pass") -> (instance out=w19)
  call "Process Result.gvi"(Formatted Results=w19, AbstractTest in=w13, Expected Result=w16, Actual Result=w18, Asserter="AssertLessEqual.gtype" constant, Error in=w14) -> (AbstractTest out=w20, Error out=w21)
  To Variant(anything=10) -> w22
  call "Set Value String.gvi"(Variant with Value in=w22, String Value="10") -> (Variant with Value out=w23)
  To Variant(anything=15) -> w24
  call "Set Value String.gvi"(Variant with Value in=w24, String Value="15") -> (Variant with Value out=w25)
  Property Node(instance in=$FormattedTestResult_4, "Class Under Test"="NumericComparison <=", "Test ID"="Actual > Expected Pass") -> (instance out=w26)
  call "Process Result.gvi"(Formatted Results=w26, AbstractTest in=w20, Expected Result=w23, Actual Result=w25, Asserter="AssertLessEqual.gtype" constant, Error in=w21) -> (AbstractTest out=w27, Error out=w28)
  $"NumericsComparisonTest out" <- w27
  $"Error out" <- w28
