vi "Double Equal.gvi"   [LabVIEW NXG 5.0.0]
inputs:
  "NumericsEqualityTest in": "NumericsEqualityTest.gtype", required
  "Error in": error
outputs:
  "Expected Result": variant
  "NumericsEqualityTest out": "NumericsEqualityTest.gtype"
  "Error out": error
  "Actual Result": variant
uses:
  LabViewNXG Test Framework::Utilities::Set Value String.gvi
diagram:
  case ($"Error in") {
    frame No Error {
      Number To Decimal String(number=15.4) -> (decimal integer string=w3)
      To Variant(anything=15.4) -> w4
      call "Set Value String.gvi"(Variant with Value in=w4, String Value=w3, Error in=$"Error in") -> (Variant with Value out=w5, Error out=w6)
      $"Expected Result" <- w5
      Number To Decimal String(number=15.4) -> (decimal integer string=w7)
      To Variant(anything=15.4) -> w8
      call "Set Value String.gvi"(Variant with Value in=w8, String Value=w7, Error in=w6) -> (Variant with Value out=w9, Error out=w1)
      $"Actual Result" <- w9
      w2 = $"NumericsEqualityTest in"
    }
    frame Error {
      w1 = $"Error in"
      w2 = $"NumericsEqualityTest in"
    }
  }
  $"NumericsEqualityTest out" <- w2
  $"Error out" <- w1
