vi "Run All Tests.gvi"   [LabVIEW NXG 5.0.0]
inputs:
  "NumericsEqualityTest in": "NumericsEqualityTest.gtype"
  "Error in": error
outputs:
  "NumericsEqualityTest out": "NumericsEqualityTest.gtype"
  "Error out": error
panel controls:
  "FormattedTestResult": "FormattedTestResult.gtype"
  "FormattedTestResult_2": "FormattedTestResult.gtype"
  "FormattedTestResult_3": "FormattedTestResult.gtype"
  "FormattedTestResult_4": "FormattedTestResult.gtype"
types:
  "FormattedTestResult.gtype" = cluster{"Class Under Test": string, "Test ID": string, "Pass-Fail": bool, "Detail": string}
uses:
  LabViewNXG Test Framework::Examples::NumericsEqualityTest.gtype::Uint Equal.gvi
  LabViewNXG Test Framework::Common::AbstractTest.gtype::Process Result.gvi
  LabViewNXG Test Framework::Examples::NumericsEqualityTest.gtype::Double Equal.gvi
  LabViewNXG Test Framework::Examples::NumericsEqualityTest.gtype::Int Equal.gvi
  LabViewNXG Test Framework::Examples::NumericsEqualityTest.gtype::Int Not Equal.gvi
diagram:
  Property Node(instance in=$FormattedTestResult, "Class Under Test"="NumericsEquality", "Test ID"="UINT32 Pass") -> (instance out=w1)
  call "Uint Equal.gvi"(NumericsEqualityTest in=$"NumericsEqualityTest in", Error in=$"Error in") -> (NumericsEqualityTest out=w2, Expected Result=w3, Actual Result=w4, Error out=w5)
  call "Process Result.gvi"(Formatted Results=w1, AbstractTest in=w2, Expected Result=w3, Actual Result=w4, Asserter="AssertEqual.gtype" constant, Error in=w5) -> (AbstractTest out=w6, Error out=w7)
  call "Double Equal.gvi"(NumericsEqualityTest in=w6, Error in=w7) -> (NumericsEqualityTest out=w8, Expected Result=w9, Actual Result=w10, Error out=w11)
  Property Node(instance in=$FormattedTestResult_2, "Class Under Test"="NumericsEquality", "Test ID"="Double Pass") -> (instance out=w12)
  call "Process Result.gvi"(Formatted Results=w12, AbstractTest in=w8, Expected Result=w9, Actual Result=w10, Asserter="AssertEqual.gtype" constant, Error in=w11) -> (AbstractTest out=w13, Error out=w14)
  call "Int Equal.gvi"(NumericsEqualityTest in=w13, Error in=w14) -> (NumericsEqualityTest out=w15, Expected Result=w16, Actual Result=w17, Error out=w18)
  Property Node(instance in=$FormattedTestResult_3, "Class Under Test"="NumericsEquality", "Test ID"="INT32 Pass") -> (instance out=w19)
  call "Process Result.gvi"(Formatted Results=w19, AbstractTest in=w15, Expected Result=w16, Actual Result=w17, Asserter="AssertEqual.gtype" constant, Error in=w18) -> (AbstractTest out=w20, Error out=w21)
  call "Int Not Equal.gvi"(NumericsEqualityTest in=w20, Error in=w21) -> (NumericsEqualityTest out=w22, Expected Result=w23, Actual Result=w24, Error out=w25)
  Property Node(instance in=$FormattedTestResult_4, "Class Under Test"="NumericsEquality", "Test ID"="INT32 fail") -> (instance out=w26)
  call "Process Result.gvi"(Formatted Results=w26, AbstractTest in=w22, Expected Result=w23, Actual Result=w24, Asserter="AssertEqual.gtype" constant, Error in=w25) -> (AbstractTest out=w27, Error out=w28)
  $"NumericsEqualityTest out" <- w27
  $"Error out" <- w28
