vi "Initialise Tests.gvi"   [LabVIEW NXG 5.0.0]
# This builds an array of all Test instances to run in this suite.  Update this method with an instance of the Test to add in the array.
inputs:
  "Test Suite in": "NumericsTestSuite.gtype"
  "Error in": error
outputs:
  "Test Suite out": "NumericsTestSuite.gtype"
  "Error out": error
uses:
  LabViewNXG Test Framework::Common::AbstractTestSuite.gtype::Write Tests To Run.gvi
  NI::G Core::Error::Multiplex Errors.gvi
diagram:
  case ($"Error in") {
    frame No Error {
      # Append a Test Instance into the array.  Don't leave AbstractTest in once concrete instances are used
      Build Array("NumericsEqualityTest.gtype" constant, "NumericsUnequalityTest.gtype" constant, "NumericsComparisonTest.gtype" constant) -> w3
      call "Write Tests To Run.gvi"(AbstractTestSuite in=$"Test Suite in", Tests To Run=w3) -> (AbstractTestSuite out=w2, Error out=w4)
      call "Multiplex Errors.gvi"(error in 1=$"Error in", error in 2=w4) -> (error out=w1)
    }
    frame Error {
      w1 = $"Error in"
      w2 = $"Test Suite in"
    }
  }
  $"Error out" <- w1
  $"Test Suite out" <- w2
