vi "Run Tests With Display.gvi"   [LabVIEW NXG 5.0.0]
inputs:
  "NumericsTestSuite in": "NumericsTestSuite.gtype"
  "Error in": error
outputs:
  "Overall Result": bool
  "NumericsTestSuite out": "NumericsTestSuite.gtype"
  "Error out": error
  "Results": "FormattedTestResult.gtype"[]
  "Tests Passed": u32
  "Tests Failed": u32
panel controls:
  "FormattedTestResult": "FormattedTestResult.gtype"
types:
  "FormattedTestResult.gtype" = cluster{"Class Under Test": string, "Test ID": string, "Pass-Fail": bool, "Detail": string}
uses:
  LabViewNXG Test Framework::Common::AbstractTestSuite.gtype::Run Tests With Display.gvi
diagram:
  sequence {
    frame 0 {
      $"Overall Result" <- TRUE
      Initialize Array(element=$FormattedTestResult, size=0) -> w1
      $Results <- w1
      $"Tests Passed" <- 0
      $"Tests Failed" <- 0
    }
  }
  call parent "Run Tests With Display.gvi"(AbstractTestSuite in=$"NumericsTestSuite in", Error in=$"Error in") -> (Results=w2, AbstractTestSuite out=w3, Overall Result=w4, Tests Passed=w5, Tests Failed=w6, Error out=w7)
  $"NumericsTestSuite out" <- w3
  $"Overall Result" <- w4
  $"Tests Passed" <- w5
  $"Tests Failed" <- w6
  $"Error out" <- w7
  $Results <- w2
