vi "Run All Tests.gvi"   [LabVIEW NXG 5.0.0]
inputs:
  "StringEqualityTest in": "StringEqualityTest.gtype"
  "Error in": error
outputs:
  "StringEqualityTest out": "StringEqualityTest.gtype"
  "Error out": error
panel controls:
  "FormattedTestResult": "FormattedTestResult.gtype"
  "FormattedTestResult_2": "FormattedTestResult.gtype"
types:
  "FormattedTestResult.gtype" = cluster{"Class Under Test": string, "Test ID": string, "Pass-Fail": bool, "Detail": string}
uses:
  LabViewNXG Test Framework::Utilities::Set Value String.gvi
  LabViewNXG Test Framework::Common::AbstractTest.gtype::Process Result.gvi
diagram:
  To Variant(anything="A Test String") -> w1
  call "Set Value String.gvi"(Variant with Value in=w1, String Value="A Test String") -> (Variant with Value out=w2)
  To Variant(anything="A Test String") -> w3
  call "Set Value String.gvi"(Variant with Value in=w3, String Value="A Test String") -> (Variant with Value out=w4)
  Property Node(instance in=$FormattedTestResult, "Class Under Test"="StringEquality", "Test ID"="Equal Strings Pass") -> (instance out=w5)
  call "Process Result.gvi"(Formatted Results=w5, AbstractTest in=$"StringEqualityTest in", Expected Result=w2, Actual Result=w4, Asserter="AssertEqual.gtype" constant, Error in=$"Error in") -> (AbstractTest out=w6, Error out=w7)
  Property Node(instance in=$FormattedTestResult_2, "Class Under Test"="StringEquality", "Test ID"="Unequal Strings Fail") -> (instance out=w8)
  To Variant(anything="A Test String") -> w9
  call "Set Value String.gvi"(Variant with Value in=w9, String Value="A Test String") -> (Variant with Value out=w10)
  To Variant(anything="Ano Test String") -> w11
  call "Set Value String.gvi"(Variant with Value in=w11, String Value="Ano Test String") -> (Variant with Value out=w12)
  call "Process Result.gvi"(Formatted Results=w8, AbstractTest in=w6, Expected Result=w10, Actual Result=w12, Asserter="AssertEqual.gtype" constant, Error in=w7) -> (AbstractTest out=w13, Error out=w14)
  $"StringEqualityTest out" <- w13
  $"Error out" <- w14
