vi "Get Value Array.gvi"   [LabVIEW NXG 5.0.0]
# Returns the value stored in the passed Variant as an Array.  If the value is not an array, Error 110 is raised.
inputs:
  "Variant with Value in": variant  # Variant whose value is an Array.
  "Error In": error
outputs:
  "Variant with Value out": variant  # Variant passed in to the VI.
  "Value as Array": variant[]  # Variant value converted to an Array.
  "Error Out": error
uses:
  NI::G Core::Error::Build Error Cluster.gvi
diagram:
  case ($"Error In") {
    frame Error, Default {
      w1 = $"Variant with Value in"
      w2 = $"Error In"
    }
    frame No Error {
      Variant To Data(type=variant[] [], variant=$"Variant with Value in") -> (data=w3, error out=w4)
      case (w4) {
        frame Error, Default {
          call "Build Error Cluster.gvi"(code=110, description="Value not an Array") -> (error out=w2)
        }
        frame No Error {
          $"Value as Array" <- w3
          w2 = w4
        }
      }
      w1 = $"Variant with Value in"
    }
  }
  $"Variant with Value out" <- w1
  $"Error Out" <- w2
