vi "Get Value Boolean.gvi"   [LabVIEW NXG 5.0.0]
# Returns the value stored in the passed Variant as a Boolean.  If the value is not a Boolean, Error 112 is raised.
inputs:
  "Variant with Value in": variant  # Variant whose value is a Boolean.
  "Error In": error
outputs:
  "Variant with Value out": variant  # Variant that was passed in to the VI.
  "Value as Boolean": bool  # Variant value converted to a Boolean.
  "Error Out": error
uses:
  NI::G Core::Error::Build Error Cluster.gvi
diagram:
  case ($"Error In") {
    frame Error, Default {
      w1 = $"Variant with Value in"
      w2 = $"Error In"
    }
    frame No Error {
      Variant To Data(type=bool TRUE, variant=$"Variant with Value in") -> (data=w3, error out=w4)
      case (w4) {
        frame Error, Default {
          call "Build Error Cluster.gvi"(code=112, description="Value not a Boolean") -> (error out=w2)
        }
        frame No Error {
          $"Value as Boolean" <- w3
          w2 = w4
        }
      }
      w1 = $"Variant with Value in"
    }
  }
  $"Variant with Value out" <- w1
  $"Error Out" <- w2
