vi "Get Value Error.gvi"   [LabVIEW NXG 5.0.0]
# Returns the value stored in the passed Variant as an Error.  If the value is not an Error, Error 111 is raised.
inputs:
  "Variant with Value in": variant  # Variant whose value is an Error.
  "Error In": error
outputs:
  "Variant with Value out": variant  # Variant passed in to the VI.
  "Value as Error": error
  "Error Out": error
uses:
  NI::G Core::Error::Build Error Cluster.gvi
diagram:
  case ($"Error In") {
    frame Error, Default {
      w1 = $"Variant with Value in"
      w2 = $"Error In"
    }
    frame No Error {
      Variant To Data(type=no error, variant=$"Variant with Value in") -> (data=w3, error out=w4)
      case (w4) {
        frame Error, Default {
          call "Build Error Cluster.gvi"(code=111, description="Value not an Error") -> (error out=w2)
        }
        frame No Error {
          $"Value as Error" <- w3
          w2 = w4
        }
      }
      w1 = $"Variant with Value in"
    }
  }
  $"Variant with Value out" <- w1
  $"Error Out" <- w2
