vi "Get Value String.gvi"   [LabVIEW NXG 5.0.0]
# Returns the variant attribute “String Value”.  If not found then Error 113 is raised.
# “Set String Value” VI will ensure the right name is used.
inputs:
  "Variant with Value in": variant  # A variant containing an attribute named “String Value”.
  "Error in": error
outputs:
  "Value as String": string  # Value of the attribute “String Value”.
  "Error out": error
  "Variant with Value out": variant  # Variant passed in to the VI.
uses:
  NI::G Core::Error::Build Error Cluster.gvi
  NI::G Core::Error::Multiplex Errors.gvi
diagram:
  case ($"Error in") {
    frame No Error {
      Get Variant Attribute(error in=$"Error in", name="String Value", variant=$"Variant with Value in") -> (error out=w3, found?=w4, value=w5)
      case (w4) {
        frame False, Default {
          call "Build Error Cluster.gvi"(code=113, description="Assertion String Value not found") -> (error out=w6)
          call "Multiplex Errors.gvi"(error in 1=w6, error in 2=w3) -> (error out=w1)
        }
        frame True {
          Variant To Data(error in (no error)=w3, type=string "String Type", variant=w5) -> (data=w7, error out=w1)
          $"Value as String" <- w7
        }
      }
      w2 = $"Variant with Value in"
    }
    frame Error {
      w1 = $"Error in"
      w2 = $"Variant with Value in"
    }
  }
  $"Variant with Value out" <- w2
  $"Error out" <- w1
